vi "Example vi 5.gvi"   [LabVIEW NXG 5.0.0]
inputs:
  "Error In": error
outputs:
  "Error Out": error
panel controls:
  "Text Ring": i32
  "String Array": string[]
panel indicators:
  "Duplicates?": bool
diagram:
  w1 = $"String Array"
  # This subVI Scans a string array in search of duplicates
  case ($"Error In") {
    frame Error, Default {
      w2 = $"Error In"
      w3 = default
    }
    frame No Error {
      for {
        w4 = each element of w1
        s1 = 0  # shift register
        for {
          w6 = each element of w1
          Increment(x=s1) -> w7
          Is Equal(x=w4, y=w6) -> w8
          Select(s=w8, t=w7, f=s1) -> w9
          next s1 = w9
        }
        Is Not Equal(x=s1, y=1) -> w10
        append w10 to w5
        stop if w10
      }
      And Array Elements(Boolean array=w5) -> (logical AND=w3)
      w2 = $"Error In"
    }
  }
  $"Error Out" <- w2
  $"Duplicates?" <- w3
