vi "JV Data Adapter.gvi"   [LabVIEW NXG 5.0.0]
inputs:
  "Error In": error
  "JV Measurements Mega Cluster In": "JV Measurements Mega Cluster.gtype"
  "Single JV Data Cluster In": "JV Data Cluster.gtype"
  "Measurement File Type": "Measurement File Type.gtype" = "TXT JV Curve"
outputs:
  "Error Out": error
  "Formatted Data Array": f64[][]
  "Formatted Data String Array": string[][]
types:
  "Cell Selector.gtype" = enum{"L.01", "L.02", "L.03", "L.04", "L.05", "L.06", "L.07", "L.08", "L.09", "L.10", "L.11", "L.12", "R.01", "R.02", "R.03", "R.04", "R.05", "R.06", "R.07", "R.08", "R.09", "R.10", "R.11", "R.12", "Custom"}
  "JV Data Cluster.gtype" = cluster{"Voltage (V)": f64[], "Current (A)": f64[], "Current Density (A/m^2)": f64[], "Cell Area (m^2)": f64, "Illumination (W/m^2)": f64, "Voc (V)": f64, "Jsc (A/m^2)": f64, "FF (%)": f64, "Rsh (Ω · m^2)": f64, "Rs (Ω · m^2)": f64, "Eff (%)": f64, "Measured Cell": "Cell Selector.gtype", "No Multiplexer": bool}
  "Measurement File Type.gtype" = enum{"TXT JV Curve", "TXT Parameters", "Excel", "Origin", "Power Point"}
  "JV Scan Mode.gtype" = enum{"Rough", "Normal", "Accurate", "Smart", "Custom"}
  "JV Curve Parameters.gtype" = cluster{"JV Scan Mode": "JV Scan Mode.gtype", "Measurement Precision": "Accuracy Parameters.gtype", "Cell Parameters": "Cell Parameters.gtype"}
  "Deposition Method.gtype" = enum{"Blade Coating", "Spin Coating", "Thermal Evaporation", "E-beam Evaporation", "Sputtering", "Drop Casting", "Dip Coating", "Pulsed Laser Deposition", "Chemical Vapour Deposition", "Atomic Layer Deposition", "Spray Coating", "Screen Printing", "Electroplating", "Molecular Beam Epitaxy", "Custom Deposition"}
  "Layer Type.gtype" = enum{"Front Electrode", "Electrode Transport Layer", "Active Layer", "Hole Transport Layer", "Back Electrode", "Annealing Treatment", "Encapsulation", "Custom Layer"}
  "Full Layer Information.gtype" = cluster{"Blade Coating Parameters": "Blade Coating Parameters.gtype", "Deposition Method": "Deposition Method.gtype", "Layer Type": "Layer Type.gtype", "Spin Coating Parameters": "Spin Coating Parameters.gtype", "Thermal Evaporation Parameters": "Thermal Evaporation Parameters.gtype", "Solution Information": "Solution Information.gtype", "General Parameters": "General Parameters.gtype", "Current Deposition Method Information Cluster": "Useless Cluster.gtype", "Layer String ID": string}
  "JV Measurements Mega Cluster.gtype" = cluster{"Cell Array": "Cell Selector.gtype"[], "JV Full Data Array": "JV Data Cluster.gtype"[], "Cell Selector": "Cell Selector.gtype", "JV Curve Parameters": "JV Curve Parameters.gtype", "Full Layer Information Array": "Full Layer Information.gtype"[]}
diagram:
  case ($"Error In") {
    frame Error, Default {
      w1 = $"Error In"
      w2 = default
      w3 = default
    }
    frame No Error {
      case ($"Measurement File Type") {
        frame "TXT JV Curve", Default {
          Property Node(instance in=$"Single JV Data Cluster In") -> ("Voltage (V)"=w4, "Current (A)"=w5, "Current Density (A/m^2)"=w6)
          Build Array(w4, w5, w6) -> w7
          Transpose 2D Array(2D array=w7) -> (transposed array=w2)
          w3 = default
          w1 = $"Error In"
        }
        frame "TXT Parameters" {
          Property Node(instance in=$"JV Measurements Mega Cluster In") -> ("JV Full Data Array"=w8)
          w9 = ["Cell Label", "Voc (V)", "Jsc (A/m^2)", "Efficiency (%)", "FF (%)", "Rs (Ω · m^2)", "Rsh (Ω · m^2)", "Light Power Density (W/m^2)"]
          s1 = $"Error In"  # shift register
          for (after w9) {
            w10 = each element of w8
            Property Node(instance in=w10) -> ("Measured Cell"=w11, "Voc (V)"=w12, "Jsc (A/m^2)"=w13, "Eff (%)"=w14, "FF (%)"=w15, "Rs (Ω · m^2)"=w16, "Rsh (Ω · m^2)"=w17, "Illumination (W/m^2)"=w18, "Cell Area (m^2)"=w19)
            Format Into String(errIn=s1, w11) -> (outString=w20, errOut=w21)
            Build Array(w12, w13, w14, w15, w16, w17, w18, w19) -> w22
            for {
              w23 = each element of w22
              Number To Fractional String(number=w23, use system decimal point (T)=FALSE) -> (F-format string=w25)
              append w25 to w24
            }
            Build Array(w20, w24) -> w26
            append w26 to w3
            next s1 = w21
          }
          w2 = default
          w1 = s1
        }
        frame "Excel" {
          Property Node(instance in=$"JV Measurements Mega Cluster In") -> ("JV Full Data Array"=w27)
          w28 = ["Cell Label", "Voc (V)", "Jsc (A/m^2)", "Efficiency (%)", "FF (%)", "Rs (Ω · m^2)", "Rsh (Ω · m^2)", "Light Power Density (W/m^2)"]
          s2 = $"Error In"  # shift register
          for (after w28) {
            w29 = each element of w27
            Property Node(instance in=w29) -> ("Measured Cell"=w30, "Voc (V)"=w31, "Jsc (A/m^2)"=w32, "Eff (%)"=w33, "FF (%)"=w34, "Rs (Ω · m^2)"=w35, "Rsh (Ω · m^2)"=w36, "Illumination (W/m^2)"=w37, "Cell Area (m^2)"=w38)
            Format Into String(errIn=s2, w30) -> (outString=w39, errOut=w40)
            Build Array(w31, w32, w33, w34, w35, w36, w37, w38) -> w41
            for {
              w42 = each element of w41
              Number To Fractional String(number=w42, use system decimal point (T)=FALSE) -> (F-format string=w44)
              append w44 to w43
            }
            Build Array(w39, w43) -> w45
            append w45 to w3
            next s2 = w40
          }
          w2 = default
          w1 = s2
        }
      }
    }
  }
  $"Formatted Data Array" <- w2
  $"Error Out" <- w1
  $"Formatted Data String Array" <- w3
