vi "File Handler.gvi"   [LabVIEW NXG 5.0.0]
inputs:
  "Error In": error
  "Misc Data Mega Cluster In": "Misc Mega Cluster.gtype"
  "JV Measurements Mega Cluster In": "JV Measurements Mega Cluster.gtype"
  "Measurement File Type": "Measurement File Type.gtype" = "TXT JV Curve"
outputs:
  "Error Out": error
types:
  "Measurement File Type.gtype" = enum{"TXT JV Curve", "TXT Parameters", "Excel", "Origin", "Power Point", "Layer Information"}
  T1 = cluster{"State Ref": "StringControl reference", "Substate Ref": "StringControl reference", "Current State Ref": "EnumSelector reference", "Main Tab Ref": "TabControl reference", "Plot Now Flag Ref": "BooleanControl reference"}
  T2 = cluster{"Default Data Saving Location Ref": "PathSelector reference"}
  T3 = cluster{"Author Initials Ref": "ComboBoxSelector reference", "Batch Name Ref": "StringControl reference", "Cell Number Ref": "StringControl reference", "Current Date Ref": "StringControl reference", "Sample Comments Ref": "StringControl reference", "Sample Prefix Ref": "StringControl reference", "Custom Date Ref": "CheckBox reference", "Label Info Error Label Ref": "StringControl reference", "Label Info Missing Error Ref": "BooleanControl reference"}
  T4 = cluster{"Cell Parameters Ref": "Cluster reference", "Cell Selector Ref": "Cluster reference", "Measurement Precision Ref": "Cluster reference", "JV Scan Mode Ref": "EnumSelector reference"}
  T5 = cluster{"Progress % Ref": "ProgressBar reference", "Progress Counter Ref": "NumericTextBoxDouble reference", "Live JV Parameters Ref": "Cluster reference"}
  T6 = cluster{"Layer Information Ref": "ArrayViewer reference"[]}
  T7 = cluster{"Cell Selector Block Ref": "Rectangle reference", "Smart Mode Block Ref": "Rectangle reference", "dV Block Ref": "Rectangle reference", "Smart Mode Text Ref": "Text reference", "No Multiplexer Detected Text Ref": "Text reference", "Current Range Block Ref": "Rectangle reference"}
  T8 = cluster{"JV Measurements Mega Cluster Ref": "Cluster reference", "Instrument Control Mega Cluster Ref": "Cluster reference"}
  T9 = cluster{"JV Main Graph Ref": "Graph reference", "Voc Graph Ref ": "Graph reference", "Jsc Graph Ref": "Graph reference", "Efficiency Graph Ref": "Graph reference", "Fill Factor Graph Ref": "Graph reference", "Series Resistance Graph Ref": "Graph reference", "Shunt Resistance Graph Ref": "Graph reference"}
  "Full Reference Cluster.gtype" = cluster{"Status Report": T1, "Path Cluster": T2, "Sample Naming Cluster": T3, "Acquisition Parameters": T4, "Live Progress Cluster": T5, "Sample Extra Information": T6, "Visual Elements": T7, "Mega Cluster References": T8, "Plotting": T9, "System Parameters": cluster{"Main VI Ref": VIRefnum}}
  "Misc Mega Cluster.gtype" = cluster{"Full Reference Cluster": "Full Reference Cluster.gtype"}
  "Cell Selector.gtype" = enum{"L.01", "L.02", "L.03", "L.04", "L.05", "L.06", "L.07", "L.08", "L.09", "L.10", "L.11", "L.12", "R.01", "R.02", "R.03", "R.04", "R.05", "R.06", "R.07", "R.08", "R.09", "R.10", "R.11", "R.12", "Custom"}
  "JV Data Cluster.gtype" = cluster{"Voltage (V)": f64[], "Current (A)": f64[], "Current Density (A/m^2)": f64[], "Cell Area (m^2)": f64, "Illumination (W/m^2)": f64, "Voc (V)": f64, "Jsc (A/m^2)": f64, "FF (%)": f64, "Rsh (Ω · m^2)": f64, "Rs (Ω · m^2)": f64, "Eff (%)": f64, "Measured Cell": "Cell Selector.gtype", "No Multiplexer": bool}
  "JV Scan Mode.gtype" = enum{"Rough", "Normal", "Accurate", "Smart", "Custom"}
  "JV Curve Parameters.gtype" = cluster{"JV Scan Mode": "JV Scan Mode.gtype", "Measurement Precision": "Accuracy Parameters.gtype", "Cell Parameters": "Cell Parameters.gtype"}
  "Deposition Method.gtype" = enum{"Blade Coating", "Spin Coating", "Thermal Evaporation", "E-beam Evaporation", "Sputtering", "Drop Casting", "Dip Coating", "Pulsed Laser Deposition", "Chemical Vapour Deposition", "Atomic Layer Deposition", "Spray Coating", "Screen Printing", "Electroplating", "Molecular Beam Epitaxy", "Custom Deposition"}
  "Layer Type.gtype" = enum{"Front Electrode", "Electrode Transport Layer", "Active Layer", "Hole Transport Layer", "Back Electrode", "Annealing Treatment", "Encapsulation", "Custom Layer"}
  "Full Layer Information.gtype" = cluster{"Blade Coating Parameters": "Blade Coating Parameters.gtype", "Deposition Method": "Deposition Method.gtype", "Layer Type": "Layer Type.gtype", "Spin Coating Parameters": "Spin Coating Parameters.gtype", "Thermal Evaporation Parameters": "Thermal Evaporation Parameters.gtype", "Solution Information": "Solution Information.gtype", "General Parameters": "General Parameters.gtype", "Current Deposition Method Information Cluster": "Useless Cluster.gtype", "Layer String ID": string}
  "JV Measurements Mega Cluster.gtype" = cluster{"Cell Array": "Cell Selector.gtype"[], "JV Full Data Array": "JV Data Cluster.gtype"[], "Cell Selector": "Cell Selector.gtype", "JV Curve Parameters": "JV Curve Parameters.gtype", "Full Layer Information Array": "Full Layer Information.gtype"[]}
uses:
  Pika IV Characterization NXG::Main Functions::File Handling::Path Generation::Filetype Folder Path Generator.gvi
  Pika IV Characterization NXG::Main Functions::File Handling::Path Generation::Single File Path Generation.gvi
  Pika IV Characterization NXG::Main Functions::File Handling::Data Formatting::JV Data Adapter.gvi
  Pika IV Characterization NXG::Main Functions::File Handling::Data Formatting::Single JV Curve Header Generator.gvi
  Pika IV Characterization NXG::Main Functions::File Handling::Path Generation::Full Data File Generator.gvi
  Pika IV Characterization NXG::Side Functions::Path Manipulation::Path Already Exists prompt.gvi
  Pika IV Characterization NXG::Main Functions::File Handling::Low Level::Single File Save.gvi
  Pika IV Characterization NXG::Main Functions::Layer Composition::File Management::Multi File Handler.gvi
  Pika IV Characterization NXG::Main Functions::File Handling::Low Level::Excel File Saver.gvi
diagram:
  case ($"Error In") {
    frame Error, Default {
      w1 = $"Error In"
    }
    frame No Error {
      call "Filetype Folder Path Generator.gvi"(Misc Data Mega Cluster In=$"Misc Data Mega Cluster In", Error In=$"Error In", Measurement File Type=$"Measurement File Type") -> (Folder to save data=w2, File Name Cluster Out=w3, Error Out=w4)
      case ($"Measurement File Type") {
        frame "TXT JV Curve", Default {
          Property Node(instance in=$"JV Measurements Mega Cluster In") -> ("JV Full Data Array"=w5)
          s1 = w4  # shift register
          for {
            w6 = each element of w5
            call "Single File Path Generation.gvi"(Folder To Save Data=w2, File Name Cluster In=w3, JV Data Cluster In=w6, Error In=s1, Measurement File Type=$"Measurement File Type") -> (Full File Path=w7, Error Out=w8)
            call "JV Data Adapter.gvi"(Single JV Data Cluster In=w6, Error In=w8, Measurement File Type=$"Measurement File Type") -> (Formatted Data Array=w9, Error Out=w10)
            call "Single JV Curve Header Generator.gvi"(JV Data Cluster In=w6, Error In=w10) -> (Single JV Curve Header=w11, Error Out=w12)
            call "Full Data File Generator.gvi"(Variable Header Info=w11, Data Array To Save=w9, Error In=w12, Measurement File Type=$"Measurement File Type") -> (Full Data Spreadsheet=w13, Error Out=w14)
            call "Path Already Exists prompt.gvi"(Path to Check=w7, Error In=w14) -> (Existing File Instruction out=w15, Error Out=w16)
            call "Single File Save.gvi"(File Path=w7, Data To Save=w13, Error In=w16, File Operation=w15) -> (Error Out=w17)
            next s1 = w17
          }
          w1 = s1
        }
        frame "Layer Information" {
          Property Node(instance in=$"JV Measurements Mega Cluster In") -> ("Full Layer Information Array"=w18, instance out=w19)
          Is Empty Array(array=w18) -> w20
          case (w20) {
            frame True {
              w1 = w4
            }
            frame False {
              call "Multi File Handler.gvi"(JV Measurements Mega Cluster In=w19, Author Default Layers Path=w2, File Operation="Save Configuration File", Error In=w4, Prompt?=FALSE) -> (Error Out=w1)
            }
          }
        }
        frame "TXT Parameters" {
          call "JV Data Adapter.gvi"(JV Measurements Mega Cluster In=$"JV Measurements Mega Cluster In", Error In=w4, Measurement File Type=$"Measurement File Type") -> (Formatted Data String Array=w21, Error Out=w22)
          call "Full Data File Generator.gvi"(Formatted Data String Array=w21, Error In=w22, Measurement File Type=$"Measurement File Type") -> (Full Data Spreadsheet=w23, Error Out=w24)
          call "Single File Path Generation.gvi"(Folder To Save Data=w2, File Name Cluster In=w3, Error In=w24, Measurement File Type=$"Measurement File Type") -> (Full File Path=w25, Error Out=w26)
          call "Path Already Exists prompt.gvi"(Path to Check=w25, Error In=w26) -> (Existing File Instruction out=w27, Error Out=w28)
          call "Single File Save.gvi"(File Path=w25, Data To Save=w23, Error In=w28, File Operation=w27) -> (Error Out=w1)
        }
        frame "Excel" {
          call "JV Data Adapter.gvi"(JV Measurements Mega Cluster In=$"JV Measurements Mega Cluster In", Error In=w4, Measurement File Type=$"Measurement File Type") -> (Formatted Data String Array=w29, Error Out=w30)
          call "Full Data File Generator.gvi"(Formatted Data String Array=w29, Error In=w30, Measurement File Type=$"Measurement File Type") -> (Full Data String Array=w31, Error Out=w32)
          call "Single File Path Generation.gvi"(Folder To Save Data=w2, File Name Cluster In=w3, Error In=w32, Measurement File Type=$"Measurement File Type") -> (Full File Path=w33, Error Out=w34)
          call "Path Already Exists prompt.gvi"(Path to Check=w33, Error In=w34) -> (Existing File Instruction out=w35, Error Out=w36)
          call "Excel File Saver.gvi"(Excel File Path=w33, IV Characterization Data String Array=w31, Error In=w36, File Operation=w35) -> (Error Out=w1)
        }
      }
    }
  }
  $"Error Out" <- w1
