vi "Header Info Merger.gvi"   [LabVIEW NXG 5.0.0]
inputs:
  "Column info array": string[]
  "Spreadsheet String": string
  "Error In": error
outputs:
  "Spreadsheet String With Header": string
  "Error Out": error
diagram:
  case ($"Error In") {
    frame Error, Default {
      w1 = $"Error In"
      w2 = $"Spreadsheet String"
    }
    frame No Error {
      s1 = ""  # shift register
      for {
        w3 = each element of $"Column info array"
        Is Empty String Or Path(string/path=w3) -> w4
        case (w4) {
          frame False, Default {
            Concatenate Strings(s1, w3, "\t") -> w5
          }
          frame True {
            w5 = s1
          }
        }
        next s1 = w5
      }
      Concatenate Strings(s1, "\r\n") -> w6
      Concatenate Strings(w6, $"Spreadsheet String") -> w2
      w1 = $"Error In"
    }
  }
  $"Spreadsheet String With Header" <- w2
  $"Error Out" <- w1
