vi "JV Data Adapter.gvi"   [LabVIEW NXG 5.0.0]
inputs:
  "Error In": error
  "JV Measurements Mega Cluster In": "JV Measurements Mega Cluster.gtype" = {"Cell Array"=[], "JV Full Data Array"=[], "JV Curve Parameters"={1, -0.2, FALSE, 0.1, TRUE, 1, 8e-06, 1000, 100, 3, 0.5, 1, 0, 0}, "Cell Selector"={FALSE, FALSE, FALSE, FALSE, FALSE, FALSE, FALSE, FALSE, FALSE, FALSE, FALSE, FALSE, FALSE, FALSE, FALSE, FALSE, FALSE, FALSE, FALSE, FALSE, FALSE, FALSE, FALSE, FALSE, FALSE, FALSE, FALSE, FALSE, FALSE, FALSE}}
  "Single JV Data Cluster In": "JV Data Cluster.gtype"
  "Measurement File Type": "Measurement File Type.gtype" = "TXT JV Curve"
outputs:
  "Error Out": error
  "Formatted Data Array": f64[][]
  "Formatted Data String Array": string[][]
types:
  "Cell Selector.gtype" = enum{"L.01", "L.02", "L.03", "L.04", "L.05", "L.06", "L.07", "L.08", "L.09", "L.10", "L.11", "L.12", "R.01", "R.02", "R.03", "R.04", "R.05", "R.06", "R.07", "R.08", "R.09", "R.10", "R.11", "R.12", "Custom"}
  "JV Data Cluster.gtype" = cluster{"Voltage (V)": f64[], "Current (A)": f64[], "Current Density (A/m^2)": f64[], "Cell Area (m^2)": f64, "Illumination (W/m^2)": f64, "Voc (V)": f64, "Jsc (A/m^2)": f64, "FF (%)": f64, "Rsh (Ω · m^2)": f64, "Rs (Ω · m^2)": f64, "Eff (%)": f64, "Measured Cell": "Cell Selector.gtype", "No Multiplexer": bool}
  "Measurement File Type.gtype" = enum{"TXT JV Curve", "TXT Parameters", "Excel", "Origin", "Power Point"}
  "JV Scan Mode.gtype" = enum{"Rough", "Normal", "Accurate", "Smart", "Custom"}
  "JV Curve Parameters.gtype" = cluster{"Cell Parameters": "Cell Parameters.gtype", "Measurement Precision": "Accuracy Parameters.gtype", "JV Scan Mode": "JV Scan Mode.gtype"}
  "JV Measurements Mega Cluster.gtype" = cluster{"Cell Array": "Cell Selector.gtype"[], "JV Full Data Array": "JV Data Cluster.gtype"[], "JV Curve Parameters": "JV Curve Parameters.gtype", "Cell Selector": "Cell Selector.gtype"}
diagram:
  case ($"Error In") {
    frame Error, Default {
      w1 = $"Error In"
      w2 = default
      w3 = default
    }
    frame No Error {
      case ($"Measurement File Type") {
        frame "TXT JV Curve", Default {
          Property Node(instance in=$"Single JV Data Cluster In") -> ("Voltage (V)"=w4, "Current (A)"=w5, "Current Density (A/m^2)"=w6)
          Build Array(w4, w5, w6) -> w7
          Transpose 2D Array(2D array=w7) -> (transposed array=w2)
          w3 = default
          w1 = $"Error In"
        }
        frame "TXT Parameters" {
          Property Node(instance in=$"JV Measurements Mega Cluster In") -> ("JV Full Data Array"=w8)
          w9 = ["Cell Label", "Voc (V)", "Jsc (A/m^2)", "Efficiency (%)", "FF (%)", "Rs (Ω · m^2)", "Rsh (Ω · m^2)", "Light Power Density (W/m^2)"]
          s1 = $"Error In"  # shift register
          for (after w9) {
            w10 = each element of w8
            Property Node(instance in=w10) -> ("Measured Cell"=w12, "Voc (V)"=w13, "Jsc (A/m^2)"=w14, "Eff (%)"=w15, "FF (%)"=w16, "Rs (Ω · m^2)"=w17, "Rsh (Ω · m^2)"=w18)
            Format Into String(errIn=s1, w12) -> (outString=w19, errOut=w20)
            Build Array(w13, w14, w15, w16, w17, w18) -> w21
            for {
              w22 = each element of w21
              Number To Fractional String(number=w22, use system decimal point (T)=FALSE) -> (F-format string=w24)
              append w24 to w23
            }
            Build Array(w19, w23) -> w25
            append w25 to w11
            next s1 = w20
          }
          Transpose 2D Array(2D array=w11) -> (transposed array=w3)
          w2 = default
          w1 = s1
        }
      }
    }
  }
  $"Formatted Data Array" <- w2
  $"Error Out" <- w1
  $"Formatted Data String Array" <- w3
