vi "Excel File Saver.gvi"   [LabVIEW NXG 5.0.0]
inputs:
  "Error In": error
  "Excel File Path": path
  "IV Characterization Data String Array": string[][]
  "Layer Information Data String Array": string[][]
  "File Operation": "File Operation.gtype" = "Replace"
outputs:
  "Error Out": error
types:
  "File Operation.gtype" = enum{"Replace", "Rename", "Do not save"}
uses:
  NI::Reporting::Excel::Report.gtype::New Excel Report.gvi
  NI::Reporting::Excel::Insert Excel Data (String).gvi
  NI::Reporting::Excel::Create Excel Data Sheet (String).gvi
  NI::Reporting::Excel::Report.gtype::Close Excel Report.gvi
  Pika IV Characterization NXG::Side Functions::Path Manipulation::Rename Prompt Window.gvi
diagram:
  # This SubVI Generates an excel report with
  # a sheet that contains all the IV parameters
  # Extracted from the IV Curves and another that
  # has all the subsequent layer information
  case ($"Error In") {
    frame Error, Default {
      w1 = $"Error In"
    }
    frame No Error {
      case ($"File Operation") {
        frame "Replace" {
          Is Empty Array(array=$"Layer Information Data String Array") -> w2
          call "New Excel Report.gvi"(file=$"Excel File Path", error in=$"Error In", sheet name="IV Characterization") -> (report=w3, error out=w4)
          call "Insert Excel Data (String).gvi"(report in=w3, 2D data=$"IV Characterization Data String Array", location="A1", error in=w4, sheet name="IV Characterization") -> (report out=w5, error out=w6)
          case (w2) {
            frame True {
              w7 = w5
              w8 = w6
            }
            frame False {
              call "Create Excel Data Sheet (String).gvi"(report in=w5, 2D data=$"Layer Information Data String Array", error in=w6, sheet name="Layer Informaiton") -> (report out=w7, error out=w8)
            }
          }
          call "Close Excel Report.gvi"(report=w7, error in=w8) -> (error out=w1)
        }
        frame "Rename" {
          Is Empty Array(array=$"Layer Information Data String Array") -> w9
          Strip Path(path=$"Excel File Path") -> (name=w10, stripped path=w11)
          call "Rename Prompt Window.gvi"(Original Filename=w10, Error In=$"Error In") -> (New Filename=w12, Error Out=w13)
          Build Path(base path=w11, name or relative path=w12) -> (appended path=w14)
          call "New Excel Report.gvi"(file=w14, error in=w13, sheet name="IV Characterization") -> (report=w15, error out=w16)
          call "Insert Excel Data (String).gvi"(report in=w15, 2D data=$"IV Characterization Data String Array", location="A1", error in=w16, sheet name="IV Characterization") -> (report out=w17, error out=w18)
          case (w9) {
            frame True {
              w19 = w17
              w20 = w18
            }
            frame False {
              call "Create Excel Data Sheet (String).gvi"(report in=w17, 2D data=$"Layer Information Data String Array", error in=w18, sheet name="Layer Informaiton") -> (report out=w19, error out=w20)
            }
          }
          call "Close Excel Report.gvi"(report=w19, error in=w20) -> (error out=w1)
        }
        frame "Do not save" {
          w1 = $"Error In"
        }
      }
    }
  }
  $"Error Out" <- w1
