vi "Generate and Check Paths.gvi"   [LabVIEW NXG 5.0.0]
panel controls:
  "Error In": error
  "Measurement File Type": "Measurement File Type.gtype" = "Single Cell Rainbow Raw"
  "Filename to load/save": path
  "Rainbow Sweep Types": "Rainbow Sweep Types.gtype" = "Red Sweep Closing"
  "Misc Data Mega Cluster In": "Misc Data Mega Cluster.gtype"
panel indicators:
  "Error Out": error
  "File path": path
  "Folder to save data": path
  "Misc Data Mega Cluster Out": "Misc Data Mega Cluster.gtype"
types:
  "Measurement File Type.gtype" = enum{"Single Cell Rainbow Raw", "Single Cell Rainbow Refined", "Multiple Cell Rainbow Raw", "Multiple Cell Rainbow Refined", "Light Calibration Power", "Light Calibration Spectral Density", "Light Calibration Power Density", "Light Calibration Dividing Wavelength Spectrum", "Dividing Wavelength To Motor Position", "Raw Div Wav to Motr Pos Fitik File"}
  "Rainbow Sweep Types.gtype" = enum{"Red Sweep Closing", "Red Sweep Opening", "Blue Sweep Closing", "Blue Sweep Opening"}
  "Full Reference Cluster.gtype" = cluster{"Enum Reference Cluster": "Enum Control Reference Cluster.gtype", "Boolean Reference Cluster": "Boolean Control Reference Cluster.gtype", "Numeric Reference Cluster": "Numeric Control Reference Cluster.gtype", "Numeric Cluster Reference Cluster": "Numeric Cluster Reference Cluster.gtype", "Path Reference Cluster": "Path Reference Cluster.gtype", "Cluster Reference Cluster": "Cluster Reference Cluster.gtype", "XZ Stage Controls Reference Cluster": "XZ Stage Controls Reference Cluster.gtype"}
  "Cell Naming Cluster.gtype" = cluster{"Cell Label": string, "Sample Prefix": string, "Author Initials": string, "Current Date": string, "Batch Name": string}
  T1 = cluster{"X Coordinate (mm)": f64, "Z Coordinate (mm)": f64, "Aprch Distance (mm)": f64}
  T2 = cluster{"X Coordinate (mm)": f64, "Z Coordinate (mm)": f64, "Vertical Spacing (mm)": f64, "Aprch Distance (mm)": f64, "Aprch Dstnc L.12 (mm)": f64}
  "XZ All Position Cluster.gtype" = cluster{"Diffusor Coordinates": T1, "Photodetector Coordinates": T1, "Cell R.01 Coordinates": T2}
  T3 = cluster{"Thorlabs Motor Serial Number File Path": path, "Default Data Saving Location": path}
  "Misc Data Mega Cluster.gtype" = cluster{"Full Reference Cluster": "Full Reference Cluster.gtype", "Cell Naming Cluster": "Cell Naming Cluster.gtype", "All XZ Position Cluster": "XZ All Position Cluster.gtype", "All Paths": T3}
uses:
  Rainbow Measurement Setup::Side Functions::Path Manipulation::Check Default Path subroutine.gvi
  Rainbow Measurement Setup::Side Functions::Path Manipulation::Create or Open Folder.gvi
  Rainbow Measurement Setup::Side Functions::Sample Naming::txt Extension adder.gvi
  NI::G Core::File IO (General)::Check if File or Folder Exists.gvi
  NI::G Core::File IO (General)::Create Directory Recursive.gvi
diagram:
  # This SubVI Generates the file paths and filenames for the different types of files that will be saved
  case ($"Error In") {
    frame Error, Default {
      w1 = $"Error In"
      w2 = default
      w3 = default
      w4 = $"Misc Data Mega Cluster In"
    }
    frame No Error {
      Property Node(instance in=$"Misc Data Mega Cluster In") -> ("Cell Naming Cluster"=w5, "All Paths:Default Data Saving Location"=w6, instance out=w7)
      case ($"Measurement File Type") {
        frame "Single Cell Rainbow Raw", Default {
          call "Check Default Path subroutine.gvi"(Default Data Saving Location Path In=w6, Misc Data Mega Cluster In=w7, Error In=$"Error In") -> (Default Data Saving Location Path Out=w3, Misc Data Mega Cluster Out=w4, Error Out=w8)
          Format Into String(errIn=w8, $"Rainbow Sweep Types") -> (outString=w9, errOut=w10)
          Concatenate Strings(w9, " Raw IV Curves") -> w11
          Property Node(instance in=w5) -> ("Author Initials"=w12, "Current Date"=w13, "Batch Name"=w14, "Sample Prefix"=w15, "Cell Label"=w16)
          Concatenate Strings("Device ", w14) -> w17
          call "Create or Open Folder.gvi"(Folder Root Path=w3, Folder Name=w12, Error In=w10) -> (New Folder's Path=w18, Error Out=w19)
          call "Create or Open Folder.gvi"(Folder Root Path=w18, Folder Name=w13, Error In=w19) -> (New Folder's Path=w20, Error Out=w21)
          call "Create or Open Folder.gvi"(Folder Root Path=w20, Folder Name=w17, Error In=w21) -> (New Folder's Path=w22, Error Out=w23)
          call "Create or Open Folder.gvi"(Folder Root Path=w22, Folder Name="TXT files", Error In=w23) -> (New Folder's Path=w24, Error Out=w25)
          call "Create or Open Folder.gvi"(Folder Root Path=w24, Folder Name=w16, Error In=w25) -> (New Folder's Path=w26, Error Out=w27)
          call "Create or Open Folder.gvi"(Folder Root Path=w26, Folder Name=w11, Error In=w27) -> (New Folder's Path=w28, Error Out=w29)
          call "txt Extension adder.gvi"(Name without .txt=w15, Error In=w29) -> (Name with .txt=w30, Error Out=w1)
          Build Path(base path=w28, name or relative path=w30) -> (appended path=w2)
        }
        frame "Single Cell Rainbow Refined" {
          Property Node(instance in=w5) -> ("Author Initials"=w31, "Current Date"=w32, "Batch Name"=w33, "Cell Label"=w34, "Sample Prefix"=w35)
          call "Check Default Path subroutine.gvi"(Default Data Saving Location Path In=w6, Misc Data Mega Cluster In=w7, Error In=$"Error In") -> (Default Data Saving Location Path Out=w3, Misc Data Mega Cluster Out=w4, Error Out=w36)
          Format Into String(errIn=w36, $"Rainbow Sweep Types") -> (outString=w37, errOut=w38)
          call "Create or Open Folder.gvi"(Folder Root Path=w3, Folder Name=w31, Error In=w38) -> (New Folder's Path=w39, Error Out=w40)
          call "Create or Open Folder.gvi"(Folder Root Path=w39, Folder Name=w32, Error In=w40) -> (New Folder's Path=w41, Error Out=w42)
          Concatenate Strings("Device ", w33) -> w43
          call "Create or Open Folder.gvi"(Folder Root Path=w41, Folder Name=w43, Error In=w42) -> (New Folder's Path=w44, Error Out=w45)
          call "Create or Open Folder.gvi"(Folder Root Path=w44, Folder Name="TXT files", Error In=w45) -> (New Folder's Path=w46, Error Out=w47)
          call "Create or Open Folder.gvi"(Folder Root Path=w46, Folder Name=w34, Error In=w47) -> (New Folder's Path=w48, Error Out=w49)
          Concatenate Strings(w35, ".", w37) -> w50
          call "txt Extension adder.gvi"(Name without .txt=w50, Error In=w49) -> (Name with .txt=w51, Error Out=w1)
          Build Path(base path=w48, name or relative path=w51) -> (appended path=w2)
        }
        frame "Light Calibration Power" {
          Property Node(instance in=w5) -> ("Author Initials"=w52, "Current Date"=w53, "Batch Name"=w54, "Sample Prefix"=w55)
          call "Check Default Path subroutine.gvi"(Default Data Saving Location Path In=w6, Misc Data Mega Cluster In=w7, Error In=$"Error In") -> (Default Data Saving Location Path Out=w3, Misc Data Mega Cluster Out=w4, Error Out=w56)
          Format Into String(errIn=w56, $"Rainbow Sweep Types") -> (outString=w57, errOut=w58)
          call "Create or Open Folder.gvi"(Folder Root Path=w3, Folder Name=w52, Error In=w58) -> (New Folder's Path=w59, Error Out=w60)
          call "Create or Open Folder.gvi"(Folder Root Path=w59, Folder Name=w53, Error In=w60) -> (New Folder's Path=w61, Error Out=w62)
          Concatenate Strings("Device ", w54) -> w63
          call "Create or Open Folder.gvi"(Folder Root Path=w61, Folder Name=w63, Error In=w62) -> (New Folder's Path=w64, Error Out=w65)
          call "Create or Open Folder.gvi"(Folder Root Path=w64, Folder Name="TXT files", Error In=w65) -> (New Folder's Path=w66, Error Out=w67)
          Concatenate Strings(w55, "Power_Calibration_", w57) -> w68
          call "txt Extension adder.gvi"(Name without .txt=w68, Error In=w67) -> (Name with .txt=w69, Error Out=w1)
          Build Path(base path=w66, name or relative path=w69) -> (appended path=w2)
        }
        frame "Light Calibration Spectral Density" {
          Get Component Directory() -> (Path=w70)
          Strip Path(path=w70) -> (stripped path=w71)
          Build Path(base path=w71, name or relative path="Extra installers\\Calibration_Files") -> (appended path=w72)
          call "Check if File or Folder Exists.gvi"(file or folder=w72, error in=$"Error In") -> (file or folder exists?=w73, error out=w74)
          Is Empty String Or Path(string/path=w72) -> w75
          Logical Or(w75, not w73) -> w76
          case (w76) {
            frame False {
              w3 = w72
              w77 = w74
            }
            frame True {
              call "Create Directory Recursive.gvi"(folder=w72, error in=w74) -> (error out=w77)
              w3 = w72
            }
          }
          call "txt Extension adder.gvi"(Name without .txt="Spectral_Density_Calibration", Error In=w77) -> (Name with .txt=w78, Error Out=w1)
          Build Path(base path=w3, name or relative path=w78) -> (appended path=w2)
          w4 = w7
        }
        frame "Light Calibration Power Density" {
          Get Component Directory() -> (Path=w79)
          Strip Path(path=w79) -> (stripped path=w80)
          Build Path(base path=w80, name or relative path="Extra installers\\Calibration_Files") -> (appended path=w81)
          call "Check if File or Folder Exists.gvi"(file or folder=w81, error in=$"Error In") -> (file or folder exists?=w82, error out=w83)
          Is Empty String Or Path(string/path=w81) -> w84
          Logical Or(w84, not w82) -> w85
          case (w85) {
            frame False {
              w3 = w81
              w86 = w83
            }
            frame True {
              call "Create Directory Recursive.gvi"(folder=w81, error in=w83) -> (error out=w86)
              w3 = w81
            }
          }
          call "txt Extension adder.gvi"(Name without .txt="Power_Density_Calibration", Error In=w86) -> (Name with .txt=w87, Error Out=w1)
          Build Path(base path=w3, name or relative path=w87) -> (appended path=w2)
          w4 = w7
        }
        frame "Light Calibration Dividing Wavelength Spectrum" {
          Strip Path(path=$"Filename to load/save") -> (stripped path=w3)
          w1 = $"Error In"
          w2 = $"Filename to load/save"
          w4 = w7
        }
        frame "Dividing Wavelength To Motor Position" {
          Get Component Directory() -> (Path=w88)
          Strip Path(path=w88) -> (stripped path=w89)
          Build Path(base path=w89, name or relative path="Extra installers\\Calibration_Files\\Div_Wav_To_Motor_Pos") -> (appended path=w90)
          call "Check if File or Folder Exists.gvi"(file or folder=w90, error in=$"Error In") -> (file or folder exists?=w91, error out=w92)
          Is Empty String Or Path(string/path=w90) -> w93
          Logical Or(w93, not w91) -> w94
          case (w94) {
            frame False {
              w3 = w90
              w95 = w92
            }
            frame True {
              call "Create Directory Recursive.gvi"(folder=w90, error in=w92) -> (error out=w95)
              w3 = w90
            }
          }
          call "txt Extension adder.gvi"(Name without .txt="Dividing Wavelength To Motor Position Calibration File", Error In=w95) -> (Name with .txt=w96, Error Out=w1)
          Build Path(base path=w3, name or relative path=w96) -> (appended path=w2)
          w4 = w7
        }
      }
    }
  }
  $"Folder to save data" <- w3
  $"Misc Data Mega Cluster Out" <- w4
  $"File path" <- w2
  $"Error Out" <- w1
