vi "Naming Cluster Generator.gvi"   [LabVIEW NXG 5.0.0]
inputs:
  "Error In": error
  "Misc Mega Cluster In": "Misc Mega Cluster.gtype"
outputs:
  "Error Out": error
  "Naming Cluster": "Naming Cluster.gtype"
types:
  "Naming Cluster.gtype" = cluster{"Authors Initials": string, "Current Date": string, "Batch Name": string, "Sample Prefix": string}
  T1 = cluster{"State Ref": "StringControl reference", "Substate Ref": "StringControl reference", "Current State Ref": "EnumSelector reference", "Main Tab Ref": "TabControl reference"}
  T2 = cluster{"Default Data Saving Location Ref": "PathSelector reference"}
  T3 = cluster{"Author Initials Ref": "ComboBoxSelector reference", "Batch Name Ref": "StringControl reference", "Cell Number Ref": "StringControl reference", "Current Date Ref": "StringControl reference", "Sample Comments Ref": "StringControl reference", "Sample Prefix Ref": "StringControl reference", "Custom Date Ref": "CheckBox reference", "Label Info Error Label Ref": "StringControl reference", "Label Info Missing Error Ref": "BooleanControl reference"}
  T4 = cluster{"Cell Parameters Ref": "Cluster reference", "IV Mode Ref": "EnumSelector reference", "Measurement Precision Ref": "Cluster reference", "Cell Selector Ref": "Cluster reference"}
  T5 = cluster{"Progress % Ref": "ProgressBar reference", "Progress Counter Ref": "NumericTextBoxDouble reference", "Live IV Parameters Ref": "Cluster reference"}
  T6 = cluster{"Layer Information Ref": "ArrayViewer reference"[]}
  "Full Reference Cluster.gtype" = cluster{"Status Report": T1, "Path Cluster": T2, "Sample Naming Cluster": T3, "Acquisition Parameters": T4, "Live Progress Cluster": T5, "Sample Extra Information": T6}
  "Misc Mega Cluster.gtype" = cluster{"Full Reference Cluster": "Full Reference Cluster.gtype"}
diagram:
  case ($"Error In") {
    frame Error, Default {
      w1 = $"Error In"
      w2 = default
    }
    frame No Error {
      Property Node(instance in=$"Misc Mega Cluster In") -> ("Full Reference Cluster:Sample Naming Cluster:Author Initials Ref"=w3, "Full Reference Cluster:Sample Naming Cluster:Current Date Ref"=w4, "Full Reference Cluster:Sample Naming Cluster:Batch Name Ref"=w5, "Full Reference Cluster:Sample Naming Cluster:Sample Prefix Ref"=w6)
      Property Node(instance in=w3, error in=$"Error In") -> ("Value"=w7, error out=w8)
      Property Node(instance in=w4, error in=w8) -> ("Value"=w9, error out=w10)
      Property Node(instance in=w5, error in=w10) -> ("Value"=w11, error out=w12)
      Property Node(instance in=w6, error in=w12) -> ("Value"=w13, error out=w1)
      Property Node(instance in="Naming Cluster.gtype" {all zero or empty}, "Authors Initials"=w7, "Current Date"=w9, "Batch Name"=w11, "Sample Prefix"=w13) -> (instance out=w2)
    }
  }
  $"Error Out" <- w1
  $"Naming Cluster" <- w2
