vi "Single File Save.gvi"   [LabVIEW NXG 5.0.0]
inputs:
  "Error In": error
  "File Operation": "File Operation.gtype" = "Replace"
  "File Path": path
  "Data To Save": string
outputs:
  "Error Out": error
types:
  "File Operation.gtype" = enum{"Replace", "Rename", "Do not save"}
uses:
  Pika IV Characterization NXG::Side Functions::Path Manipulation::Rename Prompt Window.gvi
diagram:
  # This SubVI Allows the user to rename the file if it already
  # exists.
  case ($"Error In") {
    frame Error, Default {
      w1 = $"Error In"
    }
    frame No Error {
      case ($"File Operation") {
        frame "Replace" {
          Open Or Create Or Replace File(error in=$"Error In", file path (use dialog)=$"File Path", operation (0:open)="replace or create") -> (error out=w2, refnum out=w3)
          Write To Text File(error in=w2, file (use dialog)=w3, text=$"Data To Save") -> (error out=w4, refnum out=w5)
          Close File(error in=w4, refnum=w5) -> (error out=w1)
        }
        frame "Rename", Default {
          Strip Path(path=$"File Path") -> (name=w6, stripped path=w7)
          call "Rename Prompt Window.gvi"(Original Filename=w6, Error In=$"Error In") -> (Output=w8, Error Out=w9)
          Build Path(base path=w7, name or relative path=w8) -> (appended path=w10)
          Open Or Create Or Replace File(error in=w9, file path (use dialog)=w10, operation (0:open)="replace or create") -> (error out=w11, refnum out=w12)
          Write To Text File(error in=w11, file (use dialog)=w12, text=$"Data To Save") -> (error out=w13, refnum out=w14)
          Close File(error in=w13, refnum=w14) -> (error out=w1)
        }
        frame "Do not save" {
          w1 = $"Error In"
        }
      }
    }
  }
  $"Error Out" <- w1
