vi "Base Path Generation.gvi"   [LabVIEW NXG 5.0.0]
inputs:
  "Error In": error
  "Misc Data Mega Cluster In": "Misc Mega Cluster.gtype"
outputs:
  "Error Out": error
  "Current Batch Folder Path": path
  "Misc Data Mega Cluster Out": "Misc Mega Cluster.gtype"
  "File Naming Cluster": "Naming Cluster.gtype"
  "Current Day": path
types:
  "Naming Cluster.gtype" = cluster{"Authors Initials": string, "Current Date": string, "Batch Name": string, "Sample Prefix": string}
  T1 = cluster{"State Ref": "StringControl reference", "Substate Ref": "StringControl reference", "Current State Ref": "EnumSelector reference", "Main Tab Ref": "TabControl reference", "Plot Now Flag Ref": "BooleanControl reference"}
  T2 = cluster{"Default Data Saving Location Ref": "PathSelector reference"}
  T3 = cluster{"Author Initials Ref": "ComboBoxSelector reference", "Batch Name Ref": "StringControl reference", "Cell Number Ref": "StringControl reference", "Current Date Ref": "StringControl reference", "Sample Comments Ref": "StringControl reference", "Sample Prefix Ref": "StringControl reference", "Custom Date Ref": "CheckBox reference", "Label Info Error Label Ref": "StringControl reference", "Label Info Missing Error Ref": "BooleanControl reference"}
  T4 = cluster{"Cell Parameters Ref": "Cluster reference", "Cell Selector Ref": "Cluster reference", "Measurement Precision Ref": "Cluster reference", "JV Scan Mode Ref": "EnumSelector reference"}
  T5 = cluster{"Progress % Ref": "ProgressBar reference", "Progress Counter Ref": "NumericTextBoxDouble reference", "Live JV Parameters Ref": "Cluster reference"}
  T6 = cluster{"Layer Information Ref": "ArrayViewer reference"[]}
  T7 = cluster{"Cell Selector Block Ref": "Rectangle reference", "Smart Mode Block Ref": "Rectangle reference", "dV Block Ref": "Rectangle reference", "Smart Mode Text Ref": "Text reference", "No Multiplexer Detected Text Ref": "Text reference", "Current Range Block Ref": "Rectangle reference"}
  T8 = cluster{"JV Measurements Mega Cluster Ref": "Cluster reference", "Instrument Control Mega Cluster Ref": "Cluster reference"}
  T9 = cluster{"JV Main Graph Ref": "Graph reference", "Voc Graph Ref ": "Graph reference", "Jsc Graph Ref": "Graph reference", "Efficiency Graph Ref": "Graph reference", "Fill Factor Graph Ref": "Graph reference", "Series Resistance Graph Ref": "Graph reference", "Shunt Resistance Graph Ref": "Graph reference"}
  "Full Reference Cluster.gtype" = cluster{"Status Report": T1, "Path Cluster": T2, "Sample Naming Cluster": T3, "Acquisition Parameters": T4, "Live Progress Cluster": T5, "Sample Extra Information": T6, "Visual Elements": T7, "Mega Cluster References": T8, "Plotting": T9, "System Parameters": cluster{"Main VI Ref": VIRefnum}}
  "Misc Mega Cluster.gtype" = cluster{"Full Reference Cluster": "Full Reference Cluster.gtype"}
uses:
  Pika IV Characterization NXG::Side Functions::Path Manipulation::Check Default Path Subroutine.gvi
  Pika IV Characterization NXG::Main Functions::File Handling::Low Level::Naming Cluster Generator.gvi
  Pika IV Characterization NXG::Side Functions::Path Manipulation::Create or Open Folder.gvi
diagram:
  # This SubVI Generates the folder with the current batc so that every file
  # can be saved within it
  case ($"Error In") {
    frame Error, Default {
      w1 = $"Error In"
      w2 = default
      w3 = $"Misc Data Mega Cluster In"
      w4 = default
      w5 = default
    }
    frame No Error {
      call "Check Default Path Subroutine.gvi"(Misc Data Mega Cluster In=$"Misc Data Mega Cluster In", Error In=$"Error In") -> (Misc Data Mega Cluster Out=w3, Default Data Saving Location Path Out=w6, Error Out=w7)
      call "Naming Cluster Generator.gvi"(Misc Mega Cluster In=w3, Error In=w7) -> (Naming Cluster=w8, Error Out=w9)
      Property Node(instance in=w8) -> ("Authors Initials"=w10, "Current Date"=w11, "Batch Name"=w12, instance out=w4)
      Concatenate Strings("Device ", w12) -> w13
      call "Create or Open Folder.gvi"(Folder Root Path=w6, Folder Name=w10, Error In=w9) -> (New Folder's Path=w14, Error Out=w15)
      call "Create or Open Folder.gvi"(Folder Root Path=w14, Folder Name=w11, Error In=w15) -> (New Folder's Path=w5, Error Out=w16)
      call "Create or Open Folder.gvi"(Folder Root Path=w5, Folder Name=w13, Error In=w16) -> (New Folder's Path=w2, Error Out=w1)
    }
  }
  $"Misc Data Mega Cluster Out" <- w3
  $"File Naming Cluster" <- w4
  $"Current Batch Folder Path" <- w2
  $"Error Out" <- w1
  $"Current Day" <- w5
