vi "Filetype Folder Path Generator.gvi"   [LabVIEW NXG 5.0.0]
inputs:
  "Misc Data Mega Cluster In": "Misc Mega Cluster.gtype"
  "Error In": error
  "Measurement File Type": "Measurement File Type.gtype" = "TXT JV Curve"
outputs:
  "Folder to save data": path
  "Misc Data Mega Cluster Out": "Misc Mega Cluster.gtype"
  "Error Out": error
  "File Name Cluster Out": "Naming Cluster.gtype"
types:
  "Measurement File Type.gtype" = enum{"TXT JV Curve", "TXT Parameters", "Excel", "Origin", "Power Point", "Layer Information"}
  "Naming Cluster.gtype" = cluster{"Authors Initials": string, "Current Date": string, "Batch Name": string, "Sample Prefix": string}
  T1 = cluster{"State Ref": "StringControl reference", "Substate Ref": "StringControl reference", "Current State Ref": "EnumSelector reference", "Main Tab Ref": "TabControl reference", "Plot Now Flag Ref": "BooleanControl reference"}
  T2 = cluster{"Default Data Saving Location Ref": "PathSelector reference"}
  T3 = cluster{"Author Initials Ref": "ComboBoxSelector reference", "Batch Name Ref": "StringControl reference", "Cell Number Ref": "StringControl reference", "Current Date Ref": "StringControl reference", "Sample Comments Ref": "StringControl reference", "Sample Prefix Ref": "StringControl reference", "Custom Date Ref": "CheckBox reference", "Label Info Error Label Ref": "StringControl reference", "Label Info Missing Error Ref": "BooleanControl reference"}
  T4 = cluster{"Cell Parameters Ref": "Cluster reference", "Cell Selector Ref": "Cluster reference", "Measurement Precision Ref": "Cluster reference", "JV Scan Mode Ref": "EnumSelector reference"}
  T5 = cluster{"Progress % Ref": "ProgressBar reference", "Progress Counter Ref": "NumericTextBoxDouble reference", "Live JV Parameters Ref": "Cluster reference"}
  T6 = cluster{"Layer Information Ref": "ArrayViewer reference"[]}
  T7 = cluster{"Cell Selector Block Ref": "Rectangle reference", "Smart Mode Block Ref": "Rectangle reference", "dV Block Ref": "Rectangle reference", "Smart Mode Text Ref": "Text reference", "No Multiplexer Detected Text Ref": "Text reference", "Current Range Block Ref": "Rectangle reference"}
  T8 = cluster{"JV Measurements Mega Cluster Ref": "Cluster reference", "Instrument Control Mega Cluster Ref": "Cluster reference"}
  T9 = cluster{"JV Main Graph Ref": "Graph reference", "Voc Graph Ref ": "Graph reference", "Jsc Graph Ref": "Graph reference", "Efficiency Graph Ref": "Graph reference", "Fill Factor Graph Ref": "Graph reference", "Series Resistance Graph Ref": "Graph reference", "Shunt Resistance Graph Ref": "Graph reference"}
  "Full Reference Cluster.gtype" = cluster{"Status Report": T1, "Path Cluster": T2, "Sample Naming Cluster": T3, "Acquisition Parameters": T4, "Live Progress Cluster": T5, "Sample Extra Information": T6, "Visual Elements": T7, "Mega Cluster References": T8, "Plotting": T9, "System Parameters": cluster{"Main VI Ref": VIRefnum}}
  "Misc Mega Cluster.gtype" = cluster{"Full Reference Cluster": "Full Reference Cluster.gtype"}
uses:
  Pika IV Characterization NXG::Main Functions::File Handling::Path Generation::Base Path Generation.gvi
  Pika IV Characterization NXG::Side Functions::Path Manipulation::Create or Open Folder.gvi
diagram:
  # This SubVI Generates the file paths and filenames for the different types of files that will be saved
  case ($"Error In") {
    frame Error, Default {
      w1 = $"Error In"
      w2 = default
      w3 = $"Misc Data Mega Cluster In"
      w4 = default
    }
    frame No Error {
      call "Base Path Generation.gvi"(Misc Data Mega Cluster In=$"Misc Data Mega Cluster In", Error In=$"Error In") -> (Current Day=w5, Misc Data Mega Cluster Out=w6, Current Batch Folder Path=w7, File Naming Cluster=w4, Error Out=w8)
      case ($"Measurement File Type") {
        frame "TXT JV Curve", Default {
          call "Create or Open Folder.gvi"(Folder Root Path=w7, Folder Name="JV Curve Files", Error In=w8) -> (New Folder's Path=w2, Error Out=w1)
          w3 = w6
        }
        frame "Layer Information" {
          call "Create or Open Folder.gvi"(Folder Root Path=w7, Folder Name="Layer Info Files", Error In=w8) -> (New Folder's Path=w2, Error Out=w1)
          w3 = w6
        }
        frame "TXT Parameters" {
          call "Create or Open Folder.gvi"(Folder Root Path=w5, Folder Name="TXT Parameter Files", Error In=w8) -> (New Folder's Path=w2, Error Out=w1)
          w3 = w6
        }
        frame "Excel" {
          call "Create or Open Folder.gvi"(Folder Root Path=w5, Folder Name="Excel Files", Error In=w8) -> (New Folder's Path=w2, Error Out=w1)
          w3 = w6
        }
        frame "Origin" {
          call "Create or Open Folder.gvi"(Folder Root Path=w5, Folder Name="OriginLab Files", Error In=w8) -> (New Folder's Path=w2, Error Out=w1)
          w3 = w6
        }
        frame "Power Point" {
          call "Create or Open Folder.gvi"(Folder Root Path=w5, Folder Name="Power Point Files", Error In=w8) -> (New Folder's Path=w2, Error Out=w1)
          w3 = w6
        }
      }
    }
  }
  $"File Name Cluster Out" <- w4
  $"Misc Data Mega Cluster Out" <- w3
  $"Folder to save data" <- w2
  $"Error Out" <- w1
