vi "Full Data File Generator.gvi"   [LabVIEW NXG 5.0.0]
inputs:
  "Error In": error
  "Measurement File Type": "Measurement File Type.gtype" = "TXT JV Curve"
  "Variable Header Info": string
  "Data Array To Save": f64[][]
  "Formatted Data String Array": string[][]
outputs:
  "Error Out": error
  "Full Data Spreadsheet": string
  "Full Data String Array": string[][]
types:
  "Measurement File Type.gtype" = enum{"TXT JV Curve", "TXT Parameters", "Excel", "Origin", "Power Point"}
uses:
  Pika IV Characterization NXG::Main Functions::File Handling::Data Formatting::Header Info Merger.gvi
diagram:
  case ($"Error In") {
    frame Error, Default {
      w1 = $"Error In"
      w2 = default
      w3 = $"Formatted Data String Array"
    }
    frame No Error {
      case ($"Measurement File Type") {
        frame "TXT JV Curve", Default {
          Build Array(["Voltage (V)", "Current (A)", "Current Density (A/m^2)"], $"Variable Header Info") -> w4
          Array To Spreadsheet String(array=$"Data Array To Save", format string="%g") -> (spreadsheet string=w5)
          w3 = $"Formatted Data String Array"
        }
        frame "TXT Parameters" {
          w6 = ["Cell Label", "Voc (V)", "Jsc (A/m^2)", "Efficiency (%)", "FF (%)", "Rs (Ω · m^2)", "Rsh (Ω · m^2)", "Light Power Density (W/m^2)", "Cell Area (m^2)"]
          Array To Spreadsheet String(array=$"Formatted Data String Array", format string="%g") -> (spreadsheet string=w5)
          w4 = w6
          w3 = $"Formatted Data String Array"
        }
        frame "Excel" {
          w7 = ["Cell Label", "Voc (V)", "Jsc (A/m^2)", "Efficiency (%)", "FF (%)", "Rs (Ω · m^2)", "Rsh (Ω · m^2)", "Light Power Density (W/m^2)", "Cell Area (m^2)"]
          Insert Into Array(inArray=$"Formatted Data String Array", index0=0, new=w7) -> w3
          w4 = default
          w5 = default
        }
        frame "Origin" {
          w4 = default
          w5 = default
          w3 = $"Formatted Data String Array"
        }
        frame "Power Point" {
          w4 = default
          w5 = default
          w3 = $"Formatted Data String Array"
        }
      }
      call "Header Info Merger.gvi"(Column info array=w4, Spreadsheet String=w5, Error In=$"Error In") -> (Spreadsheet String With Header=w2, Error Out=w1)
    }
  }
  $"Full Data String Array" <- w3
  $"Full Data Spreadsheet" <- w2
  $"Error Out" <- w1
