vi "Single File Path Generation.gvi"   [LabVIEW NXG 5.0.0]
inputs:
  "Error In": error
  "Measurement File Type": "Measurement File Type.gtype" = "TXT JV Curve"
  "Folder To Save Data": path
  "File Name Cluster In": "Naming Cluster.gtype"
  "JV Data Cluster In": "JV Data Cluster.gtype"
outputs:
  "Error Out": error
  "Full File Path": path
types:
  "Measurement File Type.gtype" = enum{"TXT JV Curve", "TXT Parameters", "Excel", "Origin", "Power Point"}
  "Naming Cluster.gtype" = cluster{"Authors Initials": string, "Current Date": string, "Batch Name": string, "Sample Prefix": string}
  "Cell Selector.gtype" = enum{"L.01", "L.02", "L.03", "L.04", "L.05", "L.06", "L.07", "L.08", "L.09", "L.10", "L.11", "L.12", "R.01", "R.02", "R.03", "R.04", "R.05", "R.06", "R.07", "R.08", "R.09", "R.10", "R.11", "R.12", "Custom"}
  "JV Data Cluster.gtype" = cluster{"Voltage (V)": f64[], "Current (A)": f64[], "Current Density (A/m^2)": f64[], "Cell Area (m^2)": f64, "Illumination (W/m^2)": f64, "Voc (V)": f64, "Jsc (A/m^2)": f64, "FF (%)": f64, "Rsh (Ω · m^2)": f64, "Rs (Ω · m^2)": f64, "Eff (%)": f64, "Measured Cell": "Cell Selector.gtype", "No Multiplexer": bool}
diagram:
  case ($"Error In") {
    frame Error, Default {
      w1 = $"Error In"
      w2 = $"Folder To Save Data"
    }
    frame No Error {
      case ($"Measurement File Type") {
        frame "TXT JV Curve", Default {
          Property Node(instance in=$"File Name Cluster In") -> ("Sample Prefix"=w3)
          Property Node(instance in=$"JV Data Cluster In") -> ("No Multiplexer"=w4, "Measured Cell"=w5)
          Format Into String(initString=w3, errIn=$"Error In", w5) -> (outString=w6, errOut=w1)
          Select(s=w4, t=w3, f=w6) -> w7
          Concatenate Strings(w7, " JV Curve.txt") -> w8
          Build Path(base path=$"Folder To Save Data", name or relative path=w8) -> (appended path=w2)
        }
        frame "TXT Parameters" {
          Property Node(instance in=$"File Name Cluster In") -> ("Sample Prefix"=w9)
          Concatenate Strings(w9, "Full Parameters.txt") -> w10
          Build Path(base path=$"Folder To Save Data", name or relative path=w10) -> (appended path=w2)
          w1 = $"Error In"
        }
        frame "Excel" {
          Property Node(instance in=$"File Name Cluster In") -> ("Sample Prefix"=w11)
          Concatenate Strings(w11, "Excel.xlsx") -> w12
          Build Path(base path=$"Folder To Save Data", name or relative path=w12) -> (appended path=w2)
          w1 = $"Error In"
        }
        frame "Origin" {
          Property Node(instance in=$"File Name Cluster In") -> ("Sample Prefix"=w13)
          Concatenate Strings(w13, " Origin") -> w14
          Build Path(base path=$"Folder To Save Data", name or relative path=w14) -> (appended path=w2)
          w1 = $"Error In"
        }
        frame "Power Point" {
          Property Node(instance in=$"File Name Cluster In") -> ("Sample Prefix"=w15)
          Concatenate Strings(w15, " Report") -> w16
          Build Path(base path=$"Folder To Save Data", name or relative path=w16) -> (appended path=w2)
          w1 = $"Error In"
        }
      }
    }
  }
  $"Error Out" <- w1
  $"Full File Path" <- w2
