vi "Single JV Curve Header Generator.gvi"   [LabVIEW NXG 5.0.0]
inputs:
  "Error In": error
  "JV Data Cluster In": "JV Data Cluster.gtype"
outputs:
  "Error Out": error
  "Single JV Curve Header": string
types:
  "Cell Selector.gtype" = enum{"L.01", "L.02", "L.03", "L.04", "L.05", "L.06", "L.07", "L.08", "L.09", "L.10", "L.11", "L.12", "R.01", "R.02", "R.03", "R.04", "R.05", "R.06", "R.07", "R.08", "R.09", "R.10", "R.11", "R.12", "Custom"}
  "JV Data Cluster.gtype" = cluster{"Voltage (V)": f64[], "Current (A)": f64[], "Current Density (A/m^2)": f64[], "Cell Area (m^2)": f64, "Illumination (W/m^2)": f64, "Voc (V)": f64, "Jsc (A/m^2)": f64, "FF (%)": f64, "Rsh (Ω · m^2)": f64, "Rs (Ω · m^2)": f64, "Eff (%)": f64, "Measured Cell": "Cell Selector.gtype", "No Multiplexer": bool}
diagram:
  case ($"Error In") {
    frame Error, Default {
      w1 = $"Error In"
      w2 = default
    }
    frame No Error {
      w3 = ["Voc (V)", "Jsc (A/m^2)", "Efficiency (%)", "FF (%)", "Rs (Ω · m^2)", "Rsh (Ω · m^2)", "Light Power Density (W/m^2)", "Cell Area (m^2)"]
      Property Node(instance in=$"JV Data Cluster In") -> ("Voc (V)"=w4, "Jsc (A/m^2)"=w5, "Eff (%)"=w6, "FF (%)"=w7, "Rs (Ω · m^2)"=w8, "Rsh (Ω · m^2)"=w9, "Illumination (W/m^2)"=w10, "Cell Area (m^2)"=w11)
      Build Array(w4, w5, w6, w7, w8, w9, w10, w11) -> w12
      s1 = ""  # shift register
      for {
        w13 = each element of w12
        w14 = each element of w3
        Number To Exponential String(number=w13, precision (6)=3, use system decimal point (T)=FALSE, width (-)=3) -> (E-format string=w15)
        Concatenate Strings(s1, "\t", w14, "  ", w15) -> w16
        next s1 = w16
      }
      w1 = $"Error In"
      w2 = s1
    }
  }
  $"Error Out" <- w1
  $"Single JV Curve Header" <- w2
