vi "IV Full Processing.gvi"   [LabVIEW NXG 5.0.0]
inputs:
  "Error In": error
  "IV Measurements Mega Cluster In": "IV Measurements Mega Cluster.gtype"
  "IV Data Cluster In": "IV Data Cluster.gtype"
  "Current Cell": "Cell Selector.gtype" = "L.01"
outputs:
  "Error Out": error
  "IV Measurements Mega Cluster Out": "IV Measurements Mega Cluster.gtype"
types:
  "Cell Selector.gtype" = enum{"L.01", "L.02", "L.03", "L.04", "L.05", "L.06", "L.07", "L.08", "L.09", "L.10", "L.11", "L.12", "R.01", "R.02", "R.03", "R.04", "R.05", "R.06", "R.07", "R.08", "R.09", "R.10", "R.11", "R.12", "Custom"}
  "IV Data Cluster.gtype" = cluster{"Voltage (V)": f64[], "Current (A)": f64[], "Current Density (A/m^2)": f64[], "Cell Area (m^2)": f64, "Illumination (W/m^2)": f64, "Voc (V)": f64, "Jsc (A/m^2)": f64, "FF (%)": f64, "Rsh (Ω · m^2)": f64, "Rs (Ω · m^2)": f64, "Eff (%)": f64, "Measured Cell": "Cell Selector.gtype", "Continuous Cell": bool}
  "IV Mode.gtype" = enum{"Rough", "Normal", "Accurate", "Smart", "Custom"}
  "IV Curve Parameters.gtype" = cluster{"Cell Parameters": "Cell Parameters.gtype", "Measurement Precision": "Accuracy Parameters.gtype", "IV Accuracy Mode": "IV Mode.gtype"}
  "IV Measurements Mega Cluster.gtype" = cluster{"IV Curve Parameters": "IV Curve Parameters.gtype", "Cell Selector": "Cell Selector.gtype", "Cell Array": "Cell Selector.gtype"[], "IV Full Data Array": "IV Data Cluster.gtype"[]}
uses:
  Pika IV Characterization NXG::Main Functions::IV Curves::Calculations::IV to IJV Data.gvi
  Pika IV Characterization NXG::Main Functions::IV Curves::Calculations::Jsc and Voc.gvi
  Pika IV Characterization NXG::Main Functions::IV Curves::Calculations::FF and Eff.gvi
diagram:
  case ($"Error In") {
    frame Error, Default {
      w1 = $"Error In"
      w2 = $"IV Measurements Mega Cluster In"
    }
    frame No Error {
      call "IV to IJV Data.gvi"(IV Measurements Mega Cluster In=$"IV Measurements Mega Cluster In", IV Data Cluster In=$"IV Data Cluster In", Error In=$"Error In") -> (IV Measurements Mega Cluster Out=w3, IV Data Cluster Out=w4, Error Out=w5)
      call "Jsc and Voc.gvi"(IV Measurements Mega Cluster In=w3, IV Data Cluster In=w4, Error In=w5) -> (IV Measurements Mega Cluster Out=w6, IV Data Cluster Out=w7, Error Out=w8)
      Property Node(instance in=w6) -> ("IV Full Data Array"=w9, instance out=w10)
      Is Equal(x="Custom", y=$"Current Cell") -> w11
      call "FF and Eff.gvi"(IV Data Cluster In=w7, Error In=w8) -> (IV Data Cluster Out=w12, Error Out=w1)
      Property Node(instance in=w12, "Measured Cell"=$"Current Cell", "Continuous Cell"=w11) -> (instance out=w13)
      Build Array(w9, w13) -> w14
      Property Node(instance in=w10, "IV Full Data Array"=w14) -> (instance out=w2)
    }
  }
  $"IV Measurements Mega Cluster Out" <- w2
  $"Error Out" <- w1
