vi "IV to IJV Data.gvi"   [LabVIEW NXG 5.0.0]
inputs:
  "IV Measurements Mega Cluster In": "IV Measurements Mega Cluster.gtype"
  "IV Data Cluster In": "IV Data Cluster.gtype"
  "Error In": error
outputs:
  "IV Measurements Mega Cluster Out": "IV Measurements Mega Cluster.gtype"
  "IV Data Cluster Out": "IV Data Cluster.gtype"
  "Error Out": error
types:
  "Cell Selector.gtype" = enum{"L.01", "L.02", "L.03", "L.04", "L.05", "L.06", "L.07", "L.08", "L.09", "L.10", "L.11", "L.12", "R.01", "R.02", "R.03", "R.04", "R.05", "R.06", "R.07", "R.08", "R.09", "R.10", "R.11", "R.12"}
  "IV Data Cluster.gtype" = cluster{"Voltage (V)": f64[], "Current (A)": f64[], "Current Density (A/m^2)": f64[], "Cell Area (m^2)": f64, "Illumination (W/m^2)": f64, "Voc (V)": f64, "Jsc (A/m^2)": f64, "FF (%)": f64, "Rsh (Ω · m^2)": f64, "Rs (Ω · m^2)": f64, "Eff (%)": f64, "Measured Cell": "Cell Selector.gtype", "Continuous Cell": bool}
  "IV Mode.gtype" = enum{"Rough", "Normal", "Accurate", "Smart", "Custom"}
  "IV Curve Parameters.gtype" = cluster{"Cell Parameters": "Cell Parameters.gtype", "Measurement Precision": "Accuracy Parameters.gtype", "IV Accuracy Mode": "IV Mode.gtype"}
  "IV Measurements Mega Cluster.gtype" = cluster{"IV Curve Parameters": "IV Curve Parameters.gtype", "Cell Selector": "Cell Selector.gtype"}
diagram:
  # This SubVI takes the cell area and the current and converts
  # the current array into current density
  case ($"Error In") {
    frame Error, Default {
      w1 = $"Error In"
      w2 = $"IV Data Cluster In"
      w3 = $"IV Measurements Mega Cluster In"
    }
    frame No Error {
      Property Node(instance in=$"IV Measurements Mega Cluster In") -> ("IV Curve Parameters:Cell Parameters:Cell Area (m^2)"=w4, "IV Curve Parameters:Cell Parameters:Light Power (W m^-2)"=w5, instance out=w3)
      Property Node(instance in=$"IV Data Cluster In") -> ("Current (A)"=w6, instance out=w7)
      Divide(x=w6, y=w4) -> w8
      Property Node(instance in=w7, "Current Density (A/m^2)"=w8, "Cell Area (m^2)"=w4, "Illumination (W/m^2)"=w5) -> (instance out=w2)
      w1 = $"Error In"
    }
  }
  $"Error Out" <- w1
  $"IV Measurements Mega Cluster Out" <- w3
  $"IV Data Cluster Out" <- w2
