vi "IV Curve Save Prompt.gvi"   [LabVIEW NXG 5.0.0]
inputs:
  "Error In": error
outputs:
  "Error Out": error
  "Desired State": "IV Measurement States.gtype"
types:
  "IV Measurement States.gtype" = enum{"Start App", "Initialize Instruments", "Acquire IV Curves", "Close Coms", "Process IV Data", "Load Measurement", "Save Files", "Stop App"}
uses:
  Pika IV Characterization NXG::Main Functions::IV Curves::Measurements::Data::FGV IV Save Mode.gvi
diagram:
  # This subVI Prompts the user to save or discard the measurement files in case
  # the operation was a new measurement. Otherwise it does not
  case ($"Error In") {
    frame Error, Default {
      w1 = $"Error In"
      w2 = "Stop App"
    }
    frame No Error {
      w3 = "Do you wish to save the current Measurement files, as well as a full report with ppt and origin files?\nThey will be properly saved on your Personal Folder with the current date and batch label."
      Three Button Dialog(Allow user to close window? (TRUE)=FALSE, Center Button Text ("No")="Just the .txt files are okay thanks :)", Left Button Text ("Yes")="Yes please I want a full report :D", Right Button Text ("Cancel")="These results are awful, I don't want them!", Window Title (" ")="Everything not saved will be lost", message=w3) -> (Which Button?=w4)
      case (w4) {
        frame "left button", Default {
          w5 = "Save Files"  # IV Measurement States
          call "FGV IV Save Mode.gvi"(FGV Instructions="Set State", Full Report?=TRUE, Error In=$"Error In") -> (Error Out=w1)
          w2 = w5
        }
        frame "center button" {
          w6 = "Save Files"  # IV Measurement States
          call "FGV IV Save Mode.gvi"(FGV Instructions="Set State", Full Report?=FALSE, Error In=$"Error In") -> (Error Out=w1)
          w2 = w6
        }
        frame "right button" {
          w7 = "Stop App"  # IV Measurement States
          w2 = w7
          w1 = $"Error In"
        }
        frame "window close" {
          w8 = "Stop App"  # IV Measurement States
          w2 = w8
          w1 = $"Error In"
        }
      }
    }
  }
  $"Desired State" <- w2
  $"Error Out" <- w1
