vi "IV Curves Acquiring.gvi"   [LabVIEW NXG 5.0.0]
panel controls:
  "Error In": error
  "Instrument Control Mega Cluster In": "Instrument Control Mega Cluster.gtype"
  "IV Measurements Mega Cluster In": "IV Measurements Mega Cluster.gtype"
panel indicators:
  "Error Out": error
  "Instrument Control Mega Cluster Out": "Instrument Control Mega Cluster.gtype"
  "SRM Mega Cluster Out": "SRM Mega Cluster.gtype"
types:
  "Instrument Coms Info.gtype" = cluster{"Arduino Coms Info": "Arduino Detection cluster control.gtype", "Photodetector Names": string[], "Keythley Address": "VISA Instr", "Photodetector Detected?": bool, "Thorlabs Motors Detected?": bool, "Keithley Detected?": bool, "Thorlabs Motors Serial Number": "Thorlabs Motors Serial Number In.gtype", "Photodetector IVI session": "Ivi IviDefault", "Flame ID": string, "Flame Detected?": bool, "Flame Wrapper ID": u64}
  "Debugging Cluster.gtype" = cluster{"Debugging mode?": bool, "Initialize App": bool, "Insturment Debugging": "Insturment Debugging Cluster.gtype"}
  "Instrument Control Mega Cluster.gtype" = cluster{"Instruments Coms Info": "Instrument Coms Info.gtype", "Debugging Cluster": "Debugging Cluster.gtype"}
  "SRM Specific Parameters.gtype" = cluster{"Max (V)": f64, "Min (V)": f64, "V Points": u32, "Current Range (A)": f64, "Autorange": bool, "Sweep Dir": bool, "Current Averages": u32, "Max (A)": f64, "Integration Time": f64, "Cell Area (m^2)": f64, "Full Spctr Ref": bool}
  "Raibow Sweep Selector.gtype" = enum{"Red Sweep", "Blue Sweep", "Full Sweep Red First", "Full Sweep Blue First"}
  "Rainbow Sweep Param Selector.gtype" = cluster{"Raibow Sweep Selector": "Raibow Sweep Selector.gtype", "Max Wavelength (nm)": f64, "Min Wavelength (nm)": f64, "Wavelength Step (nm)": f64, "Rainbow Sweep Type Selector": "Rainbow Sweep Type Selector.gtype"}
  "Rainbow Sweep Types.gtype" = enum{"Red Sweep Closing", "Red Sweep Opening", "Blue Sweep Closing", "Blue Sweep Opening"}
  "IV Full Data Cluster.gtype" = cluster{"IV Measurements Array": "IV Single Measurement.gtype"[], "Rainbow Sweep Types": "Rainbow Sweep Types.gtype", "IV Refined Data": "IV Refined Full Sweep Data.gtype", "Total Light Power Density (W/m^2)": f64}
  "IV Full Raw Data.gtype" = cluster{"Rainbow Sweep Types": "Rainbow Sweep Types.gtype", "IV Raw Data Array": "IV Single Measurement.gtype"[]}
  "SRM Mega Cluster.gtype" = cluster{"SRM Specific Parameters": "SRM Specific Parameters.gtype", "Rainbow Sweep Parameters SRM": "Rainbow Sweep Param Selector.gtype", "SRM Full IV data Array": "IV Full Data Cluster.gtype"[], "Full IV Curve Raw Data": "IV Full Raw Data.gtype"[]}
  "IV Mode.gtype" = enum{"Rough", "Normal", "Accurate", "Smart", "Custom"}
  "IV Curve Parameters.gtype" = cluster{"Cell Parameters": "Cell Parameters.gtype", "Measurement Precision": "Accuracy Parameters.gtype", "IV Accuracy Mode": "IV Mode.gtype"}
  T1 = cluster{"L.01": bool, "R.01": bool, "L.02": bool, "R.02": bool, "L.03": bool, "R.03": bool, "L.04": bool, "R.04": bool, "L.05": bool, "R.05": bool, "L.06": bool, "R.06": bool, "L.07": bool, "R.07": bool, "L.08": bool, "R.08": bool, "L.09": bool, "R.09": bool, "L.10": bool, "R.10": bool, "L.11": bool, "R.11": bool, "L.12": bool, "R.12": bool}
  "Cell Selector.gtype" = cluster{"All": bool, "Left": bool, "Right": bool, "Cell Cluster": T1, "Reset": bool, "Random Order ": bool, "Continuous Cell": bool}
  "IV Measurements Mega Cluster.gtype" = cluster{"IV Curve Parameters": "IV Curve Parameters.gtype", "Cell Selector": "Cell Selector.gtype"}
  "IV Single Measurement.gtype" = cluster{"Voltage (V)": f64[], "Current (A)": f64[], "Current Density (A/m^2)": f64[], "Dividing Wavelength (nm)": f64, "Light Power Density (W/m^2)": f64, "Total Light Power Density (W/m^2)": f64}
  "SRM Single Plot Cluster.gtype" = cluster{"Voltage (V)": f64[], "Current Density (A/m^2)": f64[]}
  "SRM Sweep Live Parameters.gtype" = cluster{"Current Wavelength (nm)": f64, "Rainbow Sweep Types": "Rainbow Sweep Types.gtype", "Finished Measurement?": bool}
  "SRM Sweep Live Parameters FGV Cluster.gtype" = cluster{"IV Single Measurement Array": "IV Single Measurement.gtype"[], "SRM Sweep type combo box selction": string, "IV Single Measurement Plot Array": "SRM Single Plot Cluster.gtype"[], "SRM Live Parameters": "SRM Sweep Live Parameters.gtype", "Counter": i32, "Full IV Data Array": "IV Full Raw Data.gtype"[], "Combobox Reference": "ComboBoxSelector reference", "Refresh now": bool, "Graph Reference": "Graph reference"}
uses:
  Pika IV Characterization NXG::Side Functions::Messages And Prompts::FGV Cancel Prompts until Finished Routine.gvi
  Pika IV Characterization NXG::Side Functions::Instrument Control::Keithley::Keithley Set Constant Parameters.gvi
  Rainbow Measurement Setup::Side Functions::Instrument Control::Keithley::Keithley Sweep Subroutine.gvi
  Rainbow Measurement Setup::Main Functions::Rainbow Measurement::Cell Single Rainbow Measurement::IV Calculations::IV to IJV Data.gvi
  Pika IV Characterization NXG::Side Functions::Timeout::Progress General Calculator.gvi
  Pika IV Characterization NXG::Side Functions::Timeout::FGV Progress.gvi
  Pika IV Characterization NXG::Side Functions::Abort Control::FGV Global Abort.gvi
  Rainbow Measurement Setup::Main Functions::Rainbow Measurement::Cell Single Rainbow Measurement::SRM Live Parameters::SRM Sweep Live Parameters FGV.gvi
  Rainbow Measurement Setup::Side Functions::Instrument Control::Thorlabs Motors::Movement::KCube Move to 0 or Home.gvi
diagram:
  # This SubVI Takes the specified Parameters both for the sweep types and for the keithley electrical sweep and performs all the measurements while storing them on their
  # corresponding clusters, before outputing all the information within the Full IV Curve Data array.
  case ($"Error In") {
    frame Error, Default {
      w1 = $"Error In"
      w2 = $"Instrument Control Mega Cluster In"
      w3 = w4
    }
    frame No Error {
      call "FGV Cancel Prompts until Finished Routine.gvi"(Error In=$"Error In", FGV Instructions="Reset State") -> (Error Out=w5)
      call "Keithley Set Constant Parameters.gvi"(Instrument Control Mega Cluster In=$"Instrument Control Mega Cluster In", IV Measurements Mega Cluster In=$"IV Measurements Mega Cluster In", Error In=w5) -> (Instrument Control Mega Cluster Out=w6, IV Measurements Mega Cluster Out=w7, Error Out=w8)
      s1 = w8  # shift register
      s2 = w6  # shift register
      s3 = "IV Full Raw Data.gtype"[] []  # shift register
      s4 = 0  # shift register
      s5 = w7  # shift register
      for (N -> w9) (iteration -> i1) {
        call "Keithley Sweep Subroutine.gvi"(Instrument Control Mega Cluster In=_, SRM Mega Cluster In=_, IV Single Measurement In=_, Error In=_) -> (Instrument Control Mega Cluster Out=w10, SRM Mega Cluster Out=w11, IV Single Measurement Out=w12, Error Out=w13)
        call "IV to IJV Data.gvi"(SRM Mega Cluster In=w11, IV Single Measurement In=w12, Error In=w13) -> (SRM Mega Cluster Out=w14, IV Single Measurement Out=w15, Error Out=w16)
        Insert Into Array(inArray="IV Single Measurement.gtype"[] [], new=w15) -> (outArray=w17, index0=w18)
        w19 = "SRM Sweep Live Parameters FGV Cluster.gtype" {all zero or empty}
        Property Node(instance in=w19, "IV Single Measurement Array"=w17) -> ("SRM Live Parameters"=w20, instance out=w21)
        call "Progress General Calculator.gvi"(Starting Value=40, Ending Value=80, Number Of Steps=w9, Current Step=i1, Error In=_) -> (Current Progress=w22, Error Out=w23)
        call "FGV Progress.gvi"(FGV Instructions="Set State", Progress In=w22, Error In=w23) -> (Error Out=w24)
        call "FGV Global Abort.gvi"(Global Abort Instructions="Read Current State") -> (Local Abort Out=w25, Global Abort Out=w26, Error Out=w27)
        Logical Or(w25, w26) -> w28
        Wait Until Next Multiple(multiple to wait=10)
        next s1 = w29
        next s2 = w30
        next s3 = w31
        next s4 = _
        next s5 = w14
        stop if w28
      }
      Property Node(instance in=s5, "Full IV Curve Raw Data"=s3) -> (instance out=w3)
      w32 = "SRM Sweep Live Parameters FGV Cluster.gtype" {"SRM Live Parameters"={"Current Wavelength (nm)"=-1, "Rainbow Sweep Types"="Red Sweep Closing", "Finished Measurement?"=TRUE}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}
      call "SRM Sweep Live Parameters FGV.gvi"(FGV Instructions="Set State", SRM sweep live parameters FGV Cluster In=w32, Error In=s1) -> (Error Out=w33)
      call "KCube Move to 0 or Home.gvi"(Instrument Control Mega Cluster In=s2, Error In=w33) -> (Instrument Control Mega Cluster Out=w2, Error Out=w1)
    }
  }
  $"SRM Mega Cluster Out" <- w3
  $"Instrument Control Mega Cluster Out" <- w2
  $"Error Out" <- w1
