vi "Initialize App Instruction Extractor.gvi"   [LabVIEW NXG 5.0.0]
inputs:
  "Error In": error
  "Initialize App SubroutineStates": "Initialize App States.gtype" = "Reset Disabled/Enabled Controls"
outputs:
  "Error Out": error
  "Initialize App States Array": "Initialize App States.gtype"[]
  "SubStates Output Array": string[]
types:
  "Initialize App States.gtype" = enum{"Reset Global Variables", "Reset Disabled/Enabled Controls", "Initialize Sample Naming", "Reset Doubles", "Reset Clusters", "Reset Booleans", "Reset Strings", "Detect Instruments"}
diagram:
  # This loop runs through the enum and extracts all
  # the elements storing them as an array.
  # It also stores the name of the instructions so that
  # they can be displayed afttewards for debugging purposes
  case ($"Error In") {
    frame Error, Default {
      w1 = $"Error In"
      w2 = default
      w3 = default
    }
    frame No Error {
      s1 = uninitialised  # shift register
      s2 = $"Error In"  # shift register
      while (iteration -> i1) {
        Is Not Equal To 0(x=i1) -> w4
        To Unsigned 16 Bit Integer(number=i1) -> w5
        Type Cast(type=$"Initialize App SubroutineStates", x=w5) -> w6
        case (w4) {
          frame False, Default {
            w7 = FALSE
          }
          frame True {
            Is Equal(x=s1, y=w6) -> w7
          }
        }
        Not(x=w7) -> w8
        Format Into String(errIn=s2, w6) -> (outString=w9, errOut=w10)
        append w6 to w3 if w8
        append w9 to w2 if w8
        next s1 = w6
        next s2 = w10
        stop if w7
      }
      w1 = s2
    }
  }
  $"Error Out" <- w1
  $"Initialize App States Array" <- w3
  $"SubStates Output Array" <- w2
