vi "Initialize App Subroutine.gvi"   [LabVIEW NXG 5.0.0]
inputs:
  "Error In": error
  "Instrument Control Mega Cluster In": "Instrument Control Mega Cluster.gtype"
  "Misc Data Mega Cluster In": "Misc Mega Cluster.gtype"
outputs:
  "Error Out": error
  "Instrument Control Mega Cluster Out": "Instrument Control Mega Cluster.gtype"
  "Misc Data Mega Cluster Out": "Misc Mega Cluster.gtype"
types:
  T1 = cluster{"State Ref": "StringControl reference", "Substate Ref": "StringControl reference", "Current State Ref": "EnumSelector reference", "Main Tab Ref": "TabControl reference", "Plot Now Flag Ref": "BooleanControl reference"}
  T2 = cluster{"Default Data Saving Location Ref": "PathSelector reference"}
  T3 = cluster{"Author Initials Ref": "ComboBoxSelector reference", "Batch Name Ref": "StringControl reference", "Cell Number Ref": "StringControl reference", "Current Date Ref": "StringControl reference", "Sample Comments Ref": "StringControl reference", "Sample Prefix Ref": "StringControl reference", "Custom Date Ref": "CheckBox reference", "Label Info Error Label Ref": "StringControl reference", "Label Info Missing Error Ref": "BooleanControl reference"}
  T4 = cluster{"Cell Parameters Ref": "Cluster reference", "Cell Selector Ref": "Cluster reference", "Measurement Precision Ref": "Cluster reference", "JV Scan Mode Ref": "EnumSelector reference"}
  T5 = cluster{"Progress % Ref": "ProgressBar reference", "Progress Counter Ref": "NumericTextBoxDouble reference", "Live JV Parameters Ref": "Cluster reference"}
  T6 = cluster{"Layer Information Ref": "ArrayViewer reference"[]}
  T7 = cluster{"Cell Selector Block Ref": "Rectangle reference", "Smart Mode Block Ref": "Rectangle reference", "dV Block Ref": "Rectangle reference", "Smart Mode Text Ref": "Text reference", "No Multiplexer Detected Text Ref": "Text reference", "Current Range Block Ref": "Rectangle reference"}
  T8 = cluster{"JV Measurements Mega Cluster Ref": "Cluster reference", "Instrument Control Mega Cluster Ref": "Cluster reference"}
  T9 = cluster{"JV Main Graph Ref": "Graph reference", "Voc Graph Ref ": "Graph reference", "Jsc Graph Ref": "Graph reference", "Efficiency Graph Ref": "Graph reference", "Fill Factor Graph Ref": "Graph reference", "Series Resistance Graph Ref": "Graph reference", "Shunt Resistance Graph Ref": "Graph reference"}
  "Full Reference Cluster.gtype" = cluster{"Status Report": T1, "Path Cluster": T2, "Sample Naming Cluster": T3, "Acquisition Parameters": T4, "Live Progress Cluster": T5, "Sample Extra Information": T6, "Visual Elements": T7, "Mega Cluster References": T8, "Plotting": T9, "System Parameters": cluster{"Main VI Ref": VIRefnum}}
  "Misc Mega Cluster.gtype" = cluster{"Full Reference Cluster": "Full Reference Cluster.gtype"}
  T10 = cluster{"Element 1": "VISA Instr", "Element 2": string}
  T11 = enum{"Keithley 2400 Series", "Keithley 2450 Series"}
  "Instrument Control.gtype" = cluster{"Multiplexer Arduino Detected?": bool, "Multiplexer Arduino Address": "VISA Instr", "Arduinos List": T10[], "Multiplexer Log": string, "Keythley Address": "VISA Instr", "Keithley Detected?": bool, "Keithley ID": string, "Detected Keithley Type": T11, "Database Detected?": bool}
  "Debugging Cluster.gtype" = cluster{"Debugging mode?": bool, "Initialize App": bool, "Insturment Debugging": cluster{"Keithley": bool, "Arduino": bool}}
  "Instrument Control Mega Cluster.gtype" = cluster{"Instrument Control": "Instrument Control.gtype", "Debugging Cluster": "Debugging Cluster.gtype"}
uses:
  Pika IV Characterization NXG::Main Functions::Instruction Handling::FGV Current State.gvi
  Pika IV Characterization NXG::Main Functions::Initializing App::Initialize App Instruction Extractor.gvi
  Pika IV Characterization NXG::Main Functions::Initializing App::Variable Resetting::Reset Global Variables.gvi
  Pika IV Characterization NXG::Main Functions::Initializing App::Variable Resetting::Reset Disabled Controls.gvi
  Pika IV Characterization NXG::Main Functions::Initializing App::Variable Resetting::Initialize Sample Naming.gvi
  Pika IV Characterization NXG::Main Functions::Initializing App::Variable Resetting::Reset Controls to Default Values.gvi
  Pika IV Characterization NXG::Main Functions::Initializing App::Variable Resetting::Reset Clusters.gvi
  Pika IV Characterization NXG::Side Functions::Instrument Control::Instrument Detection Subroutine.gvi
  Pika IV Characterization NXG::Side Functions::Instrument Control::Detected Instruments Check.gvi
  Pika IV Characterization NXG::Main Functions::Initializing App::Variable Resetting::Open Main Window.gvi
  Pika IV Characterization NXG::Side Functions::Abort Control::FGV Global Abort.gvi
diagram:
  Property Node(instance in=$"Instrument Control Mega Cluster In") -> ("Debugging Cluster:Debugging mode?"=w1, "Debugging Cluster:Initialize App"=w2)
  Logical And(w1, not w2) -> w3
  # This is the Initialization Subroutine, its main job is to reset the values of controls, reset functional global variables, scan for instruments
  # and read configuration files among other things.
  case (w3) {
    frame True {
      w4 = $"Error In"
      w5 = $"Instrument Control Mega Cluster In"
      w6 = $"Misc Data Mega Cluster In"
    }
    frame False {
      case ($"Error In") {
        frame Error, Default {
          w4 = $"Error In"
          w5 = $"Instrument Control Mega Cluster In"
          w6 = $"Misc Data Mega Cluster In"
        }
        frame No Error {
          call "FGV Current State.gvi"(Current State Instructions="Set Current State", Current State="Initialize App", Error In=$"Error In") -> (Error Out=w7)
          call "Initialize App Instruction Extractor.gvi"(Initialize App SubroutineStates="Reset Disabled/Enabled Controls", Error In=w7) -> (Initialize App States Array=w8, SubStates Output Array=w9, Error Out=w10)
          s1 = w10  # shift register
          s2 = $"Instrument Control Mega Cluster In"  # shift register
          s3 = $"Misc Data Mega Cluster In"  # shift register
          for {
            w11 = each element of w8
            w12 = each element of w9
            call "FGV Current State.gvi"(Current State Instructions="Set Current Substate", Current Substate=w12, Error In=s1) -> (Error Out=w13)
            case (w11) {
              frame "Reset Global Variables", Default {
                call "Reset Global Variables.gvi"(Error In=w13) -> (Error Out=w14)
                w15 = s2
                w16 = s3
              }
              frame "Reset Disabled/Enabled Controls" {
                call "Reset Disabled Controls.gvi"(Misc Data Mega Cluster In=s3, Error In=w13) -> (Misc Data Mega Cluster Out=w16, Error Out=w14)
                w15 = s2
              }
              frame "Initialize Sample Naming" {
                call "Initialize Sample Naming.gvi"(Misc Data Mega Cluster In=s3, Error In=w13) -> (Misc Data Mega Cluster Out=w16, Error Out=w14)
                w15 = s2
              }
              frame "Reset Controls to Default" {
                call "Reset Controls to Default Values.gvi"(Misc Data Mega Cluster In=s3, Error In=w13) -> (Misc Data Mega Cluster Out=w16, Error Out=w14)
                w15 = s2
              }
              frame "Reset Clusters" {
                call "Reset Clusters.gvi"(Misc Data Mega Cluster In=s3, Error In=w13) -> (Misc Data Mega Cluster Out=w16, Error Out=w14)
                w15 = s2
              }
              frame "Detect Instruments" {
                call "Instrument Detection Subroutine.gvi"(Instrument Control Mega Cluster In=s2, Error In=w13) -> (Instrument Control Mega Cluster Out=w17, Error Out=w18)
                call "Detected Instruments Check.gvi"(Misc Data Mega Cluster In=s3, Instrument Control Mega Cluster In=w17, Error In=w18) -> (Misc Data Mega Cluster Out=w16, Instrument Control Mega Cluster Out=w15, Error Out=w14)
              }
              frame "Open Main Window" {
                call "Open Main Window.gvi"(Misc Data Mega Cluster In=s3, Error In=w13) -> (Misc Data Mega Cluster Out=w16, Error Out=w14)
                w15 = s2
              }
            }
            call "FGV Global Abort.gvi"(Global Abort Instructions="Read Current State", Error In=w14) -> (Global Abort Out=w19, Error Out=w20)
            next s1 = w20
            next s2 = w15
            next s3 = w16
            stop if w19
          }
          w4 = s1
          w5 = s2
          w6 = s3
        }
      }
    }
  }
  $"Instrument Control Mega Cluster Out" <- w5
  $"Error Out" <- w4
  $"Misc Data Mega Cluster Out" <- w6
