vi "Beating Star.gvi"   [LabVIEW NXG 5.0.0]
inputs:
  "Error In": error
  "Star Reference": "Path reference"
  "Current Iteration": i32
  "Speed Divider": f64 = 10
outputs:
  "Error Out": error
  "Sinus Wave": f64
diagram:
  # This script generates a beating pabbern and forces the beat into an object
  # through the incoming reference
  case ($"Error In") {
    frame Error, Default {
      w1 = $"Error In"
    }
    frame No Error {
      w2 = cluster{"Width": f32, "Height": f32} {"Width"=10, "Height"=10}
      To Double Precision Float(number=$"Current Iteration") -> w3
      Divide(x=w3, y=$"Speed Divider") -> w4
      Sine(x=w4) -> w5
      Square(x=w5) -> w6
      Multiply(w6, 20) -> w7
      Add(w7, 10) -> w8
      Property Node(instance in=w2, "Width"=w8, "Height"=w8) -> (instance out=w9)
      Sign(number=w5) -> (-1, 0, 1=w10)
      Is Less Or Equal To 0(x=w10) -> w11
      Select(s=w11, t=30, f=10) -> w12
      Multiply(w6, w12, w10) -> w13
      Add(400, w13) -> w14
      Property Node(instance in=cluster{"Left": f32, "Top": f32} {"Left"=400, "Top"=70}, "Left"=w14) -> (instance out=w15)
      Property Node(instance in=$"Star Reference", "Size"=w9, "Position"=w15)
      $"Sinus Wave" <- w8
      w1 = $"Error In"
    }
  }
  $"Error Out" <- w1
