vi "Initializing app prompt.gvi"   [LabVIEW NXG 5.0.0]
inputs:
  "Error In": error
outputs:
  "Error Out": error
panel indicators:
  "Linear Progress Bar": f64
  "Sinus Wave": f64
  "SubStates": string[]
  "Current SubState Out": string
  "States": "Queue Instructions Control.gtype"[]
types:
  "Queue Instructions Control.gtype" = enum{"Undefined State", "Debug Check", "Initialize App", "Idle", "Change Cell", "IV Curve", "Saving TXT Files", "Generating Origin Files", "Stopping App", "State 1", "State2", "State3", "State4", "State5"}
uses:
  Pika IV Characterization NXG::Main Functions::Initializing App::Prompt::Beating Star.gvi
  Pika IV Characterization NXG::Side Functions::Abort Control::FGV Global Abort.gvi
  Pika IV Characterization NXG::Main Functions::Instruction Handling::FGV Current State.gvi
diagram:
  Property Node(instance in=reference to unnamed native front panel, error in=$"Error In") -> ("Window"=w1, error out=w2)
  Open Window(reference in=w1, error in=w2) -> (reference out=w3, error out=w4)
  # This loop checks the current state and poorly advances a horizontal progress bar while displaying the current state and
  # substate
  s1 = uninitialised  # shift register
  s2 = 0  # shift register
  s3 = uninitialised  # shift register
  s4 = 0  # shift register
  while (iteration -> i1) {
    Wait Until Next Multiple(multiple to wait=50)
    call "Beating Star.gvi"(Star Reference=reference to unnamed path, Current Iteration=i1, Speed Divider=10) -> (Sinus Wave=w7)
    $"Sinus Wave" <- w7
    call "FGV Global Abort.gvi"(Global Abort Instructions="Read Current State", Error In=w4) -> (Global Abort Out=w8, Error Out=w9)
    call "FGV Current State.gvi"(Current State Instructions="Read Current State and Substate", Error In=w9) -> (Current State Out=w10, Current SubState Out=w11, Error Out=w12)
    Is Not Equal(x=w10, y=s1) -> w13
    Increment(x=s2) -> w14
    Is Not Equal(x=w11, y=s3) -> w15
    Select(s=w15, t=w14, f=s2) -> w16
    $"Current SubState Out" <- w11
    Multiply(s2, 25) -> w17
    Increment(x=s4) -> w18
    Add(w17, 25) -> w19
    In Range And Coerce(lower limit=0, upper limit=w19, x=w18) -> (coerced(x)=w20)
    Select(s=w15, t=w17, f=w20) -> w21
    $"Linear Progress Bar" <- w21
    Is Greater(x=i1, y=20000) -> w22
    Is Equal(x=w10, y="Idle") -> w23
    Logical Or(w22, w23, w8) -> w24
    append w10 to w5 if w13
    append w11 to w6 if w15
    next s1 = w10
    next s2 = w16
    next s3 = w11
    next s4 = w21
    stop if w24
  }
  $States <- w5
  $SubStates <- w6
  Close Window(reference in=w3, error in=w12) -> (error out=w25)
  $"Error Out" <- w25
