vi "Initialize Sample Naming.gvi"   [LabVIEW NXG 5.0.0]
inputs:
  "Error In": error
  "Misc Data Mega Cluster In": "Misc Mega Cluster.gtype"
outputs:
  "Error Out": error
  "Misc Data Mega Cluster Out": "Misc Mega Cluster.gtype"
types:
  T1 = cluster{"State Ref": "StringControl reference", "Substate Ref": "StringControl reference", "Current State Ref": "EnumSelector reference", "Main Tab Ref": "TabControl reference"}
  T2 = cluster{"Default Data Saving Location Ref": "PathSelector reference"}
  T3 = cluster{"Author Initials Ref": "ComboBoxSelector reference", "Batch Name Ref": "StringControl reference", "Cell Number Ref": "StringControl reference", "Current Date Ref": "StringControl reference", "Sample Comments Ref": "StringControl reference", "Sample Prefix Ref": "StringControl reference", "Custom Date Ref": "CheckBox reference", "Label Info Error Label Ref": "StringControl reference", "Label Info Missing Error Ref": "BooleanControl reference"}
  T4 = cluster{"Cell Parameters Ref": "Cluster reference", "IV Mode Ref": "EnumSelector reference", "Measurement Precision Ref": "Cluster reference", "Cell Selector Ref": "Cluster reference"}
  T5 = cluster{"Progress % Ref": "ProgressBar reference", "Progress Counter Ref": "NumericTextBoxDouble reference", "Live IV Parameters Ref": "Cluster reference"}
  T6 = cluster{"Layer Information Ref": "ArrayViewer reference"[]}
  "Full Reference Cluster.gtype" = cluster{"Status Report": T1, "Path Cluster": T2, "Sample Naming Cluster": T3, "Acquisition Parameters": T4, "Live Progress Cluster": T5, "Sample Extra Information": T6}
  "Misc Mega Cluster.gtype" = cluster{"Full Reference Cluster": "Full Reference Cluster.gtype"}
diagram:
  # This SubVI Sets the tabs to the main tab so that the user starts where it has to
  case ($"Error In") {
    frame Error, Default {
      w1 = $"Error In"
      w2 = $"Misc Data Mega Cluster In"
    }
    frame No Error {
      Property Node(instance in=$"Misc Data Mega Cluster In") -> ("Full Reference Cluster:Status Report:Main Tab Ref"=w3, "Full Reference Cluster:Sample Naming Cluster:Cell Number Ref"=w4, instance out=w2)
      Property Node(instance in=w3, "ValueSignaling"=0, error in=$"Error In") -> (error out=w5)
      Property Node(instance in=w4, "ValueSignaling"="", error in=w5) -> (error out=w1)
    }
  }
  $"Error Out" <- w1
  $"Misc Data Mega Cluster Out" <- w2
