vi "Any Cell Selected Check.gvi"   [LabVIEW NXG 5.0.0]
inputs:
  "Error In": error
  "JV Measurements Mega Cluster In": "JV Measurements Mega Cluster.gtype"
  "Proceed to enqueue In": bool
outputs:
  "Error Out": error
  "Proceed to enqueue Out": bool
types:
  "Cell Selector.gtype" = enum{"L.01", "L.02", "L.03", "L.04", "L.05", "L.06", "L.07", "L.08", "L.09", "L.10", "L.11", "L.12", "R.01", "R.02", "R.03", "R.04", "R.05", "R.06", "R.07", "R.08", "R.09", "R.10", "R.11", "R.12", "Custom"}
  "JV Data Cluster.gtype" = cluster{"Voltage (V)": f64[], "Current (A)": f64[], "Current Density (A/m^2)": f64[], "Cell Area (m^2)": f64, "Illumination (W/m^2)": f64, "Voc (V)": f64, "Jsc (A/m^2)": f64, "FF (%)": f64, "Rsh (Ω · m^2)": f64, "Rs (Ω · m^2)": f64, "Eff (%)": f64, "Measured Cell": "Cell Selector.gtype", "No Multiplexer": bool}
  "JV Scan Mode.gtype" = enum{"Rough", "Normal", "Accurate", "Smart", "Custom"}
  "JV Curve Parameters.gtype" = cluster{"JV Scan Mode": "JV Scan Mode.gtype", "Measurement Precision": "Accuracy Parameters.gtype", "Cell Parameters": "Cell Parameters.gtype"}
  "JV Measurements Mega Cluster.gtype" = cluster{"Cell Array": "Cell Selector.gtype"[], "JV Full Data Array": "JV Data Cluster.gtype"[], "Cell Selector": "Cell Selector.gtype", "JV Curve Parameters": "JV Curve Parameters.gtype"}
uses:
  Pika IV Characterization NXG::Main Functions::JV Curve Full Subroutine::Initialization::Create Cell Array.gvi
diagram:
  # This SubVI Checks if there is any cell selected before
  # enqueing the insturction to measure the cells
  case ($"Error In") {
    frame Error, Default {
      w1 = $"Error In"
      w2 = $"Proceed to enqueue In"
    }
    frame No Error {
      call "Create Cell Array.gvi"(JV Measurements Mega Cluster In=$"JV Measurements Mega Cluster In", Error In=$"Error In") -> (JV Measurements Mega Cluster Out=w3, Error Out=w1)
      Property Node(instance in=w3) -> ("Cell Array"=w4)
      Is Empty Array(array=w4) -> w5
      case (w5) {
        frame False {
          w2 = $"Proceed to enqueue In"
        }
        frame True {
          One Button Dialog(button name ("OK")="Oh sorry, I forgot the fact\nthat I wanted to measure :3", message="You need to select at least one cell!")
          w2 = default
        }
      }
    }
  }
  $"Proceed to enqueue Out" <- w2
  $"Error Out" <- w1
