vi "Create Cell Array.gvi"   [LabVIEW NXG 5.0.0]
inputs:
  "Error In": error
  "JV Measurements Mega Cluster In": "JV Measurements Mega Cluster.gtype"
outputs:
  "Error Out": error
  "JV Measurements Mega Cluster Out": "JV Measurements Mega Cluster.gtype"
types:
  "Cell Selector.gtype" = enum{"L.01", "L.02", "L.03", "L.04", "L.05", "L.06", "L.07", "L.08", "L.09", "L.10", "L.11", "L.12", "R.01", "R.02", "R.03", "R.04", "R.05", "R.06", "R.07", "R.08", "R.09", "R.10", "R.11", "R.12", "Custom"}
  "JV Data Cluster.gtype" = cluster{"Voltage (V)": f64[], "Current (A)": f64[], "Current Density (A/m^2)": f64[], "Cell Area (m^2)": f64, "Illumination (W/m^2)": f64, "Voc (V)": f64, "Jsc (A/m^2)": f64, "FF (%)": f64, "Rsh (Ω · m^2)": f64, "Rs (Ω · m^2)": f64, "Eff (%)": f64, "Measured Cell": "Cell Selector.gtype", "No Multiplexer": bool}
  "JV Scan Mode.gtype" = enum{"Rough", "Normal", "Accurate", "Smart", "Custom"}
  "JV Curve Parameters.gtype" = cluster{"JV Scan Mode": "JV Scan Mode.gtype", "Measurement Precision": "Accuracy Parameters.gtype", "Cell Parameters": "Cell Parameters.gtype"}
  "JV Measurements Mega Cluster.gtype" = cluster{"Cell Array": "Cell Selector.gtype"[], "JV Full Data Array": "JV Data Cluster.gtype"[], "Cell Selector": "Cell Selector.gtype", "JV Curve Parameters": "JV Curve Parameters.gtype"}
uses:
  NI::G Core::Numeric::Random Number (Range) DBL.gvi
diagram:
  # This SubVI Generates the Cell array and randomizes it if desired
  case ($"Error In") {
    frame Error, Default {
      w1 = $"Error In"
      w2 = $"JV Measurements Mega Cluster In"
    }
    frame No Error {
      Property Node(instance in=$"JV Measurements Mega Cluster In") -> ("Cell Selector:Cell Cluster"=w3, "Cell Selector:Random Order "=w4, "Cell Selector:No Multiplexer"=w5, instance out=w6)
      Property Node(instance in=w3) -> ("L.01"=w7, "L.02"=w8, "L.03"=w9, "L.04"=w10, "L.05"=w11, "L.06"=w12, "L.07"=w13, "L.08"=w14, "L.09"=w15, "L.10"=w16, "L.11"=w17, "L.12"=w18, "R.01"=w19, "R.02"=w20, "R.03"=w21, "R.04"=w22, "R.05"=w23, "R.06"=w24, "R.07"=w25, "R.08"=w26, "R.09"=w27, "R.10"=w28, "R.11"=w29, "R.12"=w30)
      Build Array(w7, w8, w9, w10, w11, w12, w13, w14, w15, w16, w17, w18, w19, w20, w21, w22, w23, w24, w25, w26, w27, w28, w29, w30, w5) -> w31
      for (iteration -> i1) {
        w32 = each element of w31
        To Unsigned 16 Bit Integer(number=i1) -> w34
        Type Cast(type="Cell Selector.gtype" "L.01", x=w34) -> w35
        append w35 to w33 if w32
      }
      case (w4) {
        frame False, Default {
          w36 = w33
        }
        frame True {
          Array Size(array=w33) -> (size(s)=w37)
          for (N = w37) {
            w38 = each element of w33
            To Double Precision Float(number=w37) -> w40
            call "Random Number (Range) DBL.gvi"(upper bound=w40) -> (number=w41)
            Build Cluster(w41, w38) -> w42
            append w42 to w39
          }
          Sort 1D Array(array=w39) -> (sorted array=w43)
          for {
            w44 = each element of w43
            Property Node(instance in=w44) -> ("Element 2"=w45)
            append w45 to w36
          }
        }
      }
      Property Node(instance in=w6, "Cell Array"=w36) -> (instance out=w2)
      w1 = $"Error In"
    }
  }
  $"Error Out" <- w1
  $"JV Measurements Mega Cluster Out" <- w2
