vi "FF and Eff.gvi"   [LabVIEW NXG 5.0.0]
inputs:
  "IV Data Cluster In": "JV Data Cluster.gtype"
  "Error In": error
outputs:
  "Error Out": error
  "IV Data Cluster Out": "JV Data Cluster.gtype"
types:
  "Cell Selector.gtype" = enum{"L.01", "L.02", "L.03", "L.04", "L.05", "L.06", "L.07", "L.08", "L.09", "L.10", "L.11", "L.12", "R.01", "R.02", "R.03", "R.04", "R.05", "R.06", "R.07", "R.08", "R.09", "R.10", "R.11", "R.12", "Custom"}
  "JV Data Cluster.gtype" = cluster{"Voltage (V)": f64[], "Current (A)": f64[], "Current Density (A/m^2)": f64[], "Cell Area (m^2)": f64, "Illumination (W/m^2)": f64, "Voc (V)": f64, "Jsc (A/m^2)": f64, "FF (%)": f64, "Rsh (Ω · m^2)": f64, "Rs (Ω · m^2)": f64, "Eff (%)": f64, "Measured Cell": "Cell Selector.gtype", "No Multiplexer": bool}
diagram:
  # This SubVI Calculates the point of maximum generated power
  # and calculates the filling factor taking into account the previously
  # calculated Jsc and Voc.
  case ($"Error In") {
    frame Error, Default {
      w1 = $"Error In"
      w2 = $"IV Data Cluster In"
    }
    frame No Error {
      Property Node(instance in=$"IV Data Cluster In") -> ("Voc (V)"=w3, "Jsc (A/m^2)"=w4, "Voltage (V)"=w5, "Current Density (A/m^2)"=w6, "Illumination (W/m^2)"=w7, instance out=w8)
      Multiply(w5, w6) -> w9
      Array Max And Min(array=w9) -> (min value=w10)
      Absolute Value(x=w10) -> w11
      Divide(x=w11, y=w7) -> w12
      Multiply(w12, 100) -> w13
      Multiply(w3, w4) -> w14
      Absolute Value(x=w14) -> w15
      Multiply(w5, w6) -> w16
      Array Max And Min(array=w16) -> (min value=w17)
      Absolute Value(x=w17) -> w18
      Multiply(w18, 100) -> w19
      Divide(x=w19, y=w15) -> w20
      In Range And Coerce(lower limit=0, upper limit=100, x=w20) -> (In Range?=w21, coerced(x)=w22)
      Select(s=w21, t=w22, f=0) -> w23
      Property Node(instance in=w8, "FF (%)"=w23, "Eff (%)"=w13) -> (instance out=w2)
      w1 = $"Error In"
    }
  }
  $"Error Out" <- w1
  $"IV Data Cluster Out" <- w2
