vi "IV to IJV Data.gvi"   [LabVIEW NXG 5.0.0]
inputs:
  "JV Measurements Mega Cluster In": "JV Measurements Mega Cluster.gtype"
  "IV Data Cluster In": "JV Data Cluster.gtype"
  "Error In": error
  "Instrument Control Mega Cluster In": "Instrument Control Mega Cluster.gtype"
outputs:
  "JV Measurements Mega Cluster Out": "JV Measurements Mega Cluster.gtype"
  "JV Data Cluster Out": "JV Data Cluster.gtype"
  "Error Out": error
  "instrument control mega cluster out": "Instrument Control Mega Cluster.gtype"
types:
  "Cell Selector.gtype" = enum{"L.01", "L.02", "L.03", "L.04", "L.05", "L.06", "L.07", "L.08", "L.09", "L.10", "L.11", "L.12", "R.01", "R.02", "R.03", "R.04", "R.05", "R.06", "R.07", "R.08", "R.09", "R.10", "R.11", "R.12", "Custom"}
  "JV Data Cluster.gtype" = cluster{"Voltage (V)": f64[], "Current (A)": f64[], "Current Density (A/m^2)": f64[], "Cell Area (m^2)": f64, "Illumination (W/m^2)": f64, "Voc (V)": f64, "Jsc (A/m^2)": f64, "FF (%)": f64, "Rsh (Ω · m^2)": f64, "Rs (Ω · m^2)": f64, "Eff (%)": f64, "Measured Cell": "Cell Selector.gtype", "No Multiplexer": bool}
  "JV Scan Mode.gtype" = enum{"Rough", "Normal", "Accurate", "Smart", "Custom"}
  "JV Curve Parameters.gtype" = cluster{"JV Scan Mode": "JV Scan Mode.gtype", "Measurement Precision": "Accuracy Parameters.gtype", "Cell Parameters": "Cell Parameters.gtype"}
  "Deposition Method.gtype" = enum{"Blade Coating", "Spin Coating", "Thermal Evaporation", "E-beam Evaporation", "Sputtering", "Drop Casting", "Dip Coating", "Pulsed Laser Deposition", "Chemical Vapour Deposition", "Atomic Layer Deposition", "Spray Coating", "Screen Printing", "Electroplating", "Molecular Beam Epitaxy", "Custom Deposition"}
  "Layer Type.gtype" = enum{"Front Electrode", "Electron Transport Layer", "Active Layer", "Hole Transport Layer", "Back Electrode", "Custom Layer"}
  "Full Layer Information.gtype" = cluster{"Blade Coating Parameters": "Blade Coating Parameters.gtype", "Deposition Method": "Deposition Method.gtype", "Layer Type": "Layer Type.gtype", "Spin Coating Parameters": "Spin Coating Parameters.gtype", "Thermal Evaporation Parameters": "Thermal Evaporation Parameters.gtype", "Solution Information": "Solution Information.gtype", "General Parameters": "General Parameters.gtype", "Current Deposition Method Information Cluster": "Useless Cluster.gtype", "Layer String ID": string}
  "JV Measurements Mega Cluster.gtype" = cluster{"Cell Array": "Cell Selector.gtype"[], "JV Full Data Array": "JV Data Cluster.gtype"[], "Cell Selector": "Cell Selector.gtype", "JV Curve Parameters": "JV Curve Parameters.gtype", "Full Layer Information Array": "Full Layer Information.gtype"[]}
  T1 = cluster{"Element 1": "VISA Instr", "Element 2": string}
  T2 = enum{"Keithley 2400 Series", "Keithley 2450 Series"}
  "Instrument Control.gtype" = cluster{"Multiplexer Arduino Detected?": bool, "Multiplexer Arduino Address": "VISA Instr", "Arduinos List": T1[], "Multiplexer Log": string, "Keythley Address": "VISA Instr", "Keithley Detected?": bool, "Keithley ID": string, "Detected Keithley Type": T2, "Database Detected?": bool}
  T3 = cluster{"Keithley": bool, "Arduino": bool, "Database": bool}
  "Debugging Cluster.gtype" = cluster{"Debugging mode?": bool, "Initialize App": bool, "Insturment Debugging": T3}
  "Instrument Control Mega Cluster.gtype" = cluster{"Instrument Control": "Instrument Control.gtype", "Debugging Cluster": "Debugging Cluster.gtype"}
diagram:
  # This SubVI takes the cell area and the current and converts
  # the current array into current density
  case ($"Error In") {
    frame Error, Default {
      w1 = $"Error In"
      w2 = $"IV Data Cluster In"
      w3 = $"JV Measurements Mega Cluster In"
      w4 = $"Instrument Control Mega Cluster In"
    }
    frame No Error {
      Property Node(instance in=$"JV Measurements Mega Cluster In") -> ("JV Curve Parameters:Cell Parameters:Cell Area (m^2)"=w5, "JV Curve Parameters:Cell Parameters:Light Power (W m^-2)"=w6, instance out=w3)
      Property Node(instance in=$"IV Data Cluster In") -> ("Current (A)"=w7, instance out=w8)
      Divide(x=w7, y=w5) -> w9
      Property Node(instance in=$"Instrument Control Mega Cluster In") -> ("Debugging Cluster:Debugging mode?"=w10, "Debugging Cluster:Insturment Debugging:Keithley"=w11, instance out=w4)
      Logical And[output inverted](w10, not w11) -> w12
      Select(s=w12, t=w9, f=w7) -> w13
      Property Node(instance in=w8, "Current Density (A/m^2)"=w13, "Cell Area (m^2)"=w5, "Illumination (W/m^2)"=w6) -> (instance out=w2)
      w1 = $"Error In"
    }
  }
  $"Error Out" <- w1
  $"JV Measurements Mega Cluster Out" <- w3
  $"instrument control mega cluster out" <- w4
  $"JV Data Cluster Out" <- w2
