vi "JV Full Processing.gvi"   [LabVIEW NXG 5.0.0]
inputs:
  "Error In": error
  "JV Measurements Mega Cluster In": "JV Measurements Mega Cluster.gtype"
  "JV Data Cluster In": "JV Data Cluster.gtype"
  "Instrument Control Mega Cluster In": "Instrument Control Mega Cluster.gtype"
  "Current Cell": "Cell Selector.gtype" = "L.01"
outputs:
  "Error Out": error
  "JV Measurements Mega Cluster Out": "JV Measurements Mega Cluster.gtype"
  "instrument control mega cluster out": "Instrument Control Mega Cluster.gtype"
types:
  "Cell Selector.gtype" = enum{"L.01", "L.02", "L.03", "L.04", "L.05", "L.06", "L.07", "L.08", "L.09", "L.10", "L.11", "L.12", "R.01", "R.02", "R.03", "R.04", "R.05", "R.06", "R.07", "R.08", "R.09", "R.10", "R.11", "R.12", "Custom"}
  "JV Data Cluster.gtype" = cluster{"Voltage (V)": f64[], "Current (A)": f64[], "Current Density (A/m^2)": f64[], "Cell Area (m^2)": f64, "Illumination (W/m^2)": f64, "Voc (V)": f64, "Jsc (A/m^2)": f64, "FF (%)": f64, "Rsh (Ω · m^2)": f64, "Rs (Ω · m^2)": f64, "Eff (%)": f64, "Measured Cell": "Cell Selector.gtype", "No Multiplexer": bool}
  "JV Scan Mode.gtype" = enum{"Rough", "Normal", "Accurate", "Smart", "Custom"}
  "JV Curve Parameters.gtype" = cluster{"JV Scan Mode": "JV Scan Mode.gtype", "Measurement Precision": "Accuracy Parameters.gtype", "Cell Parameters": "Cell Parameters.gtype"}
  "Deposition Method.gtype" = enum{"Blade Coating", "Spin Coating", "Thermal Evaporation", "E-beam Evaporation", "Sputtering", "Drop Casting", "Dip Coating", "Pulsed Laser Deposition", "Chemical Vapour Deposition", "Atomic Layer Deposition", "Spray Coating", "Screen Printing", "Electroplating", "Molecular Beam Epitaxy", "Custom Deposition"}
  "Layer Type.gtype" = enum{"Front Electrode", "Electron Transport Layer", "Active Layer", "Hole Transport Layer", "Back Electrode", "Custom Layer"}
  "Full Layer Information.gtype" = cluster{"Blade Coating Parameters": "Blade Coating Parameters.gtype", "Deposition Method": "Deposition Method.gtype", "Layer Type": "Layer Type.gtype", "Spin Coating Parameters": "Spin Coating Parameters.gtype", "Thermal Evaporation Parameters": "Thermal Evaporation Parameters.gtype", "Solution Information": "Solution Information.gtype", "General Parameters": "General Parameters.gtype", "Current Deposition Method Information Cluster": "Useless Cluster.gtype", "Layer String ID": string}
  "JV Measurements Mega Cluster.gtype" = cluster{"Cell Array": "Cell Selector.gtype"[], "JV Full Data Array": "JV Data Cluster.gtype"[], "Cell Selector": "Cell Selector.gtype", "JV Curve Parameters": "JV Curve Parameters.gtype", "Full Layer Information Array": "Full Layer Information.gtype"[]}
  T1 = cluster{"Element 1": "VISA Instr", "Element 2": string}
  T2 = enum{"Keithley 2400 Series", "Keithley 2450 Series"}
  "Instrument Control.gtype" = cluster{"Multiplexer Arduino Detected?": bool, "Multiplexer Arduino Address": "VISA Instr", "Arduinos List": T1[], "Multiplexer Log": string, "Keythley Address": "VISA Instr", "Keithley Detected?": bool, "Keithley ID": string, "Detected Keithley Type": T2, "Database Detected?": bool}
  T3 = cluster{"Keithley": bool, "Arduino": bool, "Database": bool}
  "Debugging Cluster.gtype" = cluster{"Debugging mode?": bool, "Initialize App": bool, "Insturment Debugging": T3}
  "Instrument Control Mega Cluster.gtype" = cluster{"Instrument Control": "Instrument Control.gtype", "Debugging Cluster": "Debugging Cluster.gtype"}
uses:
  Pika IV Characterization NXG::Main Functions::JV Curve Full Subroutine::State Machine::JV Curves Aquiring::JV Calculations::IV to IJV Data.gvi
  Pika IV Characterization NXG::Main Functions::JV Curve Full Subroutine::State Machine::JV Curves Aquiring::JV Calculations::Jsc and Voc.gvi
  Pika IV Characterization NXG::Main Functions::JV Curve Full Subroutine::State Machine::JV Curves Aquiring::JV Calculations::FF and Eff.gvi
diagram:
  case ($"Error In") {
    frame Error, Default {
      w1 = $"Error In"
      w2 = $"JV Measurements Mega Cluster In"
      w3 = $"Instrument Control Mega Cluster In"
    }
    frame No Error {
      call "IV to IJV Data.gvi"(JV Measurements Mega Cluster In=$"JV Measurements Mega Cluster In", IV Data Cluster In=$"JV Data Cluster In", Instrument Control Mega Cluster In=$"Instrument Control Mega Cluster In", Error In=$"Error In") -> (JV Measurements Mega Cluster Out=w4, JV Data Cluster Out=w5, instrument control mega cluster out=w3, Error Out=w6)
      call "Jsc and Voc.gvi"(JV Measurements Mega Cluster In=w4, JV Data Cluster In=w5, Error In=w6) -> (JV Measurements Mega Cluster Out=w7, JV Data Cluster Out=w8, Error Out=w9)
      Property Node(instance in=w7) -> ("JV Full Data Array"=w10, instance out=w11)
      Is Equal(x="Custom", y=$"Current Cell") -> w12
      call "FF and Eff.gvi"(IV Data Cluster In=w8, Error In=w9) -> (IV Data Cluster Out=w13, Error Out=w1)
      Property Node(instance in=w13, "Measured Cell"=$"Current Cell", "No Multiplexer"=w12) -> (instance out=w14)
      Build Array(w10, w14) -> w15
      Property Node(instance in=w11, "JV Full Data Array"=w15) -> (instance out=w2)
    }
  }
  $"JV Measurements Mega Cluster Out" <- w2
  $"Error Out" <- w1
  $"instrument control mega cluster out" <- w3
