vi "JV Curves Acquire Subroutine.gvi"   [LabVIEW NXG 5.0.0]
inputs:
  "Instrument Control Mega Cluster In": "Instrument Control Mega Cluster.gtype"
  "JV Measurements Mega Cluster In": "JV Measurements Mega Cluster.gtype"
  "Error In": error
  "Misc Data Mega Cluster In": "Misc Mega Cluster.gtype"
outputs:
  "Instrument Control Mega Cluster Out": "Instrument Control Mega Cluster.gtype"
  "JV Measurements Mega Cluster Out": "JV Measurements Mega Cluster.gtype"
  "Misc Data Mega Cluster Out": "Misc Mega Cluster.gtype"
  "Error Out": error
types:
  T1 = cluster{"Element 1": "VISA Instr", "Element 2": string}
  T2 = enum{"Keithley 2400 Series", "Keithley 2450 Series"}
  "Instrument Control.gtype" = cluster{"Multiplexer Arduino Detected?": bool, "Multiplexer Arduino Address": "VISA Instr", "Arduinos List": T1[], "Multiplexer Log": string, "Keythley Address": "VISA Instr", "Keithley Detected?": bool, "Keithley ID": string, "Detected Keithley Type": T2, "Database Detected?": bool}
  T3 = cluster{"Keithley": bool, "Arduino": bool, "Database": bool}
  "Debugging Cluster.gtype" = cluster{"Debugging mode?": bool, "Initialize App": bool, "Insturment Debugging": T3}
  "Instrument Control Mega Cluster.gtype" = cluster{"Instrument Control": "Instrument Control.gtype", "Debugging Cluster": "Debugging Cluster.gtype"}
  "Cell Selector.gtype" = enum{"L.01", "L.02", "L.03", "L.04", "L.05", "L.06", "L.07", "L.08", "L.09", "L.10", "L.11", "L.12", "R.01", "R.02", "R.03", "R.04", "R.05", "R.06", "R.07", "R.08", "R.09", "R.10", "R.11", "R.12", "Custom"}
  "JV Data Cluster.gtype" = cluster{"Voltage (V)": f64[], "Current (A)": f64[], "Current Density (A/m^2)": f64[], "Cell Area (m^2)": f64, "Illumination (W/m^2)": f64, "Voc (V)": f64, "Jsc (A/m^2)": f64, "FF (%)": f64, "Rsh (Ω · m^2)": f64, "Rs (Ω · m^2)": f64, "Eff (%)": f64, "Measured Cell": "Cell Selector.gtype", "No Multiplexer": bool}
  "JV Scan Mode.gtype" = enum{"Rough", "Normal", "Accurate", "Smart", "Custom"}
  "JV Curve Parameters.gtype" = cluster{"JV Scan Mode": "JV Scan Mode.gtype", "Measurement Precision": "Accuracy Parameters.gtype", "Cell Parameters": "Cell Parameters.gtype"}
  "Deposition Method.gtype" = enum{"Blade Coating", "Spin Coating", "Thermal Evaporation", "E-beam Evaporation", "Sputtering", "Drop Casting", "Dip Coating", "Pulsed Laser Deposition", "Chemical Vapour Deposition", "Atomic Layer Deposition", "Spray Coating", "Screen Printing", "Electroplating", "Molecular Beam Epitaxy", "Custom Deposition"}
  "Layer Type.gtype" = enum{"Front Electrode", "Electron Transport Layer", "Active Layer", "Hole Transport Layer", "Back Electrode", "Custom Layer"}
  "Full Layer Information.gtype" = cluster{"Blade Coating Parameters": "Blade Coating Parameters.gtype", "Deposition Method": "Deposition Method.gtype", "Layer Type": "Layer Type.gtype", "Spin Coating Parameters": "Spin Coating Parameters.gtype", "Thermal Evaporation Parameters": "Thermal Evaporation Parameters.gtype", "Solution Information": "Solution Information.gtype", "General Parameters": "General Parameters.gtype", "Current Deposition Method Information Cluster": "Useless Cluster.gtype", "Layer String ID": string}
  "JV Measurements Mega Cluster.gtype" = cluster{"Cell Array": "Cell Selector.gtype"[], "JV Full Data Array": "JV Data Cluster.gtype"[], "Cell Selector": "Cell Selector.gtype", "JV Curve Parameters": "JV Curve Parameters.gtype", "Full Layer Information Array": "Full Layer Information.gtype"[]}
  T4 = cluster{"State Ref": "StringControl reference", "Substate Ref": "StringControl reference", "Current State Ref": "EnumSelector reference", "Main Tab Ref": "TabControl reference", "Plot Now Flag Ref": "BooleanControl reference"}
  T5 = cluster{"Default Data Saving Location Ref": "PathSelector reference"}
  T6 = cluster{"Author Initials Ref": "ComboBoxSelector reference", "Batch Name Ref": "StringControl reference", "Cell Number Ref": "StringControl reference", "Current Date Ref": "StringControl reference", "Sample Comments Ref": "StringControl reference", "Sample Prefix Ref": "StringControl reference", "Custom Date Ref": "CheckBox reference", "Label Info Error Label Ref": "StringControl reference", "Label Info Missing Error Ref": "BooleanControl reference"}
  T7 = cluster{"Cell Parameters Ref": "Cluster reference", "Cell Selector Ref": "Cluster reference", "Measurement Precision Ref": "Cluster reference", "JV Scan Mode Ref": "EnumSelector reference"}
  T8 = cluster{"Progress % Ref": "ProgressBar reference", "Progress Counter Ref": "NumericTextBoxDouble reference", "Live JV Parameters Ref": "Cluster reference"}
  T9 = cluster{"Layer Information Ref": "ArrayViewer reference"[]}
  T10 = cluster{"Cell Selector Block Ref": "Rectangle reference", "Smart Mode Block Ref": "Rectangle reference", "dV Block Ref": "Rectangle reference", "Smart Mode Text Ref": "Text reference", "No Multiplexer Detected Text Ref": "Text reference", "Current Range Block Ref": "Rectangle reference"}
  T11 = cluster{"JV Measurements Mega Cluster Ref": "Cluster reference", "Instrument Control Mega Cluster Ref": "Cluster reference"}
  T12 = cluster{"JV Main Graph Ref": "Graph reference", "Voc Graph Ref ": "Graph reference", "Jsc Graph Ref": "Graph reference", "Efficiency Graph Ref": "Graph reference", "Fill Factor Graph Ref": "Graph reference", "Series Resistance Graph Ref": "Graph reference", "Shunt Resistance Graph Ref": "Graph reference"}
  "Full Reference Cluster.gtype" = cluster{"Status Report": T4, "Path Cluster": T5, "Sample Naming Cluster": T6, "Acquisition Parameters": T7, "Live Progress Cluster": T8, "Sample Extra Information": T9, "Visual Elements": T10, "Mega Cluster References": T11, "Plotting": T12, "System Parameters": cluster{"Main VI Ref": VIRefnum}}
  "Misc Mega Cluster.gtype" = cluster{"Full Reference Cluster": "Full Reference Cluster.gtype"}
uses:
  Pika IV Characterization NXG::Side Functions::Messages And Prompts::FGV Cancel Prompts until Finished Routine.gvi
  Pika IV Characterization NXG::Side Functions::Instrument Control::Keithley::Keithley Set Constant Parameters general.gvi
  Pika IV Characterization NXG::Main Functions::JV Curve Full Subroutine::State Machine::JV Curves Aquiring::Extract Cell Array.gvi
  Pika IV Characterization NXG::Side Functions::Abort Control::FGV Global Abort.gvi
  Pika IV Characterization NXG::Side Functions::Instrument Control::Arduino Multiplexer::Set Cell Subroutine.gvi
  Pika IV Characterization NXG::Side Functions::Instrument Control::Keithley::Keithley Sweep Subroutine General.gvi
  Pika IV Characterization NXG::Main Functions::JV Curve Full Subroutine::State Machine::JV Curves Aquiring::JV Calculations::JV Full Processing.gvi
  Pika IV Characterization NXG::Main Functions::Plotting::JV Curve Plotting.gvi
  Pika IV Characterization NXG::Main Functions::Plotting::Extracted Parameters Plotting.gvi
  Pika IV Characterization NXG::Main Functions::Timeout::Progress General Calculator.gvi
  Pika IV Characterization NXG::Main Functions::Timeout::FGV Progress.gvi
diagram:
  # This SubVI Takes the specified Parameters both for the sweep types and for the keithley electrical sweep and performs all the measurements while storing them on their
  # corresponding clusters, before outputing all the information within the Full IV Curve Data array.
  case ($"Error In") {
    frame Error, Default {
      w1 = $"Error In"
      w2 = $"Instrument Control Mega Cluster In"
      w3 = $"JV Measurements Mega Cluster In"
      w4 = $"Misc Data Mega Cluster In"
    }
    frame No Error {
      call "FGV Cancel Prompts until Finished Routine.gvi"(Error In=$"Error In", FGV Instructions="Reset State") -> (Error Out=w5)
      call "Keithley Set Constant Parameters general.gvi"(Instrument Control Mega Cluster In=$"Instrument Control Mega Cluster In", JV Measurements Mega Cluster In=$"JV Measurements Mega Cluster In", Error In=w5) -> (Instrument Control Mega Cluster Out=w6, JV Measurements Mega Cluster Out=w7, Error Out=w8)
      call "Extract Cell Array.gvi"(JV Measurements Mega Cluster In=w7, Error In=w8) -> (JV Measurements Mega Cluster Out=w9, Cell Array=w10, Error Out=w11)
      s1 = w11  # shift register
      s2 = w6  # shift register
      s3 = w9  # shift register
      s4 = $"Misc Data Mega Cluster In"  # shift register
      for (iteration -> i1) {
        w12 = each element of w10
        call "FGV Global Abort.gvi"(Global Abort Instructions="Read Current State", Error In=s1) -> (Local Abort Out=w13, Global Abort Out=w14, Error Out=w15)
        call "Set Cell Subroutine.gvi"(Instrument Control Mega Cluster In=s2, Desired Cell=w12, Error In=w15) -> (Instrument Control Mega Cluster Out=w16, Error Out=w17)
        call "Keithley Sweep Subroutine General.gvi"(Instrument Control Mega Cluster In=w16, JV Measurements Mega Cluster In=s3, Error In=w17) -> (Instrument Control Mega Cluster Out=w18, JV Measurements Mega Cluster Out=w19, JV Data Cluster Out=w20, Error Out=w21)
        call "JV Full Processing.gvi"(JV Measurements Mega Cluster In=w19, JV Data Cluster In=w20, Current Cell=w12, Error In=w21, Instrument Control Mega Cluster In=w18) -> (JV Measurements Mega Cluster Out=w22, Error Out=w23, instrument control mega cluster out=w24)
        call "JV Curve Plotting.gvi"(JV Measurements Mega Cluster In=w22, Misc Data Mega Cluster In=s4, Error In=w23) -> (JV Measurements Mega Cluster Out=w25, Misc Data Mega Cluster Out=w26, Error Out=w27)
        call "Extracted Parameters Plotting.gvi"(JV Measurements Mega Cluster In=w25, Misc Data Mega Cluster In=w26, Error In=w27) -> (JV Measurements Mega Cluster Out=w28, Misc Data Mega Cluster Out=w29, Error Out=w30)
        call "Progress General Calculator.gvi"(Starting Value=40, Ending Value=80, Current Step=i1, Error In=w30) -> (Current Progress=w31, Error Out=w32)
        call "FGV Progress.gvi"(FGV Instructions="Set State", Progress In=w31, Error In=w32) -> (Error Out=w33)
        Logical Or(w13, w14) -> w34
        Wait Until Next Multiple(multiple to wait=10)
        next s1 = w33
        next s2 = w24
        next s3 = w28
        next s4 = w29
        stop if w34
      }
      call "Extracted Parameters Plotting.gvi"(JV Measurements Mega Cluster In=s3, Misc Data Mega Cluster In=s4, Error In=s1) -> (JV Measurements Mega Cluster Out=w3, Misc Data Mega Cluster Out=w4, Error Out=w1)
      w2 = s2
    }
  }
  $"Misc Data Mega Cluster Out" <- w4
  $"Instrument Control Mega Cluster Out" <- w2
  $"JV Measurements Mega Cluster Out" <- w3
  $"Error Out" <- w1
