vi "JV Measurements Abort Detect.gvi"   [LabVIEW NXG 5.0.0]
inputs:
  "Previous State": "JV Measurement States.gtype" = "Start App"
  "Error In": error
outputs:
  "Next State": "JV Measurement States.gtype"
  "Stop Loop": bool
  "Error Out": error
types:
  "JV Measurement States.gtype" = enum{"Start App", "Initialize Instruments", "Acquire IV Curves", "Close Coms", "Load Measurement", "Save Files", "Stop App"}
uses:
  Pika IV Characterization NXG::Side Functions::Abort Control::FGV Global Abort.gvi
  Pika IV Characterization NXG::Main Functions::Instruction Handling::FGV Current State.gvi
diagram:
  call "FGV Global Abort.gvi"(Global Abort Instructions="Read Current State", Error In=$"Error In") -> (Local Abort Out=w1, Global Abort Out=w2, Error Out=w3)
  Is Not Equal(x=$"Previous State", y="Stop App") -> w4
  Logical And(w4, w1) -> w5
  Select(s=w5, t="Close Coms", f=$"Previous State") -> w6
  $"Next State" <- w6
  Format Into String(errIn=w3, w6) -> (outString=w7, errOut=w8)
  call "FGV Current State.gvi"(Current State Instructions="Set Current Substate", Current Substate=w7, Error In=w8) -> (Error Out=w9)
  $"Error Out" <- w9
  $"Stop Loop" <- w2
