vi "JV Curve Save Prompt.gvi"   [LabVIEW NXG 5.0.0]
inputs:
  "Error In": error
outputs:
  "Error Out": error
  "Next State": "JV Measurement States.gtype"
types:
  "JV Measurement States.gtype" = enum{"Start App", "Initialize Instruments", "Acquire IV Curves", "Close Coms", "Load Measurement", "Save Files", "Stop App"}
uses:
  Pika IV Characterization NXG::Main Functions::JV Curve Full Subroutine::State Machine::Saving Data::FGV JV Save Mode.gvi
diagram:
  # This subVI Prompts the user to save or discard the measurement files in case
  # the operation was a new measurement. Otherwise it does not
  case ($"Error In") {
    frame Error, Default {
      w1 = $"Error In"
      w2 = "Stop App"
    }
    frame No Error {
      w3 = """Do you wish to save the current Measurement files, 
as well as a full report with ppt and origin files?

They will be properly saved on your Personal Folder
 with the current date and batch label."""
      Three Button Dialog(Allow user to close window? (TRUE)=FALSE, Center Button Text ("No")="Just the .txt files\nare okay thanks :)", Left Button Text ("Yes")="Yes please I want \na full report :D", Right Button Text ("Cancel")="These results are awful,\nI don't want them!", Window Title (" ")="Everything not saved will be lost", message=w3) -> (Which Button?=w4)
      case (w4) {
        frame "left button", Default {
          call "FGV JV Save Mode.gvi"(FGV Instructions="Set State", Full Report?=TRUE, Error In=$"Error In") -> (Error Out=w1)
          w2 = "Save Files"
        }
        frame "center button" {
          call "FGV JV Save Mode.gvi"(FGV Instructions="Set State", Full Report?=FALSE, Error In=$"Error In") -> (Error Out=w1)
          w2 = "Save Files"
        }
        frame "right button" {
          w1 = $"Error In"
          w2 = "Stop App"
        }
        frame "window close" {
          w1 = $"Error In"
          w2 = "Stop App"
        }
      }
    }
  }
  $"Next State" <- w2
  $"Error Out" <- w1
