vi "JV Operation Translation.gvi"   [LabVIEW NXG 5.0.0]
inputs:
  "Acquire Button": bool
  "Load Measurement": bool
  "Save Measurement": bool
  "Error In": error
outputs:
  "Error Out": error
uses:
  Pika IV Characterization NXG::Main Functions::JV Curve Full Subroutine::Initialization::FGV JV Operation.gvi
diagram:
  # This SubVI Checks which button has been pressed and
  # decides the operation that needs to be done.
  # If more than one button was pressed it prompts the user
  # to not press so many buttons at the same time.
  # It also stores the desired output on an FGV For further use
  # on other independent subVIs
  case ($"Error In") {
    frame Error, Default {
      w1 = $"Error In"
    }
    frame No Error {
      Logical And($"Save Measurement", $"Acquire Button") -> w2
      Logical And($"Acquire Button", $"Load Measurement") -> w3
      Logical And($"Save Measurement", $"Load Measurement") -> w4
      Logical Or(w2, w3, w4) -> w5
      case (w5) {
        frame False, Default {
          w7 = "Save Measurement"  # JV Operations
          w8 = "Load Measurement"  # JV Operations
          Select(s=$"Save Measurement", t=w7, f=w8) -> w9
          w10 = "Aquire Measurement"  # JV Operations
          Select(s=$"Acquire Button", t=w10, f=w9) -> w6
        }
        frame True {
          w11 = "Please do not Press all the buttons\nat once, otherwise I do not know what\nyou want me to do first :("
          w12 = "Oh, sorry I will press them\none by one, while waiting for\nyou to finish."
          One Button Dialog(button name ("OK")=w12, message=w11)
          w6 = "Load Measurement"
        }
      }
      call "FGV JV Operation.gvi"(FGV Instructions="Set State", IV Operations=w6, Error In=$"Error In") -> (Error Out=w1)
    }
  }
  $"Error Out" <- w1
