vi "Check and Set Control Visibility.gvi"   [LabVIEW NXG 5.0.0]
inputs:
  "Error In": error
  "Layer Controls Prompt Ref Cluster In": "Layer Controls Prompt Ref Cluster.gtype"
outputs:
  "Error Out": error
  "Layer Controls Prompt Ref Cluster Out": "Layer Controls Prompt Ref Cluster.gtype"
types:
  "Layer Controls Prompt Ref Cluster.gtype" = cluster{"Add Layer Button Ref": "BooleanControl reference", "This VI Ref": VIRefnum, "Blade Coating Parameters Ref": "Cluster reference", "Deposition Method Ref": "EnumSelector reference", "General Parameters Ref": "Cluster reference", "Layer Type ref": "EnumSelector reference", "Solution Information Ref": "Cluster reference", "Spin Coating Parameters Ref": "Cluster reference", "Thermal Evaporation Parameters Ref": "Cluster reference", "Load Layer File Ref": "BooleanControl reference", "Save Layer File Ref": "BooleanControl reference", "Layer To Edit Ref": "EnumSelector reference"}
  "Control Visibility Cluster.gtype" = cluster{"Add Layer Position Button": cluster{"Left": f32, "Top": f32}, "Blade Controls Visible": bool, "General Controls Visible": bool, "Solution Inform Visible": bool, "Spin Coating Controls Visible": bool, "Thermal Evaporation Controls Visible": bool, "Panel Size": cluster{"Width": f32, "Height": f32}, "Save Layer Position Button": cluster{"Left": f32, "Top": f32}, "Load Layer Position Button": cluster{"Left": f32, "Top": f32}}
diagram:
  case ($"Error In") {
    frame Error, Default {
      w1 = $"Error In"
      w2 = $"Layer Controls Prompt Ref Cluster In"
    }
    frame No Error {
      Property Node(instance in=$"Layer Controls Prompt Ref Cluster In") -> ("Deposition Method Ref"=w3, instance out=w4)
      Property Node(instance in=w4) -> ("Add Layer Button Ref"=w5, "Load Layer File Ref"=w6, "Save Layer File Ref"=w7, "Blade Coating Parameters Ref"=w8, "General Parameters Ref"=w9, "Solution Information Ref"=w10, "Spin Coating Parameters Ref"=w11, "Thermal Evaporation Parameters Ref"=w12, "This VI Ref"=w13, instance out=w2)
      Property Node(instance in=w3, error in=$"Error In") -> ("Value"=w14, error out=w15)
      case (w14) {
        frame "E-beam Evaporation" {
          w17 = "Control Visibility Cluster.gtype" {"0x43920000", "0x43040000", FALSE, TRUE, FALSE, FALSE, FALSE, "0x43DC0000", "0x43B90000", "0x43920000", "0x43440000", "0x43920000", "0x43820000"}  # Control Visibility Cluster
          w16 = w17
        }
        frame "Sputtering" {
          w18 = "Control Visibility Cluster.gtype" {"0x43920000", "0x43040000", FALSE, TRUE, FALSE, FALSE, FALSE, "0x43DC0000", "0x43B90000", "0x43920000", "0x43440000", "0x43920000", "0x43820000"}  # Control Visibility Cluster
          w16 = w18
        }
        frame "Drop Casting" {
          w19 = "Control Visibility Cluster.gtype" {"0x43C30000", "0x425C0000", FALSE, TRUE, TRUE, FALSE, FALSE, "0x44458000", "0x43FA0000", "0x4400C000", "0x425C0000", "0x44204000", "0x425C0000"}  # Control Visibility Cluster
          w16 = w19
        }
        frame "Dip Coating" {
          w20 = "Control Visibility Cluster.gtype" {"0x43C30000", "0x425C0000", FALSE, TRUE, TRUE, FALSE, FALSE, "0x44458000", "0x43FA0000", "0x4400C000", "0x425C0000", "0x44204000", "0x425C0000"}  # Control Visibility Cluster
          w16 = w20
        }
        frame "Pulsed Laser Deposition" {
          w21 = "Control Visibility Cluster.gtype" {"0x43920000", "0x43040000", FALSE, TRUE, FALSE, FALSE, FALSE, "0x43DC0000", "0x43B90000", "0x43920000", "0x43440000", "0x43920000", "0x43820000"}  # Control Visibility Cluster
          w16 = w21
        }
        frame "Chemical Vapour Deposition" {
          w22 = "Control Visibility Cluster.gtype" {"0x43920000", "0x43040000", FALSE, TRUE, FALSE, FALSE, FALSE, "0x43DC0000", "0x43B90000", "0x43920000", "0x43440000", "0x43920000", "0x43820000"}  # Control Visibility Cluster
          w16 = w22
        }
        frame "Atomic Layer Deposition" {
          w23 = "Control Visibility Cluster.gtype" {"0x43920000", "0x43040000", FALSE, TRUE, FALSE, FALSE, FALSE, "0x43DC0000", "0x43B90000", "0x43920000", "0x43440000", "0x43920000", "0x43820000"}  # Control Visibility Cluster
          w16 = w23
        }
        frame "Spray Coating" {
          w24 = "Control Visibility Cluster.gtype" {"0x43C30000", "0x425C0000", FALSE, TRUE, TRUE, FALSE, FALSE, "0x44458000", "0x43FA0000", "0x4400C000", "0x425C0000", "0x44204000", "0x425C0000"}  # Control Visibility Cluster
          w16 = w24
        }
        frame "Screen Printing" {
          w25 = "Control Visibility Cluster.gtype" {"0x43C30000", "0x425C0000", FALSE, TRUE, TRUE, FALSE, FALSE, "0x44458000", "0x43FA0000", "0x4400C000", "0x425C0000", "0x44204000", "0x425C0000"}  # Control Visibility Cluster
          w16 = w25
        }
        frame "Electroplating" {
          w26 = "Control Visibility Cluster.gtype" {"0x43920000", "0x43040000", FALSE, TRUE, FALSE, FALSE, FALSE, "0x43DC0000", "0x43B90000", "0x43920000", "0x43440000", "0x43920000", "0x43820000"}  # Control Visibility Cluster
          w16 = w26
        }
        frame "Molecular Beam Epitaxy" {
          w27 = "Control Visibility Cluster.gtype" {"0x43920000", "0x43040000", FALSE, TRUE, FALSE, FALSE, FALSE, "0x43DC0000", "0x43B90000", "0x43920000", "0x43440000", "0x43920000", "0x43820000"}  # Control Visibility Cluster
          w16 = w27
        }
        frame "Custom Deposition" {
          w28 = "Control Visibility Cluster.gtype" {"0x43C30000", "0x425C0000", FALSE, TRUE, TRUE, FALSE, FALSE, "0x44458000", "0x43FA0000", "0x4400C000", "0x425C0000", "0x44204000", "0x425C0000"}  # Control Visibility Cluster
          w16 = w28
        }
        frame "Thermal Evaporation" {
          w29 = "Control Visibility Cluster.gtype" {"0x43920000", "0x43040000", FALSE, FALSE, FALSE, FALSE, TRUE, "0x43DC0000", "0x43B90000", "0x43920000", "0x43440000", "0x43920000", "0x43820000"}  # Control Visibility Cluster
          w16 = w29
        }
        frame "Spin Coating" {
          w30 = "Control Visibility Cluster.gtype" {"0x43C30000", "0x425C0000", FALSE, FALSE, TRUE, TRUE, FALSE, "0x44458000", "0x43FA0000", "0x4400C000", "0x425C0000", "0x44204000", "0x425C0000"}  # Control Visibility Cluster
          w16 = w30
        }
        frame "Blade Coating", Default {
          w31 = "Control Visibility Cluster.gtype" {"0x43C30000", "0x425C0000", TRUE, FALSE, TRUE, FALSE, FALSE, "0x44458000", "0x43FA0000", "0x4400C000", "0x425C0000", "0x44204000", "0x425C0000"}  # Control Visibility Cluster
          w16 = w31
        }
      }
      Property Node(instance in=w16) -> ("Add Layer Position Button"=w32, "Save Layer Position Button"=w33, "Load Layer Position Button"=w34, "Blade Controls Visible"=w35, "General Controls Visible"=w36, "Solution Inform Visible"=w37, "Spin Coating Controls Visible"=w38, "Thermal Evaporation Controls Visible"=w39, "Panel Size"=w40)
      Property Node(instance in=w13, error in=w15) -> ("Panel"=w41, error out=w42)
      Property Node(instance in=w41, error in=w42) -> ("Window"=w43, error out=w44)
      Property Node(instance in=w43, "Size"=w40, error in=w44) -> (error out=w45)
      Property Node(instance in=w5, "Position"=w32, error in=w45) -> (error out=w46)
      Property Node(instance in=w6, "Position"=w34, error in=w46) -> (error out=w47)
      Property Node(instance in=w7, "Position"=w33, error in=w47) -> (error out=w48)
      Property Node(instance in=w8, "Visible"=w35, error in=w48) -> (error out=w49)
      Property Node(instance in=w9, "Visible"=w36, error in=w49) -> (error out=w50)
      Property Node(instance in=w12, "Visible"=w39, error in=w50) -> (error out=w51)
      Property Node(instance in=w10, "Visible"=w37, error in=w51) -> (error out=w52)
      Property Node(instance in=w11, "Visible"=w38, error in=w52) -> (error out=w1)
    }
  }
  $"Error Out" <- w1
  $"Layer Controls Prompt Ref Cluster Out" <- w2
