vi "Check Layer Array.gvi"   [LabVIEW NXG 5.0.0]
inputs:
  "Error In": error
  "JV Measurements Mega Cluster In": "JV Measurements Mega Cluster.gtype"
  "Proceed? In": bool
outputs:
  "Error Out": error
  "JV Measurements Mega Cluster Out": "JV Measurements Mega Cluster.gtype"
  "Proceed? Out": bool
types:
  "Cell Selector.gtype" = enum{"L.01", "L.02", "L.03", "L.04", "L.05", "L.06", "L.07", "L.08", "L.09", "L.10", "L.11", "L.12", "R.01", "R.02", "R.03", "R.04", "R.05", "R.06", "R.07", "R.08", "R.09", "R.10", "R.11", "R.12", "Custom"}
  "JV Data Cluster.gtype" = cluster{"Voltage (V)": f64[], "Current (A)": f64[], "Current Density (A/m^2)": f64[], "Cell Area (m^2)": f64, "Illumination (W/m^2)": f64, "Voc (V)": f64, "Jsc (A/m^2)": f64, "FF (%)": f64, "Rsh (Ω · m^2)": f64, "Rs (Ω · m^2)": f64, "Eff (%)": f64, "Measured Cell": "Cell Selector.gtype", "No Multiplexer": bool}
  "JV Scan Mode.gtype" = enum{"Rough", "Normal", "Accurate", "Smart", "Custom"}
  "JV Curve Parameters.gtype" = cluster{"JV Scan Mode": "JV Scan Mode.gtype", "Measurement Precision": "Accuracy Parameters.gtype", "Cell Parameters": "Cell Parameters.gtype"}
  "Deposition Method.gtype" = enum{"Blade Coating", "Spin Coating", "Thermal Evaporation", "E-beam Evaporation", "Sputtering", "Drop Casting", "Dip Coating", "Pulsed Laser Deposition", "Chemical Vapour Deposition", "Atomic Layer Deposition", "Spray Coating", "Screen Printing", "Electroplating", "Molecular Beam Epitaxy", "Custom Deposition"}
  "Layer Type.gtype" = enum{"Front Electrode", "Electrode Transport Layer", "Active Layer", "Hole Transport Layer", "Back Electrode", "Annealing Treatment", "Encapsulation", "Custom Layer"}
  "Full Layer Information.gtype" = cluster{"Blade Coating Parameters": "Blade Coating Parameters.gtype", "Deposition Method": "Deposition Method.gtype", "Layer Type": "Layer Type.gtype", "Spin Coating Parameters": "Spin Coating Parameters.gtype", "Thermal Evaporation Parameters": "Thermal Evaporation Parameters.gtype", "Solution Information": "Solution Information.gtype", "General Parameters": "General Parameters.gtype", "Current Deposition Method Information Cluster": "Useless Cluster.gtype", "Layer String ID": string}
  "JV Measurements Mega Cluster.gtype" = cluster{"Cell Array": "Cell Selector.gtype"[], "JV Full Data Array": "JV Data Cluster.gtype"[], "Cell Selector": "Cell Selector.gtype", "JV Curve Parameters": "JV Curve Parameters.gtype", "Full Layer Information Array": "Full Layer Information.gtype"[]}
uses:
  Pika IV Characterization NXG::Main Functions::Layer Composition::Data Management::Layer String Array Generator.gvi
  Pika IV Characterization NXG::Side Functions::Utilities::Array Handling::Check String Array Duplicates.gvi
diagram:
  # This SubVI checks if there are any layers before enqueuing a edit layer command.
  # It also checks there are no duplicates to prevent software errors on the layer edit screen
  case ($"Error In") {
    frame Error, Default {
      w1 = $"Error In"
      w2 = $"JV Measurements Mega Cluster In"
      w3 = default
    }
    frame No Error {
      case ($"Proceed? In") {
        frame False, Default {
          w2 = $"JV Measurements Mega Cluster In"
          w3 = $"Proceed? In"
          w1 = $"Error In"
        }
        frame True {
          Property Node(instance in=$"JV Measurements Mega Cluster In") -> ("Full Layer Information Array"=w4, instance out=w5)
          Is Empty Array(array=w4) -> w6
          case (w6) {
            frame False, Default {
              call "Layer String Array Generator.gvi"(JV Measurements Mega Cluster In=w5, Error In=$"Error In") -> (JV Measurements Mega Cluster Out=w2, Layer String ID Array=w7, Error Out=w8)
              call "Check String Array Duplicates.gvi"(String Array=w7, Error In=w8) -> (Duplicates?=w9, Error Out=w1)
              case (w9) {
                frame False, Default {
                  w3 = TRUE
                }
                frame True {
                  w10 = "There seem to be at least two identical layers in your layer info. Please delete the duplicates and try again.\nIf you really need to have almost identical names, try to place a number after each material (ITO 2)"
                  One Button Dialog(button name ("OK")="Okay I'll change them", message=w10)
                  w3 = default
                }
              }
            }
            frame True {
              One Button Dialog(button name ("OK")="Okay I'll add some first", message="No layers have been added!!")
              w3 = default
              w1 = $"Error In"
              w2 = w5
            }
          }
        }
      }
    }
  }
  $"Proceed? Out" <- w3
  $"JV Measurements Mega Cluster Out" <- w2
  $"Error Out" <- w1
