vi "Layer Information Cluster Subroutine.gvi"   [LabVIEW NXG 5.0.0]
inputs:
  "Error In": error
  "Layer Controls Prompt Ref Cluster In": "Layer Controls Prompt Ref Cluster.gtype"
  "Full Layer Information In": "Full Layer Information.gtype"
  "Layer Information Operation": "Layer Information Operation.gtype" = "Update Cluster"
outputs:
  "Error Out": error
  "Layer Controls Prompt Ref Cluster Out": "Layer Controls Prompt Ref Cluster.gtype"
  "Full Layer Information Out": "Full Layer Information.gtype"
types:
  "Blade Coating Parameters.gtype" = cluster{"Thickness (nm)": f64, "Blade Initial Speed (mm/s)": f64, "Speed Gradient": bool, "Blade Final Speed (mm/s)": f64, "Blade Gap (um)": f64, "Blade Temperature (ºC)": f64, "Droplet Volume (ul)": f64, "Subsequent layers": f64, "Glovebox": bool, "Comments": string}
  "Deposition Method.gtype" = enum{"Blade Coating", "Spin Coating", "Thermal Evaporation", "E-beam Evaporation", "Sputtering", "Drop Casting", "Dip Coating", "Pulsed Laser Deposition", "Chemical Vapour Deposition", "Atomic Layer Deposition", "Spray Coating", "Screen Printing", "Electroplating", "Molecular Beam Epitaxy", "Custom Deposition"}
  "Layer Type.gtype" = enum{"Front Electrode", "Electron Transport Layer", "Active Layer", "Hole Transport Layer", "Back Electrode", "Custom Layer"}
  "Spin Coating Parameters.gtype" = cluster{"Thickness (nm)": f64, "Spin Speed (rpm)": f64, "Dynamic Deposition": bool, "Spin Acceleration (rpm/s)": f64, "Droplet Volume (ul)": f64, "Subsequent layers": f64, "Glovebox": bool, "Comments": string, "Spin Time (s)": f64}
  "Thermal Evaporation Parameters.gtype" = cluster{"Thickness (nm)": f64, "Deposition Rate (nm/s)": f64, "Comments": string, "Sample Rotation": bool, "Material": string}
  "Solution Information.gtype" = cluster{"Concentration (mg/ml)": f64, "Stir Time (kr)": f64, "Composition Array": cluster{"Material": string, "Ratio": f64}[], "Solvent Array": cluster{"Solvent": string, "Ratio": f64}[], "Solution Preparation Date": string, "Comments": string, "Stir Temp (ºC)": f64, "Glovebox": bool, "Solution Label": string, "Solution Descriptor": string, "Volume (ul)": f64}
  "General Parameters.gtype" = cluster{"Thickness (nm)": f64, "Comments": string, "Material": string}
  "Useless Cluster.gtype" = cluster{"Blade Coating Information": bool, "General Information": bool, "Solution Information": bool, "Spin Coating Information": bool, "Thermal Evaporation Information": bool}
  "Full Layer Information.gtype" = cluster{"Blade Coating Parameters": "Blade Coating Parameters.gtype", "Deposition Method": "Deposition Method.gtype", "Layer Type": "Layer Type.gtype", "Spin Coating Parameters": "Spin Coating Parameters.gtype", "Thermal Evaporation Parameters": "Thermal Evaporation Parameters.gtype", "Solution Information": "Solution Information.gtype", "General Parameters": "General Parameters.gtype", "Current Deposition Method Information Cluster": "Useless Cluster.gtype", "Layer String ID": string}
  "Layer Information Operation.gtype" = enum{"Update Cluster", "Update Controls"}
  "Layer Controls Prompt Ref Cluster.gtype" = cluster{"Add Layer Button Ref": "BooleanControl reference", "This VI Ref": VIRefnum, "Blade Coating Parameters Ref": "Cluster reference", "Deposition Method Ref": "EnumSelector reference", "General Parameters Ref": "Cluster reference", "Layer Type ref": "EnumSelector reference", "Solution Information Ref": "Cluster reference", "Spin Coating Parameters Ref": "Cluster reference", "Thermal Evaporation Parameters Ref": "Cluster reference", "Load Layer File Ref": "BooleanControl reference", "Save Layer File Ref": "BooleanControl reference", "Layer To Edit Ref": "RingSelectorInt32 reference"}
uses:
  Pika IV Characterization NXG::Main Functions::Layer Composition::Data Management::Reset Unwanted Values.gvi
  Pika IV Characterization NXG::Main Functions::Layer Composition::Data Management::Method Constant Selection.gvi
  Pika IV Characterization NXG::Main Functions::Layer Composition::Data Management::Layer String Generator.gvi
diagram:
  case ($"Error In") {
    frame Error, Default {
      w1 = $"Error In"
      w2 = $"Layer Controls Prompt Ref Cluster In"
      w3 = $"Full Layer Information In"
    }
    frame No Error {
      case ($"Layer Information Operation") {
        frame "Update Controls" {
          call "Reset Unwanted Values.gvi"(Full Layer Information In=$"Full Layer Information In", Error In=$"Error In") -> (Full Layer Information Out=w4, Error Out=w5)
          Property Node(instance in=w4) -> ("Blade Coating Parameters"=w6, "Deposition Method"=w7, "Layer Type"=w8, "Spin Coating Parameters"=w9, "Thermal Evaporation Parameters"=w10, "Solution Information"=w11, "General Parameters"=w12, instance out=w13)
          Property Node(instance in=$"Layer Controls Prompt Ref Cluster In") -> ("Deposition Method Ref"=w14, "Layer Type ref"=w15, "Blade Coating Parameters Ref"=w16, "Spin Coating Parameters Ref"=w17, "Solution Information Ref"=w18, "Thermal Evaporation Parameters Ref"=w19, "General Parameters Ref"=w20, instance out=w2)
          Property Node(instance in=w14, "ValueSignaling"=w7, error in=w5) -> (error out=w21)
          Property Node(instance in=w15, "ValueSignaling"=w8, error in=w21) -> (error out=w22)
          Property Node(instance in=w18, "Value"=w11, error in=w22) -> (error out=w23)
          Property Node(instance in=w16, "Value"=w6, error in=w23) -> (error out=w24)
          Property Node(instance in=w17, "Value"=w9, error in=w24) -> (error out=w25)
          Property Node(instance in=w19, "Value"=w10, error in=w25) -> (error out=w26)
          Property Node(instance in=w20, "Value"=w12, error in=w26) -> (error out=w27)
          call "Method Constant Selection.gvi"(Deposition Method In=w7, Error In=w27) -> (Current Deposition Method Cluster Out=w28, Error Out=w29)
          Property Node(instance in=w13, "Current Deposition Method Information Cluster"=w28) -> (instance out=w30)
          call "Layer String Generator.gvi"(Full Layer Information In=w30, Error In=w29) -> (Full Layer Information Out=w3, Error Out=w1)
        }
        frame "Update Cluster", Default {
          Property Node(instance in=$"Layer Controls Prompt Ref Cluster In") -> ("Deposition Method Ref"=w31, "Layer Type ref"=w32, "Blade Coating Parameters Ref"=w33, "Spin Coating Parameters Ref"=w34, "Solution Information Ref"=w35, "Thermal Evaporation Parameters Ref"=w36, "General Parameters Ref"=w37, instance out=w2)
          Property Node(instance in=w31, error in=$"Error In") -> ("Value"=w38, error out=w39)
          Property Node(instance in=w32, error in=w39) -> ("Value"=w40, error out=w41)
          Property Node(instance in=w35, error in=w41) -> ("Value"=w42, error out=w43)
          Property Node(instance in=w33, error in=w43) -> ("Value"=w44, error out=w45)
          Property Node(instance in=w34, error in=w45) -> ("Value"=w46, error out=w47)
          Property Node(instance in=w36, error in=w47) -> ("Value"=w48, error out=w49)
          Property Node(instance in=w37, error in=w49) -> ("Value"=w50, error out=w51)
          call "Method Constant Selection.gvi"(Deposition Method In=w38, Error In=w51) -> (Current Deposition Method Cluster Out=w52, Error Out=w53)
          Property Node(instance in=$"Full Layer Information In", "Blade Coating Parameters"=w44, "Deposition Method"=w38, "Layer Type"=w40, "Spin Coating Parameters"=w46, "Thermal Evaporation Parameters"=w48, "Solution Information"=w42, "General Parameters"=w50, "Current Deposition Method Information Cluster"=w52) -> (instance out=w54)
          call "Layer String Generator.gvi"(Full Layer Information In=w54, Error In=w53) -> (Full Layer Information Out=w55, Error Out=w56)
          call "Reset Unwanted Values.gvi"(Full Layer Information In=w55, Error In=w56) -> (Full Layer Information Out=w3, Error Out=w1)
        }
      }
    }
  }
  $"Layer Controls Prompt Ref Cluster Out" <- w2
  $"Full Layer Information Out" <- w3
  $"Error Out" <- w1
