vi "Layer String Generator.gvi"   [LabVIEW NXG 5.0.0]
inputs:
  "Error In": error
  "Full Layer Information In": "Full Layer Information.gtype"
outputs:
  "Error Out": error
  "Full Layer Information Out": "Full Layer Information.gtype"
types:
  "Blade Coating Parameters.gtype" = cluster{"Thickness (nm)": f64, "Blade Initial Speed (mm/s)": f64, "Speed Gradient": bool, "Blade Final Speed (mm/s)": f64, "Blade Gap (um)": f64, "Blade Temperature (ºC)": f64, "Droplet Volume (ul)": f64, "Subsequent layers": f64, "Glovebox": bool, "Comments": string}
  "Deposition Method.gtype" = enum{"Blade Coating", "Spin Coating", "Thermal Evaporation", "E-beam Evaporation", "Sputtering", "Drop Casting", "Dip Coating", "Pulsed Laser Deposition", "Chemical Vapour Deposition", "Atomic Layer Deposition", "Spray Coating", "Screen Printing", "Electroplating", "Molecular Beam Epitaxy", "Custom Deposition"}
  "Layer Type.gtype" = enum{"Front Electrode", "Electrode Transport Layer", "Active Layer", "Hole Transport Layer", "Back Electrode", "Annealing Treatment", "Encapsulation", "Custom Layer"}
  "Spin Coating Parameters.gtype" = cluster{"Thickness (nm)": f64, "Spin Speed (rpm)": f64, "Dynamic Deposition": bool, "Spin Acceleration (rpm/s)": f64, "Droplet Volume (ul)": f64, "Subsequent layers": f64, "Glovebox": bool, "Comments": string}
  "Thermal Evaporation Parameters.gtype" = cluster{"Thickness (nm)": f64, "Deposition Rate (nm/s)": f64, "Comments": string, "Sample Rotation": bool, "Material": string}
  "Solution Information.gtype" = cluster{"Concentration (mg/ml)": f64, "Stirring Time (kr)": f64, "Glovebox": bool, "Composition Array": cluster{"Material": string, "Ratio": f64}[], "Solvent Array": cluster{"Solvent": string, "Ratio": f64}[], "Solution Preparation Date": f64, "Comments": string}
  "General Parameters.gtype" = cluster{"Thickness (nm)": f64, "Comments": string, "Material": string}
  "Useless Cluster.gtype" = cluster{"Blade Coating Information": bool, "General Information": bool, "Solution Information": bool, "Spin Coating Information": bool, "Thermal Evaporation Information": bool}
  "Full Layer Information.gtype" = cluster{"Blade Coating Parameters": "Blade Coating Parameters.gtype", "Deposition Method": "Deposition Method.gtype", "Layer Type": "Layer Type.gtype", "Spin Coating Parameters": "Spin Coating Parameters.gtype", "Thermal Evaporation Parameters": "Thermal Evaporation Parameters.gtype", "Solution Information": "Solution Information.gtype", "General Parameters": "General Parameters.gtype", "Current Deposition Method Information Cluster": "Useless Cluster.gtype", "Layer String ID": string}
uses:
  Pika IV Characterization NXG::Side Functions::Utilities::Fractional String Trim 0.gvi
  NI::G Core::Strings::Trim Whitespace.gvi
diagram:
  case ($"Error In") {
    frame Error, Default {
      w1 = $"Error In"
      w2 = $"Full Layer Information In"
    }
    frame No Error {
      Property Node(instance in=$"Full Layer Information In") -> ("Deposition Method"=w3, instance out=w4)
      case (w3) {
        frame "Blade Coating", Default {
          Property Node(instance in=w4) -> ("Solution Information:Composition Array"=w7, "Blade Coating Parameters:Thickness (nm)"=w8, "Blade Coating Parameters:Blade Initial Speed (mm/s)"=w9, "Blade Coating Parameters:Speed Gradient"=w10, "Blade Coating Parameters:Blade Final Speed (mm/s)"=w11, "Blade Coating Parameters:Comments"=w12, "Blade Coating Parameters:Blade Temperature (ºC)"=w13, instance out=w5)
          Is Empty Array(array=w7) -> w14
          case (w14) {
            frame True {
              w15 = "Unknown Material"
            }
            frame False {
              s1 = ""  # shift register
              for (iteration -> i1) {
                w16 = each element of w7
                Property Node(instance in=w16) -> ("Material"=w17)
                Is Greater Than 0(x=i1) -> w18
                Select(s=w18, t=":", f="") -> w19
                Concatenate Strings(s1, w19, w17) -> w20
                next s1 = w20
              }
              w15 = s1
            }
          }
          Number To Fractional String(number=w8, use system decimal point (T)=FALSE) -> (F-format string=w21)
          call "Fractional String Trim 0.gvi"(String with trailing 0=w21) -> (String Without 0=w22)
          Concatenate Strings(w22, " nm") -> w23
          Is Not Equal To 0(x=w8) -> w24
          Number To Fractional String(number=w13, use system decimal point (T)=FALSE) -> (F-format string=w25)
          call "Fractional String Trim 0.gvi"(String with trailing 0=w25) -> (String Without 0=w26)
          Number To Fractional String(number=w9, use system decimal point (T)=FALSE) -> (F-format string=w27)
          call "Fractional String Trim 0.gvi"(String with trailing 0=w27) -> (String Without 0=w28)
          Number To Fractional String(number=w11, use system decimal point (T)=FALSE) -> (F-format string=w29)
          call "Fractional String Trim 0.gvi"(String with trailing 0=w29) -> (String Without 0=w30)
          Concatenate Strings(w28, "-", w30, " mm/s") -> w31
          Concatenate Strings(w28, " mm/s") -> w32
          Select(s=w10, t=w31, f=w32) -> w33
          Concatenate Strings(w26, "ºC ", w33) -> w34
          Select(s=w24, t=w23, f=w34) -> w35
          Concatenate Strings(w15, "  ", w35, "  ", w12) -> w6
        }
        frame "Spin Coating" {
          Property Node(instance in=w4) -> ("Solution Information:Composition Array"=w36, "Spin Coating Parameters:Thickness (nm)"=w37, "Spin Coating Parameters:Spin Speed (rpm)"=w38, "Spin Coating Parameters:Dynamic Deposition"=w39, "Spin Coating Parameters:Comments"=w40, instance out=w5)
          Is Empty Array(array=w36) -> w41
          case (w41) {
            frame True {
              w42 = "Unknown Material"
            }
            frame False {
              s2 = ""  # shift register
              for (iteration -> i2) {
                w43 = each element of w36
                Property Node(instance in=w43) -> ("Material"=w44)
                Is Greater Than 0(x=i2) -> w45
                Select(s=w45, t=":", f="") -> w46
                Concatenate Strings(s2, w46, w44) -> w47
                next s2 = w47
              }
              w42 = s2
            }
          }
          Is Not Equal To 0(x=w37) -> w48
          Number To Fractional String(number=w37, use system decimal point (T)=FALSE) -> (F-format string=w49)
          call "Fractional String Trim 0.gvi"(String with trailing 0=w49) -> (String Without 0=w50)
          Concatenate Strings(w50, " nm") -> w51
          Number To Fractional String(number=w38, use system decimal point (T)=FALSE) -> (F-format string=w52)
          call "Fractional String Trim 0.gvi"(String with trailing 0=w52) -> (String Without 0=w53)
          Concatenate Strings(w53, "rpm Dyn ") -> w54
          Concatenate Strings(w53, "rpm") -> w55
          Select(s=w39, t=w54, f=w55) -> w56
          Select(s=w48, t=w51, f=w56) -> w57
          Concatenate Strings(w42, "  ", w57, "  ", w40) -> w6
        }
        frame "Dip Coating" {
          Property Node(instance in=w4) -> ("Solution Information:Composition Array"=w58, "General Parameters:Thickness (nm)"=w59, "General Parameters:Comments"=w60, instance out=w5)
          Is Empty Array(array=w58) -> w61
          case (w61) {
            frame True {
              w62 = "Unknown Material"
            }
            frame False {
              s3 = ""  # shift register
              for (iteration -> i3) {
                w63 = each element of w58
                Property Node(instance in=w63) -> ("Material"=w64)
                Is Greater Than 0(x=i3) -> w65
                Select(s=w65, t=":", f="") -> w66
                Concatenate Strings(s3, w66, w64) -> w67
                next s3 = w67
              }
              w62 = s3
            }
          }
          Is Not Equal To 0(x=w59) -> w68
          Number To Fractional String(number=w59, use system decimal point (T)=FALSE) -> (F-format string=w69)
          call "Fractional String Trim 0.gvi"(String with trailing 0=w69) -> (String Without 0=w70)
          Concatenate Strings(w70, " nm") -> w71
          Select(s=w68, t="", f=w71) -> w72
          Concatenate Strings(w62, "  ", w72, "  ", w60) -> w6
        }
        frame "Custom Deposition" {
          Property Node(instance in=w4) -> ("Solution Information:Composition Array"=w73, "General Parameters:Thickness (nm)"=w74, "General Parameters:Comments"=w75, instance out=w5)
          Is Empty Array(array=w73) -> w76
          case (w76) {
            frame True {
              w77 = "Unknown Material"
            }
            frame False {
              s4 = ""  # shift register
              for (iteration -> i4) {
                w78 = each element of w73
                Property Node(instance in=w78) -> ("Material"=w79)
                Is Greater Than 0(x=i4) -> w80
                Select(s=w80, t=":", f="") -> w81
                Concatenate Strings(s4, w81, w79) -> w82
                next s4 = w82
              }
              w77 = s4
            }
          }
          Is Equal To 0(x=w74) -> w83
          Number To Fractional String(number=w74, use system decimal point (T)=FALSE) -> (F-format string=w84)
          call "Fractional String Trim 0.gvi"(String with trailing 0=w84) -> (String Without 0=w85)
          Concatenate Strings(w85, " nm") -> w86
          Select(s=w83, t="", f=w86) -> w87
          Concatenate Strings(w77, "  ", w87, "  ", w75) -> w6
        }
        frame "Drop Casting" {
          Property Node(instance in=w4) -> ("Solution Information:Composition Array"=w88, "General Parameters:Thickness (nm)"=w89, "General Parameters:Comments"=w90, instance out=w5)
          Is Empty Array(array=w88) -> w91
          case (w91) {
            frame True {
              w92 = "Unknown Material"
            }
            frame False {
              s5 = ""  # shift register
              for (iteration -> i5) {
                w93 = each element of w88
                Property Node(instance in=w93) -> ("Material"=w94)
                Is Greater Than 0(x=i5) -> w95
                Select(s=w95, t=":", f="") -> w96
                Concatenate Strings(s5, w96, w94) -> w97
                next s5 = w97
              }
              w92 = s5
            }
          }
          Is Equal To 0(x=w89) -> w98
          Number To Fractional String(number=w89, use system decimal point (T)=FALSE) -> (F-format string=w99)
          call "Fractional String Trim 0.gvi"(String with trailing 0=w99) -> (String Without 0=w100)
          Concatenate Strings(w100, " nm") -> w101
          Select(s=w98, t="", f=w101) -> w102
          Concatenate Strings(w92, "  ", w102, "  ", w90) -> w6
        }
        frame "Spray Coating" {
          Property Node(instance in=w4) -> ("Solution Information:Composition Array"=w103, "General Parameters:Thickness (nm)"=w104, "General Parameters:Comments"=w105, instance out=w5)
          Is Empty Array(array=w103) -> w106
          case (w106) {
            frame True {
              w107 = "Unknown Material"
            }
            frame False {
              s6 = ""  # shift register
              for (iteration -> i6) {
                w108 = each element of w103
                Property Node(instance in=w108) -> ("Material"=w109)
                Is Greater Than 0(x=i6) -> w110
                Select(s=w110, t=":", f="") -> w111
                Concatenate Strings(s6, w111, w109) -> w112
                next s6 = w112
              }
              w107 = s6
            }
          }
          Is Equal To 0(x=w104) -> w113
          Number To Fractional String(number=w104, use system decimal point (T)=FALSE) -> (F-format string=w114)
          call "Fractional String Trim 0.gvi"(String with trailing 0=w114) -> (String Without 0=w115)
          Concatenate Strings(w115, " nm") -> w116
          Select(s=w113, t="", f=w116) -> w117
          Concatenate Strings(w107, "  ", w117, "  ", w105) -> w6
        }
        frame "Screen Printing" {
          Property Node(instance in=w4) -> ("Solution Information:Composition Array"=w118, "General Parameters:Thickness (nm)"=w119, "General Parameters:Comments"=w120, instance out=w5)
          Is Empty Array(array=w118) -> w121
          case (w121) {
            frame True {
              w122 = "Unknown Material"
            }
            frame False {
              s7 = ""  # shift register
              for (iteration -> i7) {
                w123 = each element of w118
                Property Node(instance in=w123) -> ("Material"=w124)
                Is Greater Than 0(x=i7) -> w125
                Select(s=w125, t=":", f="") -> w126
                Concatenate Strings(s7, w126, w124) -> w127
                next s7 = w127
              }
              w122 = s7
            }
          }
          Is Equal To 0(x=w119) -> w128
          Number To Fractional String(number=w119, use system decimal point (T)=FALSE) -> (F-format string=w129)
          call "Fractional String Trim 0.gvi"(String with trailing 0=w129) -> (String Without 0=w130)
          Concatenate Strings(w130, " nm") -> w131
          Select(s=w128, t="", f=w131) -> w132
          Concatenate Strings(w122, "  ", w132, "  ", w120) -> w6
        }
        frame "Thermal Evaporation" {
          Property Node(instance in=w4) -> ("Thermal Evaporation Parameters:Material"=w133, "Thermal Evaporation Parameters:Thickness (nm)"=w134, "Thermal Evaporation Parameters:Deposition Rate (nm/s)"=w135, "Thermal Evaporation Parameters:Comments"=w136, instance out=w5)
          call "Trim Whitespace.gvi"(string=w133) -> (trimmed string=w137)
          Is Empty String Or Path(string/path=w137) -> w138
          Select(s=w138, t="Unknown Material", f=w133) -> w139
          Is Equal To 0(x=w134) -> w140
          Number To Fractional String(number=w134, use system decimal point (T)=FALSE) -> (F-format string=w141)
          call "Fractional String Trim 0.gvi"(String with trailing 0=w141) -> (String Without 0=w142)
          Number To Fractional String(number=w135, use system decimal point (T)=FALSE) -> (F-format string=w143)
          call "Fractional String Trim 0.gvi"(String with trailing 0=w143) -> (String Without 0=w144)
          Concatenate Strings(w142, " nm ", w144, " nm/s") -> w145
          Select(s=w140, t="", f=w145) -> w146
          Concatenate Strings(w139, "  ", w146, "  ", w136) -> w6
        }
        frame "Pulsed Laser Deposition" {
          Property Node(instance in=w4) -> ("General Parameters:Material"=w147, "General Parameters:Thickness (nm)"=w148, "Thermal Evaporation Parameters:Comments"=w149, instance out=w5)
          call "Trim Whitespace.gvi"(string=w147) -> (trimmed string=w150)
          Is Empty String Or Path(string/path=w150) -> w151
          Select(s=w151, t="Unknown Material", f=w147) -> w152
          Is Equal To 0(x=w148) -> w153
          Number To Fractional String(number=w148, use system decimal point (T)=FALSE) -> (F-format string=w154)
          call "Fractional String Trim 0.gvi"(String with trailing 0=w154) -> (String Without 0=w155)
          Concatenate Strings(w155, " nm") -> w156
          Select(s=w153, t="", f=w156) -> w157
          Concatenate Strings(w152, "  ", w157, "  ", w149) -> w6
        }
        frame "Electroplating" {
          Property Node(instance in=w4) -> ("General Parameters:Material"=w158, "General Parameters:Thickness (nm)"=w159, "Thermal Evaporation Parameters:Comments"=w160, instance out=w5)
          call "Trim Whitespace.gvi"(string=w158) -> (trimmed string=w161)
          Is Empty String Or Path(string/path=w161) -> w162
          Select(s=w162, t="Unknown Material", f=w158) -> w163
          Is Equal To 0(x=w159) -> w164
          Number To Fractional String(number=w159, use system decimal point (T)=FALSE) -> (F-format string=w165)
          call "Fractional String Trim 0.gvi"(String with trailing 0=w165) -> (String Without 0=w166)
          Concatenate Strings(w166, " nm") -> w167
          Select(s=w164, t="", f=w167) -> w168
          Concatenate Strings(w163, "  ", w168, "  ", w160) -> w6
        }
        frame "Molecular Beam Epitaxy" {
          Property Node(instance in=w4) -> ("General Parameters:Material"=w169, "General Parameters:Thickness (nm)"=w170, "Thermal Evaporation Parameters:Comments"=w171, instance out=w5)
          call "Trim Whitespace.gvi"(string=w169) -> (trimmed string=w172)
          Is Empty String Or Path(string/path=w172) -> w173
          Select(s=w173, t="Unknown Material", f=w169) -> w174
          Is Equal To 0(x=w170) -> w175
          Number To Fractional String(number=w170, use system decimal point (T)=FALSE) -> (F-format string=w176)
          call "Fractional String Trim 0.gvi"(String with trailing 0=w176) -> (String Without 0=w177)
          Concatenate Strings(w177, " nm") -> w178
          Select(s=w175, t="", f=w178) -> w179
          Concatenate Strings(w174, "  ", w179, "  ", w171) -> w6
        }
        frame "E-beam Evaporation" {
          Property Node(instance in=w4) -> ("General Parameters:Material"=w180, "General Parameters:Thickness (nm)"=w181, "Thermal Evaporation Parameters:Comments"=w182, instance out=w5)
          call "Trim Whitespace.gvi"(string=w180) -> (trimmed string=w183)
          Is Empty String Or Path(string/path=w183) -> w184
          Select(s=w184, t="Unknown Material", f=w180) -> w185
          Is Equal To 0(x=w181) -> w186
          Number To Fractional String(number=w181, use system decimal point (T)=FALSE) -> (F-format string=w187)
          call "Fractional String Trim 0.gvi"(String with trailing 0=w187) -> (String Without 0=w188)
          Concatenate Strings(w188, " nm") -> w189
          Select(s=w186, t="", f=w189) -> w190
          Concatenate Strings(w185, "  ", w190, "  ", w182) -> w6
        }
        frame "Chemical Vapour Deposition" {
          Property Node(instance in=w4) -> ("General Parameters:Material"=w191, "General Parameters:Thickness (nm)"=w192, "Thermal Evaporation Parameters:Comments"=w193, instance out=w5)
          call "Trim Whitespace.gvi"(string=w191) -> (trimmed string=w194)
          Is Empty String Or Path(string/path=w194) -> w195
          Select(s=w195, t="Unknown Material", f=w191) -> w196
          Is Equal To 0(x=w192) -> w197
          Number To Fractional String(number=w192, use system decimal point (T)=FALSE) -> (F-format string=w198)
          call "Fractional String Trim 0.gvi"(String with trailing 0=w198) -> (String Without 0=w199)
          Concatenate Strings(w199, " nm") -> w200
          Select(s=w197, t="", f=w200) -> w201
          Concatenate Strings(w196, "  ", w201, "  ", w193) -> w6
        }
        frame "Sputtering" {
          Property Node(instance in=w4) -> ("General Parameters:Material"=w202, "General Parameters:Thickness (nm)"=w203, "Thermal Evaporation Parameters:Comments"=w204, instance out=w5)
          call "Trim Whitespace.gvi"(string=w202) -> (trimmed string=w205)
          Is Empty String Or Path(string/path=w205) -> w206
          Select(s=w206, t="Unknown Material", f=w202) -> w207
          Is Equal To 0(x=w203) -> w208
          Number To Fractional String(number=w203, use system decimal point (T)=FALSE) -> (F-format string=w209)
          call "Fractional String Trim 0.gvi"(String with trailing 0=w209) -> (String Without 0=w210)
          Concatenate Strings(w210, " nm") -> w211
          Select(s=w208, t="", f=w211) -> w212
          Concatenate Strings(w207, "  ", w212, "  ", w204) -> w6
        }
        frame "Atomic Layer Deposition" {
          Property Node(instance in=w4) -> ("General Parameters:Material"=w213, "General Parameters:Thickness (nm)"=w214, "Thermal Evaporation Parameters:Comments"=w215, instance out=w5)
          call "Trim Whitespace.gvi"(string=w213) -> (trimmed string=w216)
          Is Empty String Or Path(string/path=w216) -> w217
          Select(s=w217, t="Unknown Material", f=w213) -> w218
          Is Equal To 0(x=w214) -> w219
          Number To Fractional String(number=w214, use system decimal point (T)=FALSE) -> (F-format string=w220)
          call "Fractional String Trim 0.gvi"(String with trailing 0=w220) -> (String Without 0=w221)
          Concatenate Strings(w221, " nm") -> w222
          Select(s=w219, t="", f=w222) -> w223
          Concatenate Strings(w218, "  ", w223, "  ", w215) -> w6
        }
      }
      call "Trim Whitespace.gvi"(string=w6) -> (trimmed string=w224)
      Property Node(instance in=w5, "Layer String ID"=w224) -> (instance out=w2)
      w1 = $"Error In"
    }
  }
  $"Error Out" <- w1
  $"Full Layer Information Out" <- w2
