vi "Missing Information Check.gvi"   [LabVIEW NXG 5.0.0]
inputs:
  "Error In": error
  "Full Layer Information In": "Full Layer Information.gtype"
  "New Layer Prompt Ref Cluster In": "New Layer Prompt Ref Cluster.gtype"
outputs:
  "Error Out": error
  "Full Layer Information Out": "Full Layer Information.gtype"
  "New Layer Prompt Ref Cluster Out": "New Layer Prompt Ref Cluster.gtype"
  "Proceed?": bool
types:
  "Blade Coating Parameters.gtype" = cluster{"Thickness (nm)": f64, "Blade Initial Speed (mm/s)": f64, "Speed Gradient": bool, "Blade Final Speed (mm/s)": f64, "Blade Gap (um)": f64, "Blade Temperature (ºC)": f64, "Droplet Volume (ul)": f64, "Subsequent layers": f64, "Glovebox": bool, "Comments": string}
  "Deposition Method.gtype" = enum{"Blade Coating", "Spin Coating", "Thermal Evaporation", "E-beam Evaporation", "Sputtering", "Drop Casting", "Dip Coating", "Pulsed Laser Deposition", "Chemical Vapour Deposition", "Atomic Layer Deposition", "Spray Coating", "Screen Printing", "Electroplating", "Molecular Beam Epitaxy", "Custom Deposition"}
  "Layer Type.gtype" = enum{"Front Electrode", "Electrode Transport Layer", "Active Layer", "Hole Transport Layer", "Back Electrode", "Annealing Treatment", "Encapsulation", "Custom Layer"}
  "Spin Coating Parameters.gtype" = cluster{"Thickness (nm)": f64, "Spin Speed (rpm)": f64, "Dynamic Deposition": bool, "Spin Acceleration (rpm/s)": f64, "Droplet Volume (ul)": f64, "Subsequent layers": f64, "Glovebox": bool, "Comments": string}
  "Thermal Evaporation Parameters.gtype" = cluster{"Thickness (nm)": f64, "Deposition Rate (nm/s)": f64, "Comments": string, "Sample Rotation": bool, "Material": string}
  "Solution Information.gtype" = cluster{"Concentration (mg/ml)": f64, "Stirring Time (kr)": f64, "Glovebox": bool, "Composition Array": cluster{"Material": string, "Ratio": f64}[], "Solvent Array": cluster{"Solvent": string, "Ratio": f64}[], "Solution Preparation Date": f64, "Comments": string}
  "General Parameters.gtype" = cluster{"Thickness (nm)": f64, "Comments": string, "Material": string}
  "Useless Cluster.gtype" = cluster{"Blade Coating Information": bool, "General Information": bool, "Solution Information": bool, "Spin Coating Information": bool, "Thermal Evaporation Information": bool}
  "Full Layer Information.gtype" = cluster{"Blade Coating Parameters": "Blade Coating Parameters.gtype", "Deposition Method": "Deposition Method.gtype", "Layer Type": "Layer Type.gtype", "Spin Coating Parameters": "Spin Coating Parameters.gtype", "Thermal Evaporation Parameters": "Thermal Evaporation Parameters.gtype", "Solution Information": "Solution Information.gtype", "General Parameters": "General Parameters.gtype", "Current Deposition Method Information Cluster": "Useless Cluster.gtype", "Layer String ID": string}
  "New Layer Prompt Ref Cluster.gtype" = cluster{"Add Layer Button Ref": "BooleanControl reference", "This VI Ref": VIRefnum, "Blade Coating Parameters Ref": "Cluster reference", "Deposition Method Ref": "EnumSelector reference", "General Parameters Ref": "Cluster reference", "Layer Type ref": "EnumSelector reference", "Solution Information Ref": "Cluster reference", "Spin Coating Parameters Ref": "Cluster reference", "Thermal Evaporation Parameters Ref": "Cluster reference", "Load Layer File Ref": "BooleanControl reference", "Save Layer File Ref": "BooleanControl reference"}
diagram:
  # This SubVI Checks if there is any missing information depending on the layer type and if there is
  # it prompts the user if it wants to proceed withoud adding the infomration or not.
  # It outputs the result as a boolean
  case ($"Error In") {
    frame Error, Default {
      w1 = $"Error In"
      w2 = $"Full Layer Information In"
      w3 = $"New Layer Prompt Ref Cluster In"
      w4 = default
    }
    frame No Error {
      Property Node(instance in=$"Full Layer Information In") -> ("Layer Type"=w5, "Deposition Method"=w6, instance out=w7)
      case (w5) {
        frame "Front Electrode" {
          Property Node(instance in=w7) -> ("General Parameters:Material"=w8, "General Parameters:Thickness (nm)"=w9, instance out=w10)
          Is Not Equal(x=w6, y="Sputtering") -> w11
          Is Not Equal(x=w8, y="ITO") -> w12
          Is Not Equal(x=w9, y=100) -> w13
          Logical Or(w12, w13, w11) -> w14
          case (w14) {
            frame False, Default {
              w3 = $"New Layer Prompt Ref Cluster In"
              w1 = $"Error In"
              w2 = w10
            }
            frame True {
              w15 = """I've noticed that you are trying to add an unusual front electrode layer.
the usual parameters are the following:

Material: ITO
Thickness 100 nm
Deposition Method: Sputtering

Are you sure you want to continue with your custom parameters?"""
              Two Button Dialog(F button name ("Cancel")="Oh no, please change\nthem back to default", T button name ("OK")="Yes, I know \nwhat I'm doing!", message=w15) -> (T Button?=w16)
              case (w16) {
                frame True {
                  w2 = w10
                  w3 = $"New Layer Prompt Ref Cluster In"
                  w1 = $"Error In"
                }
                frame False {
                  Property Node(instance in="Full Layer Information.gtype" {all zero or empty}, "General Parameters:Material"="ITO", "General Parameters:Thickness (nm)"=100, "Deposition Method"="Sputtering") -> (instance out=w2)
                  Property Node(instance in=$"New Layer Prompt Ref Cluster In") -> ("General Parameters Ref"=w17, "Deposition Method Ref"=w18, instance out=w3)
                  w19 = "General Parameters.gtype" {"Thickness (nm)"=100, "Comments"="", "Material"="ITO"}
                  Property Node(instance in=w17, "Value"=w19, error in=$"Error In") -> (error out=w20)
                  Property Node(instance in=w18, "Value"="Sputtering", error in=w20) -> (error out=w1)
                }
              }
            }
          }
          w4 = TRUE
        }
        frame Default {
          case (w6) {
            frame "Spin Coating" {
              Property Node(instance in=w7) -> ("Spin Coating Parameters:Thickness (nm)"=w21, "Spin Coating Parameters:Spin Speed (rpm)"=w22, instance out=w23)
              Is Equal To 0(x=w21) -> w24
              Is Equal To 0(x=w22) -> w25
              Logical And(w24, w25) -> w26
              Property Node(instance in=w23) -> ("Solution Information:Composition Array"=w27, "Solution Information:Solvent Array"=w28, "Solution Information:Concentration (mg/ml)"=w29, instance out=w2)
              Is Empty Array(array=w27) -> w30
              Is Empty Array(array=w28) -> w31
              Is Equal To 0(x=w29) -> w32
              Logical Or(w30, w31, w32) -> w33
              Concatenate Strings("The composition array is Empty!", "\r\n") -> w34
              Select(s=w30, t=w34, f="") -> w35
              Concatenate Strings("The solvent array is Empty!", "\r\n") -> w36
              Select(s=w31, t=w36, f="") -> w37
              Concatenate Strings("The concentration is 0!", "\r\n") -> w38
              Select(s=w32, t=w38, f="") -> w39
              Concatenate Strings(w35, w37, w39) -> w40
              Concatenate Strings("Besides, I'm missing some solution information:", "\r\n", w40) -> w41
              case (w26) {
                frame False, Default {
                  w4 = TRUE
                  w1 = $"Error In"
                }
                frame True {
                  Select(s=w33, t=w41, f="") -> w42
                  Format Into String(initString="You have selected ", errIn=$"Error In", w6) -> (outString=w43, errOut=w1)
                  w44 = "as Deposition method but you have not input neither the thickness nor the spin speed. Do you wish to continue without adding this information?"
                  Concatenate Strings(w43, w44) -> w45
                  Concatenate Strings(w45, "\r\n", w42, "Do you wish to continue without adding this information?") -> w46
                  Two Button Dialog(F button name ("Cancel")="Oh no please, let me\nadd the missing info", T button name ("OK")="Yes, I do not want\nto add any information!", message=w46) -> (T Button?=w4)
                }
              }
            }
            frame "Blade Coating", Default {
              Property Node(instance in=w7) -> ("Blade Coating Parameters:Thickness (nm)"=w47, "Blade Coating Parameters:Blade Initial Speed (mm/s)"=w48, "Blade Coating Parameters:Speed Gradient"=w49, "Blade Coating Parameters:Blade Final Speed (mm/s)"=w50, "Blade Coating Parameters:Blade Gap (um)"=w51, "Blade Coating Parameters:Blade Temperature (ºC)"=w52, "Blade Coating Parameters:Droplet Volume (ul)"=w53, instance out=w54)
              Property Node(instance in=w54) -> ("Solution Information:Composition Array"=w55, "Solution Information:Solvent Array"=w56, "Solution Information:Concentration (mg/ml)"=w57, instance out=w2)
              Is Empty Array(array=w55) -> w58
              Is Empty Array(array=w56) -> w59
              Is Equal To 0(x=w57) -> w60
              Logical Or(w58, w59, w60) -> w61
              Is Equal To 0(x=w47) -> w62
              Is Equal To 0(x=w51) -> w63
              Is Equal To 0(x=w52) -> w64
              Is Equal To 0(x=w53) -> w65
              Is Equal To 0(x=w48) -> w66
              Is Equal To 0(x=w50) -> w67
              Logical And(w49, w67) -> w68
              Logical Or(w66, w63, w64, w65, w68) -> w69
              Logical And(w62, w69) -> w70
              Concatenate Strings("The composition array is Empty!", "\r\n") -> w71
              Select(s=w58, t=w71, f="") -> w72
              Concatenate Strings("The solvent array is Empty!", "\r\n") -> w73
              Select(s=w59, t=w73, f="") -> w74
              Concatenate Strings("The concentration is 0!", "\r\n") -> w75
              Select(s=w60, t=w75, f="") -> w76
              Concatenate Strings(w72, w74, w76) -> w77
              Concatenate Strings("Besides, I'm missing some solution information:", "\r\n", w77) -> w78
              case (w70) {
                frame False, Default {
                  w4 = TRUE
                  w1 = $"Error In"
                }
                frame True {
                  Select(s=w61, t=w78, f="") -> w79
                  Format Into String(initString="You have selected ", errIn=$"Error In", w6) -> (outString=w80, errOut=w1)
                  w81 = "as Deposition method but you have not input neither the thickness nor some of the blade deposition parameters. Do you wish to continue without adding this information?"
                  Concatenate Strings(w80, w81) -> w82
                  Concatenate Strings(w82, "\r\n", w79, "Do you wish to continue without adding this information?") -> w83
                  Two Button Dialog(F button name ("Cancel")="Oh no please, let me\nadd the missing info", T button name ("OK")="Yes, I do not want\nto add any information!", message=w83) -> (T Button?=w4)
                }
              }
            }
            frame "Drop Casting" {
              Property Node(instance in=w7) -> ("General Parameters:Thickness (nm)"=w84, "General Parameters:Material"=w85, instance out=w86)
              Is Equal To 0(x=w84) -> w87
              Is Empty String Or Path(string/path=w85) -> w88
              Logical Or(w87, w88) -> w89
              Property Node(instance in=w86) -> ("Solution Information:Composition Array"=w90, "Solution Information:Solvent Array"=w91, "Solution Information:Concentration (mg/ml)"=w92, instance out=w2)
              Is Empty Array(array=w90) -> w93
              Is Empty Array(array=w91) -> w94
              Is Equal To 0(x=w92) -> w95
              Logical Or(w93, w94, w95) -> w96
              Concatenate Strings("The composition array is Empty!", "\r\n") -> w97
              Select(s=w93, t=w97, f="") -> w98
              Concatenate Strings("The solvent array is Empty!", "\r\n") -> w99
              Select(s=w94, t=w99, f="") -> w100
              Concatenate Strings("The concentration is 0!", "\r\n") -> w101
              Select(s=w95, t=w101, f="") -> w102
              Concatenate Strings(w98, w100, w102) -> w103
              Concatenate Strings("Besides, I'm missing some solution information:", "\r\n", w103) -> w104
              case (w89) {
                frame False, Default {
                  w4 = TRUE
                  w1 = $"Error In"
                }
                frame True {
                  Select(s=w96, t=w104, f="") -> w105
                  Format Into String(initString="You have selected ", errIn=$"Error In", w6) -> (outString=w106, errOut=w1)
                  w107 = "as Deposition method but you have not input neither the thickness nor the material. Do you wish to continue without adding this information?"
                  Concatenate Strings(w106, w107) -> w108
                  Concatenate Strings(w108, "\r\n", w105, "Do you wish to continue without adding this information?") -> w109
                  Two Button Dialog(F button name ("Cancel")="Oh no please, let me\nadd the missing info", T button name ("OK")="Yes, I do not want\nto add any information!", message=w109) -> (T Button?=w4)
                }
              }
            }
            frame "Dip Coating" {
              Property Node(instance in=w7) -> ("General Parameters:Thickness (nm)"=w110, "General Parameters:Material"=w111, instance out=w112)
              Is Equal To 0(x=w110) -> w113
              Is Empty String Or Path(string/path=w111) -> w114
              Logical Or(w113, w114) -> w115
              Property Node(instance in=w112) -> ("Solution Information:Composition Array"=w116, "Solution Information:Solvent Array"=w117, "Solution Information:Concentration (mg/ml)"=w118, instance out=w2)
              Is Empty Array(array=w116) -> w119
              Is Empty Array(array=w117) -> w120
              Is Equal To 0(x=w118) -> w121
              Logical Or(w119, w120, w121) -> w122
              Concatenate Strings("The composition array is Empty!", "\r\n") -> w123
              Select(s=w119, t=w123, f="") -> w124
              Concatenate Strings("The solvent array is Empty!", "\r\n") -> w125
              Select(s=w120, t=w125, f="") -> w126
              Concatenate Strings("The concentration is 0!", "\r\n") -> w127
              Select(s=w121, t=w127, f="") -> w128
              Concatenate Strings(w124, w126, w128) -> w129
              Concatenate Strings("Besides, I'm missing some solution information:", "\r\n", w129) -> w130
              case (w115) {
                frame False, Default {
                  w4 = TRUE
                  w1 = $"Error In"
                }
                frame True {
                  Select(s=w122, t=w130, f="") -> w131
                  Format Into String(initString="You have selected ", errIn=$"Error In", w6) -> (outString=w132, errOut=w1)
                  w133 = "as Deposition method but you have not input neither the thickness nor the material. Do you wish to continue without adding this information?"
                  Concatenate Strings(w132, w133) -> w134
                  Concatenate Strings(w134, "\r\n", w131, "Do you wish to continue without adding this information?") -> w135
                  Two Button Dialog(F button name ("Cancel")="Oh no please, let me\nadd the missing info", T button name ("OK")="Yes, I do not want\nto add any information!", message=w135) -> (T Button?=w4)
                }
              }
            }
            frame "Custom Deposition" {
              Property Node(instance in=w7) -> ("General Parameters:Thickness (nm)"=w136, "General Parameters:Material"=w137, instance out=w138)
              Is Equal To 0(x=w136) -> w139
              Is Empty String Or Path(string/path=w137) -> w140
              Logical Or(w139, w140) -> w141
              Property Node(instance in=w138) -> ("Solution Information:Composition Array"=w142, "Solution Information:Solvent Array"=w143, "Solution Information:Concentration (mg/ml)"=w144, instance out=w2)
              Is Empty Array(array=w142) -> w145
              Is Empty Array(array=w143) -> w146
              Is Equal To 0(x=w144) -> w147
              Logical Or(w145, w146, w147) -> w148
              Concatenate Strings("The composition array is Empty!", "\r\n") -> w149
              Select(s=w145, t=w149, f="") -> w150
              Concatenate Strings("The solvent array is Empty!", "\r\n") -> w151
              Select(s=w146, t=w151, f="") -> w152
              Concatenate Strings("The concentration is 0!", "\r\n") -> w153
              Select(s=w147, t=w153, f="") -> w154
              Concatenate Strings(w150, w152, w154) -> w155
              Concatenate Strings("Besides, I'm missing some solution information:", "\r\n", w155) -> w156
              case (w141) {
                frame False, Default {
                  w4 = TRUE
                  w1 = $"Error In"
                }
                frame True {
                  Select(s=w148, t=w156, f="") -> w157
                  Format Into String(initString="You have selected ", errIn=$"Error In", w6) -> (outString=w158, errOut=w1)
                  w159 = "as Deposition method but you have not input neither the thickness nor the material. Do you wish to continue without adding this information?"
                  Concatenate Strings(w158, w159) -> w160
                  Concatenate Strings(w160, "\r\n", w157, "Do you wish to continue without adding this information?") -> w161
                  Two Button Dialog(F button name ("Cancel")="Oh no please, let me\nadd the missing info", T button name ("OK")="Yes, I do not want\nto add any information!", message=w161) -> (T Button?=w4)
                }
              }
            }
            frame "Spray Coating" {
              Property Node(instance in=w7) -> ("General Parameters:Thickness (nm)"=w162, "General Parameters:Material"=w163, instance out=w164)
              Is Equal To 0(x=w162) -> w165
              Is Empty String Or Path(string/path=w163) -> w166
              Logical Or(w165, w166) -> w167
              Property Node(instance in=w164) -> ("Solution Information:Composition Array"=w168, "Solution Information:Solvent Array"=w169, "Solution Information:Concentration (mg/ml)"=w170, instance out=w2)
              Is Empty Array(array=w168) -> w171
              Is Empty Array(array=w169) -> w172
              Is Equal To 0(x=w170) -> w173
              Logical Or(w171, w172, w173) -> w174
              Concatenate Strings("The composition array is Empty!", "\r\n") -> w175
              Select(s=w171, t=w175, f="") -> w176
              Concatenate Strings("The solvent array is Empty!", "\r\n") -> w177
              Select(s=w172, t=w177, f="") -> w178
              Concatenate Strings("The concentration is 0!", "\r\n") -> w179
              Select(s=w173, t=w179, f="") -> w180
              Concatenate Strings(w176, w178, w180) -> w181
              Concatenate Strings("Besides, I'm missing some solution information:", "\r\n", w181) -> w182
              case (w167) {
                frame False, Default {
                  w4 = TRUE
                  w1 = $"Error In"
                }
                frame True {
                  Select(s=w174, t=w182, f="") -> w183
                  Format Into String(initString="You have selected ", errIn=$"Error In", w6) -> (outString=w184, errOut=w1)
                  w185 = "as Deposition method but you have not input neither the thickness nor the material. Do you wish to continue without adding this information?"
                  Concatenate Strings(w184, w185) -> w186
                  Concatenate Strings(w186, "\r\n", w183, "Do you wish to continue without adding this information?") -> w187
                  Two Button Dialog(F button name ("Cancel")="Oh no please, let me\nadd the missing info", T button name ("OK")="Yes, I do not want\nto add any information!", message=w187) -> (T Button?=w4)
                }
              }
            }
            frame "Screen Printing" {
              Property Node(instance in=w7) -> ("General Parameters:Thickness (nm)"=w188, "General Parameters:Material"=w189, instance out=w190)
              Is Equal To 0(x=w188) -> w191
              Is Empty String Or Path(string/path=w189) -> w192
              Logical Or(w191, w192) -> w193
              Property Node(instance in=w190) -> ("Solution Information:Composition Array"=w194, "Solution Information:Solvent Array"=w195, "Solution Information:Concentration (mg/ml)"=w196, instance out=w2)
              Is Empty Array(array=w194) -> w197
              Is Empty Array(array=w195) -> w198
              Is Equal To 0(x=w196) -> w199
              Logical Or(w197, w198, w199) -> w200
              Concatenate Strings("The composition array is Empty!", "\r\n") -> w201
              Select(s=w197, t=w201, f="") -> w202
              Concatenate Strings("The solvent array is Empty!", "\r\n") -> w203
              Select(s=w198, t=w203, f="") -> w204
              Concatenate Strings("The concentration is 0!", "\r\n") -> w205
              Select(s=w199, t=w205, f="") -> w206
              Concatenate Strings(w202, w204, w206) -> w207
              Concatenate Strings("Besides, I'm missing some solution information:", "\r\n", w207) -> w208
              case (w193) {
                frame False, Default {
                  w4 = TRUE
                  w1 = $"Error In"
                }
                frame True {
                  Select(s=w200, t=w208, f="") -> w209
                  Format Into String(initString="You have selected ", errIn=$"Error In", w6) -> (outString=w210, errOut=w1)
                  w211 = "as Deposition method but you have not input neither the thickness nor the material. Do you wish to continue without adding this information?"
                  Concatenate Strings(w210, w211) -> w212
                  Concatenate Strings(w212, "\r\n", w209, "Do you wish to continue without adding this information?") -> w213
                  Two Button Dialog(F button name ("Cancel")="Oh no please, let me\nadd the missing info", T button name ("OK")="Yes, I do not want\nto add any information!", message=w213) -> (T Button?=w4)
                }
              }
            }
            frame "Thermal Evaporation" {
              Property Node(instance in=w7) -> ("Thermal Evaporation Parameters:Thickness (nm)"=w214, "Thermal Evaporation Parameters:Deposition Rate (nm/s)"=w215, "Thermal Evaporation Parameters:Material"=w216, instance out=w2)
              Is Equal To 0(x=w214) -> w217
              Is Equal To 0(x=w215) -> w218
              Is Empty String Or Path(string/path=w216) -> w219
              Logical Or(w217, w218, w219) -> w220
              case (w220) {
                frame False, Default {
                  w4 = TRUE
                  w1 = $"Error In"
                }
                frame True {
                  Format Into String(initString="You have selected ", errIn=$"Error In", w6) -> (outString=w221, errOut=w1)
                  w222 = "as Deposition method but you have not input either the thickness or the deposition rate or the material. Do you wish to continue without adding this information?"
                  Concatenate Strings(w221, w222) -> w223
                  Two Button Dialog(F button name ("Cancel")="Oh no please, let me\nadd the missing info", T button name ("OK")="Yes, I do not want\nto add any information!", message=w223) -> (T Button?=w4)
                }
              }
            }
            frame "E-beam Evaporation" {
              Property Node(instance in=w7) -> ("General Parameters:Thickness (nm)"=w224, "General Parameters:Comments"=w225, instance out=w2)
              Is Equal To 0(x=w224) -> w226
              Is Empty String Or Path(string/path=w225) -> w227
              Logical Or(w226, w227) -> w228
              case (w228) {
                frame False, Default {
                  w4 = TRUE
                  w1 = $"Error In"
                }
                frame True {
                  Format Into String(initString="You have selected ", errIn=$"Error In", w6) -> (outString=w229, errOut=w1)
                  w230 = "as Deposition method but you have not input either the thickness or the material. Do you wish to continue without adding this information?"
                  Concatenate Strings(w229, w230) -> w231
                  Two Button Dialog(F button name ("Cancel")="Oh no please, let me\nadd the missing info", T button name ("OK")="Yes, I do not want\nto add any information!", message=w231) -> (T Button?=w4)
                }
              }
            }
            frame "Electroplating" {
              Property Node(instance in=w7) -> ("General Parameters:Thickness (nm)"=w232, "General Parameters:Comments"=w233, instance out=w2)
              Is Equal To 0(x=w232) -> w234
              Is Empty String Or Path(string/path=w233) -> w235
              Logical Or(w234, w235) -> w236
              case (w236) {
                frame False, Default {
                  w4 = TRUE
                  w1 = $"Error In"
                }
                frame True {
                  Format Into String(initString="You have selected ", errIn=$"Error In", w6) -> (outString=w237, errOut=w1)
                  w238 = "as Deposition method but you have not input either the thickness or the material. Do you wish to continue without adding this information?"
                  Concatenate Strings(w237, w238) -> w239
                  Two Button Dialog(F button name ("Cancel")="Oh no please, let me\nadd the missing info", T button name ("OK")="Yes, I do not want\nto add any information!", message=w239) -> (T Button?=w4)
                }
              }
            }
            frame "Molecular Beam Epitaxy" {
              Property Node(instance in=w7) -> ("General Parameters:Thickness (nm)"=w240, "General Parameters:Comments"=w241, instance out=w2)
              Is Equal To 0(x=w240) -> w242
              Is Empty String Or Path(string/path=w241) -> w243
              Logical Or(w242, w243) -> w244
              case (w244) {
                frame False, Default {
                  w4 = TRUE
                  w1 = $"Error In"
                }
                frame True {
                  Format Into String(initString="You have selected ", errIn=$"Error In", w6) -> (outString=w245, errOut=w1)
                  w246 = "as Deposition method but you have not input either the thickness or the material. Do you wish to continue without adding this information?"
                  Concatenate Strings(w245, w246) -> w247
                  Two Button Dialog(F button name ("Cancel")="Oh no please, let me\nadd the missing info", T button name ("OK")="Yes, I do not want\nto add any information!", message=w247) -> (T Button?=w4)
                }
              }
            }
            frame "Pulsed Laser Deposition" {
              Property Node(instance in=w7) -> ("General Parameters:Thickness (nm)"=w248, "General Parameters:Comments"=w249, instance out=w2)
              Is Equal To 0(x=w248) -> w250
              Is Empty String Or Path(string/path=w249) -> w251
              Logical Or(w250, w251) -> w252
              case (w252) {
                frame False, Default {
                  w4 = TRUE
                  w1 = $"Error In"
                }
                frame True {
                  Format Into String(initString="You have selected ", errIn=$"Error In", w6) -> (outString=w253, errOut=w1)
                  w254 = "as Deposition method but you have not input either the thickness or the material. Do you wish to continue without adding this information?"
                  Concatenate Strings(w253, w254) -> w255
                  Two Button Dialog(F button name ("Cancel")="Oh no please, let me\nadd the missing info", T button name ("OK")="Yes, I do not want\nto add any information!", message=w255) -> (T Button?=w4)
                }
              }
            }
            frame "Chemical Vapour Deposition" {
              Property Node(instance in=w7) -> ("General Parameters:Thickness (nm)"=w256, "General Parameters:Comments"=w257, instance out=w2)
              Is Equal To 0(x=w256) -> w258
              Is Empty String Or Path(string/path=w257) -> w259
              Logical Or(w258, w259) -> w260
              case (w260) {
                frame False, Default {
                  w4 = TRUE
                  w1 = $"Error In"
                }
                frame True {
                  Format Into String(initString="You have selected ", errIn=$"Error In", w6) -> (outString=w261, errOut=w1)
                  w262 = "as Deposition method but you have not input either the thickness or the material. Do you wish to continue without adding this information?"
                  Concatenate Strings(w261, w262) -> w263
                  Two Button Dialog(F button name ("Cancel")="Oh no please, let me\nadd the missing info", T button name ("OK")="Yes, I do not want\nto add any information!", message=w263) -> (T Button?=w4)
                }
              }
            }
            frame "Atomic Layer Deposition" {
              Property Node(instance in=w7) -> ("General Parameters:Thickness (nm)"=w264, "General Parameters:Comments"=w265, instance out=w2)
              Is Equal To 0(x=w264) -> w266
              Is Empty String Or Path(string/path=w265) -> w267
              Logical Or(w266, w267) -> w268
              case (w268) {
                frame False, Default {
                  w4 = TRUE
                  w1 = $"Error In"
                }
                frame True {
                  Format Into String(initString="You have selected ", errIn=$"Error In", w6) -> (outString=w269, errOut=w1)
                  w270 = "as Deposition method but you have not input either the thickness or the material. Do you wish to continue without adding this information?"
                  Concatenate Strings(w269, w270) -> w271
                  Two Button Dialog(F button name ("Cancel")="Oh no please, let me\nadd the missing info", T button name ("OK")="Yes, I do not want\nto add any information!", message=w271) -> (T Button?=w4)
                }
              }
            }
            frame "Sputtering" {
              Property Node(instance in=w7) -> ("General Parameters:Thickness (nm)"=w272, "General Parameters:Comments"=w273, instance out=w2)
              Is Equal To 0(x=w272) -> w274
              Is Empty String Or Path(string/path=w273) -> w275
              Logical Or(w274, w275) -> w276
              case (w276) {
                frame False, Default {
                  w4 = TRUE
                  w1 = $"Error In"
                }
                frame True {
                  Format Into String(initString="You have selected ", errIn=$"Error In", w6) -> (outString=w277, errOut=w1)
                  w278 = "as Deposition method but you have not input either the thickness or the material. Do you wish to continue without adding this information?"
                  Concatenate Strings(w277, w278) -> w279
                  Two Button Dialog(F button name ("Cancel")="Oh no please, let me\nadd the missing info", T button name ("OK")="Yes, I do not want\nto add any information!", message=w279) -> (T Button?=w4)
                }
              }
            }
          }
          w3 = $"New Layer Prompt Ref Cluster In"
        }
      }
    }
  }
  $"New Layer Prompt Ref Cluster Out" <- w3
  $"Full Layer Information Out" <- w2
  $"Error Out" <- w1
  $"Proceed?" <- w4
