vi "Front Electrode Default Check.gvi"   [LabVIEW NXG 5.0.0]
inputs:
  "Layer Controls Reference Cluster In": "Layer Controls Prompt Ref Cluster.gtype"
  "Full Layer Info In": "Full Layer Information.gtype"
  "Deposition Method": "Deposition Method.gtype" = "Blade Coating"
  "Error In": error
outputs:
  "Proceed?": bool
  "Layer Controls Reference Cluster Out": "Layer Controls Prompt Ref Cluster.gtype"
  "Full Layer Info Out": "Full Layer Information.gtype"
  "Error Out": error
types:
  "Blade Coating Parameters.gtype" = cluster{"Thickness (nm)": f64, "Blade Initial Speed (mm/s)": f64, "Speed Gradient": bool, "Blade Final Speed (mm/s)": f64, "Blade Gap (um)": f64, "Blade Temperature (ºC)": f64, "Droplet Volume (ul)": f64, "Subsequent layers": f64, "Glovebox": bool, "Comments": string}
  "Deposition Method.gtype" = enum{"Blade Coating", "Spin Coating", "Thermal Evaporation", "E-beam Evaporation", "Sputtering", "Drop Casting", "Dip Coating", "Pulsed Laser Deposition", "Chemical Vapour Deposition", "Atomic Layer Deposition", "Spray Coating", "Screen Printing", "Electroplating", "Molecular Beam Epitaxy", "Custom Deposition"}
  "Layer Type.gtype" = enum{"Front Electrode", "Electrode Transport Layer", "Active Layer", "Hole Transport Layer", "Back Electrode", "Annealing Treatment", "Encapsulation", "Custom Layer"}
  "Spin Coating Parameters.gtype" = cluster{"Thickness (nm)": f64, "Spin Speed (rpm)": f64, "Dynamic Deposition": bool, "Spin Acceleration (rpm/s)": f64, "Droplet Volume (ul)": f64, "Subsequent layers": f64, "Glovebox": bool, "Comments": string}
  "Thermal Evaporation Parameters.gtype" = cluster{"Thickness (nm)": f64, "Deposition Rate (nm/s)": f64, "Comments": string, "Sample Rotation": bool, "Material": string}
  "Solution Information.gtype" = cluster{"Concentration (mg/ml)": f64, "Stirring Time (kr)": f64, "Glovebox": bool, "Composition Array": cluster{"Material": string, "Ratio": f64}[], "Solvent Array": cluster{"Solvent": string, "Ratio": f64}[], "Solution Preparation Date": f64, "Comments": string}
  "General Parameters.gtype" = cluster{"Thickness (nm)": f64, "Comments": string, "Material": string}
  "Useless Cluster.gtype" = cluster{"Blade Coating Information": bool, "General Information": bool, "Solution Information": bool, "Spin Coating Information": bool, "Thermal Evaporation Information": bool}
  "Full Layer Information.gtype" = cluster{"Blade Coating Parameters": "Blade Coating Parameters.gtype", "Deposition Method": "Deposition Method.gtype", "Layer Type": "Layer Type.gtype", "Spin Coating Parameters": "Spin Coating Parameters.gtype", "Thermal Evaporation Parameters": "Thermal Evaporation Parameters.gtype", "Solution Information": "Solution Information.gtype", "General Parameters": "General Parameters.gtype", "Current Deposition Method Information Cluster": "Useless Cluster.gtype", "Layer String ID": string}
  "Layer Controls Prompt Ref Cluster.gtype" = cluster{"Add Layer Button Ref": "BooleanControl reference", "This VI Ref": VIRefnum, "Blade Coating Parameters Ref": "Cluster reference", "Deposition Method Ref": "EnumSelector reference", "General Parameters Ref": "Cluster reference", "Layer Type ref": "EnumSelector reference", "Solution Information Ref": "Cluster reference", "Spin Coating Parameters Ref": "Cluster reference", "Thermal Evaporation Parameters Ref": "Cluster reference", "Load Layer File Ref": "BooleanControl reference", "Save Layer File Ref": "BooleanControl reference", "Layer To Edit Ref": "RingSelectorInt32 reference"}
diagram:
  # This subVI Checks that the front electrode is the usual ITO and if not, prompts the user
  # to make sure he knows about it
  case ($"Error In") {
    frame Error, Default {
      w1 = default
      w2 = $"Full Layer Info In"
      w3 = $"Layer Controls Reference Cluster In"
      w4 = $"Error In"
    }
    frame No Error {
      Property Node(instance in=$"Full Layer Info In") -> ("General Parameters:Material"=w5, "General Parameters:Thickness (nm)"=w6, instance out=w7)
      Is Not Equal(x=$"Deposition Method", y="Sputtering") -> w8
      Is Not Equal(x=w5, y="ITO") -> w9
      Is Not Equal(x=w6, y=100) -> w10
      Logical Or(w9, w10, w8) -> w11
      case (w11) {
        frame False, Default {
          w3 = $"Layer Controls Reference Cluster In"
          w4 = $"Error In"
          w2 = w7
          w1 = TRUE
        }
        frame True {
          w12 = """I've noticed that you are trying to add an unusual front electrode layer.
the usual parameters are the following:

Material: ITO
Thickness 100 nm
Deposition Method: Sputtering

Are you sure you want to continue with your custom parameters?"""
          Three Button Dialog(Allow user to close window? (TRUE)=FALSE, Center Button Text ("No")="Oh no, please let me \nchange them manually", Left Button Text ("Yes")="Yes, I know \nwhat I'm doing!", Right Button Text ("Cancel")="Set them to the\ndefault values please", message=w12) -> (Which Button?=w13)
          case (w13) {
            frame "left button" {
              w2 = w7
              w3 = $"Layer Controls Reference Cluster In"
              w4 = $"Error In"
              w1 = TRUE
            }
            frame "center button", Default {
              w2 = w7
              w3 = $"Layer Controls Reference Cluster In"
              w4 = $"Error In"
              w1 = FALSE
            }
            frame "right button" {
              Property Node(instance in=$"Layer Controls Reference Cluster In") -> ("General Parameters Ref"=w14, "Deposition Method Ref"=w15, instance out=w3)
              w16 = "General Parameters.gtype" {"Thickness (nm)"=100, "Comments"="", "Material"="ITO"}
              Property Node(instance in=w14, "Value"=w16, error in=$"Error In") -> (error out=w17)
              Property Node(instance in=w15, "Value"="Sputtering", error in=w17) -> (error out=w4)
              Property Node(instance in="Full Layer Information.gtype" {all zero or empty}, "General Parameters:Material"="ITO", "General Parameters:Thickness (nm)"=100, "Deposition Method"="Sputtering") -> (instance out=w2)
              w1 = FALSE
            }
          }
        }
      }
    }
  }
  $"Proceed?" <- w1
  $"Layer Controls Reference Cluster Out" <- w3
  $"Error Out" <- w4
  $"Full Layer Info Out" <- w2
