vi "Missing Deposition Info.gvi"   [LabVIEW NXG 5.0.0]
inputs:
  "Error In": error
  "Deposition Method": "Deposition Method.gtype" = "Blade Coating"
  "Full Layer Information In": "Full Layer Information.gtype"
outputs:
  "Error Out": error
  "Full Layer Information Out": "Full Layer Information.gtype"
  "Output Prompt": string
  "Layer Deposition Information Missing?": bool
types:
  "Deposition Method.gtype" = enum{"Blade Coating", "Spin Coating", "Thermal Evaporation", "E-beam Evaporation", "Sputtering", "Drop Casting", "Dip Coating", "Pulsed Laser Deposition", "Chemical Vapour Deposition", "Atomic Layer Deposition", "Spray Coating", "Screen Printing", "Electroplating", "Molecular Beam Epitaxy", "Custom Deposition"}
  "Blade Coating Parameters.gtype" = cluster{"Thickness (nm)": f64, "Blade Initial Speed (mm/s)": f64, "Speed Gradient": bool, "Blade Final Speed (mm/s)": f64, "Blade Gap (um)": f64, "Blade Temperature (ºC)": f64, "Droplet Volume (ul)": f64, "Subsequent layers": f64, "Glovebox": bool, "Comments": string}
  "Layer Type.gtype" = enum{"Front Electrode", "Electrode Transport Layer", "Active Layer", "Hole Transport Layer", "Back Electrode", "Annealing Treatment", "Encapsulation", "Custom Layer"}
  "Spin Coating Parameters.gtype" = cluster{"Thickness (nm)": f64, "Spin Speed (rpm)": f64, "Dynamic Deposition": bool, "Spin Acceleration (rpm/s)": f64, "Droplet Volume (ul)": f64, "Subsequent layers": f64, "Glovebox": bool, "Comments": string}
  "Thermal Evaporation Parameters.gtype" = cluster{"Thickness (nm)": f64, "Deposition Rate (nm/s)": f64, "Comments": string, "Sample Rotation": bool, "Material": string}
  "Solution Information.gtype" = cluster{"Concentration (mg/ml)": f64, "Stirring Time (kr)": f64, "Glovebox": bool, "Composition Array": cluster{"Material": string, "Ratio": f64}[], "Solvent Array": cluster{"Solvent": string, "Ratio": f64}[], "Solution Preparation Date": f64, "Comments": string}
  "General Parameters.gtype" = cluster{"Thickness (nm)": f64, "Comments": string, "Material": string}
  "Useless Cluster.gtype" = cluster{"Blade Coating Information": bool, "General Information": bool, "Solution Information": bool, "Spin Coating Information": bool, "Thermal Evaporation Information": bool}
  "Full Layer Information.gtype" = cluster{"Blade Coating Parameters": "Blade Coating Parameters.gtype", "Deposition Method": "Deposition Method.gtype", "Layer Type": "Layer Type.gtype", "Spin Coating Parameters": "Spin Coating Parameters.gtype", "Thermal Evaporation Parameters": "Thermal Evaporation Parameters.gtype", "Solution Information": "Solution Information.gtype", "General Parameters": "General Parameters.gtype", "Current Deposition Method Information Cluster": "Useless Cluster.gtype", "Layer String ID": string}
diagram:
  # This subVI Adds a string saying that there is solution information missing in case there is
  case ($"Error In") {
    frame Error, Default {
      w1 = $"Error In"
      w2 = $"Full Layer Information In"
      w3 = default
      w4 = default
    }
    frame No Error {
      case ($"Deposition Method") {
        frame "Blade Coating", Default {
          w5 = "However you have not input neither the thickness nor some of the blade deposition parameters."
          Property Node(instance in=$"Full Layer Information In") -> ("Blade Coating Parameters:Thickness (nm)"=w6, "Blade Coating Parameters:Blade Initial Speed (mm/s)"=w7, "Blade Coating Parameters:Speed Gradient"=w8, "Blade Coating Parameters:Blade Final Speed (mm/s)"=w9, "Blade Coating Parameters:Blade Gap (um)"=w10, "Blade Coating Parameters:Blade Temperature (ºC)"=w11, "Blade Coating Parameters:Droplet Volume (ul)"=w12, instance out=w2)
          Is Equal To 0(x=w6) -> w13
          Is Equal To 0(x=w11) -> w14
          Is Equal To 0(x=w12) -> w15
          Is Equal To 0(x=w9) -> w16
          Logical And(w8, w16) -> w17
          Is Equal To 0(x=w7) -> w18
          Is Equal To 0(x=w10) -> w19
          Logical Or(w18, w19, w14, w15, w17) -> w20
          Logical And(w13, w20) -> w4
          w3 = w5
        }
        frame "Spin Coating" {
          w21 = "However you have not input neither the thickness nor the spin speed."
          Property Node(instance in=$"Full Layer Information In") -> ("Spin Coating Parameters:Thickness (nm)"=w22, "Spin Coating Parameters:Spin Speed (rpm)"=w23, instance out=w2)
          Is Equal To 0(x=w22) -> w24
          Is Equal To 0(x=w23) -> w25
          Logical And(w24, w25) -> w4
          w3 = w21
        }
        frame "Thermal Evaporation" {
          w26 = "However you have not input either the thickness or the deposition rate or the material."
          Property Node(instance in=$"Full Layer Information In") -> ("Thermal Evaporation Parameters:Thickness (nm)"=w27, "Thermal Evaporation Parameters:Deposition Rate (nm/s)"=w28, "Thermal Evaporation Parameters:Material"=w29, instance out=w2)
          Is Equal To 0(x=w27) -> w30
          Is Equal To 0(x=w28) -> w31
          Is Empty String Or Path(string/path=w29) -> w32
          Logical Or(w30, w31, w32) -> w4
          w3 = w26
        }
        frame "E-beam Evaporation" {
          w33 = "However you have not input either the thickness or the material."
          Property Node(instance in=$"Full Layer Information In") -> ("General Parameters:Thickness (nm)"=w34, "General Parameters:Comments"=w35, instance out=w2)
          Is Equal To 0(x=w34) -> w36
          Is Empty String Or Path(string/path=w35) -> w37
          Logical Or(w36, w37) -> w4
          w3 = w33
        }
        frame "Sputtering" {
          w38 = "However you have not input either the thickness or the material."
          Property Node(instance in=$"Full Layer Information In") -> ("General Parameters:Thickness (nm)"=w39, "General Parameters:Comments"=w40, instance out=w2)
          Is Equal To 0(x=w39) -> w41
          Is Empty String Or Path(string/path=w40) -> w42
          Logical Or(w41, w42) -> w4
          w3 = w38
        }
        frame "Drop Casting" {
          w43 = "However you have not input either the thickness or the material."
          Property Node(instance in=$"Full Layer Information In") -> ("General Parameters:Thickness (nm)"=w44, "General Parameters:Comments"=w45, instance out=w2)
          Is Equal To 0(x=w44) -> w46
          Is Empty String Or Path(string/path=w45) -> w47
          Logical Or(w46, w47) -> w4
          w3 = w43
        }
        frame "Dip Coating" {
          w48 = "However you have not input either the thickness or the material."
          Property Node(instance in=$"Full Layer Information In") -> ("General Parameters:Thickness (nm)"=w49, "General Parameters:Comments"=w50, instance out=w2)
          Is Equal To 0(x=w49) -> w51
          Is Empty String Or Path(string/path=w50) -> w52
          Logical Or(w51, w52) -> w4
          w3 = w48
        }
        frame "Pulsed Laser Deposition" {
          w53 = "However you have not input either the thickness or the material."
          Property Node(instance in=$"Full Layer Information In") -> ("General Parameters:Thickness (nm)"=w54, "General Parameters:Comments"=w55, instance out=w2)
          Is Equal To 0(x=w54) -> w56
          Is Empty String Or Path(string/path=w55) -> w57
          Logical Or(w56, w57) -> w4
          w3 = w53
        }
        frame "Chemical Vapour Deposition" {
          w58 = "However you have not input either the thickness or the material."
          Property Node(instance in=$"Full Layer Information In") -> ("General Parameters:Thickness (nm)"=w59, "General Parameters:Comments"=w60, instance out=w2)
          Is Equal To 0(x=w59) -> w61
          Is Empty String Or Path(string/path=w60) -> w62
          Logical Or(w61, w62) -> w4
          w3 = w58
        }
        frame "Atomic Layer Deposition" {
          w63 = "However you have not input either the thickness or the material."
          Property Node(instance in=$"Full Layer Information In") -> ("General Parameters:Thickness (nm)"=w64, "General Parameters:Comments"=w65, instance out=w2)
          Is Equal To 0(x=w64) -> w66
          Is Empty String Or Path(string/path=w65) -> w67
          Logical Or(w66, w67) -> w4
          w3 = w63
        }
        frame "Spray Coating" {
          w68 = "However you have not input either the thickness or the material."
          Property Node(instance in=$"Full Layer Information In") -> ("General Parameters:Thickness (nm)"=w69, "General Parameters:Comments"=w70, instance out=w2)
          Is Equal To 0(x=w69) -> w71
          Is Empty String Or Path(string/path=w70) -> w72
          Logical Or(w71, w72) -> w4
          w3 = w68
        }
        frame "Screen Printing" {
          w73 = "However you have not input either the thickness or the material."
          Property Node(instance in=$"Full Layer Information In") -> ("General Parameters:Thickness (nm)"=w74, "General Parameters:Comments"=w75, instance out=w2)
          Is Equal To 0(x=w74) -> w76
          Is Empty String Or Path(string/path=w75) -> w77
          Logical Or(w76, w77) -> w4
          w3 = w73
        }
        frame "Electroplating" {
          w78 = "However you have not input either the thickness or the material."
          Property Node(instance in=$"Full Layer Information In") -> ("General Parameters:Thickness (nm)"=w79, "General Parameters:Comments"=w80, instance out=w2)
          Is Equal To 0(x=w79) -> w81
          Is Empty String Or Path(string/path=w80) -> w82
          Logical Or(w81, w82) -> w4
          w3 = w78
        }
        frame "Molecular Beam Epitaxy" {
          w83 = "However you have not input either the thickness or the material."
          Property Node(instance in=$"Full Layer Information In") -> ("General Parameters:Thickness (nm)"=w84, "General Parameters:Comments"=w85, instance out=w2)
          Is Equal To 0(x=w84) -> w86
          Is Empty String Or Path(string/path=w85) -> w87
          Logical Or(w86, w87) -> w4
          w3 = w83
        }
        frame "Custom Deposition" {
          w88 = "However you have not input either the thickness or the material."
          Property Node(instance in=$"Full Layer Information In") -> ("General Parameters:Thickness (nm)"=w89, "General Parameters:Comments"=w90, instance out=w2)
          Is Equal To 0(x=w89) -> w91
          Is Empty String Or Path(string/path=w90) -> w92
          Logical Or(w91, w92) -> w4
          w3 = w88
        }
      }
      w1 = $"Error In"
    }
  }
  $"Error Out" <- w1
  $"Output Prompt" <- w3
  $"Full Layer Information Out" <- w2
  $"Layer Deposition Information Missing?" <- w4
