vi "Missing Information Check.gvi"   [LabVIEW NXG 5.0.0]
inputs:
  "Error In": error
  "Full Layer Information In": "Full Layer Information.gtype"
  "Layer Controls Prompt Ref Cluster In": "Layer Controls Prompt Ref Cluster.gtype"
outputs:
  "Error Out": error
  "Full Layer Information Out": "Full Layer Information.gtype"
  "Layer Controls Prompt Ref Cluster Out": "Layer Controls Prompt Ref Cluster.gtype"
  "Proceed?": bool
types:
  "Blade Coating Parameters.gtype" = cluster{"Thickness (nm)": f64, "Blade Initial Speed (mm/s)": f64, "Speed Gradient": bool, "Blade Final Speed (mm/s)": f64, "Blade Gap (um)": f64, "Blade Temperature (ºC)": f64, "Droplet Volume (ul)": f64, "Subsequent layers": f64, "Glovebox": bool, "Comments": string}
  "Deposition Method.gtype" = enum{"Blade Coating", "Spin Coating", "Thermal Evaporation", "E-beam Evaporation", "Sputtering", "Drop Casting", "Dip Coating", "Pulsed Laser Deposition", "Chemical Vapour Deposition", "Atomic Layer Deposition", "Spray Coating", "Screen Printing", "Electroplating", "Molecular Beam Epitaxy", "Custom Deposition"}
  "Layer Type.gtype" = enum{"Front Electrode", "Electrode Transport Layer", "Active Layer", "Hole Transport Layer", "Back Electrode", "Annealing Treatment", "Encapsulation", "Custom Layer"}
  "Spin Coating Parameters.gtype" = cluster{"Thickness (nm)": f64, "Spin Speed (rpm)": f64, "Dynamic Deposition": bool, "Spin Acceleration (rpm/s)": f64, "Droplet Volume (ul)": f64, "Subsequent layers": f64, "Glovebox": bool, "Comments": string}
  "Thermal Evaporation Parameters.gtype" = cluster{"Thickness (nm)": f64, "Deposition Rate (nm/s)": f64, "Comments": string, "Sample Rotation": bool, "Material": string}
  "Solution Information.gtype" = cluster{"Concentration (mg/ml)": f64, "Stirring Time (kr)": f64, "Glovebox": bool, "Composition Array": cluster{"Material": string, "Ratio": f64}[], "Solvent Array": cluster{"Solvent": string, "Ratio": f64}[], "Solution Preparation Date": f64, "Comments": string}
  "General Parameters.gtype" = cluster{"Thickness (nm)": f64, "Comments": string, "Material": string}
  "Useless Cluster.gtype" = cluster{"Blade Coating Information": bool, "General Information": bool, "Solution Information": bool, "Spin Coating Information": bool, "Thermal Evaporation Information": bool}
  "Full Layer Information.gtype" = cluster{"Blade Coating Parameters": "Blade Coating Parameters.gtype", "Deposition Method": "Deposition Method.gtype", "Layer Type": "Layer Type.gtype", "Spin Coating Parameters": "Spin Coating Parameters.gtype", "Thermal Evaporation Parameters": "Thermal Evaporation Parameters.gtype", "Solution Information": "Solution Information.gtype", "General Parameters": "General Parameters.gtype", "Current Deposition Method Information Cluster": "Useless Cluster.gtype", "Layer String ID": string}
  "Layer Controls Prompt Ref Cluster.gtype" = cluster{"Add Layer Button Ref": "BooleanControl reference", "This VI Ref": VIRefnum, "Blade Coating Parameters Ref": "Cluster reference", "Deposition Method Ref": "EnumSelector reference", "General Parameters Ref": "Cluster reference", "Layer Type ref": "EnumSelector reference", "Solution Information Ref": "Cluster reference", "Spin Coating Parameters Ref": "Cluster reference", "Thermal Evaporation Parameters Ref": "Cluster reference", "Load Layer File Ref": "BooleanControl reference", "Save Layer File Ref": "BooleanControl reference", "Layer To Edit Ref": "EnumSelector reference"}
uses:
  Pika IV Characterization NXG::Main Functions::Layer Composition::Data Management::Missing info::Missing Deposition Info.gvi
  Pika IV Characterization NXG::Main Functions::Layer Composition::Data Management::Missing info::Missing Solution Info.gvi
  Pika IV Characterization NXG::Main Functions::Layer Composition::Data Management::Missing info::Prompt Generator.gvi
diagram:
  # This SubVI Checks if there is any missing information depending on the layer type and if there is
  # it prompts the user if it wants to proceed withoud adding the infomration or not.
  # It outputs the result as a boolean
  case ($"Error In") {
    frame Error, Default {
      w1 = $"Error In"
      w2 = $"Full Layer Information In"
      w3 = $"Layer Controls Prompt Ref Cluster In"
      w4 = default
    }
    frame No Error {
      Property Node(instance in=$"Full Layer Information In") -> ("Layer Type"=w5, "Deposition Method"=w6, instance out=w7)
      case (w5) {
        frame "Front Electrode" {
          Property Node(instance in=w7) -> ("General Parameters:Material"=w8, "General Parameters:Thickness (nm)"=w9, instance out=w10)
          Is Not Equal(x=w6, y="Sputtering") -> w11
          Is Not Equal(x=w8, y="ITO") -> w12
          Is Not Equal(x=w9, y=100) -> w13
          Logical Or(w12, w13, w11) -> w14
          case (w14) {
            frame False, Default {
              w3 = $"Layer Controls Prompt Ref Cluster In"
              w1 = $"Error In"
              w2 = w10
              w4 = TRUE
            }
            frame True {
              w15 = """I've noticed that you are trying to add an unusual front electrode layer.
the usual parameters are the following:

Material: ITO
Thickness 100 nm
Deposition Method: Sputtering

Are you sure you want to continue with your custom parameters?"""
              Three Button Dialog(Allow user to close window? (TRUE)=FALSE, Center Button Text ("No")="Oh no, please let me \nchange them manually", Left Button Text ("Yes")="Yes, I know \nwhat I'm doing!", Right Button Text ("Cancel")="Set them to the\ndefault values please", message=w15) -> (Which Button?=w16)
              case (w16) {
                frame "left button" {
                  w2 = w10
                  w3 = $"Layer Controls Prompt Ref Cluster In"
                  w1 = $"Error In"
                  w4 = TRUE
                }
                frame "center button", Default {
                  w2 = w10
                  w3 = $"Layer Controls Prompt Ref Cluster In"
                  w1 = $"Error In"
                  w4 = FALSE
                }
                frame "right button" {
                  Property Node(instance in=$"Layer Controls Prompt Ref Cluster In") -> ("General Parameters Ref"=w17, "Deposition Method Ref"=w18, instance out=w3)
                  w19 = "General Parameters.gtype" {"Thickness (nm)"=100, "Comments"="", "Material"="ITO"}
                  Property Node(instance in=w17, "Value"=w19, error in=$"Error In") -> (error out=w20)
                  Property Node(instance in=w18, "Value"="Sputtering", error in=w20) -> (error out=w1)
                  Property Node(instance in="Full Layer Information.gtype" {all zero or empty}, "General Parameters:Material"="ITO", "General Parameters:Thickness (nm)"=100, "Deposition Method"="Sputtering") -> (instance out=w2)
                  w4 = FALSE
                }
              }
            }
          }
        }
        frame Default {
          call "Missing Deposition Info.gvi"(Full Layer Information In=w7, Error In=$"Error In", Deposition Method=w6) -> (Full Layer Information Out=w21, Output Prompt=w22, Layer Deposition Information Missing?=w23, Error Out=w24)
          call "Missing Solution Info.gvi"(Full Layer Information In=w21, Error In=w24, Deposition Method=w6) -> (Full Layer Information Out=w2, Output Prompt=w25, Solution Information Missing?=w26, Error Out=w27)
          call "Prompt Generator.gvi"(Deposition Method=w6, Layer Info Prompt=w22, Solution Info Prompt=w25, Error In=w27, Missing Solution Info?=w26, Missing Layer Info?=w23) -> (Proceed?=w4, Error Out=w1)
          w3 = $"Layer Controls Prompt Ref Cluster In"
        }
      }
    }
  }
  $"Layer Controls Prompt Ref Cluster Out" <- w3
  $"Proceed?" <- w4
  $"Error Out" <- w1
  $"Full Layer Information Out" <- w2
