vi "Missing Solution Info.gvi"   [LabVIEW NXG 5.0.0]
inputs:
  "Error In": error
  "Deposition Method": "Deposition Method.gtype" = "Blade Coating"
  "Full Layer Information In": "Full Layer Information.gtype"
outputs:
  "Error Out": error
  "Full Layer Information Out": "Full Layer Information.gtype"
  "Output Prompt": string
  "Solution Information Missing?": bool
types:
  "Deposition Method.gtype" = enum{"Blade Coating", "Spin Coating", "Thermal Evaporation", "E-beam Evaporation", "Sputtering", "Drop Casting", "Dip Coating", "Pulsed Laser Deposition", "Chemical Vapour Deposition", "Atomic Layer Deposition", "Spray Coating", "Screen Printing", "Electroplating", "Molecular Beam Epitaxy", "Custom Deposition"}
  "Blade Coating Parameters.gtype" = cluster{"Thickness (nm)": f64, "Blade Initial Speed (mm/s)": f64, "Speed Gradient": bool, "Blade Final Speed (mm/s)": f64, "Blade Gap (um)": f64, "Blade Temperature (ºC)": f64, "Droplet Volume (ul)": f64, "Subsequent layers": f64, "Glovebox": bool, "Comments": string}
  "Layer Type.gtype" = enum{"Front Electrode", "Electrode Transport Layer", "Active Layer", "Hole Transport Layer", "Back Electrode", "Annealing Treatment", "Encapsulation", "Custom Layer"}
  "Spin Coating Parameters.gtype" = cluster{"Thickness (nm)": f64, "Spin Speed (rpm)": f64, "Dynamic Deposition": bool, "Spin Acceleration (rpm/s)": f64, "Droplet Volume (ul)": f64, "Subsequent layers": f64, "Glovebox": bool, "Comments": string}
  "Thermal Evaporation Parameters.gtype" = cluster{"Thickness (nm)": f64, "Deposition Rate (nm/s)": f64, "Comments": string, "Sample Rotation": bool, "Material": string}
  "Solution Information.gtype" = cluster{"Concentration (mg/ml)": f64, "Stirring Time (kr)": f64, "Glovebox": bool, "Composition Array": cluster{"Material": string, "Ratio": f64}[], "Solvent Array": cluster{"Solvent": string, "Ratio": f64}[], "Solution Preparation Date": f64, "Comments": string}
  "General Parameters.gtype" = cluster{"Thickness (nm)": f64, "Comments": string, "Material": string}
  "Useless Cluster.gtype" = cluster{"Blade Coating Information": bool, "General Information": bool, "Solution Information": bool, "Spin Coating Information": bool, "Thermal Evaporation Information": bool}
  "Full Layer Information.gtype" = cluster{"Blade Coating Parameters": "Blade Coating Parameters.gtype", "Deposition Method": "Deposition Method.gtype", "Layer Type": "Layer Type.gtype", "Spin Coating Parameters": "Spin Coating Parameters.gtype", "Thermal Evaporation Parameters": "Thermal Evaporation Parameters.gtype", "Solution Information": "Solution Information.gtype", "General Parameters": "General Parameters.gtype", "Current Deposition Method Information Cluster": "Useless Cluster.gtype", "Layer String ID": string}
diagram:
  # This subVI Adds a string saying that there is solution information missing in case there is
  case ($"Error In") {
    frame Error, Default {
      w1 = $"Error In"
      w2 = $"Full Layer Information In"
      w3 = default
      w4 = default
    }
    frame No Error {
      case ($"Deposition Method") {
        frame "Blade Coating", Default {
          Property Node(instance in=$"Full Layer Information In") -> ("Solution Information:Composition Array"=w5, "Solution Information:Solvent Array"=w6, "Solution Information:Concentration (mg/ml)"=w7, instance out=w2)
          Is Empty Array(array=w5) -> w8
          Concatenate Strings("The composition array is Empty!", "\r\n") -> w9
          Select(s=w8, t=w9, f="") -> w10
          Is Empty Array(array=w6) -> w11
          Concatenate Strings("The solvent array is Empty!", "\r\n") -> w12
          Select(s=w11, t=w12, f="") -> w13
          Is Equal To 0(x=w7) -> w14
          Concatenate Strings("The concentration is 0!", "\r\n") -> w15
          Select(s=w14, t=w15, f="") -> w16
          Concatenate Strings(w10, w13, w16) -> w17
          Concatenate Strings("I'm missing some solution information:", "\r\n", w17) -> w3
          Logical Or(w8, w11, w14) -> w4
        }
        frame "Spin Coating" {
          Property Node(instance in=$"Full Layer Information In") -> ("Solution Information:Composition Array"=w18, "Solution Information:Solvent Array"=w19, "Solution Information:Concentration (mg/ml)"=w20, instance out=w2)
          Is Empty Array(array=w18) -> w21
          Concatenate Strings("The composition array is Empty!", "\r\n") -> w22
          Select(s=w21, t=w22, f="") -> w23
          Is Empty Array(array=w19) -> w24
          Concatenate Strings("The solvent array is Empty!", "\r\n") -> w25
          Select(s=w24, t=w25, f="") -> w26
          Is Equal To 0(x=w20) -> w27
          Concatenate Strings("The concentration is 0!", "\r\n") -> w28
          Select(s=w27, t=w28, f="") -> w29
          Concatenate Strings(w23, w26, w29) -> w30
          Concatenate Strings("I'm missing some solution information:", "\r\n", w30) -> w3
          Logical Or(w21, w24, w27) -> w4
        }
        frame "Thermal Evaporation" {
          w2 = $"Full Layer Information In"
          w3 = default
          w4 = default
        }
        frame "E-beam Evaporation" {
          w2 = $"Full Layer Information In"
          w3 = default
          w4 = default
        }
        frame "Sputtering" {
          w2 = $"Full Layer Information In"
          w3 = default
          w4 = default
        }
        frame "Drop Casting" {
          Property Node(instance in=$"Full Layer Information In") -> ("Solution Information:Composition Array"=w31, "Solution Information:Solvent Array"=w32, "Solution Information:Concentration (mg/ml)"=w33, instance out=w2)
          Is Empty Array(array=w31) -> w34
          Concatenate Strings("The composition array is Empty!", "\r\n") -> w35
          Select(s=w34, t=w35, f="") -> w36
          Is Empty Array(array=w32) -> w37
          Concatenate Strings("The solvent array is Empty!", "\r\n") -> w38
          Select(s=w37, t=w38, f="") -> w39
          Is Equal To 0(x=w33) -> w40
          Concatenate Strings("The concentration is 0!", "\r\n") -> w41
          Select(s=w40, t=w41, f="") -> w42
          Concatenate Strings(w36, w39, w42) -> w43
          Concatenate Strings("I'm missing some solution information:", "\r\n", w43) -> w3
          Logical Or(w34, w37, w40) -> w4
        }
        frame "Dip Coating" {
          Property Node(instance in=$"Full Layer Information In") -> ("Solution Information:Composition Array"=w44, "Solution Information:Solvent Array"=w45, "Solution Information:Concentration (mg/ml)"=w46, instance out=w2)
          Is Empty Array(array=w44) -> w47
          Concatenate Strings("The composition array is Empty!", "\r\n") -> w48
          Select(s=w47, t=w48, f="") -> w49
          Is Empty Array(array=w45) -> w50
          Concatenate Strings("The solvent array is Empty!", "\r\n") -> w51
          Select(s=w50, t=w51, f="") -> w52
          Is Equal To 0(x=w46) -> w53
          Concatenate Strings("The concentration is 0!", "\r\n") -> w54
          Select(s=w53, t=w54, f="") -> w55
          Concatenate Strings(w49, w52, w55) -> w56
          Concatenate Strings("I'm missing some solution information:", "\r\n", w56) -> w3
          Logical Or(w47, w50, w53) -> w4
        }
        frame "Pulsed Laser Deposition" {
          w2 = $"Full Layer Information In"
          w3 = default
          w4 = default
        }
        frame "Chemical Vapour Deposition" {
          w2 = $"Full Layer Information In"
          w3 = default
          w4 = default
        }
        frame "Atomic Layer Deposition" {
          w2 = $"Full Layer Information In"
          w3 = default
          w4 = default
        }
        frame "Spray Coating" {
          Property Node(instance in=$"Full Layer Information In") -> ("Solution Information:Composition Array"=w57, "Solution Information:Solvent Array"=w58, "Solution Information:Concentration (mg/ml)"=w59, instance out=w2)
          Is Empty Array(array=w57) -> w60
          Concatenate Strings("The composition array is Empty!", "\r\n") -> w61
          Select(s=w60, t=w61, f="") -> w62
          Is Empty Array(array=w58) -> w63
          Concatenate Strings("The solvent array is Empty!", "\r\n") -> w64
          Select(s=w63, t=w64, f="") -> w65
          Is Equal To 0(x=w59) -> w66
          Concatenate Strings("The concentration is 0!", "\r\n") -> w67
          Select(s=w66, t=w67, f="") -> w68
          Concatenate Strings(w62, w65, w68) -> w69
          Concatenate Strings("I'm missing some solution information:", "\r\n", w69) -> w3
          Logical Or(w60, w63, w66) -> w4
        }
        frame "Screen Printing" {
          Property Node(instance in=$"Full Layer Information In") -> ("Solution Information:Composition Array"=w70, "Solution Information:Solvent Array"=w71, "Solution Information:Concentration (mg/ml)"=w72, instance out=w2)
          Is Empty Array(array=w70) -> w73
          Concatenate Strings("The composition array is Empty!", "\r\n") -> w74
          Select(s=w73, t=w74, f="") -> w75
          Is Empty Array(array=w71) -> w76
          Concatenate Strings("The solvent array is Empty!", "\r\n") -> w77
          Select(s=w76, t=w77, f="") -> w78
          Is Equal To 0(x=w72) -> w79
          Concatenate Strings("The concentration is 0!", "\r\n") -> w80
          Select(s=w79, t=w80, f="") -> w81
          Concatenate Strings(w75, w78, w81) -> w82
          Concatenate Strings("I'm missing some solution information:", "\r\n", w82) -> w3
          Logical Or(w73, w76, w79) -> w4
        }
        frame "Electroplating" {
          w2 = $"Full Layer Information In"
          w3 = default
          w4 = default
        }
        frame "Molecular Beam Epitaxy" {
          w2 = $"Full Layer Information In"
          w3 = default
          w4 = default
        }
        frame "Custom Deposition" {
          Property Node(instance in=$"Full Layer Information In") -> ("Solution Information:Composition Array"=w83, "Solution Information:Solvent Array"=w84, "Solution Information:Concentration (mg/ml)"=w85, instance out=w2)
          Is Empty Array(array=w83) -> w86
          Concatenate Strings("The composition array is Empty!", "\r\n") -> w87
          Select(s=w86, t=w87, f="") -> w88
          Is Empty Array(array=w84) -> w89
          Concatenate Strings("The solvent array is Empty!", "\r\n") -> w90
          Select(s=w89, t=w90, f="") -> w91
          Is Equal To 0(x=w85) -> w92
          Concatenate Strings("The concentration is 0!", "\r\n") -> w93
          Select(s=w92, t=w93, f="") -> w94
          Concatenate Strings(w88, w91, w94) -> w95
          Concatenate Strings("I'm missing some solution information:", "\r\n", w95) -> w3
          Logical Or(w86, w89, w92) -> w4
        }
      }
      w1 = $"Error In"
    }
  }
  $"Error Out" <- w1
  $"Full Layer Information Out" <- w2
  $"Output Prompt" <- w3
  $"Solution Information Missing?" <- w4
