vi "Prompt Generator.gvi"   [LabVIEW NXG 5.0.0]
inputs:
  "Error In": error
  "Missing Solution Info?": bool
  "Missing Layer Info?": bool
  "Deposition Method": "Deposition Method.gtype" = "Blade Coating"
  "Layer Info Prompt": string
  "Solution Info Prompt": string
outputs:
  "Error Out": error
  "Proceed?": bool
types:
  "Deposition Method.gtype" = enum{"Blade Coating", "Spin Coating", "Thermal Evaporation", "E-beam Evaporation", "Sputtering", "Drop Casting", "Dip Coating", "Pulsed Laser Deposition", "Chemical Vapour Deposition", "Atomic Layer Deposition", "Spray Coating", "Screen Printing", "Electroplating", "Molecular Beam Epitaxy", "Custom Deposition"}
diagram:
  # This SubVI Prompts the user in case some of the
  # flags is True, because that means there'll be missing
  # information.
  case ($"Error In") {
    frame Error, Default {
      w1 = $"Error In"
      w2 = default
    }
    frame No Error {
      Logical Or($"Missing Solution Info?", $"Missing Layer Info?") -> w3
      Format Into String(initString="You have selected ", errIn=$"Error In", $"Deposition Method") -> (outString=w4, errOut=w1)
      Concatenate Strings(w4, " as your deposition Method.") -> w5
      Concatenate Strings("\r\n", $"Solution Info Prompt") -> w6
      Select(s=$"Missing Solution Info?", t=w6, f="") -> w7
      Concatenate Strings("\r\n", $"Layer Info Prompt") -> w8
      Select(s=$"Missing Layer Info?", t=w8, f="") -> w9
      Concatenate Strings(w5, w7, w9) -> w10
      case (w3) {
        frame False, Default {
          w2 = TRUE
        }
        frame True {
          Two Button Dialog(F button name ("Cancel")="Oh no please, let me\nadd the missing info", T button name ("OK")="Yes, I do not want\nto add any information!", message=w10) -> (T Button?=w2)
        }
      }
    }
  }
  $"Error Out" <- w1
  $"Proceed?" <- w2
