vi "Reset Unwanted Values.gvi"   [LabVIEW NXG 5.0.0]
inputs:
  "Error In": error
  "Full Layer Information In": "Full Layer Information.gtype"
  "Reset All?": bool
outputs:
  "Error Out": error
  "Full Layer Information Out": "Full Layer Information.gtype"
types:
  "Blade Coating Parameters.gtype" = cluster{"Thickness (nm)": f64, "Blade Initial Speed (mm/s)": f64, "Speed Gradient": bool, "Blade Final Speed (mm/s)": f64, "Blade Gap (um)": f64, "Blade Temperature (ºC)": f64, "Droplet Volume (ul)": f64, "Subsequent layers": f64, "Glovebox": bool, "Comments": string}
  "Deposition Method.gtype" = enum{"Blade Coating", "Spin Coating", "Thermal Evaporation", "E-beam Evaporation", "Sputtering", "Drop Casting", "Dip Coating", "Pulsed Laser Deposition", "Chemical Vapour Deposition", "Atomic Layer Deposition", "Spray Coating", "Screen Printing", "Electroplating", "Molecular Beam Epitaxy", "Custom Deposition"}
  "Layer Type.gtype" = enum{"Front Electrode", "Electrode Transport Layer", "Active Layer", "Hole Transport Layer", "Back Electrode", "Annealing Treatment", "Encapsulation", "Custom Layer"}
  "Spin Coating Parameters.gtype" = cluster{"Thickness (nm)": f64, "Spin Speed (rpm)": f64, "Dynamic Deposition": bool, "Spin Acceleration (rpm/s)": f64, "Droplet Volume (ul)": f64, "Subsequent layers": f64, "Glovebox": bool, "Comments": string}
  "Thermal Evaporation Parameters.gtype" = cluster{"Thickness (nm)": f64, "Deposition Rate (nm/s)": f64, "Comments": string, "Sample Rotation": bool, "Material": string}
  "Solution Information.gtype" = cluster{"Concentration (mg/ml)": f64, "Stirring Time (kr)": f64, "Glovebox": bool, "Composition Array": cluster{"Material": string, "Ratio": f64}[], "Solvent Array": cluster{"Solvent": string, "Ratio": f64}[], "Solution Preparation Date": f64, "Comments": string}
  "General Parameters.gtype" = cluster{"Thickness (nm)": f64, "Comments": string, "Material": string}
  "Useless Cluster.gtype" = cluster{"Blade Coating Information": bool, "General Information": bool, "Solution Information": bool, "Spin Coating Information": bool, "Thermal Evaporation Information": bool}
  "Full Layer Information.gtype" = cluster{"Blade Coating Parameters": "Blade Coating Parameters.gtype", "Deposition Method": "Deposition Method.gtype", "Layer Type": "Layer Type.gtype", "Spin Coating Parameters": "Spin Coating Parameters.gtype", "Thermal Evaporation Parameters": "Thermal Evaporation Parameters.gtype", "Solution Information": "Solution Information.gtype", "General Parameters": "General Parameters.gtype", "Current Deposition Method Information Cluster": "Useless Cluster.gtype", "Layer String ID": string}
diagram:
  # This SubVI Resets either the unwanted values that might have been left by jumping through different deposition methods
  # or it simply erases all layer information when requested.
  case ($"Error In") {
    frame Error, Default {
      w1 = $"Error In"
      w2 = $"Full Layer Information In"
    }
    frame No Error {
      case ($"Reset All?") {
        frame True {
          Property Node(instance in=$"Full Layer Information In", "Blade Coating Parameters"="Blade Coating Parameters.gtype" {all zero or empty}, "Deposition Method"="Blade Coating", "Layer Type"="Front Electrode", "Spin Coating Parameters"="Spin Coating Parameters.gtype" {all zero or empty}, "Thermal Evaporation Parameters"="Thermal Evaporation Parameters.gtype" {all zero or empty}, "Solution Information"="Solution Information.gtype" {all zero or empty}, "General Parameters"="General Parameters.gtype" {all zero or empty}, "Current Deposition Method Information Cluster"="Useless Cluster.gtype" {all zero or empty}, "Layer String ID"="") -> (instance out=w2)
        }
        frame False {
          Property Node(instance in=$"Full Layer Information In") -> ("Deposition Method"=w3, instance out=w4)
          case (w3) {
            frame "Spin Coating" {
              Property Node(instance in=w4, "Blade Coating Parameters"="Blade Coating Parameters.gtype" {all zero or empty}, "Thermal Evaporation Parameters"="Thermal Evaporation Parameters.gtype" {all zero or empty}, "General Parameters"="General Parameters.gtype" {all zero or empty}) -> (instance out=w2)
            }
            frame "Thermal Evaporation" {
              Property Node(instance in=w4, "Blade Coating Parameters"="Blade Coating Parameters.gtype" {all zero or empty}, "Spin Coating Parameters"="Spin Coating Parameters.gtype" {all zero or empty}, "Solution Information"="Solution Information.gtype" {all zero or empty}, "General Parameters"="General Parameters.gtype" {all zero or empty}) -> (instance out=w2)
            }
            frame "E-beam Evaporation" {
              Property Node(instance in=w4, "Blade Coating Parameters"="Blade Coating Parameters.gtype" {all zero or empty}, "Spin Coating Parameters"="Spin Coating Parameters.gtype" {all zero or empty}, "Thermal Evaporation Parameters"="Thermal Evaporation Parameters.gtype" {all zero or empty}, "Solution Information"="Solution Information.gtype" {all zero or empty}) -> (instance out=w2)
            }
            frame "Sputtering" {
              Property Node(instance in=w4, "Blade Coating Parameters"="Blade Coating Parameters.gtype" {all zero or empty}, "Spin Coating Parameters"="Spin Coating Parameters.gtype" {all zero or empty}, "Thermal Evaporation Parameters"="Thermal Evaporation Parameters.gtype" {all zero or empty}, "Solution Information"="Solution Information.gtype" {all zero or empty}) -> (instance out=w2)
            }
            frame "Drop Casting" {
              Property Node(instance in=w4, "Blade Coating Parameters"="Blade Coating Parameters.gtype" {all zero or empty}, "Spin Coating Parameters"="Spin Coating Parameters.gtype" {all zero or empty}, "Thermal Evaporation Parameters"="Thermal Evaporation Parameters.gtype" {all zero or empty}) -> (instance out=w2)
            }
            frame "Dip Coating" {
              Property Node(instance in=w4, "Blade Coating Parameters"="Blade Coating Parameters.gtype" {all zero or empty}, "Spin Coating Parameters"="Spin Coating Parameters.gtype" {all zero or empty}, "Thermal Evaporation Parameters"="Thermal Evaporation Parameters.gtype" {all zero or empty}) -> (instance out=w2)
            }
            frame "Pulsed Laser Deposition" {
              Property Node(instance in=w4, "Blade Coating Parameters"="Blade Coating Parameters.gtype" {all zero or empty}, "Spin Coating Parameters"="Spin Coating Parameters.gtype" {all zero or empty}, "Thermal Evaporation Parameters"="Thermal Evaporation Parameters.gtype" {all zero or empty}, "Solution Information"="Solution Information.gtype" {all zero or empty}) -> (instance out=w2)
            }
            frame "Chemical Vapour Deposition" {
              Property Node(instance in=w4, "Blade Coating Parameters"="Blade Coating Parameters.gtype" {all zero or empty}, "Spin Coating Parameters"="Spin Coating Parameters.gtype" {all zero or empty}, "Thermal Evaporation Parameters"="Thermal Evaporation Parameters.gtype" {all zero or empty}, "Solution Information"="Solution Information.gtype" {all zero or empty}) -> (instance out=w2)
            }
            frame "Atomic Layer Deposition" {
              Property Node(instance in=w4, "Blade Coating Parameters"="Blade Coating Parameters.gtype" {all zero or empty}, "Spin Coating Parameters"="Spin Coating Parameters.gtype" {all zero or empty}, "Thermal Evaporation Parameters"="Thermal Evaporation Parameters.gtype" {all zero or empty}, "Solution Information"="Solution Information.gtype" {all zero or empty}) -> (instance out=w2)
            }
            frame "Spray Coating" {
              Property Node(instance in=w4, "Blade Coating Parameters"="Blade Coating Parameters.gtype" {all zero or empty}, "Spin Coating Parameters"="Spin Coating Parameters.gtype" {all zero or empty}, "Thermal Evaporation Parameters"="Thermal Evaporation Parameters.gtype" {all zero or empty}) -> (instance out=w2)
            }
            frame "Screen Printing" {
              Property Node(instance in=w4, "Blade Coating Parameters"="Blade Coating Parameters.gtype" {all zero or empty}, "Spin Coating Parameters"="Spin Coating Parameters.gtype" {all zero or empty}, "Thermal Evaporation Parameters"="Thermal Evaporation Parameters.gtype" {all zero or empty}) -> (instance out=w2)
            }
            frame "Electroplating" {
              Property Node(instance in=w4, "Blade Coating Parameters"="Blade Coating Parameters.gtype" {all zero or empty}, "Spin Coating Parameters"="Spin Coating Parameters.gtype" {all zero or empty}, "Thermal Evaporation Parameters"="Thermal Evaporation Parameters.gtype" {all zero or empty}, "Solution Information"="Solution Information.gtype" {all zero or empty}) -> (instance out=w2)
            }
            frame "Molecular Beam Epitaxy" {
              Property Node(instance in=w4, "Blade Coating Parameters"="Blade Coating Parameters.gtype" {all zero or empty}, "Spin Coating Parameters"="Spin Coating Parameters.gtype" {all zero or empty}, "Thermal Evaporation Parameters"="Thermal Evaporation Parameters.gtype" {all zero or empty}, "Solution Information"="Solution Information.gtype" {all zero or empty}) -> (instance out=w2)
            }
            frame "Custom Deposition" {
              Property Node(instance in=w4, "Blade Coating Parameters"="Blade Coating Parameters.gtype" {all zero or empty}, "Spin Coating Parameters"="Spin Coating Parameters.gtype" {all zero or empty}, "Thermal Evaporation Parameters"="Thermal Evaporation Parameters.gtype" {all zero or empty}) -> (instance out=w2)
            }
            frame "Blade Coating" {
              Property Node(instance in=w4, "Spin Coating Parameters"="Spin Coating Parameters.gtype" {all zero or empty}, "Thermal Evaporation Parameters"="Thermal Evaporation Parameters.gtype" {all zero or empty}, "General Parameters"="General Parameters.gtype" {all zero or empty}) -> (instance out=w2)
            }
          }
        }
      }
      w1 = $"Error In"
    }
  }
  $"Error Out" <- w1
  $"Full Layer Information Out" <- w2
