vi "Solution Arrays to String.gvi"   [LabVIEW NXG 5.0.0]
inputs:
  "Error In": error
  "Solution Information:Composition Array In": cluster{"Material": string, "Ratio": f64}[]
  "Solution Information:Solvent Array In": cluster{"Solvent": string, "Ratio": f64}[]
outputs:
  "Error Out": error
  "Solvent Information String Out": string
  "Composition Information String Out": string
diagram:
  case ($"Error In") {
    frame Error, Default {
      w1 = $"Error In"
      w2 = default
      w3 = default
    }
    frame No Error {
      s1 = ""  # shift register
      for {
        w4 = each element of $"Solution Information:Composition Array In"
        Property Node(instance in=w4) -> ("Material"=w5, "Ratio"=w6)
        Number To Fractional String(number=w6, use system decimal point (T)=FALSE) -> (F-format string=w7)
        Concatenate Strings(s1, w5, "\t", w7, "\r\n") -> w8
        next s1 = w8
      }
      s2 = ""  # shift register
      for {
        w9 = each element of $"Solution Information:Solvent Array In"
        Property Node(instance in=w9) -> ("Solvent"=w10, "Ratio"=w11)
        Number To Fractional String(number=w11, use system decimal point (T)=FALSE) -> (F-format string=w12)
        Concatenate Strings(s2, w10, "\t", w12, "\r\n") -> w13
        next s2 = w13
      }
      w1 = $"Error In"
      w2 = s2
      w3 = s1
    }
  }
  $"Error Out" <- w1
  $"Composition Information String Out" <- w3
  $"Solvent Information String Out" <- w2
