vi "Format Material.gvi"   [LabVIEW NXG 5.0.0]
inputs:
  "Error In": error
  "Composition Array": cluster{"Material": string, "Ratio": f64}[]
  "Solvent Array": cluster{"Solvent": string, "Ratio": f64}[]
outputs:
  "Error Out": error
  "Material String Descriptor": string
uses:
  Pika IV Characterization NXG::Side Functions::Utilities::Fractional String Trim 0.gvi
diagram:
  # This SubVI Formats the materials with their ratios so that they fit into the solution descriptor
  # nicely.
  case ($"Error In") {
    frame Error, Default {
      w1 = $"Error In"
      w2 = default
    }
    frame No Error {
      Is Empty Array(array=$"Composition Array") -> w3
      Is Empty Array(array=$"Solvent Array") -> w4
      case (w3) {
        frame True {
          w2 = default
        }
        frame False {
          Array Size(array=$"Composition Array") -> (size(s)=w5)
          Is Greater(x=w5, y=1) -> w6
          case (w6) {
            frame False, Default {
              Select(s=w4, t=" ", f="") -> w7
              Array Index(array=$"Composition Array") -> (out0[0]=w8)
              Property Node(instance in=w8) -> ("Material"=w9)
              Concatenate Strings(w9, w7) -> w2
            }
            frame True {
              s1 = ""  # shift register
              s2 = ""  # shift register
              for {
                w10 = each element of $"Composition Array"
                Property Node(instance in=w10) -> ("Material"=w11, "Ratio"=w12)
                Is Empty String Or Path(string/path=s1) -> w13
                Select(s=w13, t="", f=":") -> w14
                Concatenate Strings(s1, w14, w11) -> w15
                Is Empty String Or Path(string/path=s2) -> w16
                Select(s=w16, t="", f=":") -> w17
                Number To Fractional String(number=w12, use system decimal point (T)=FALSE) -> (F-format string=w18)
                call "Fractional String Trim 0.gvi"(String with trailing 0=w18) -> (String Without 0=w19)
                Concatenate Strings(s2, w17, w19) -> w20
                next s1 = w15
                next s2 = w20
              }
              Select(s=w4, t=" ", f="") -> w21
              Concatenate Strings(s1, " ", s2, w21) -> w2
            }
          }
        }
      }
      w1 = $"Error In"
    }
  }
  $"Error Out" <- w1
  $"Material String Descriptor" <- w2
