vi "Format Solvent.gvi"   [LabVIEW NXG 5.0.0]
inputs:
  "Error In": error
  "Solvent Array": cluster{"Solvent": string, "Ratio": f64}[]
outputs:
  "Error Out": error
  "Formatted Solvent Descriptor": string
uses:
  Pika IV Characterization NXG::Side Functions::Utilities::Fractional String Trim 0.gvi
diagram:
  # This SubVI Formats the solvents with their ratios so that they fit into the solution descriptor
  # nicely.
  case ($"Error In") {
    frame Error, Default {
      w1 = $"Error In"
      w2 = default
    }
    frame No Error {
      Is Empty Array(array=$"Solvent Array") -> w3
      case (w3) {
        frame True {
          w2 = default
        }
        frame False {
          Array Size(array=$"Solvent Array") -> (size(s)=w4)
          Is Greater(x=w4, y=1) -> w5
          case (w5) {
            frame False, Default {
              Array Index(array=$"Solvent Array") -> (out0[0]=w6)
              Property Node(instance in=w6) -> ("Solvent"=w2)
            }
            frame True {
              s1 = ""  # shift register
              s2 = ""  # shift register
              for {
                w7 = each element of $"Solvent Array"
                Property Node(instance in=w7) -> ("Solvent"=w8, "Ratio"=w9)
                Is Empty String Or Path(string/path=s1) -> w10
                Select(s=w10, t="", f=":") -> w11
                Concatenate Strings(s1, w11, w8) -> w12
                Is Empty String Or Path(string/path=s2) -> w13
                Select(s=w13, t="", f=":") -> w14
                Number To Fractional String(number=w9, use system decimal point (T)=FALSE) -> (F-format string=w15)
                call "Fractional String Trim 0.gvi"(String with trailing 0=w15) -> (String Without 0=w16)
                Concatenate Strings(s2, w14, w16) -> w17
                next s1 = w12
                next s2 = w17
              }
              Concatenate Strings(s1, " ", s2) -> w2
            }
          }
        }
      }
      w1 = $"Error In"
    }
  }
  $"Error Out" <- w1
  $"Formatted Solvent Descriptor" <- w2
