vi "Solution Descriptor Update.gvi"   [LabVIEW NXG 5.0.0]
inputs:
  "Error In": error
  "Full Layer Information In": "Full Layer Information.gtype"
  "Layer Controls Prompt Ref Cluster In": "Layer Controls Prompt Ref Cluster.gtype"
outputs:
  "Error Out": error
  "Full Layer Information Out": "Full Layer Information.gtype"
  "Layer Controls Prompt Ref Cluster Out": "Layer Controls Prompt Ref Cluster.gtype"
types:
  "Blade Coating Parameters.gtype" = cluster{"Thickness (nm)": f64, "Blade Initial Speed (mm/s)": f64, "Speed Gradient": bool, "Blade Final Speed (mm/s)": f64, "Blade Gap (um)": f64, "Blade Temperature (ºC)": f64, "Droplet Volume (ul)": f64, "Subsequent layers": f64, "Glovebox": bool, "Comments": string}
  "Deposition Method.gtype" = enum{"Blade Coating", "Spin Coating", "Thermal Evaporation", "E-beam Evaporation", "Sputtering", "Drop Casting", "Dip Coating", "Pulsed Laser Deposition", "Chemical Vapour Deposition", "Atomic Layer Deposition", "Spray Coating", "Screen Printing", "Electroplating", "Molecular Beam Epitaxy", "Custom Deposition"}
  "Layer Type.gtype" = enum{"Front Electrode", "Electron Transport Layer", "Active Layer", "Hole Transport Layer", "Back Electrode", "Custom Layer"}
  "Spin Coating Parameters.gtype" = cluster{"Thickness (nm)": f64, "Spin Speed (rpm)": f64, "Dynamic Deposition": bool, "Spin Acceleration (rpm/s)": f64, "Droplet Volume (ul)": f64, "Subsequent layers": f64, "Glovebox": bool, "Comments": string, "Spin Time (s)": f64}
  "Thermal Evaporation Parameters.gtype" = cluster{"Thickness (nm)": f64, "Deposition Rate (nm/s)": f64, "Comments": string, "Sample Rotation": bool, "Material": string}
  "Solution Information.gtype" = cluster{"Concentration (mg/ml)": f64, "Stir Time (kr)": f64, "Composition Array": cluster{"Material": string, "Ratio": f64}[], "Solvent Array": cluster{"Solvent": string, "Ratio": f64}[], "Solution Preparation Date": string, "Comments": string, "Stir Temp (ºC)": f64, "Glovebox": bool, "Solution Label": string, "Solution Descriptor": string, "Volume (ul)": f64}
  "General Parameters.gtype" = cluster{"Thickness (nm)": f64, "Comments": string, "Material": string}
  "Useless Cluster.gtype" = cluster{"Blade Coating Information": bool, "General Information": bool, "Solution Information": bool, "Spin Coating Information": bool, "Thermal Evaporation Information": bool}
  "Full Layer Information.gtype" = cluster{"Blade Coating Parameters": "Blade Coating Parameters.gtype", "Deposition Method": "Deposition Method.gtype", "Layer Type": "Layer Type.gtype", "Spin Coating Parameters": "Spin Coating Parameters.gtype", "Thermal Evaporation Parameters": "Thermal Evaporation Parameters.gtype", "Solution Information": "Solution Information.gtype", "General Parameters": "General Parameters.gtype", "Current Deposition Method Information Cluster": "Useless Cluster.gtype", "Layer String ID": string}
  "Layer Controls Prompt Ref Cluster.gtype" = cluster{"Add Layer Button Ref": "BooleanControl reference", "This VI Ref": VIRefnum, "Blade Coating Parameters Ref": "Cluster reference", "Deposition Method Ref": "EnumSelector reference", "General Parameters Ref": "Cluster reference", "Layer Type ref": "EnumSelector reference", "Solution Information Ref": "Cluster reference", "Spin Coating Parameters Ref": "Cluster reference", "Thermal Evaporation Parameters Ref": "Cluster reference", "Load Layer File Ref": "BooleanControl reference", "Save Layer File Ref": "BooleanControl reference", "Layer To Edit Ref": "RingSelectorInt32 reference"}
uses:
  Pika IV Characterization NXG::Main Functions::Layer Composition::Data Management::Solution Descriptor::Format Material.gvi
  Pika IV Characterization NXG::Main Functions::Layer Composition::Data Management::Solution Descriptor::Format Solvent.gvi
  Pika IV Characterization NXG::Side Functions::Utilities::Fractional String Trim 0.gvi
diagram:
  # This SubVI Takes the solution information and creates a solution descriptor that more or less defines what is in the solution to better identify it.
  case ($"Error In") {
    frame Error, Default {
      w1 = $"Error In"
      w2 = $"Full Layer Information In"
      w3 = $"Layer Controls Prompt Ref Cluster In"
    }
    frame No Error {
      Property Node(instance in=$"Layer Controls Prompt Ref Cluster In") -> ("Solution Information Ref"=w4, instance out=w3)
      Property Node(instance in=w4, error in=$"Error In") -> ("Value"=w5, error out=w6, instance out=w7)
      Property Node(instance in=$"Full Layer Information In") -> ("Solution Information:Composition Array"=w8, "Solution Information:Concentration (mg/ml)"=w9, "Solution Information:Solvent Array"=w10, instance out=w2)
      call "Format Material.gvi"(Composition Array=w8, Solvent Array=w10, Error In=w6) -> (Material String Descriptor=w11, Error Out=w12)
      call "Format Solvent.gvi"(Solvent Array=w10, Error In=w12) -> (Formatted Solvent Descriptor=w13, Error Out=w14)
      Is Not Equal To 0(x=w9) -> w15
      case (w15) {
        frame False, Default {
          w16 = default
        }
        frame True {
          Number To Fractional String(number=w9, use system decimal point (T)=FALSE) -> (F-format string=w17)
          call "Fractional String Trim 0.gvi"(String with trailing 0=w17) -> (String Without 0=w18)
          Concatenate Strings(w18, " mg/ml ") -> w16
        }
      }
      Concatenate Strings(w11, w16, w13) -> w19
      Property Node(instance in=w5, "Solution Descriptor"=w19) -> (instance out=w20)
      Property Node(instance in=w7, "Value"=w20, error in=w14) -> (error out=w1)
    }
  }
  $"Layer Controls Prompt Ref Cluster Out" <- w3
  $"Error Out" <- w1
  $"Full Layer Information Out" <- w2
