vi "String to Solution Arrays.gvi"   [LabVIEW NXG 5.0.0]
inputs:
  "Error In": error
  "Solvent String": string = "Chlorobenzene\t1.000000\r\nDichlorobenzene\t0.500000\r\n"
  "Composition String": string = "PBTTT\t1.000000\r\nPBDBT\t2.000000\r\nITIC\t4.000000\r\nPBTTT\t4.000000\r\n"
outputs:
  "Error Out": error
  "Solvent Array Out": cluster{"Solvent": string, "Ratio": f64}[]
  "Composition Array Out": cluster{"Material": string, "Ratio": f64}[]
types:
  "Solution Information.gtype" = cluster{"Concentration (mg/ml)": f64, "Stirring Time (kr)": f64, "Glovebox": bool, "Composition Array": cluster{"Material": string, "Ratio": f64}[], "Solvent Array": cluster{"Solvent": string, "Ratio": f64}[], "Solution Preparation Date": f64, "Comments": string}
diagram:
  # This subVI Scans the input strings from the config files
  # and converts them into the propper array information
  case ($"Error In") {
    frame Error, Default {
      w1 = $"Error In"
      w2 = default
      w3 = default
    }
    frame No Error {
      Spreadsheet String To Array(array type=string[][] [], format string="%g", spreadsheet string=$"Solvent String") -> (array=w4)
      for {
        w5 = each element of w4
        Array Index(array=w5) -> (out0[0]=w6, out1[1]=w7)
        Floating Point String To Number(string=w7, use system decimal point (T)=FALSE) -> (number=w8)
        Property Node(instance in="Solution Information.gtype" {all zero or empty}) -> ("Solvent Array"=w9)
        Array Index(array=w9) -> (out0[0]=w10)
        Property Node(instance in=w10, "Solvent"=w6, "Ratio"=w8) -> (instance out=w11)
        append w11 to w3
      }
      Spreadsheet String To Array(array type=string[][] [], format string="%g", spreadsheet string=$"Composition String") -> (array=w12)
      for {
        w13 = each element of w12
        Array Index(array=w13) -> (out0[0]=w14, out1[1]=w15)
        Floating Point String To Number(string=w15, use system decimal point (T)=FALSE) -> (number=w16)
        Property Node(instance in="Solution Information.gtype" {all zero or empty}) -> ("Composition Array"=w17)
        Array Index(array=w17) -> (out0[0]=w18)
        Property Node(instance in=w18, "Material"=w14, "Ratio"=w16) -> (instance out=w19)
        append w19 to w2
      }
      w1 = $"Error In"
    }
  }
  $"Error Out" <- w1
  $"Solvent Array Out" <- w3
  $"Composition Array Out" <- w2
