vi "Default Layers Handler.gvi"   [LabVIEW NXG 5.0.0]
inputs:
  "Error In": error
  "Misc Data Mega Cluster In": "Misc Mega Cluster.gtype"
  "JV Measurements Mega Cluster In": "JV Measurements Mega Cluster.gtype"
  "Configuration File Operation": "Configuration File Operation.gtype" = "Save Configuration File"
outputs:
  "Error Out": error
  "Layer String ID Array": string[]
  "Misc Data Mega Cluster Out": "Misc Mega Cluster.gtype"
  "JV Measurements Mega Cluster Out": "JV Measurements Mega Cluster.gtype"
types:
  T1 = cluster{"State Ref": "StringControl reference", "Substate Ref": "StringControl reference", "Current State Ref": "EnumSelector reference", "Main Tab Ref": "TabControl reference", "Plot Now Flag Ref": "BooleanControl reference"}
  T2 = cluster{"Default Data Saving Location Ref": "PathSelector reference"}
  T3 = cluster{"Author Initials Ref": "ComboBoxSelector reference", "Batch Name Ref": "StringControl reference", "Cell Number Ref": "StringControl reference", "Current Date Ref": "StringControl reference", "Sample Comments Ref": "StringControl reference", "Sample Prefix Ref": "StringControl reference", "Custom Date Ref": "CheckBox reference", "Label Info Error Label Ref": "StringControl reference", "Label Info Missing Error Ref": "BooleanControl reference"}
  T4 = cluster{"Cell Parameters Ref": "Cluster reference", "Cell Selector Ref": "Cluster reference", "Measurement Precision Ref": "Cluster reference", "JV Scan Mode Ref": "EnumSelector reference"}
  T5 = cluster{"Progress % Ref": "ProgressBar reference", "Progress Counter Ref": "NumericTextBoxDouble reference", "Live JV Parameters Ref": "Cluster reference"}
  T6 = cluster{"Layer Information Ref": "ArrayViewer reference"[]}
  T7 = cluster{"Cell Selector Block Ref": "Rectangle reference", "Smart Mode Block Ref": "Rectangle reference", "dV Block Ref": "Rectangle reference", "Smart Mode Text Ref": "Text reference", "No Multiplexer Detected Text Ref": "Text reference", "Current Range Block Ref": "Rectangle reference"}
  T8 = cluster{"JV Measurements Mega Cluster Ref": "Cluster reference", "Instrument Control Mega Cluster Ref": "Cluster reference"}
  T9 = cluster{"JV Main Graph Ref": "Graph reference", "Voc Graph Ref ": "Graph reference", "Jsc Graph Ref": "Graph reference", "Efficiency Graph Ref": "Graph reference", "Fill Factor Graph Ref": "Graph reference", "Series Resistance Graph Ref": "Graph reference", "Shunt Resistance Graph Ref": "Graph reference"}
  "Full Reference Cluster.gtype" = cluster{"Status Report": T1, "Path Cluster": T2, "Sample Naming Cluster": T3, "Acquisition Parameters": T4, "Live Progress Cluster": T5, "Sample Extra Information": T6, "Visual Elements": T7, "Mega Cluster References": T8, "Plotting": T9, "System Parameters": cluster{"Main VI Ref": VIRefnum}}
  "Misc Mega Cluster.gtype" = cluster{"Full Reference Cluster": "Full Reference Cluster.gtype"}
  "Configuration File Operation.gtype" = enum{"Save Configuration File", "Load Configuration File"}
  "Cell Selector.gtype" = enum{"L.01", "L.02", "L.03", "L.04", "L.05", "L.06", "L.07", "L.08", "L.09", "L.10", "L.11", "L.12", "R.01", "R.02", "R.03", "R.04", "R.05", "R.06", "R.07", "R.08", "R.09", "R.10", "R.11", "R.12", "Custom"}
  "JV Data Cluster.gtype" = cluster{"Voltage (V)": f64[], "Current (A)": f64[], "Current Density (A/m^2)": f64[], "Cell Area (m^2)": f64, "Illumination (W/m^2)": f64, "Voc (V)": f64, "Jsc (A/m^2)": f64, "FF (%)": f64, "Rsh (Ω · m^2)": f64, "Rs (Ω · m^2)": f64, "Eff (%)": f64, "Measured Cell": "Cell Selector.gtype", "No Multiplexer": bool}
  "JV Scan Mode.gtype" = enum{"Rough", "Normal", "Accurate", "Smart", "Custom"}
  "JV Curve Parameters.gtype" = cluster{"JV Scan Mode": "JV Scan Mode.gtype", "Measurement Precision": "Accuracy Parameters.gtype", "Cell Parameters": "Cell Parameters.gtype"}
  "Deposition Method.gtype" = enum{"Blade Coating", "Spin Coating", "Thermal Evaporation", "E-beam Evaporation", "Sputtering", "Drop Casting", "Dip Coating", "Pulsed Laser Deposition", "Chemical Vapour Deposition", "Atomic Layer Deposition", "Spray Coating", "Screen Printing", "Electroplating", "Molecular Beam Epitaxy", "Custom Deposition"}
  "Layer Type.gtype" = enum{"Front Electrode", "Electrode Transport Layer", "Active Layer", "Hole Transport Layer", "Back Electrode", "Annealing Treatment", "Encapsulation", "Custom Layer"}
  "Full Layer Information.gtype" = cluster{"Blade Coating Parameters": "Blade Coating Parameters.gtype", "Deposition Method": "Deposition Method.gtype", "Layer Type": "Layer Type.gtype", "Spin Coating Parameters": "Spin Coating Parameters.gtype", "Thermal Evaporation Parameters": "Thermal Evaporation Parameters.gtype", "Solution Information": "Solution Information.gtype", "General Parameters": "General Parameters.gtype", "Current Deposition Method Information Cluster": "Useless Cluster.gtype", "Layer String ID": string}
  "JV Measurements Mega Cluster.gtype" = cluster{"Cell Array": "Cell Selector.gtype"[], "JV Full Data Array": "JV Data Cluster.gtype"[], "Cell Selector": "Cell Selector.gtype", "JV Curve Parameters": "JV Curve Parameters.gtype", "Full Layer Information Array": "Full Layer Information.gtype"[]}
uses:
  Pika IV Characterization NXG::Main Functions::Instruction Handling::FGV Current State.gvi
  Pika IV Characterization NXG::Main Functions::Layer Composition::File Management::Check Author Empty.gvi
  Pika IV Characterization NXG::Main Functions::Layer Composition::File Management::Generate Author Path.gvi
  Pika IV Characterization NXG::Main Functions::Layer Composition::File Management::Multi File Handler.gvi
  Pika IV Characterization NXG::Main Functions::Layer Composition::Data Management::Layer String Array Generator.gvi
diagram:
  # This subVI Takes care of saving and loading default layer information files
  case ($"Error In") {
    frame Error, Default {
      w1 = $"Error In"
      w2 = $"Misc Data Mega Cluster In"
      w3 = $"JV Measurements Mega Cluster In"
      w4 = default
    }
    frame No Error {
      Is Equal(x=$"Configuration File Operation", y="Save Configuration File") -> w5
      Select(s=w5, t="Set Layer Defaults", f="Load Layer Defaults") -> w6
      call "FGV Current State.gvi"(Current State Instructions="Set Current State", Current State=w6, Error In=$"Error In") -> (Error Out=w7)
      call "Check Author Empty.gvi"(Misc Data Mega Cluster In=$"Misc Data Mega Cluster In", Error In=w7) -> (Misc Data Mega Cluster Out=w2, Author Initials=w8, No Author?=w9, Error Out=w10)
      case (w9) {
        frame True {
          w11 = "I'm missing the author name so I cannot load your default layers"
          One Button Dialog(button name ("OK")="Okay, I'll make sure I write my name down", message=w11)
          w1 = w10
          w3 = $"JV Measurements Mega Cluster In"
          w4 = default
        }
        frame False {
          call "Generate Author Path.gvi"(Authors Initials=w8, Error In=w10, Defaults Folder?=TRUE) -> (Author Path=w12, Error Out=w13)
          call "Multi File Handler.gvi"(JV Measurements Mega Cluster In=$"JV Measurements Mega Cluster In", Author Default Layers Path=w12, File Operation=$"Configuration File Operation", Error In=w13, Prompt?=TRUE) -> (JV Measurements Mega Cluster Out=w14, Error Out=w15)
          call "Layer String Array Generator.gvi"(JV Measurements Mega Cluster In=w14, Error In=w15) -> (JV Measurements Mega Cluster Out=w3, Layer String ID Array=w4, Error Out=w1)
        }
      }
    }
  }
  $"Misc Data Mega Cluster Out" <- w2
  $"JV Measurements Mega Cluster Out" <- w3
  $"Layer String ID Array" <- w4
  $"Error Out" <- w1
