vi "Edit Layer Prompt.gvi"   [LabVIEW NXG 5.0.0]
inputs:
  "Error In": error
  "Misc Data Mega Cluster In": "Misc Mega Cluster.gtype"
  "JV Measurements Mega Cluster In": "JV Measurements Mega Cluster.gtype"
outputs:
  "Error Out": error
  "Misc Mega Cluster Data Out": "Misc Mega Cluster.gtype"
  "JV Measurements Mega Cluster Out": "JV Measurements Mega Cluster.gtype"
  "Cancelled?": bool
  "Layer String ID Array": string[]
panel controls:
  "Layer Type": "Layer Type.gtype" = "Front Electrode"
  "Deposition Method": "Deposition Method.gtype" = "Blade Coating"
  "Blade Coating Parameters": "Blade Coating Parameters.gtype"
  "Solution Information": "Solution Information.gtype"
  "Spin Coating Parameters": "Spin Coating Parameters.gtype"
  "Thermal Evaporation Parameters": "Thermal Evaporation Parameters.gtype"
  "General Parameters": "General Parameters.gtype"
  "Add Layer Button": bool
  "Layer Controls Prompt Ref Cluster In": "Layer Controls Prompt Ref Cluster.gtype"
  "Save Layer File": bool
  "Load Layer File": bool
  "Cancel Button": bool
  "Reset Layer Button": bool
  "Layer to Edit": i32 = "ITO  100 nm"(0)
types:
  "Layer Type.gtype" = enum{"Front Electrode", "Electron Transport Layer", "Active Layer", "Hole Transport Layer", "Back Electrode", "Custom Layer"}
  "Deposition Method.gtype" = enum{"Blade Coating", "Spin Coating", "Thermal Evaporation", "E-beam Evaporation", "Sputtering", "Drop Casting", "Dip Coating", "Pulsed Laser Deposition", "Chemical Vapour Deposition", "Atomic Layer Deposition", "Spray Coating", "Screen Printing", "Electroplating", "Molecular Beam Epitaxy", "Custom Deposition"}
  "Blade Coating Parameters.gtype" = cluster{"Thickness (nm)": f64, "Blade Initial Speed (mm/s)": f64, "Speed Gradient": bool, "Blade Final Speed (mm/s)": f64, "Blade Gap (um)": f64, "Blade Temperature (ºC)": f64, "Droplet Volume (ul)": f64, "Subsequent layers": f64, "Glovebox": bool, "Comments": string}
  "Solution Information.gtype" = cluster{"Concentration (mg/ml)": f64, "Stir Time (kr)": f64, "Composition Array": cluster{"Material": string, "Ratio": f64}[], "Solvent Array": cluster{"Solvent": string, "Ratio": f64}[], "Solution Preparation Date": string, "Comments": string, "Stir Temp (ºC)": f64, "Glovebox": bool, "Solution Label": string, "Solution Descriptor": string, "Volume (ul)": f64}
  "Spin Coating Parameters.gtype" = cluster{"Thickness (nm)": f64, "Spin Speed (rpm)": f64, "Dynamic Deposition": bool, "Spin Acceleration (rpm/s)": f64, "Droplet Volume (ul)": f64, "Subsequent layers": f64, "Glovebox": bool, "Comments": string, "Spin Time (s)": f64}
  "Thermal Evaporation Parameters.gtype" = cluster{"Thickness (nm)": f64, "Deposition Rate (nm/s)": f64, "Comments": string, "Sample Rotation": bool, "Material": string}
  "General Parameters.gtype" = cluster{"Thickness (nm)": f64, "Comments": string, "Material": string}
  T1 = cluster{"State Ref": "StringControl reference", "Substate Ref": "StringControl reference", "Current State Ref": "EnumSelector reference", "Main Tab Ref": "TabControl reference", "Plot Now Flag Ref": "BooleanControl reference"}
  T2 = cluster{"Default Data Saving Location Ref": "PathSelector reference"}
  T3 = cluster{"Author Initials Ref": "ComboBoxSelector reference", "Batch Name Ref": "StringControl reference", "Cell Number Ref": "StringControl reference", "Current Date Ref": "StringControl reference", "Sample Comments Ref": "StringControl reference", "Sample Prefix Ref": "StringControl reference", "Custom Date Ref": "CheckBox reference", "Label Info Error Label Ref": "StringControl reference", "Label Info Missing Error Ref": "BooleanControl reference"}
  T4 = cluster{"Cell Parameters Ref": "Cluster reference", "Cell Selector Ref": "Cluster reference", "Measurement Precision Ref": "Cluster reference", "JV Scan Mode Ref": "EnumSelector reference"}
  T5 = cluster{"Progress % Ref": "ProgressBar reference", "Progress Counter Ref": "NumericTextBoxDouble reference", "Live JV Parameters Ref": "Cluster reference"}
  T6 = cluster{"Layer Information Ref": "ArrayViewer reference"[]}
  T7 = cluster{"Cell Selector Block Ref": "Rectangle reference", "Smart Mode Block Ref": "Rectangle reference", "dV Block Ref": "Rectangle reference", "Smart Mode Text Ref": "Text reference", "No Multiplexer Detected Text Ref": "Text reference", "Current Range Block Ref": "Rectangle reference"}
  T8 = cluster{"JV Measurements Mega Cluster Ref": "Cluster reference", "Instrument Control Mega Cluster Ref": "Cluster reference"}
  T9 = cluster{"JV Main Graph Ref": "Graph reference", "Voc Graph Ref ": "Graph reference", "Jsc Graph Ref": "Graph reference", "Efficiency Graph Ref": "Graph reference", "Fill Factor Graph Ref": "Graph reference", "Series Resistance Graph Ref": "Graph reference", "Shunt Resistance Graph Ref": "Graph reference"}
  "Full Reference Cluster.gtype" = cluster{"Status Report": T1, "Path Cluster": T2, "Sample Naming Cluster": T3, "Acquisition Parameters": T4, "Live Progress Cluster": T5, "Sample Extra Information": T6, "Visual Elements": T7, "Mega Cluster References": T8, "Plotting": T9, "System Parameters": cluster{"Main VI Ref": VIRefnum}}
  "Misc Mega Cluster.gtype" = cluster{"Full Reference Cluster": "Full Reference Cluster.gtype"}
  "Layer Controls Prompt Ref Cluster.gtype" = cluster{"Add Layer Button Ref": "BooleanControl reference", "This VI Ref": VIRefnum, "Blade Coating Parameters Ref": "Cluster reference", "Deposition Method Ref": "EnumSelector reference", "General Parameters Ref": "Cluster reference", "Layer Type ref": "EnumSelector reference", "Solution Information Ref": "Cluster reference", "Spin Coating Parameters Ref": "Cluster reference", "Thermal Evaporation Parameters Ref": "Cluster reference", "Load Layer File Ref": "BooleanControl reference", "Save Layer File Ref": "BooleanControl reference", "Layer To Edit Ref": "RingSelectorInt32 reference"}
  "Cell Selector.gtype" = enum{"L.01", "L.02", "L.03", "L.04", "L.05", "L.06", "L.07", "L.08", "L.09", "L.10", "L.11", "L.12", "R.01", "R.02", "R.03", "R.04", "R.05", "R.06", "R.07", "R.08", "R.09", "R.10", "R.11", "R.12", "Custom"}
  "JV Data Cluster.gtype" = cluster{"Voltage (V)": f64[], "Current (A)": f64[], "Current Density (A/m^2)": f64[], "Cell Area (m^2)": f64, "Illumination (W/m^2)": f64, "Voc (V)": f64, "Jsc (A/m^2)": f64, "FF (%)": f64, "Rsh (Ω · m^2)": f64, "Rs (Ω · m^2)": f64, "Eff (%)": f64, "Measured Cell": "Cell Selector.gtype", "No Multiplexer": bool}
  "JV Scan Mode.gtype" = enum{"Rough", "Normal", "Accurate", "Smart", "Custom"}
  "JV Curve Parameters.gtype" = cluster{"JV Scan Mode": "JV Scan Mode.gtype", "Measurement Precision": "Accuracy Parameters.gtype", "Cell Parameters": "Cell Parameters.gtype"}
  "Full Layer Information.gtype" = cluster{"Blade Coating Parameters": "Blade Coating Parameters.gtype", "Deposition Method": "Deposition Method.gtype", "Layer Type": "Layer Type.gtype", "Spin Coating Parameters": "Spin Coating Parameters.gtype", "Thermal Evaporation Parameters": "Thermal Evaporation Parameters.gtype", "Solution Information": "Solution Information.gtype", "General Parameters": "General Parameters.gtype", "Current Deposition Method Information Cluster": "Useless Cluster.gtype", "Layer String ID": string}
  "JV Measurements Mega Cluster.gtype" = cluster{"Cell Array": "Cell Selector.gtype"[], "JV Full Data Array": "JV Data Cluster.gtype"[], "Cell Selector": "Cell Selector.gtype", "JV Curve Parameters": "JV Curve Parameters.gtype", "Full Layer Information Array": "Full Layer Information.gtype"[]}
uses:
  Pika IV Characterization NXG::Main Functions::Instruction Handling::FGV Current State.gvi
  Pika IV Characterization NXG::Main Functions::Layer Composition::Data Management::Layer String Array Generator.gvi
  Pika IV Characterization NXG::Main Functions::Layer Composition::Controls and Data Clusters::Layer Controls Reference Setting.gvi
  Pika IV Characterization NXG::Main Functions::Layer Composition::Check and Set Control Visibility.gvi
  Pika IV Characterization NXG::Main Functions::Layer Composition::Data Management::Layer Information Cluster Subroutine.gvi
  Pika IV Characterization NXG::Main Functions::Layer Composition::Data Management::Missing info::Missing Information Check.gvi
  Pika IV Characterization NXG::Main Functions::Layer Composition::Data Management::Edit Layer::Replace Current Layer.gvi
  Pika IV Characterization NXG::Main Functions::Layer Composition::File Management::Layer File Handler.gvi
  Pika IV Characterization NXG::Main Functions::Layer Composition::Data Management::Reset Layer Info Subroutine.gvi
  Pika IV Characterization NXG::Main Functions::Layer Composition::Data Management::Edit Layer::Extract Layer Information.gvi
  Pika IV Characterization NXG::Main Functions::Layer Composition::Data Management::Solution Descriptor::Solution Descriptor Update.gvi
diagram:
  case ($"Error In") {
    frame Error, Default {
      w1 = $"Error In"
      w2 = $"Misc Data Mega Cluster In"
      w3 = default
      w4 = $"JV Measurements Mega Cluster In"
      w5 = default
    }
    frame No Error {
      call "FGV Current State.gvi"(Current State Instructions="Set Current State and Substate", Current State="Edit Layers", Current Substate="", Error In=$"Error In") -> (Error Out=w6)
      call "Layer String Array Generator.gvi"(JV Measurements Mega Cluster In=$"JV Measurements Mega Cluster In", Error In=w6) -> (JV Measurements Mega Cluster Out=w7, Layer String ID Array=w8, Error Out=w9)
      This VI Reference() -> (reference out=w10)
      Property Node(instance in=w10, error in=w9) -> ("Panel"=w11, error out=w12)
      Property Node(instance in=w11, error in=w12) -> ("Window"=w13, error out=w14)
      Open Window(reference in=w13, error in=w14, modal=TRUE) -> (reference out=w15, error out=w16)
      Property Node(instance in=reference to "Layer to Edit", "Items"=w8, "ValueSignaling"=0, error in=w16) -> (error out=w17)
      case (TRUE) {
        frame False, Default {
          w18 = default
          w19 = w17
        }
        frame True {
          This VI Reference() -> (reference out=w20)
          call "Layer Controls Reference Setting.gvi"(Error In=w17, This VI Ref=w20, Add Layer Button Ref=reference to "Add Layer Button", Blade Coating ParametersRef=reference to "Blade Coating Parameters", Deposition Method Ref=reference to "Deposition Method", General ParametersRef=reference to "General Parameters", Layer Type ref=reference to "Layer Type", Solution Information Ref=reference to "Solution Information", Spin Coating ParametersRef=reference to "Spin Coating Parameters", Thermal Evaporation ParametersRef=reference to "Thermal Evaporation Parameters", Load Layer File Ref=reference to "Load Layer File", Save Layer File Ref=reference to "Save Layer File", Layer To Edit Ref=reference to "Layer to Edit", Layer Controls Prompt Ref Cluster In=$"Layer Controls Prompt Ref Cluster In") -> (Error Out=w21, Layer Controls Prompt Ref Cluster Out=w22)
          call "Check and Set Control Visibility.gvi"(Layer Controls Prompt Ref Cluster In=w22, Error In=w21) -> (Layer Controls Prompt Ref Cluster Out=w18, Error Out=w19)
        }
      }
      s1 = w19  # shift register
      s2 = w18  # shift register
      s3 = $"Misc Data Mega Cluster In"  # shift register
      s4 = "Full Layer Information.gtype" {all zero or empty}  # shift register
      s5 = w7  # shift register
      while {
        event (timeout = 50) {
          on "Timeout" {
            w23 = s1
            w24 = s2
            w25 = default
            w26 = s3
            w27 = s4
            w3 = default
            w28 = s5
          }
          on "Deposition Method" Value changed {
            call "Check and Set Control Visibility.gvi"(Layer Controls Prompt Ref Cluster In=s2, Error In=s1) -> (Layer Controls Prompt Ref Cluster Out=w24, Error Out=w23)
            w25 = default
            w26 = s3
            w27 = s4
            w3 = default
            w28 = s5
          }
          on "Add Layer Button" Value changed {
            call "Layer Information Cluster Subroutine.gvi"(Layer Controls Prompt Ref Cluster In=s2, Full Layer Information In=s4, Error In=s1, Layer Information Operation="Update Cluster") -> (Layer Controls Prompt Ref Cluster Out=w29, Full Layer Information Out=w30, Error Out=w31)
            call "Missing Information Check.gvi"(Layer Controls Prompt Ref Cluster In=w29, Full Layer Information In=w30, Error In=w31) -> (Layer Controls Prompt Ref Cluster Out=w32, Full Layer Information Out=w33, Proceed?=w25, Error Out=w34)
            call "Layer Information Cluster Subroutine.gvi"(Layer Controls Prompt Ref Cluster In=w32, Full Layer Information In=w33, Error In=w34, Layer Information Operation="Update Controls") -> (Layer Controls Prompt Ref Cluster Out=w35, Full Layer Information Out=w36, Error Out=w37)
            call "Replace Current Layer.gvi"(JV Measurements Mega Cluster In=s5, Full Layer Information In=w36, Layer Controls Prompt Ref Cluster In=w35, Error In=w37, Proceed?=w25) -> (JV Measurements Mega Cluster Out=w28, Full Layer Information Out=w27, Layer Controls Prompt Ref Cluster Out=w24, Error Out=w23)
            w26 = s3
            w3 = default
          }
          on "Save Layer File" Value changed {
            call "FGV Current State.gvi"(Current State Instructions="Set Current Substate", Current Substate="Saving Layer", Error In=s1) -> (Error Out=w38)
            call "Layer Information Cluster Subroutine.gvi"(Layer Controls Prompt Ref Cluster In=s2, Full Layer Information In=s4, Error In=w38, Layer Information Operation="Update Cluster") -> (Layer Controls Prompt Ref Cluster Out=w39, Full Layer Information Out=w40, Error Out=w41)
            call "Missing Information Check.gvi"(Layer Controls Prompt Ref Cluster In=w39, Full Layer Information In=w40, Error In=w41) -> (Layer Controls Prompt Ref Cluster Out=w24, Full Layer Information Out=w42, Proceed?=w43, Error Out=w44)
            call "Layer File Handler.gvi"(Misc Data Mega Cluster In=s3, Full Layer Information In=w42, Proceed?=w43, Error In=w44, Configuration File Operation="Save Configuration File") -> (Misc Data Mega Cluster Out=w26, Full Layer Information Out=w27, Error Out=w23)
            w25 = default
            w3 = default
            w28 = s5
          }
          on "Cancel Button" Value changed; "Window" Close {
            w23 = s1
            w24 = s2
            w25 = TRUE
            w26 = s3
            w27 = s4
            w3 = TRUE
            w28 = s5
          }
          on "Load Layer File" Value changed {
            call "FGV Current State.gvi"(Current State Instructions="Set Current Substate", Current Substate="Loading Layer", Error In=s1) -> (Error Out=w45)
            call "Layer File Handler.gvi"(Misc Data Mega Cluster In=s3, Full Layer Information In=s4, Proceed?=TRUE, Error In=w45, Configuration File Operation="Load Configuration File") -> (Misc Data Mega Cluster Out=w26, Full Layer Information Out=w46, Error Out=w47)
            call "Layer Information Cluster Subroutine.gvi"(Layer Controls Prompt Ref Cluster In=s2, Full Layer Information In=w46, Error In=w47, Layer Information Operation="Update Controls") -> (Layer Controls Prompt Ref Cluster Out=w24, Full Layer Information Out=w27, Error Out=w23)
            w25 = default
            w3 = default
            w28 = s5
          }
          on "Reset Layer Button" Value changed {
            call "Reset Layer Info Subroutine.gvi"(Full Layer Information In=s4, Error In=s1) -> (Full Layer Information Out=w48, Error Out=w49)
            call "Layer Information Cluster Subroutine.gvi"(Layer Controls Prompt Ref Cluster In=s2, Full Layer Information In=w48, Error In=w49, Layer Information Operation="Update Controls") -> (Layer Controls Prompt Ref Cluster Out=w24, Full Layer Information Out=w27, Error Out=w23)
            w25 = default
            w26 = s3
            w3 = default
            w28 = s5
          }
          on "Layer to Edit" Value changed {
            Event Data() -> ("New Value"=w50)
            call "Extract Layer Information.gvi"(JV Measurements Mega Cluster In=s5, Layer Number=w50, Error In=s1) -> (JV Measurements Mega Cluster Out=w28, Full Layer Information Out=w51, Error Out=w52)
            call "Layer Information Cluster Subroutine.gvi"(Layer Controls Prompt Ref Cluster In=s2, Full Layer Information In=w51, Error In=w52, Layer Information Operation="Update Controls") -> (Layer Controls Prompt Ref Cluster Out=w24, Full Layer Information Out=w27, Error Out=w23)
            w25 = default
            w26 = s3
            w3 = default
          }
          on "Solution Information" Value changed {
            call "Solution Descriptor Update.gvi"(Full Layer Information In=s4, Layer Controls Prompt Ref Cluster In=s2, Error In=s1) -> (Full Layer Information Out=w27, Layer Controls Prompt Ref Cluster Out=w24, Error Out=w23)
            w25 = default
            w26 = s3
            w3 = default
            w28 = s5
          }
        }
        Logical Or(w23, w25) -> w53
        next s1 = w23
        next s2 = w24
        next s3 = w26
        next s4 = w27
        next s5 = w28
        stop if w53
      }
      Close Window(reference in=w15, error in=s1) -> (error out=w54)
      call "Layer String Array Generator.gvi"(JV Measurements Mega Cluster In=s5, Error In=w54) -> (JV Measurements Mega Cluster Out=w4, Layer String ID Array=w5, Error Out=w1)
      w2 = s3
    }
  }
  $"Cancelled?" <- w3
  $"JV Measurements Mega Cluster Out" <- w4
  $"Layer String ID Array" <- w5
  $"Error Out" <- w1
  $"Misc Mega Cluster Data Out" <- w2
