vi "Default Configuration Handler.gvi"   [LabVIEW NXG 5.0.0]
inputs:
  "Error In": error
  "Misc Data Mega Cluster In": "Misc Mega Cluster.gtype"
  "Configuration File Operation": "Configuration File Operation.gtype" = "Save Configuration File"
  "Full Layer Information In": "Full Layer Information.gtype"
outputs:
  "Error Out": error
  "Misc Data Mega Cluster Out": "Misc Mega Cluster.gtype"
types:
  T1 = cluster{"State Ref": "StringControl reference", "Substate Ref": "StringControl reference", "Current State Ref": "EnumSelector reference", "Main Tab Ref": "TabControl reference", "Plot Now Flag Ref": "BooleanControl reference"}
  T2 = cluster{"Default Data Saving Location Ref": "PathSelector reference"}
  T3 = cluster{"Author Initials Ref": "ComboBoxSelector reference", "Batch Name Ref": "StringControl reference", "Cell Number Ref": "StringControl reference", "Current Date Ref": "StringControl reference", "Sample Comments Ref": "StringControl reference", "Sample Prefix Ref": "StringControl reference", "Custom Date Ref": "CheckBox reference", "Label Info Error Label Ref": "StringControl reference", "Label Info Missing Error Ref": "BooleanControl reference"}
  T4 = cluster{"Cell Parameters Ref": "Cluster reference", "Cell Selector Ref": "Cluster reference", "Measurement Precision Ref": "Cluster reference", "JV Scan Mode Ref": "EnumSelector reference"}
  T5 = cluster{"Progress % Ref": "ProgressBar reference", "Progress Counter Ref": "NumericTextBoxDouble reference", "Live JV Parameters Ref": "Cluster reference"}
  T6 = cluster{"Layer Information Ref": "ArrayViewer reference"[]}
  T7 = cluster{"Cell Selector Block Ref": "Rectangle reference", "Smart Mode Block Ref": "Rectangle reference", "dV Block Ref": "Rectangle reference", "Smart Mode Text Ref": "Text reference", "No Multiplexer Detected Text Ref": "Text reference"}
  T8 = cluster{"JV Measurements Mega Cluster Ref": "Cluster reference", "Instrument Control Mega Cluster Ref": "Cluster reference"}
  T9 = cluster{"JV Main Graph Ref": "Graph reference", "Voc Graph Ref ": "Graph reference", "Jsc Graph Ref": "Graph reference", "Efficiency Graph Ref": "Graph reference", "Fill Factor Graph Ref": "Graph reference", "Series Resistance Graph Ref": "Graph reference", "Shunt Resistance Graph Ref": "Graph reference"}
  "Full Reference Cluster.gtype" = cluster{"Status Report": T1, "Path Cluster": T2, "Sample Naming Cluster": T3, "Acquisition Parameters": T4, "Live Progress Cluster": T5, "Sample Extra Information": T6, "Visual Elements": T7, "Mega Cluster References": T8, "Plotting": T9, "System Parameters": cluster{"Main VI Ref": VIRefnum}}
  "Misc Mega Cluster.gtype" = cluster{"Full Reference Cluster": "Full Reference Cluster.gtype"}
  "Configuration File Operation.gtype" = enum{"Save Configuration File", "Load Configuration File", "Erase Configuration File"}
  "Blade Coating Parameters.gtype" = cluster{"Thickness (nm)": f64, "Blade Initial Speed (mm/s)": f64, "Speed Gradient": bool, "Blade Final Speed (mm/s)": f64, "Blade Gap (um)": f64, "Blade Temperature (ºC)": f64, "Droplet Volume (ul)": f64, "Subsequent layers": f64, "Glovebox": bool, "Comments": string}
  "Deposition Method.gtype" = enum{"Blade Coating", "Spin Coating", "Thermal Evaporation", "E-beam Evaporation", "Sputtering", "Drop Casting", "Dip Coating", "Pulsed Laser Deposition", "Chemical Vapour Deposition", "Atomic Layer Deposition", "Spray Coating", "Screen Printing", "Electroplating", "Molecular Beam Epitaxy", "Custom Deposition"}
  "Layer Type.gtype" = enum{"Front Electrode", "Electrode Transport Layer", "Active Layer", "Hole Transport Layer", "Back Electrode", "Annealing Treatment", "Encapsulation", "Custom Layer"}
  "Spin Coating Parameters.gtype" = cluster{"Thickness (nm)": f64, "Spin Speed (rpm)": f64, "Dynamic Deposition": bool, "Spin Acceleration (rpm/s)": f64, "Droplet Volume (ul)": f64, "Subsequent layers": f64, "Glovebox": bool, "Comments": string}
  "Thermal Evaporation Parameters.gtype" = cluster{"Thickness (nm)": f64, "Deposition Rate (nm/s)": f64, "Comments": string, "Sample Rotation": bool, "Material": string}
  "Solution Information.gtype" = cluster{"Concentration (mg/ml)": f64, "Stirring Time (kr)": f64, "Glovebox": bool, "Composition Array": cluster{"Material": string, "Ratio": f64}[], "Solvent Array": cluster{"Solvent": string, "Ratio": f64}[], "Solution Preparation Date": f64, "Comments": string}
  "General Parameters.gtype" = cluster{"Thickness (nm)": f64, "Comments": string, "Material": string}
  "Useless Cluster.gtype" = cluster{"Blade Coating Information": bool, "General Information": bool, "Solution Information": bool, "Spin Coating Information": bool, "Thermal Evaporation Information": bool}
  "Full Layer Information.gtype" = cluster{"Blade Coating Parameters": "Blade Coating Parameters.gtype", "Deposition Method": "Deposition Method.gtype", "Layer Type": "Layer Type.gtype", "Spin Coating Parameters": "Spin Coating Parameters.gtype", "Thermal Evaporation Parameters": "Thermal Evaporation Parameters.gtype", "Solution Information": "Solution Information.gtype", "General Parameters": "General Parameters.gtype", "Current Deposition Method Information Cluster": "Useless Cluster.gtype", "Layer String ID": string}
uses:
  Pika IV Characterization NXG::Main Functions::Layer Composition::File Management::Check Author Empty.gvi
  Pika IV Characterization NXG::Main Functions::Layer Composition::File Management::Generate Author Path.gvi
  Pika IV Characterization NXG::Side Functions::Path Manipulation::Name File Prompt Window.gvi
  Pika IV Characterization NXG::Side Functions::Path Manipulation::Path Already Exists prompt.gvi
  Pika IV Characterization NXG::Main Functions::Layer Composition::File Management::Single File Save.gvi
  Pika IV Characterization NXG::Side Functions::Path Manipulation::Rename Prompt Window.gvi
diagram:
  case ($"Error In") {
    frame Error, Default {
      w1 = $"Error In"
      w2 = $"Misc Data Mega Cluster In"
    }
    frame No Error {
      call "Check Author Empty.gvi"(Misc Data Mega Cluster In=$"Misc Data Mega Cluster In", Error In=$"Error In") -> (Misc Data Mega Cluster Out=w2, Author Initials=w3, No Author?=w4, Error Out=w5)
      case (w4) {
        frame True {
          w6 = "I'm missing the author name so I cannot load your default layers"
          One Button Dialog(button name ("OK")="Okay, I'll make sure I write my name down", message=w6)
          w1 = w5
        }
        frame False {
          call "Generate Author Path.gvi"(Authors Initials=w3, Error In=w5) -> (Author Path=w7, Error Out=w8)
          case ($"Configuration File Operation") {
            frame "Save Configuration File", Default {
              call "Name File Prompt Window.gvi"(Error In=w8) -> (Output=w9, Error Out=w10)
              Build Path(base path=w7, name or relative path=w9) -> (appended path=w11)
              call "Path Already Exists prompt.gvi"(Path to Check=w11, Error In=w10) -> (Existing File Instruction out=w12, Error Out=w13)
              case (w12) {
                frame "Replace" {
                  Delete File Or Folder(error in=w13, path (use dialog)=w11) -> (error out=w14)
                  call "Single File Save.gvi"(Full Layer Information In=$"Full Layer Information In", Error In=w14) -> (Error Out=w1)
                }
                frame "Rename", Default {
                  Strip Path(path=w11) -> (name=w15, stripped path=w16)
                  call "Rename Prompt Window.gvi"(Original Filename=w15, Error In=w13) -> (Output=w17, Error Out=w18)
                  Build Path(base path=w16, name or relative path=w17) -> (appended path=w19)
                  call "Single File Save.gvi"(Full Layer Information In=$"Full Layer Information In", Layer Type Data Path=w19, Error In=w18) -> (Error Out=w1)
                }
                frame "Do not save" {
                  w1 = w13
                }
              }
            }
          }
        }
      }
    }
  }
  $"Misc Data Mega Cluster Out" <- w2
  $"Error Out" <- w1
