vi "Generate Author Path.gvi"   [LabVIEW NXG 5.0.0]
inputs:
  "Error In": error
  "Authors Initials": string
  "Defaults Folder?": bool
outputs:
  "Error Out": error
  "Author Path": path
uses:
  NI::G Core::File IO (General)::Create Directory Recursive.gvi
diagram:
  # This SubVI Takes the author initials and generates
  # a folder where all the layer information will be stored
  case ($"Error In") {
    frame Error, Default {
      w1 = $"Error In"
      w2 = default
    }
    frame No Error {
      Get Component Directory() -> (Path=w3)
      Build Path(base path=w3, name or relative path="Data") -> (appended path=w4)
      Build Path(base path=w4, name or relative path="Layer_Default_Files") -> (appended path=w5)
      Build Path(base path=w5, name or relative path=$"Authors Initials") -> (appended path=w6)
      Build Path(base path=w6, name or relative path="Default Layers") -> (appended path=w7)
      Select(s=$"Defaults Folder?", t=w7, f=w6) -> w2
      call "Create Directory Recursive.gvi"(folder=w2, error in=$"Error In") -> (error out=w1)
    }
  }
  $"Author Path" <- w2
  $"Error Out" <- w1
