vi "Get Author Defaults.gvi"   [LabVIEW NXG 5.0.0]
inputs:
  "Error In": error
  "Author Path": path
outputs:
  "Error Out": error
  "Config File Information Array": "Config File Information.gtype"[]
types:
  "Config File Information.gtype" = cluster{"Config File Path": path, "Config File Name": string}
diagram:
  case ($"Error In") {
    frame Error, Default {
      w1 = $"Error In"
      w2 = default
    }
    frame No Error {
      List Folder(error in=$"Error In", path=$"Author Path") -> (file names=w3, path out=w4)
      for {
        w5 = each element of w3
        Build Path(base path=w4, name or relative path=w5) -> (appended path=w6)
        Property Node(instance in="Config File Information.gtype" {all zero or empty}, "Config File Path"=w6, "Config File Name"=w5) -> (instance out=w7)
        Search And Replace String(input string=w5, search string=".ini") -> (number of replacements=w8)
        Is Not Equal To 0(x=w8) -> w9
        append w7 to w2 if w9
      }
      w1 = $"Error In"
    }
  }
  $"Error Out" <- w1
  $"Config File Information Array" <- w2
