vi "Layer Types Extractor.gvi"   [LabVIEW NXG 5.0.0]
inputs:
  "Error In": error
  "Layer Type": "Layer Type.gtype" = "Front Electrode"
outputs:
  "Layer Types": "Layer Type.gtype"[]
  "Error Out": error
types:
  "Layer Type.gtype" = enum{"Front Electrode", "Electrode Transport Layer", "Active Layer", "Hole Transport Layer", "Back Electrode", "Annealing Treatment", "Encapsulation", "Custom Layer"}
diagram:
  case ($"Error In") {
    frame Error, Default {
      w1 = $"Error In"
      w2 = default
    }
    frame No Error {
      # This loop runs through the enum and extracts all
      # the elements storing them as an array.
      # It also stores the name of the instructions so that
      # they can be displayed afttewards for debugging purposes
      s1 = uninitialised  # shift register
      s2 = $"Error In"  # shift register
      while (iteration -> i1) {
        Is Not Equal To 0(x=i1) -> w3
        To Unsigned 16 Bit Integer(number=i1) -> w4
        Type Cast(type=$"Layer Type", x=w4) -> w5
        case (w3) {
          frame False, Default {
            w6 = FALSE
          }
          frame True {
            Is Equal(x=s1, y=w5) -> w6
          }
        }
        Not(x=w6) -> w7
        append w5 to w2 if w7
        next s1 = w5
        stop if w6
      }
      w1 = s2
    }
  }
  $"Error Out" <- w1
  $"Layer Types" <- w2
