vi "Load Config Parser.gvi"   [LabVIEW NXG 5.0.0]
inputs:
  "Full Layer Information In": "Full Layer Information.gtype"
  "Config File In": "Config Data Reference.gtype"
  "Error In": error
  "Config Types": "Config Types.gtype" = "General Parameters"
outputs:
  "Full Layer Information Out": "Full Layer Information.gtype"
  "Config File Ref Out": "Config Data Reference.gtype"
  "Error Out": error
types:
  "Config Data Reference.gtype" = i32
  "Blade Coating Parameters.gtype" = cluster{"Thickness (nm)": f64, "Blade Initial Speed (mm/s)": f64, "Speed Gradient": bool, "Blade Final Speed (mm/s)": f64, "Blade Gap (um)": f64, "Blade Temperature (ºC)": f64, "Droplet Volume (ul)": f64, "Subsequent layers": f64, "Glovebox": bool, "Comments": string}
  "Deposition Method.gtype" = enum{"Blade Coating", "Spin Coating", "Thermal Evaporation", "E-beam Evaporation", "Sputtering", "Drop Casting", "Dip Coating", "Pulsed Laser Deposition", "Chemical Vapour Deposition", "Atomic Layer Deposition", "Spray Coating", "Screen Printing", "Electroplating", "Molecular Beam Epitaxy", "Custom Deposition"}
  "Layer Type.gtype" = enum{"Front Electrode", "Electron Transport Layer", "Active Layer", "Hole Transport Layer", "Back Electrode", "Custom Layer"}
  "Spin Coating Parameters.gtype" = cluster{"Thickness (nm)": f64, "Spin Speed (rpm)": f64, "Dynamic Deposition": bool, "Spin Acceleration (rpm/s)": f64, "Droplet Volume (ul)": f64, "Subsequent layers": f64, "Glovebox": bool, "Comments": string, "Spin Time (s)": f64}
  "Thermal Evaporation Parameters.gtype" = cluster{"Thickness (nm)": f64, "Deposition Rate (nm/s)": f64, "Comments": string, "Sample Rotation": bool, "Material": string}
  "Solution Information.gtype" = cluster{"Concentration (mg/ml)": f64, "Stir Time (kr)": f64, "Composition Array": cluster{"Material": string, "Ratio": f64}[], "Solvent Array": cluster{"Solvent": string, "Ratio": f64}[], "Solution Preparation Date": string, "Comments": string, "Stir Temp (ºC)": f64, "Glovebox": bool, "Solution Label": string, "Solution Descriptor": string, "Volume (ul)": f64}
  "General Parameters.gtype" = cluster{"Thickness (nm)": f64, "Comments": string, "Material": string}
  "Useless Cluster.gtype" = cluster{"Blade Coating Information": bool, "General Information": bool, "Solution Information": bool, "Spin Coating Information": bool, "Thermal Evaporation Information": bool}
  "Full Layer Information.gtype" = cluster{"Blade Coating Parameters": "Blade Coating Parameters.gtype", "Deposition Method": "Deposition Method.gtype", "Layer Type": "Layer Type.gtype", "Spin Coating Parameters": "Spin Coating Parameters.gtype", "Thermal Evaporation Parameters": "Thermal Evaporation Parameters.gtype", "Solution Information": "Solution Information.gtype", "General Parameters": "General Parameters.gtype", "Current Deposition Method Information Cluster": "Useless Cluster.gtype", "Layer String ID": string}
  "Config Types.gtype" = enum{"General Parameters", "Thermal Evaporation Parameters", "Spin Coating Parameters", "Blade Coating Parameters", "Solution Parameters"}
uses:
  NI::G Core::Configuration File (INI)::Read Key::Read Key (Double).gvi
  NI::G Core::Configuration File (INI)::Read Key::Read Key (Boolean).gvi
  NI::G Core::Configuration File (INI)::Read Key::Read Key (String).gvi
  Pika IV Characterization NXG::Main Functions::Layer Composition::Data Management::String to Solution Arrays.gvi
diagram:
  # This SubVI Takes care of writting the information about the solution within the corresponding configuration file
  case ($"Error In") {
    frame Error, Default {
      w1 = $"Full Layer Information In"
      w2 = $"Error In"
      w3 = $"Config File In"
    }
    frame No Error {
      case ($"Config Types") {
        frame "Thermal Evaporation Parameters" {
          call "Read Key (Double).gvi"(reference in=$"Config File In", key="Thickness (nm)", error in=$"Error In", section="Deposition Method Specific Parameters") -> (reference out=w4, value=w5, error out=w6)
          call "Read Key (Double).gvi"(reference in=w4, key="Deposition Rate (nm/s)", error in=w6, section="Deposition Method Specific Parameters") -> (reference out=w7, value=w8, error out=w9)
          call "Read Key (Boolean).gvi"(reference in=w7, key="Sample Rotation", error in=w9, section="Deposition Method Specific Parameters") -> (reference out=w10, value=w11, error out=w12)
          call "Read Key (String).gvi"(reference in=w10, key="Material", error in=w12, section="Deposition Method Specific Parameters") -> (reference out=w13, value=w14, error out=w15)
          call "Read Key (String).gvi"(reference in=w13, key="Comments", error in=w15, section="Deposition Method Specific Parameters") -> (reference out=w3, value=w16, error out=w2)
          Property Node(instance in=$"Full Layer Information In", "Thermal Evaporation Parameters:Thickness (nm)"=w5, "Thermal Evaporation Parameters:Deposition Rate (nm/s)"=w8, "Thermal Evaporation Parameters:Sample Rotation"=w11, "Thermal Evaporation Parameters:Material"=w14, "Thermal Evaporation Parameters:Comments"=w16) -> (instance out=w1)
        }
        frame "Spin Coating Parameters" {
          call "Read Key (Double).gvi"(reference in=$"Config File In", key="Thickness (nm)", error in=$"Error In", section="Deposition Method Specific Parameters") -> (reference out=w17, value=w18, error out=w19)
          call "Read Key (Double).gvi"(reference in=w17, key="Spin Speed (rpm)", error in=w19, section="Deposition Method Specific Parameters") -> (reference out=w20, value=w21, error out=w22)
          call "Read Key (Boolean).gvi"(reference in=w20, key="Dynamic Deposition", error in=w22, section="Deposition Method Specific Parameters") -> (reference out=w23, value=w24, error out=w25)
          call "Read Key (Double).gvi"(reference in=w23, key="Acceleration (rpm/s)", error in=w25, section="Deposition Method Specific Parameters") -> (reference out=w26, value=w27, error out=w28)
          call "Read Key (Double).gvi"(reference in=w26, key="Spin Time (s)", error in=w28, section="Deposition Method Specific Parameters") -> (reference out=w29, value=w30, error out=w31)
          call "Read Key (Double).gvi"(reference in=w29, key="Droplet Volume (ul)", error in=w31, section="Deposition Method Specific Parameters") -> (reference out=w32, value=w33, error out=w34)
          call "Read Key (Double).gvi"(reference in=w32, key="Subsequent Layers", error in=w34, section="Deposition Method Specific Parameters") -> (reference out=w35, value=w36, error out=w37)
          call "Read Key (Boolean).gvi"(reference in=w35, key="Glovebox", error in=w37, section="Deposition Method Specific Parameters") -> (reference out=w38, value=w39, error out=w40)
          call "Read Key (String).gvi"(reference in=w38, key="Comments", error in=w40, section="Deposition Method Specific Parameters") -> (reference out=w3, value=w41, error out=w2)
          Property Node(instance in=$"Full Layer Information In", "Spin Coating Parameters:Thickness (nm)"=w18, "Spin Coating Parameters:Spin Speed (rpm)"=w21, "Spin Coating Parameters:Dynamic Deposition"=w24, "Spin Coating Parameters:Spin Acceleration (rpm/s)"=w27, "Spin Coating Parameters:Droplet Volume (ul)"=w33, "Spin Coating Parameters:Subsequent layers"=w36, "Spin Coating Parameters:Glovebox"=w39, "Spin Coating Parameters:Comments"=w41, "Spin Coating Parameters:Spin Time (s)"=w30) -> (instance out=w1)
        }
        frame "Solution Parameters" {
          call "Read Key (String).gvi"(reference in=$"Config File In", key="Solution Label", error in=$"Error In", section="Solution Specific Parameters") -> (reference out=w42, value=w43, error out=w44)
          call "Read Key (Double).gvi"(reference in=w42, key="Concentration (mg/ml)", error in=w44, section="Solution Specific Parameters") -> (reference out=w45, value=w46, error out=w47)
          call "Read Key (Double).gvi"(reference in=w45, key="Stir Time (kr)", error in=w47, section="Solution Specific Parameters") -> (reference out=w48, value=w49, error out=w50)
          call "Read Key (Double).gvi"(reference in=w48, key="Stir Temp (ºC)", error in=w50, section="Solution Specific Parameters") -> (reference out=w51, value=w52, error out=w53)
          call "Read Key (Double).gvi"(reference in=w51, key="Volume (ul)", error in=w53, section="Solution Specific Parameters") -> (reference out=w54, value=w55, error out=w56)
          call "Read Key (Boolean).gvi"(reference in=w54, key="Glovebox", error in=w56, section="Solution Specific Parameters") -> (reference out=w57, value=w58, error out=w59)
          call "Read Key (String).gvi"(reference in=w57, key="Composition Array", error in=w59, section="Solution Specific Parameters") -> (reference out=w60, value=w61, error out=w62)
          call "Read Key (String).gvi"(reference in=w60, key="Solvent Array", error in=w62, section="Solution Specific Parameters") -> (reference out=w63, value=w64, error out=w65)
          call "Read Key (String).gvi"(reference in=w63, key="Preparation Date", error in=w65, section="Solution Specific Parameters") -> (reference out=w66, value=w67, error out=w68)
          call "Read Key (String).gvi"(reference in=w66, key="Comments", error in=w68, section="Solution Specific Parameters") -> (reference out=w69, value=w70, error out=w71)
          call "Read Key (String).gvi"(reference in=w69, key="Solution Descriptor", error in=w71, section="Solution Specific Parameters") -> (reference out=w3, value=w72, error out=w73)
          call "String to Solution Arrays.gvi"(Solvent String=w64, Composition String=w61, Error In=w73) -> (Solvent Array Out=w74, Composition Array Out=w75, Error Out=w2)
          Property Node(instance in=$"Full Layer Information In", "Solution Information:Concentration (mg/ml)"=w46, "Solution Information:Solution Label"=w43, "Solution Information:Stir Time (kr)"=w49, "Solution Information:Stir Temp (ºC)"=w52, "Solution Information:Volume (ul)"=w55, "Solution Information:Glovebox"=w58, "Solution Information:Composition Array"=w75, "Solution Information:Solvent Array"=w74, "Solution Information:Solution Preparation Date"=w67, "Solution Information:Comments"=w70, "Solution Information:Solution Descriptor"=w72) -> (instance out=w1)
        }
        frame "Blade Coating Parameters" {
          call "Read Key (Double).gvi"(reference in=$"Config File In", key="Thickness (nm)", error in=$"Error In", section="Deposition Method Specific Parameters") -> (reference out=w76, value=w77, error out=w78)
          call "Read Key (Double).gvi"(reference in=w76, key="Blade Initial Speed (mm/s)", error in=w78, section="Deposition Method Specific Parameters") -> (reference out=w79, value=w80, error out=w81)
          call "Read Key (Boolean).gvi"(reference in=w79, key="Speed Gradient", error in=w81, section="Deposition Method Specific Parameters") -> (reference out=w82, value=w83, error out=w84)
          call "Read Key (Double).gvi"(reference in=w82, key="Blade Final Speed (mm/s)", error in=w84, section="Deposition Method Specific Parameters") -> (reference out=w85, value=w86, error out=w87)
          call "Read Key (Double).gvi"(reference in=w85, key="Dropled Volume (ul)", error in=w87, section="Deposition Method Specific Parameters") -> (reference out=w88, value=w89, error out=w90)
          call "Read Key (Double).gvi"(reference in=w88, key="Subsequent Layers", error in=w90, section="Deposition Method Specific Parameters") -> (reference out=w91, value=w92, error out=w93)
          call "Read Key (Boolean).gvi"(reference in=w91, key="Glovebox", error in=w93, section="Deposition Method Specific Parameters") -> (reference out=w94, value=w95, error out=w96)
          call "Read Key (String).gvi"(reference in=w94, key="Comments", error in=w96, section="Deposition Method Specific Parameters") -> (reference out=w97, value=w98, error out=w99)
          call "Read Key (Double).gvi"(reference in=w97, key="Blade Gap (um)", error in=w99, section="Deposition Method Specific Parameters") -> (reference out=w100, value=w101, error out=w102)
          call "Read Key (Double).gvi"(reference in=w100, key="Blade Temperature (ºC)", error in=w102, section="Deposition Method Specific Parameters") -> (reference out=w3, value=w103, error out=w2)
          Property Node(instance in=$"Full Layer Information In", "Blade Coating Parameters:Thickness (nm)"=w77, "Blade Coating Parameters:Blade Initial Speed (mm/s)"=w80, "Blade Coating Parameters:Speed Gradient"=w83, "Blade Coating Parameters:Blade Final Speed (mm/s)"=w86, "Blade Coating Parameters:Droplet Volume (ul)"=w89, "Blade Coating Parameters:Subsequent layers"=w92, "Blade Coating Parameters:Glovebox"=w95, "Blade Coating Parameters:Comments"=w98, "Blade Coating Parameters:Blade Gap (um)"=w101, "Blade Coating Parameters:Blade Temperature (ºC)"=w103) -> (instance out=w1)
        }
        frame "General Parameters", Default {
          call "Read Key (Double).gvi"(reference in=$"Config File In", key="Thickness (nm)", error in=$"Error In", section="Deposition Method Specific Parameters") -> (reference out=w104, value=w105, error out=w106)
          call "Read Key (String).gvi"(reference in=w104, key="Material", error in=w106, section="Deposition Method Specific Parameters") -> (reference out=w107, value=w108, error out=w109)
          call "Read Key (String).gvi"(reference in=w107, key="Comments", error in=w109, section="Deposition Method Specific Parameters") -> (reference out=w3, value=w110, error out=w2)
          Property Node(instance in=$"Full Layer Information In", "General Parameters:Thickness (nm)"=w105, "General Parameters:Material"=w108, "General Parameters:Comments"=w110) -> (instance out=w1)
        }
      }
    }
  }
  $"Config File Ref Out" <- w3
  $"Error Out" <- w2
  $"Full Layer Information Out" <- w1
