vi "Save Config Parser.gvi"   [LabVIEW NXG 5.0.0]
inputs:
  "Full Layer Information In": "Full Layer Information.gtype"
  "Config File In": "Config Data Reference.gtype"
  "Error In": error
  "Config Types": "Config Types.gtype" = "General Parameters"
outputs:
  "Full Layer Information Out": "Full Layer Information.gtype"
  "Config File Ref Out": "Config Data Reference.gtype"
  "Error Out": error
types:
  "Config Data Reference.gtype" = i32
  "Blade Coating Parameters.gtype" = cluster{"Thickness (nm)": f64, "Blade Initial Speed (mm/s)": f64, "Speed Gradient": bool, "Blade Final Speed (mm/s)": f64, "Blade Gap (um)": f64, "Blade Temperature (ºC)": f64, "Droplet Volume (ul)": f64, "Subsequent layers": f64, "Glovebox": bool, "Comments": string}
  "Deposition Method.gtype" = enum{"Blade Coating", "Spin Coating", "Thermal Evaporation", "E-beam Evaporation", "Sputtering", "Drop Casting", "Dip Coating", "Pulsed Laser Deposition", "Chemical Vapour Deposition", "Atomic Layer Deposition", "Spray Coating", "Screen Printing", "Electroplating", "Molecular Beam Epitaxy", "Custom Deposition"}
  "Layer Type.gtype" = enum{"Front Electrode", "Electron Transport Layer", "Active Layer", "Hole Transport Layer", "Back Electrode", "Custom Layer"}
  "Spin Coating Parameters.gtype" = cluster{"Thickness (nm)": f64, "Spin Speed (rpm)": f64, "Dynamic Deposition": bool, "Spin Acceleration (rpm/s)": f64, "Droplet Volume (ul)": f64, "Subsequent layers": f64, "Glovebox": bool, "Comments": string, "Spin Time (s)": f64}
  "Thermal Evaporation Parameters.gtype" = cluster{"Thickness (nm)": f64, "Deposition Rate (nm/s)": f64, "Comments": string, "Sample Rotation": bool, "Material": string}
  "Solution Information.gtype" = cluster{"Concentration (mg/ml)": f64, "Stir Time (kr)": f64, "Composition Array": cluster{"Material": string, "Ratio": f64}[], "Solvent Array": cluster{"Solvent": string, "Ratio": f64}[], "Solution Preparation Date": string, "Comments": string, "Stir Temp (ºC)": f64, "Glovebox": bool, "Solution Label": string, "Solution Descriptor": string, "Volume (ul)": f64}
  "General Parameters.gtype" = cluster{"Thickness (nm)": f64, "Comments": string, "Material": string}
  "Useless Cluster.gtype" = cluster{"Blade Coating Information": bool, "General Information": bool, "Solution Information": bool, "Spin Coating Information": bool, "Thermal Evaporation Information": bool}
  "Full Layer Information.gtype" = cluster{"Blade Coating Parameters": "Blade Coating Parameters.gtype", "Deposition Method": "Deposition Method.gtype", "Layer Type": "Layer Type.gtype", "Spin Coating Parameters": "Spin Coating Parameters.gtype", "Thermal Evaporation Parameters": "Thermal Evaporation Parameters.gtype", "Solution Information": "Solution Information.gtype", "General Parameters": "General Parameters.gtype", "Current Deposition Method Information Cluster": "Useless Cluster.gtype", "Layer String ID": string}
  "Config Types.gtype" = enum{"General Parameters", "Thermal Evaporation Parameters", "Spin Coating Parameters", "Blade Coating Parameters", "Solution Parameters"}
uses:
  NI::G Core::Configuration File (INI)::Write Key::Write Key (Double).gvi
  NI::G Core::Configuration File (INI)::Write Key::Write Key (Boolean).gvi
  NI::G Core::Configuration File (INI)::Write Key::Write Key (String).gvi
  Pika IV Characterization NXG::Main Functions::Layer Composition::Data Management::Solution Arrays to String.gvi
diagram:
  # This SubVI Takes care of writting the information about the solution within the corresponding configuration file
  case ($"Error In") {
    frame Error, Default {
      w1 = $"Full Layer Information In"
      w2 = $"Error In"
      w3 = $"Config File In"
    }
    frame No Error {
      case ($"Config Types") {
        frame "Thermal Evaporation Parameters" {
          Property Node(instance in=$"Full Layer Information In") -> ("Thermal Evaporation Parameters:Thickness (nm)"=w4, "Thermal Evaporation Parameters:Deposition Rate (nm/s)"=w5, "Thermal Evaporation Parameters:Sample Rotation"=w6, "Thermal Evaporation Parameters:Material"=w7, "Thermal Evaporation Parameters:Comments"=w8, instance out=w1)
          call "Write Key (Double).gvi"(reference in=$"Config File In", key="Thickness (nm)", value=w4, error in=$"Error In", section="Deposition Method Specific Parameters") -> (reference out=w9, error out=w10)
          call "Write Key (Double).gvi"(reference in=w9, key="Deposition Rate (nm/s)", value=w5, error in=w10, section="Deposition Method Specific Parameters") -> (reference out=w11, error out=w12)
          call "Write Key (Boolean).gvi"(reference in=w11, key="Sample Rotation", value=w6, error in=w12, section="Deposition Method Specific Parameters") -> (reference out=w13, error out=w14)
          call "Write Key (String).gvi"(reference in=w13, key="Material", value=w7, error in=w14, section="Deposition Method Specific Parameters") -> (reference out=w15, error out=w16)
          call "Write Key (String).gvi"(reference in=w15, key="Comments", value=w8, error in=w16, section="Deposition Method Specific Parameters") -> (reference out=w3, error out=w2)
        }
        frame "Solution Parameters" {
          Property Node(instance in=$"Full Layer Information In") -> ("Solution Information:Concentration (mg/ml)"=w17, "Solution Information:Solution Label"=w18, "Solution Information:Volume (ul)"=w19, "Solution Information:Stir Temp (ºC)"=w20, "Solution Information:Stir Time (kr)"=w21, "Solution Information:Glovebox"=w22, "Solution Information:Composition Array"=w23, "Solution Information:Solvent Array"=w24, "Solution Information:Solution Preparation Date"=w25, "Solution Information:Comments"=w26, "Solution Information:Solution Descriptor"=w27, instance out=w1)
          call "Solution Arrays to String.gvi"(Solution Information:Composition Array In=w23, Solution Information:Solvent Array In=w24, Error In=$"Error In") -> (Solvent Information String Out=w28, Composition Information String Out=w29, Error Out=w30)
          call "Write Key (String).gvi"(reference in=$"Config File In", key="Solution Label", value=w18, error in=w30, section="Solution Specific Parameters") -> (reference out=w31, error out=w32)
          call "Write Key (Double).gvi"(reference in=w31, key="Concentration (mg/ml)", value=w17, error in=w32, section="Solution Specific Parameters") -> (reference out=w33, error out=w34)
          call "Write Key (Double).gvi"(reference in=w33, key="Stir Time (kr)", value=w21, error in=w34, section="Solution Specific Parameters") -> (reference out=w35, error out=w36)
          call "Write Key (Double).gvi"(reference in=w35, key="Stir Temp (ºC)", value=w20, error in=w36, section="Solution Specific Parameters") -> (reference out=w37, error out=w38)
          call "Write Key (Double).gvi"(reference in=w37, key="Volume (ul)", value=w19, error in=w38, section="Solution Specific Parameters") -> (reference out=w39, error out=w40)
          call "Write Key (Boolean).gvi"(reference in=w39, key="Glovebox", value=w22, error in=w40, section="Solution Specific Parameters") -> (reference out=w41, error out=w42)
          call "Write Key (String).gvi"(reference in=w41, key="Composition Array", value=w29, error in=w42, section="Solution Specific Parameters") -> (reference out=w43, error out=w44)
          call "Write Key (String).gvi"(reference in=w43, key="Solvent Array", value=w28, error in=w44, section="Solution Specific Parameters") -> (reference out=w45, error out=w46)
          call "Write Key (String).gvi"(reference in=w45, key="Preparation Date", value=w25, error in=w46, section="Solution Specific Parameters") -> (reference out=w47, error out=w48)
          call "Write Key (String).gvi"(reference in=w47, key="Comments", value=w26, error in=w48, section="Solution Specific Parameters") -> (reference out=w49, error out=w50)
          call "Write Key (String).gvi"(reference in=w49, key="Solution Descriptor", value=w27, error in=w50, section="Solution Specific Parameters") -> (reference out=w3, error out=w2)
        }
        frame "Spin Coating Parameters" {
          Property Node(instance in=$"Full Layer Information In") -> ("Spin Coating Parameters:Thickness (nm)"=w51, "Spin Coating Parameters:Spin Speed (rpm)"=w52, "Spin Coating Parameters:Dynamic Deposition"=w53, "Spin Coating Parameters:Spin Acceleration (rpm/s)"=w54, "Spin Coating Parameters:Droplet Volume (ul)"=w55, "Spin Coating Parameters:Subsequent layers"=w56, "Spin Coating Parameters:Glovebox"=w57, "Spin Coating Parameters:Comments"=w58, "Spin Coating Parameters:Spin Time (s)"=w59, instance out=w1)
          call "Write Key (Double).gvi"(reference in=$"Config File In", key="Thickness (nm)", value=w51, error in=$"Error In", section="Deposition Method Specific Parameters") -> (reference out=w60, error out=w61)
          call "Write Key (Double).gvi"(reference in=w60, key="Spin Speed (rpm)", value=w52, error in=w61, section="Deposition Method Specific Parameters") -> (reference out=w62, error out=w63)
          call "Write Key (Boolean).gvi"(reference in=w62, key="Dynamic Deposition", value=w53, error in=w63, section="Deposition Method Specific Parameters") -> (reference out=w64, error out=w65)
          call "Write Key (Double).gvi"(reference in=w64, key="Acceleration (rpm/s)", value=w54, error in=w65, section="Deposition Method Specific Parameters") -> (reference out=w66, error out=w67)
          call "Write Key (Double).gvi"(reference in=w66, key="Spin Time (s)", value=w59, error in=w67, section="Deposition Method Specific Parameters") -> (reference out=w68, error out=w69)
          call "Write Key (Double).gvi"(reference in=w68, key="Droplet Volume (ul)", value=w55, error in=w69, section="Deposition Method Specific Parameters") -> (reference out=w70, error out=w71)
          call "Write Key (Double).gvi"(reference in=w70, key="Subsequent Layers", value=w56, error in=w71, section="Deposition Method Specific Parameters") -> (reference out=w72, error out=w73)
          call "Write Key (Boolean).gvi"(reference in=w72, key="Glovebox", value=w57, error in=w73, section="Deposition Method Specific Parameters") -> (reference out=w74, error out=w75)
          call "Write Key (String).gvi"(reference in=w74, key="Comments", value=w58, error in=w75, section="Deposition Method Specific Parameters") -> (reference out=w3, error out=w2)
        }
        frame "Blade Coating Parameters" {
          Property Node(instance in=$"Full Layer Information In") -> ("Blade Coating Parameters:Thickness (nm)"=w76, "Blade Coating Parameters:Blade Initial Speed (mm/s)"=w77, "Blade Coating Parameters:Speed Gradient"=w78, "Blade Coating Parameters:Blade Final Speed (mm/s)"=w79, "Blade Coating Parameters:Droplet Volume (ul)"=w80, "Blade Coating Parameters:Subsequent layers"=w81, "Blade Coating Parameters:Glovebox"=w82, "Blade Coating Parameters:Comments"=w83, "Blade Coating Parameters:Blade Gap (um)"=w84, instance out=w1)
          call "Write Key (Double).gvi"(reference in=$"Config File In", key="Thickness (nm)", value=w76, error in=$"Error In", section="Deposition Method Specific Parameters") -> (reference out=w85, error out=w86)
          call "Write Key (Double).gvi"(reference in=w85, key="Blade Initial Speed (mm/s)", value=w77, error in=w86, section="Deposition Method Specific Parameters") -> (reference out=w87, error out=w88)
          call "Write Key (Boolean).gvi"(reference in=w87, key="Speed Gradient", value=w78, error in=w88, section="Deposition Method Specific Parameters") -> (reference out=w89, error out=w90)
          call "Write Key (Double).gvi"(reference in=w89, key="Blade Final Speed (mm/s)", value=w79, error in=w90, section="Deposition Method Specific Parameters") -> (reference out=w91, error out=w92)
          call "Write Key (Double).gvi"(reference in=w91, key="Dropled Volume (ul)", value=w80, error in=w92, section="Deposition Method Specific Parameters") -> (reference out=w93, error out=w94)
          call "Write Key (Double).gvi"(reference in=w93, key="Subsequent Layers", value=w81, error in=w94, section="Deposition Method Specific Parameters") -> (reference out=w95, error out=w96)
          call "Write Key (Boolean).gvi"(reference in=w95, key="Glovebox", value=w82, error in=w96, section="Deposition Method Specific Parameters") -> (reference out=w97, error out=w98)
          call "Write Key (String).gvi"(reference in=w97, key="Comments", value=w83, error in=w98, section="Deposition Method Specific Parameters") -> (reference out=w99, error out=w100)
          call "Write Key (Double).gvi"(reference in=w99, key="Blade Gap (um)", value=w84, error in=w100, section="Deposition Method Specific Parameters") -> (reference out=w101, error out=w102)
          call "Write Key (Double).gvi"(reference in=w101, key="Blade Temperature (ºC)", error in=w102, section="Deposition Method Specific Parameters") -> (reference out=w3, error out=w2)
        }
        frame "General Parameters", Default {
          Property Node(instance in=$"Full Layer Information In") -> ("General Parameters:Thickness (nm)"=w103, "General Parameters:Material"=w104, "General Parameters:Comments"=w105, instance out=w1)
          call "Write Key (Double).gvi"(reference in=$"Config File In", key="Thickness (nm)", value=w103, section="Deposition Method Specific Parameters") -> (reference out=w106, error out=w107)
          call "Write Key (String).gvi"(reference in=w106, key="Material", value=w104, error in=w107, section="Deposition Method Specific Parameters") -> (reference out=w108, error out=w109)
          call "Write Key (String).gvi"(reference in=w108, key="Comments", value=w105, error in=w109, section="Deposition Method Specific Parameters") -> (reference out=w3, error out=w2)
        }
      }
    }
  }
  $"Config File Ref Out" <- w3
  $"Error Out" <- w2
  $"Full Layer Information Out" <- w1
