vi "Single File Load.gvi"   [LabVIEW NXG 5.0.0]
inputs:
  "Error In": error
  "Full Layer Information In": "Full Layer Information.gtype"
  "Layer Type Data Path": path
outputs:
  "Error Out": error
  "Full Layer Information Out": "Full Layer Information.gtype"
types:
  "Blade Coating Parameters.gtype" = cluster{"Thickness (nm)": f64, "Blade Initial Speed (mm/s)": f64, "Speed Gradient": bool, "Blade Final Speed (mm/s)": f64, "Blade Gap (um)": f64, "Blade Temperature (ºC)": f64, "Droplet Volume (ul)": f64, "Subsequent layers": f64, "Glovebox": bool, "Comments": string}
  "Deposition Method.gtype" = enum{"Blade Coating", "Spin Coating", "Thermal Evaporation", "E-beam Evaporation", "Sputtering", "Drop Casting", "Dip Coating", "Pulsed Laser Deposition", "Chemical Vapour Deposition", "Atomic Layer Deposition", "Spray Coating", "Screen Printing", "Electroplating", "Molecular Beam Epitaxy", "Custom Deposition"}
  "Layer Type.gtype" = enum{"Front Electrode", "Electrode Transport Layer", "Active Layer", "Hole Transport Layer", "Back Electrode", "Annealing Treatment", "Encapsulation", "Custom Layer"}
  "Spin Coating Parameters.gtype" = cluster{"Thickness (nm)": f64, "Spin Speed (rpm)": f64, "Dynamic Deposition": bool, "Spin Acceleration (rpm/s)": f64, "Droplet Volume (ul)": f64, "Subsequent layers": f64, "Glovebox": bool, "Comments": string}
  "Thermal Evaporation Parameters.gtype" = cluster{"Thickness (nm)": f64, "Deposition Rate (nm/s)": f64, "Comments": string, "Sample Rotation": bool, "Material": string}
  "Solution Information.gtype" = cluster{"Concentration (mg/ml)": f64, "Stirring Time (kr)": f64, "Glovebox": bool, "Composition Array": cluster{"Material": string, "Ratio": f64}[], "Solvent Array": cluster{"Solvent": string, "Ratio": f64}[], "Solution Preparation Date": f64, "Comments": string}
  "General Parameters.gtype" = cluster{"Thickness (nm)": f64, "Comments": string, "Material": string}
  "Useless Cluster.gtype" = cluster{"Blade Coating Information": bool, "General Information": bool, "Solution Information": bool, "Spin Coating Information": bool, "Thermal Evaporation Information": bool}
  "Full Layer Information.gtype" = cluster{"Blade Coating Parameters": "Blade Coating Parameters.gtype", "Deposition Method": "Deposition Method.gtype", "Layer Type": "Layer Type.gtype", "Spin Coating Parameters": "Spin Coating Parameters.gtype", "Thermal Evaporation Parameters": "Thermal Evaporation Parameters.gtype", "Solution Information": "Solution Information.gtype", "General Parameters": "General Parameters.gtype", "Current Deposition Method Information Cluster": "Useless Cluster.gtype", "Layer String ID": string}
uses:
  NI::G Core::Configuration File (INI)::Open Config Data.gvi
  NI::G Core::Configuration File (INI)::Read Key::Read Key (String).gvi
  Pika IV Characterization NXG::Main Functions::Layer Composition::File Management::Low Level::String to Layer Information.gvi
  NI::G Core::Configuration File (INI)::Read Key::Read Key (Double).gvi
  NI::G Core::Configuration File (INI)::Read Key::Read Key (Boolean).gvi
  Pika IV Characterization NXG::Main Functions::Layer Composition::Data Management::String to Solution Arrays.gvi
  NI::G Core::Configuration File (INI)::Close Config Data.gvi
diagram:
  case ($"Error In") {
    frame Error, Default {
      w1 = $"Error In"
      w2 = $"Full Layer Information In"
    }
    frame No Error {
      call "Open Config Data.gvi"(configuration file=$"Layer Type Data Path", error in=$"Error In") -> (reference=w3, error out=w4)
      call "Read Key (String).gvi"(reference in=w3, key="Layer String ID", error in=w4, section="General Information") -> (reference out=w5, value=w6, error out=w7)
      call "Read Key (String).gvi"(reference in=w5, key="Layer Type", error in=w7, section="General Information") -> (reference out=w8, value=w9, error out=w10)
      call "String to Layer Information.gvi"(Info To Retreive="Deposition Method", String To Convert=w9, Error In=w10) -> (Deposition Method=w11, Error Out=w12)
      call "Read Key (String).gvi"(reference in=w8, key="Deposition Method", error in=w12, section="General Information") -> (reference out=w13, value=w14, error out=w15)
      call "String to Layer Information.gvi"(Info To Retreive="Layer Type", String To Convert=w14, Error In=w15) -> (Layer Type=w16, Error Out=w17)
      Property Node(instance in=$"Full Layer Information In", "Layer String ID"=w6, "Deposition Method"=w11, "Layer Type"=w16) -> (instance out=w18)
      case (w11) {
        frame "Spin Coating" {
          call "Read Key (Double).gvi"(reference in=w13, key="Thickness (nm)", error in=w17, section="Deposition Method Specific Parameters") -> (reference out=w21, value=w22, error out=w23)
          call "Read Key (Double).gvi"(reference in=w21, key="Spin Speed (rpm)", error in=w23, section="Deposition Method Specific Parameters") -> (reference out=w24, value=w25, error out=w26)
          call "Read Key (Boolean).gvi"(reference in=w24, key="Dynamic Deposition", error in=w26, section="Deposition Method Specific Parameters") -> (reference out=w27, value=w28, error out=w29)
          call "Read Key (Double).gvi"(reference in=w27, key="Acceleration (rpm/s)", error in=w29, section="Deposition Method Specific Parameters") -> (reference out=w30, value=w31, error out=w32)
          call "Read Key (Double).gvi"(reference in=w30, key="Dropled Volume (ul)", error in=w32, section="Deposition Method Specific Parameters") -> (reference out=w33, value=w34, error out=w35)
          call "Read Key (Double).gvi"(reference in=w33, key="Subsequent Layers", error in=w35, section="Deposition Method Specific Parameters") -> (reference out=w36, value=w37, error out=w38)
          call "Read Key (Boolean).gvi"(reference in=w36, key="Glovebox", error in=w38, section="Deposition Method Specific Parameters") -> (reference out=w39, value=w40, error out=w41)
          call "Read Key (String).gvi"(reference in=w39, key="Comments", error in=w41, section="Deposition Method Specific Parameters") -> (reference out=w42, value=w43, error out=w44)
          Property Node(instance in=w18, "Spin Coating Parameters:Thickness (nm)"=w22, "Spin Coating Parameters:Spin Speed (rpm)"=w25, "Spin Coating Parameters:Dynamic Deposition"=w28, "Spin Coating Parameters:Spin Acceleration (rpm/s)"=w31, "Spin Coating Parameters:Droplet Volume (ul)"=w34, "Spin Coating Parameters:Subsequent layers"=w37, "Spin Coating Parameters:Glovebox"=w40, "Spin Coating Parameters:Comments"=w43) -> (instance out=w45)
          call "Read Key (Double).gvi"(reference in=w42, key="Concentration (mg/ml)", error in=w44, section="Solution Specific Parameters") -> (reference out=w46, value=w47, error out=w48)
          call "Read Key (Double).gvi"(reference in=w46, key="Stirring Time (kr)", error in=w48, section="Solution Specific Parameters") -> (reference out=w49, value=w50, error out=w51)
          call "Read Key (Boolean).gvi"(reference in=w49, key="Glovebox", error in=w51, section="Solution Specific Parameters") -> (reference out=w52, value=w53, error out=w54)
          call "Read Key (String).gvi"(reference in=w52, key="Composition Array", error in=w54, section="Solution Specific Parameters") -> (reference out=w55, value=w56, error out=w57)
          call "Read Key (String).gvi"(reference in=w55, key="Solvent Array", error in=w57, section="Solution Specific Parameters") -> (reference out=w58, value=w59, error out=w60)
          call "Read Key (Double).gvi"(reference in=w58, key="Preparation Date", error in=w60, section="Solution Specific Parameters") -> (reference out=w61, value=w62, error out=w63)
          call "Read Key (String).gvi"(reference in=w61, key="Comments", error in=w63, section="Solution Specific Parameters") -> (reference out=w20, value=w64, error out=w65)
          call "String to Solution Arrays.gvi"(Solvent String=w59, Composition String=w56, Error In=w65) -> (Solvent Array Out=w66, Composition Array Out=w67, Error Out=w19)
          Property Node(instance in=w45, "Solution Information:Concentration (mg/ml)"=w47, "Solution Information:Stirring Time (kr)"=w50, "Solution Information:Glovebox"=w53, "Solution Information:Composition Array"=w67, "Solution Information:Solvent Array"=w66, "Solution Information:Solution Preparation Date"=w62, "Solution Information:Comments"=w64) -> (instance out=w2)
        }
        frame "Blade Coating", Default {
          call "Read Key (Double).gvi"(reference in=w13, key="Thickness (nm)", error in=w17, section="Deposition Method Specific Parameters") -> (reference out=w68, value=w69, error out=w70)
          call "Read Key (Double).gvi"(reference in=w68, key="Blade Initial Speed (mm/s)", error in=w70, section="Deposition Method Specific Parameters") -> (reference out=w71, value=w72, error out=w73)
          call "Read Key (Boolean).gvi"(reference in=w71, key="Speed Gradient", error in=w73, section="Deposition Method Specific Parameters") -> (reference out=w74, value=w75, error out=w76)
          call "Read Key (Double).gvi"(reference in=w74, key="Blade Final Speed (mm/s)", error in=w76, section="Deposition Method Specific Parameters") -> (reference out=w77, value=w78, error out=w79)
          call "Read Key (Double).gvi"(reference in=w77, key="Dropled Volume (ul)", error in=w79, section="Deposition Method Specific Parameters") -> (reference out=w80, value=w81, error out=w82)
          call "Read Key (Double).gvi"(reference in=w80, key="Subsequent Layers", error in=w82, section="Deposition Method Specific Parameters") -> (reference out=w83, value=w84, error out=w85)
          call "Read Key (Boolean).gvi"(reference in=w83, key="Glovebox", error in=w85, section="Deposition Method Specific Parameters") -> (reference out=w86, value=w87, error out=w88)
          call "Read Key (String).gvi"(reference in=w86, key="Comments", error in=w88, section="Deposition Method Specific Parameters") -> (reference out=w89, value=w90, error out=w91)
          call "Read Key (Double).gvi"(reference in=w89, key="Blade Gap (um)", error in=w91, section="Deposition Method Specific Parameters") -> (reference out=w92, value=w93, error out=w94)
          call "Read Key (Double).gvi"(reference in=w92, key="Blade Temperature (ºC)", error in=w94, section="Deposition Method Specific Parameters") -> (reference out=w95, value=w96, error out=w97)
          Property Node(instance in=w18, "Blade Coating Parameters:Thickness (nm)"=w69, "Blade Coating Parameters:Blade Initial Speed (mm/s)"=w72, "Blade Coating Parameters:Speed Gradient"=w75, "Blade Coating Parameters:Blade Final Speed (mm/s)"=w78, "Blade Coating Parameters:Droplet Volume (ul)"=w81, "Blade Coating Parameters:Subsequent layers"=w84, "Blade Coating Parameters:Glovebox"=w87, "Blade Coating Parameters:Comments"=w90, "Blade Coating Parameters:Blade Gap (um)"=w93, "Blade Coating Parameters:Blade Temperature (ºC)"=w96) -> (instance out=w98)
          call "Read Key (Double).gvi"(reference in=w95, key="Concentration (mg/ml)", error in=w97, section="Solution Specific Parameters") -> (reference out=w99, value=w100, error out=w101)
          call "Read Key (Double).gvi"(reference in=w99, key="Stirring Time (kr)", error in=w101, section="Solution Specific Parameters") -> (reference out=w102, value=w103, error out=w104)
          call "Read Key (Boolean).gvi"(reference in=w102, key="Glovebox", error in=w104, section="Solution Specific Parameters") -> (reference out=w105, value=w106, error out=w107)
          call "Read Key (String).gvi"(reference in=w105, key="Composition Array", error in=w107, section="Solution Specific Parameters") -> (reference out=w108, value=w109, error out=w110)
          call "Read Key (String).gvi"(reference in=w108, key="Solvent Array", error in=w110, section="Solution Specific Parameters") -> (reference out=w111, value=w112, error out=w113)
          call "Read Key (Double).gvi"(reference in=w111, key="Preparation Date", error in=w113, section="Solution Specific Parameters") -> (reference out=w114, value=w115, error out=w116)
          call "Read Key (String).gvi"(reference in=w114, key="Comments", error in=w116, section="Solution Specific Parameters") -> (reference out=w20, value=w117, error out=w118)
          call "String to Solution Arrays.gvi"(Solvent String=w112, Composition String=w109, Error In=w118) -> (Solvent Array Out=w119, Composition Array Out=w120, Error Out=w19)
          Property Node(instance in=w98, "Solution Information:Concentration (mg/ml)"=w100, "Solution Information:Stirring Time (kr)"=w103, "Solution Information:Glovebox"=w106, "Solution Information:Composition Array"=w120, "Solution Information:Solvent Array"=w119, "Solution Information:Solution Preparation Date"=w115, "Solution Information:Comments"=w117) -> (instance out=w2)
        }
        frame "Drop Casting" {
          call "Read Key (Double).gvi"(reference in=w13, key="Thickness (nm)", error in=w17, section="Deposition Method Specific Parameters") -> (reference out=w121, value=w122, error out=w123)
          call "Read Key (String).gvi"(reference in=w121, key="Material", error in=w123, section="Deposition Method Specific Parameters") -> (reference out=w124, value=w125, error out=w126)
          call "Read Key (String).gvi"(reference in=w124, key="Comments", error in=w126, section="Deposition Method Specific Parameters") -> (reference out=w127, value=w128, error out=w129)
          Property Node(instance in=w18, "General Parameters:Thickness (nm)"=w122, "General Parameters:Material"=w125, "General Parameters:Comments"=w128) -> (instance out=w130)
          call "Read Key (Double).gvi"(reference in=w127, key="Concentration (mg/ml)", error in=w129, section="Solution Specific Parameters") -> (reference out=w131, value=w132, error out=w133)
          call "Read Key (Double).gvi"(reference in=w131, key="Stirring Time (kr)", error in=w133, section="Solution Specific Parameters") -> (reference out=w134, value=w135, error out=w136)
          call "Read Key (Boolean).gvi"(reference in=w134, key="Glovebox", error in=w136, section="Solution Specific Parameters") -> (reference out=w137, value=w138, error out=w139)
          call "Read Key (String).gvi"(reference in=w137, key="Composition Array", error in=w139, section="Solution Specific Parameters") -> (reference out=w140, value=w141, error out=w142)
          call "Read Key (String).gvi"(reference in=w140, key="Solvent Array", error in=w142, section="Solution Specific Parameters") -> (reference out=w143, value=w144, error out=w145)
          call "Read Key (Double).gvi"(reference in=w143, key="Preparation Date", error in=w145, section="Solution Specific Parameters") -> (reference out=w146, value=w147, error out=w148)
          call "Read Key (String).gvi"(reference in=w146, key="Comments", error in=w148, section="Solution Specific Parameters") -> (reference out=w20, value=w149, error out=w150)
          call "String to Solution Arrays.gvi"(Solvent String=w144, Composition String=w141, Error In=w150) -> (Solvent Array Out=w151, Composition Array Out=w152, Error Out=w19)
          Property Node(instance in=w130, "Solution Information:Concentration (mg/ml)"=w132, "Solution Information:Stirring Time (kr)"=w135, "Solution Information:Glovebox"=w138, "Solution Information:Composition Array"=w152, "Solution Information:Solvent Array"=w151, "Solution Information:Solution Preparation Date"=w147, "Solution Information:Comments"=w149) -> (instance out=w2)
        }
        frame "Dip Coating" {
          call "Read Key (Double).gvi"(reference in=w13, key="Thickness (nm)", error in=w17, section="Deposition Method Specific Parameters") -> (reference out=w153, value=w154, error out=w155)
          call "Read Key (String).gvi"(reference in=w153, key="Material", error in=w155, section="Deposition Method Specific Parameters") -> (reference out=w156, value=w157, error out=w158)
          call "Read Key (String).gvi"(reference in=w156, key="Comments", error in=w158, section="Deposition Method Specific Parameters") -> (reference out=w159, value=w160, error out=w161)
          Property Node(instance in=w18, "General Parameters:Thickness (nm)"=w154, "General Parameters:Material"=w157, "General Parameters:Comments"=w160) -> (instance out=w162)
          call "Read Key (Double).gvi"(reference in=w159, key="Concentration (mg/ml)", error in=w161, section="Solution Specific Parameters") -> (reference out=w163, value=w164, error out=w165)
          call "Read Key (Double).gvi"(reference in=w163, key="Stirring Time (kr)", error in=w165, section="Solution Specific Parameters") -> (reference out=w166, value=w167, error out=w168)
          call "Read Key (Boolean).gvi"(reference in=w166, key="Glovebox", error in=w168, section="Solution Specific Parameters") -> (reference out=w169, value=w170, error out=w171)
          call "Read Key (String).gvi"(reference in=w169, key="Composition Array", error in=w171, section="Solution Specific Parameters") -> (reference out=w172, value=w173, error out=w174)
          call "Read Key (String).gvi"(reference in=w172, key="Solvent Array", error in=w174, section="Solution Specific Parameters") -> (reference out=w175, value=w176, error out=w177)
          call "Read Key (Double).gvi"(reference in=w175, key="Preparation Date", error in=w177, section="Solution Specific Parameters") -> (reference out=w178, value=w179, error out=w180)
          call "Read Key (String).gvi"(reference in=w178, key="Comments", error in=w180, section="Solution Specific Parameters") -> (reference out=w20, value=w181, error out=w182)
          call "String to Solution Arrays.gvi"(Solvent String=w176, Composition String=w173, Error In=w182) -> (Solvent Array Out=w183, Composition Array Out=w184, Error Out=w19)
          Property Node(instance in=w162, "Solution Information:Concentration (mg/ml)"=w164, "Solution Information:Stirring Time (kr)"=w167, "Solution Information:Glovebox"=w170, "Solution Information:Composition Array"=w184, "Solution Information:Solvent Array"=w183, "Solution Information:Solution Preparation Date"=w179, "Solution Information:Comments"=w181) -> (instance out=w2)
        }
        frame "Custom Deposition" {
          call "Read Key (Double).gvi"(reference in=w13, key="Thickness (nm)", error in=w17, section="Deposition Method Specific Parameters") -> (reference out=w185, value=w186, error out=w187)
          call "Read Key (String).gvi"(reference in=w185, key="Material", error in=w187, section="Deposition Method Specific Parameters") -> (reference out=w188, value=w189, error out=w190)
          call "Read Key (String).gvi"(reference in=w188, key="Comments", error in=w190, section="Deposition Method Specific Parameters") -> (reference out=w191, value=w192, error out=w193)
          Property Node(instance in=w18, "General Parameters:Thickness (nm)"=w186, "General Parameters:Material"=w189, "General Parameters:Comments"=w192) -> (instance out=w194)
          call "Read Key (Double).gvi"(reference in=w191, key="Concentration (mg/ml)", error in=w193, section="Solution Specific Parameters") -> (reference out=w195, value=w196, error out=w197)
          call "Read Key (Double).gvi"(reference in=w195, key="Stirring Time (kr)", error in=w197, section="Solution Specific Parameters") -> (reference out=w198, value=w199, error out=w200)
          call "Read Key (Boolean).gvi"(reference in=w198, key="Glovebox", error in=w200, section="Solution Specific Parameters") -> (reference out=w201, value=w202, error out=w203)
          call "Read Key (String).gvi"(reference in=w201, key="Composition Array", error in=w203, section="Solution Specific Parameters") -> (reference out=w204, value=w205, error out=w206)
          call "Read Key (String).gvi"(reference in=w204, key="Solvent Array", error in=w206, section="Solution Specific Parameters") -> (reference out=w207, value=w208, error out=w209)
          call "Read Key (Double).gvi"(reference in=w207, key="Preparation Date", error in=w209, section="Solution Specific Parameters") -> (reference out=w210, value=w211, error out=w212)
          call "Read Key (String).gvi"(reference in=w210, key="Comments", error in=w212, section="Solution Specific Parameters") -> (reference out=w20, value=w213, error out=w214)
          call "String to Solution Arrays.gvi"(Solvent String=w208, Composition String=w205, Error In=w214) -> (Solvent Array Out=w215, Composition Array Out=w216, Error Out=w19)
          Property Node(instance in=w194, "Solution Information:Concentration (mg/ml)"=w196, "Solution Information:Stirring Time (kr)"=w199, "Solution Information:Glovebox"=w202, "Solution Information:Composition Array"=w216, "Solution Information:Solvent Array"=w215, "Solution Information:Solution Preparation Date"=w211, "Solution Information:Comments"=w213) -> (instance out=w2)
        }
        frame "Spray Coating" {
          call "Read Key (Double).gvi"(reference in=w13, key="Thickness (nm)", error in=w17, section="Deposition Method Specific Parameters") -> (reference out=w217, value=w218, error out=w219)
          call "Read Key (String).gvi"(reference in=w217, key="Material", error in=w219, section="Deposition Method Specific Parameters") -> (reference out=w220, value=w221, error out=w222)
          call "Read Key (String).gvi"(reference in=w220, key="Comments", error in=w222, section="Deposition Method Specific Parameters") -> (reference out=w223, value=w224, error out=w225)
          Property Node(instance in=w18, "General Parameters:Thickness (nm)"=w218, "General Parameters:Material"=w221, "General Parameters:Comments"=w224) -> (instance out=w226)
          call "Read Key (Double).gvi"(reference in=w223, key="Concentration (mg/ml)", error in=w225, section="Solution Specific Parameters") -> (reference out=w227, value=w228, error out=w229)
          call "Read Key (Double).gvi"(reference in=w227, key="Stirring Time (kr)", error in=w229, section="Solution Specific Parameters") -> (reference out=w230, value=w231, error out=w232)
          call "Read Key (Boolean).gvi"(reference in=w230, key="Glovebox", error in=w232, section="Solution Specific Parameters") -> (reference out=w233, value=w234, error out=w235)
          call "Read Key (String).gvi"(reference in=w233, key="Composition Array", error in=w235, section="Solution Specific Parameters") -> (reference out=w236, value=w237, error out=w238)
          call "Read Key (String).gvi"(reference in=w236, key="Solvent Array", error in=w238, section="Solution Specific Parameters") -> (reference out=w239, value=w240, error out=w241)
          call "Read Key (Double).gvi"(reference in=w239, key="Preparation Date", error in=w241, section="Solution Specific Parameters") -> (reference out=w242, value=w243, error out=w244)
          call "Read Key (String).gvi"(reference in=w242, key="Comments", error in=w244, section="Solution Specific Parameters") -> (reference out=w20, value=w245, error out=w246)
          call "String to Solution Arrays.gvi"(Solvent String=w240, Composition String=w237, Error In=w246) -> (Solvent Array Out=w247, Composition Array Out=w248, Error Out=w19)
          Property Node(instance in=w226, "Solution Information:Concentration (mg/ml)"=w228, "Solution Information:Stirring Time (kr)"=w231, "Solution Information:Glovebox"=w234, "Solution Information:Composition Array"=w248, "Solution Information:Solvent Array"=w247, "Solution Information:Solution Preparation Date"=w243, "Solution Information:Comments"=w245) -> (instance out=w2)
        }
        frame "Screen Printing" {
          call "Read Key (Double).gvi"(reference in=w13, key="Thickness (nm)", error in=w17, section="Deposition Method Specific Parameters") -> (reference out=w249, value=w250, error out=w251)
          call "Read Key (String).gvi"(reference in=w249, key="Material", error in=w251, section="Deposition Method Specific Parameters") -> (reference out=w252, value=w253, error out=w254)
          call "Read Key (String).gvi"(reference in=w252, key="Comments", error in=w254, section="Deposition Method Specific Parameters") -> (reference out=w255, value=w256, error out=w257)
          Property Node(instance in=w18, "General Parameters:Thickness (nm)"=w250, "General Parameters:Material"=w253, "General Parameters:Comments"=w256) -> (instance out=w258)
          call "Read Key (Double).gvi"(reference in=w255, key="Concentration (mg/ml)", error in=w257, section="Solution Specific Parameters") -> (reference out=w259, value=w260, error out=w261)
          call "Read Key (Double).gvi"(reference in=w259, key="Stirring Time (kr)", error in=w261, section="Solution Specific Parameters") -> (reference out=w262, value=w263, error out=w264)
          call "Read Key (Boolean).gvi"(reference in=w262, key="Glovebox", error in=w264, section="Solution Specific Parameters") -> (reference out=w265, value=w266, error out=w267)
          call "Read Key (String).gvi"(reference in=w265, key="Composition Array", error in=w267, section="Solution Specific Parameters") -> (reference out=w268, value=w269, error out=w270)
          call "Read Key (String).gvi"(reference in=w268, key="Solvent Array", error in=w270, section="Solution Specific Parameters") -> (reference out=w271, value=w272, error out=w273)
          call "Read Key (Double).gvi"(reference in=w271, key="Preparation Date", error in=w273, section="Solution Specific Parameters") -> (reference out=w274, value=w275, error out=w276)
          call "Read Key (String).gvi"(reference in=w274, key="Comments", error in=w276, section="Solution Specific Parameters") -> (reference out=w20, value=w277, error out=w278)
          call "String to Solution Arrays.gvi"(Solvent String=w272, Composition String=w269, Error In=w278) -> (Solvent Array Out=w279, Composition Array Out=w280, Error Out=w19)
          Property Node(instance in=w258, "Solution Information:Concentration (mg/ml)"=w260, "Solution Information:Stirring Time (kr)"=w263, "Solution Information:Glovebox"=w266, "Solution Information:Composition Array"=w280, "Solution Information:Solvent Array"=w279, "Solution Information:Solution Preparation Date"=w275, "Solution Information:Comments"=w277) -> (instance out=w2)
        }
        frame "Thermal Evaporation" {
          call "Read Key (Double).gvi"(reference in=w13, key="Thickness (nm)", error in=w17, section="Deposition Method Specific Parameters") -> (reference out=w281, value=w282, error out=w283)
          call "Read Key (Double).gvi"(reference in=w281, key="Deposition Rate (nm/s)", error in=w283, section="Deposition Method Specific Parameters") -> (reference out=w284, value=w285, error out=w286)
          call "Read Key (Boolean).gvi"(reference in=w284, key="Sample Rotation", error in=w286, section="Deposition Method Specific Parameters") -> (reference out=w287, value=w288, error out=w289)
          call "Read Key (String).gvi"(reference in=w287, key="Material", error in=w289, section="Deposition Method Specific Parameters") -> (reference out=w290, value=w291, error out=w292)
          call "Read Key (String).gvi"(reference in=w290, key="Comments", error in=w292, section="Deposition Method Specific Parameters") -> (reference out=w20, value=w293, error out=w19)
          Property Node(instance in=w18, "Thermal Evaporation Parameters:Thickness (nm)"=w282, "Thermal Evaporation Parameters:Deposition Rate (nm/s)"=w285, "Thermal Evaporation Parameters:Sample Rotation"=w288, "Thermal Evaporation Parameters:Material"=w291, "Thermal Evaporation Parameters:Comments"=w293) -> (instance out=w2)
        }
        frame "E-beam Evaporation" {
          call "Read Key (Double).gvi"(reference in=w13, key="Thickness (nm)", error in=w17, section="Deposition Method Specific Parameters") -> (reference out=w294, value=w295, error out=w296)
          call "Read Key (String).gvi"(reference in=w294, key="Material", error in=w296, section="Deposition Method Specific Parameters") -> (reference out=w297, value=w298, error out=w299)
          call "Read Key (String).gvi"(reference in=w297, key="Comments", error in=w299, section="Deposition Method Specific Parameters") -> (reference out=w20, value=w300, error out=w19)
          Property Node(instance in=w18, "General Parameters:Thickness (nm)"=w295, "General Parameters:Material"=w298, "General Parameters:Comments"=w300) -> (instance out=w2)
        }
        frame "Electroplating" {
          call "Read Key (Double).gvi"(reference in=w13, key="Thickness (nm)", error in=w17, section="Deposition Method Specific Parameters") -> (reference out=w301, value=w302, error out=w303)
          call "Read Key (String).gvi"(reference in=w301, key="Material", error in=w303, section="Deposition Method Specific Parameters") -> (reference out=w304, value=w305, error out=w306)
          call "Read Key (String).gvi"(reference in=w304, key="Comments", error in=w306, section="Deposition Method Specific Parameters") -> (reference out=w20, value=w307, error out=w19)
          Property Node(instance in=w18, "General Parameters:Thickness (nm)"=w302, "General Parameters:Material"=w305, "General Parameters:Comments"=w307) -> (instance out=w2)
        }
        frame "Molecular Beam Epitaxy" {
          call "Read Key (Double).gvi"(reference in=w13, key="Thickness (nm)", error in=w17, section="Deposition Method Specific Parameters") -> (reference out=w308, value=w309, error out=w310)
          call "Read Key (String).gvi"(reference in=w308, key="Material", error in=w310, section="Deposition Method Specific Parameters") -> (reference out=w311, value=w312, error out=w313)
          call "Read Key (String).gvi"(reference in=w311, key="Comments", error in=w313, section="Deposition Method Specific Parameters") -> (reference out=w20, value=w314, error out=w19)
          Property Node(instance in=w18, "General Parameters:Thickness (nm)"=w309, "General Parameters:Material"=w312, "General Parameters:Comments"=w314) -> (instance out=w2)
        }
        frame "Pulsed Laser Deposition" {
          call "Read Key (Double).gvi"(reference in=w13, key="Thickness (nm)", error in=w17, section="Deposition Method Specific Parameters") -> (reference out=w315, value=w316, error out=w317)
          call "Read Key (String).gvi"(reference in=w315, key="Material", error in=w317, section="Deposition Method Specific Parameters") -> (reference out=w318, value=w319, error out=w320)
          call "Read Key (String).gvi"(reference in=w318, key="Comments", error in=w320, section="Deposition Method Specific Parameters") -> (reference out=w20, value=w321, error out=w19)
          Property Node(instance in=w18, "General Parameters:Thickness (nm)"=w316, "General Parameters:Material"=w319, "General Parameters:Comments"=w321) -> (instance out=w2)
        }
        frame "Chemical Vapour Deposition" {
          call "Read Key (Double).gvi"(reference in=w13, key="Thickness (nm)", error in=w17, section="Deposition Method Specific Parameters") -> (reference out=w322, value=w323, error out=w324)
          call "Read Key (String).gvi"(reference in=w322, key="Material", error in=w324, section="Deposition Method Specific Parameters") -> (reference out=w325, value=w326, error out=w327)
          call "Read Key (String).gvi"(reference in=w325, key="Comments", error in=w327, section="Deposition Method Specific Parameters") -> (reference out=w20, value=w328, error out=w19)
          Property Node(instance in=w18, "General Parameters:Thickness (nm)"=w323, "General Parameters:Material"=w326, "General Parameters:Comments"=w328) -> (instance out=w2)
        }
        frame "Atomic Layer Deposition" {
          call "Read Key (Double).gvi"(reference in=w13, key="Thickness (nm)", error in=w17, section="Deposition Method Specific Parameters") -> (reference out=w329, value=w330, error out=w331)
          call "Read Key (String).gvi"(reference in=w329, key="Material", error in=w331, section="Deposition Method Specific Parameters") -> (reference out=w332, value=w333, error out=w334)
          call "Read Key (String).gvi"(reference in=w332, key="Comments", error in=w334, section="Deposition Method Specific Parameters") -> (reference out=w20, value=w335, error out=w19)
          Property Node(instance in=w18, "General Parameters:Thickness (nm)"=w330, "General Parameters:Material"=w333, "General Parameters:Comments"=w335) -> (instance out=w2)
        }
        frame "Sputtering" {
          call "Read Key (Double).gvi"(reference in=w13, key="Thickness (nm)", error in=w17, section="Deposition Method Specific Parameters") -> (reference out=w336, value=w337, error out=w338)
          call "Read Key (String).gvi"(reference in=w336, key="Material", error in=w338, section="Deposition Method Specific Parameters") -> (reference out=w339, value=w340, error out=w341)
          call "Read Key (String).gvi"(reference in=w339, key="Comments", error in=w341, section="Deposition Method Specific Parameters") -> (reference out=w20, value=w342, error out=w19)
          Property Node(instance in=w18, "General Parameters:Thickness (nm)"=w337, "General Parameters:Material"=w340, "General Parameters:Comments"=w342) -> (instance out=w2)
        }
      }
      call "Close Config Data.gvi"(reference=w20, error in=w19) -> (error out=w1)
    }
  }
  $"Error Out" <- w1
  $"Full Layer Information Out" <- w2
