vi "Single File Save.gvi"   [LabVIEW NXG 5.0.0]
inputs:
  "Error In": error
  "Full Layer Information In": "Full Layer Information.gtype"
  "Layer Type Data Path": path
  "Prompt?": bool = TRUE
outputs:
  "Error Out": error
types:
  "Blade Coating Parameters.gtype" = cluster{"Thickness (nm)": f64, "Blade Initial Speed (mm/s)": f64, "Speed Gradient": bool, "Blade Final Speed (mm/s)": f64, "Blade Gap (um)": f64, "Blade Temperature (ºC)": f64, "Droplet Volume (ul)": f64, "Subsequent layers": f64, "Glovebox": bool, "Comments": string}
  "Deposition Method.gtype" = enum{"Blade Coating", "Spin Coating", "Thermal Evaporation", "E-beam Evaporation", "Sputtering", "Drop Casting", "Dip Coating", "Pulsed Laser Deposition", "Chemical Vapour Deposition", "Atomic Layer Deposition", "Spray Coating", "Screen Printing", "Electroplating", "Molecular Beam Epitaxy", "Custom Deposition"}
  "Layer Type.gtype" = enum{"Front Electrode", "Electrode Transport Layer", "Active Layer", "Hole Transport Layer", "Back Electrode", "Annealing Treatment", "Encapsulation", "Custom Layer"}
  "Spin Coating Parameters.gtype" = cluster{"Thickness (nm)": f64, "Spin Speed (rpm)": f64, "Dynamic Deposition": bool, "Spin Acceleration (rpm/s)": f64, "Droplet Volume (ul)": f64, "Subsequent layers": f64, "Glovebox": bool, "Comments": string}
  "Thermal Evaporation Parameters.gtype" = cluster{"Thickness (nm)": f64, "Deposition Rate (nm/s)": f64, "Comments": string, "Sample Rotation": bool, "Material": string}
  "Solution Information.gtype" = cluster{"Concentration (mg/ml)": f64, "Stirring Time (kr)": f64, "Glovebox": bool, "Composition Array": cluster{"Material": string, "Ratio": f64}[], "Solvent Array": cluster{"Solvent": string, "Ratio": f64}[], "Solution Preparation Date": f64, "Comments": string}
  "General Parameters.gtype" = cluster{"Thickness (nm)": f64, "Comments": string, "Material": string}
  "Useless Cluster.gtype" = cluster{"Blade Coating Information": bool, "General Information": bool, "Solution Information": bool, "Spin Coating Information": bool, "Thermal Evaporation Information": bool}
  "Full Layer Information.gtype" = cluster{"Blade Coating Parameters": "Blade Coating Parameters.gtype", "Deposition Method": "Deposition Method.gtype", "Layer Type": "Layer Type.gtype", "Spin Coating Parameters": "Spin Coating Parameters.gtype", "Thermal Evaporation Parameters": "Thermal Evaporation Parameters.gtype", "Solution Information": "Solution Information.gtype", "General Parameters": "General Parameters.gtype", "Current Deposition Method Information Cluster": "Useless Cluster.gtype", "Layer String ID": string}
uses:
  NI::G Core::Configuration File (INI)::Open Config Data.gvi
  NI::G Core::Configuration File (INI)::Write Key::Write Key (String).gvi
  NI::G Core::Configuration File (INI)::Write Key::Write Key (Double).gvi
  NI::G Core::Configuration File (INI)::Write Key::Write Key (Boolean).gvi
  Pika IV Characterization NXG::Main Functions::Layer Composition::Data Management::Solution Arrays to String.gvi
  NI::G Core::Configuration File (INI)::Close Config Data.gvi
  Pika IV Characterization NXG::Side Functions::Messages And Prompts::General Simple Prompt.gvi
diagram:
  case ($"Error In") {
    frame Error, Default {
      w1 = $"Error In"
    }
    frame No Error {
      Property Node(instance in=$"Full Layer Information In") -> ("Layer String ID"=w2, "Deposition Method"=w3, "Layer Type"=w4, instance out=w5)
      call "Open Config Data.gvi"(configuration file=$"Layer Type Data Path", error in=$"Error In") -> (reference=w6, error out=w7)
      call "Write Key (String).gvi"(reference in=w6, key="Layer String ID", value=w2, error in=w7, section="General Information") -> (reference out=w8, error out=w9)
      Format Into String(errIn=w9, w4) -> (outString=w10, errOut=w11)
      call "Write Key (String).gvi"(reference in=w8, key="Layer Type", value=w10, error in=w11, section="General Information") -> (reference out=w12, error out=w13)
      Format Into String(errIn=w13, w3) -> (outString=w14, errOut=w15)
      call "Write Key (String).gvi"(reference in=w12, key="Deposition Method", value=w14, error in=w15, section="General Information") -> (reference out=w16, error out=w17)
      case (w3) {
        frame "Spin Coating" {
          Property Node(instance in=w5) -> ("Spin Coating Parameters:Thickness (nm)"=w20, "Spin Coating Parameters:Spin Speed (rpm)"=w21, "Spin Coating Parameters:Dynamic Deposition"=w22, "Spin Coating Parameters:Spin Acceleration (rpm/s)"=w23, "Spin Coating Parameters:Droplet Volume (ul)"=w24, "Spin Coating Parameters:Subsequent layers"=w25, "Spin Coating Parameters:Glovebox"=w26, "Spin Coating Parameters:Comments"=w27, instance out=w28)
          Property Node(instance in=w28) -> ("Solution Information:Concentration (mg/ml)"=w29, "Solution Information:Stirring Time (kr)"=w30, "Solution Information:Glovebox"=w31, "Solution Information:Composition Array"=w32, "Solution Information:Solvent Array"=w33, "Solution Information:Solution Preparation Date"=w34, "Solution Information:Comments"=w35, instance out=w36)
          call "Write Key (Double).gvi"(reference in=w16, key="Thickness (nm)", value=w20, error in=w17, section="Deposition Method Specific Parameters") -> (reference out=w37, error out=w38)
          call "Write Key (Double).gvi"(reference in=w37, key="Spin Speed (rpm)", value=w21, error in=w38, section="Deposition Method Specific Parameters") -> (reference out=w39, error out=w40)
          call "Write Key (Boolean).gvi"(reference in=w39, key="Dynamic Deposition", value=w22, error in=w40, section="Deposition Method Specific Parameters") -> (reference out=w41, error out=w42)
          call "Write Key (Double).gvi"(reference in=w41, key="Acceleration (rpm/s)", value=w23, error in=w42, section="Deposition Method Specific Parameters") -> (reference out=w43, error out=w44)
          call "Write Key (Double).gvi"(reference in=w43, key="Dropled Volume (ul)", value=w24, error in=w44, section="Deposition Method Specific Parameters") -> (reference out=w45, error out=w46)
          call "Write Key (Double).gvi"(reference in=w45, key="Subsequent Layers", value=w25, error in=w46, section="Deposition Method Specific Parameters") -> (reference out=w47, error out=w48)
          call "Write Key (Boolean).gvi"(reference in=w47, key="Glovebox", value=w26, error in=w48, section="Deposition Method Specific Parameters") -> (reference out=w49, error out=w50)
          call "Write Key (String).gvi"(reference in=w49, key="Comments", value=w27, error in=w50, section="Deposition Method Specific Parameters") -> (reference out=w51, error out=w52)
          call "Solution Arrays to String.gvi"(Solution Information:Composition Array In=w32, Solution Information:Solvent Array In=w33, Error In=w52) -> (Solvent Information String Out=w53, Composition Information String Out=w54, Error Out=w55)
          call "Write Key (Double).gvi"(reference in=w51, key="Concentration (mg/ml)", value=w29, error in=w55, section="Solution Specific Parameters") -> (reference out=w56, error out=w57)
          call "Write Key (Double).gvi"(reference in=w56, key="Stirring Time (kr)", value=w30, error in=w57, section="Solution Specific Parameters") -> (reference out=w58, error out=w59)
          call "Write Key (Boolean).gvi"(reference in=w58, key="Glovebox", value=w31, error in=w59, section="Solution Specific Parameters") -> (reference out=w60, error out=w61)
          call "Write Key (String).gvi"(reference in=w60, key="Composition Array", value=w54, error in=w61, section="Solution Specific Parameters") -> (reference out=w62, error out=w63)
          call "Write Key (String).gvi"(reference in=w62, key="Solvent Array", value=w53, error in=w63, section="Solution Specific Parameters") -> (reference out=w64, error out=w65)
          call "Write Key (Double).gvi"(reference in=w64, key="Preparation Date", value=w34, error in=w65, section="Solution Specific Parameters") -> (reference out=w66, error out=w67)
          call "Write Key (String).gvi"(reference in=w66, key="Comments", value=w35, error in=w67, section="Solution Specific Parameters") -> (reference out=w19, error out=w18)
        }
        frame "Blade Coating", Default {
          Property Node(instance in=w5) -> ("Blade Coating Parameters:Thickness (nm)"=w68, "Blade Coating Parameters:Blade Initial Speed (mm/s)"=w69, "Blade Coating Parameters:Speed Gradient"=w70, "Blade Coating Parameters:Blade Final Speed (mm/s)"=w71, "Blade Coating Parameters:Droplet Volume (ul)"=w72, "Blade Coating Parameters:Subsequent layers"=w73, "Blade Coating Parameters:Glovebox"=w74, "Blade Coating Parameters:Comments"=w75, "Blade Coating Parameters:Blade Gap (um)"=w76, "Blade Coating Parameters:Blade Temperature (ºC)"=w77, instance out=w78)
          Property Node(instance in=w78) -> ("Solution Information:Concentration (mg/ml)"=w79, "Solution Information:Stirring Time (kr)"=w80, "Solution Information:Glovebox"=w81, "Solution Information:Composition Array"=w82, "Solution Information:Solvent Array"=w83, "Solution Information:Solution Preparation Date"=w84, "Solution Information:Comments"=w85, instance out=w86)
          call "Write Key (Double).gvi"(reference in=w16, key="Thickness (nm)", value=w68, error in=w17, section="Deposition Method Specific Parameters") -> (reference out=w87, error out=w88)
          call "Write Key (Double).gvi"(reference in=w87, key="Blade Initial Speed (mm/s)", value=w69, error in=w88, section="Deposition Method Specific Parameters") -> (reference out=w89, error out=w90)
          call "Write Key (Boolean).gvi"(reference in=w89, key="Speed Gradient", value=w70, error in=w90, section="Deposition Method Specific Parameters") -> (reference out=w91, error out=w92)
          call "Write Key (Double).gvi"(reference in=w91, key="Blade Final Speed (mm/s)", value=w71, error in=w92, section="Deposition Method Specific Parameters") -> (reference out=w93, error out=w94)
          call "Write Key (Double).gvi"(reference in=w93, key="Dropled Volume (ul)", value=w72, error in=w94, section="Deposition Method Specific Parameters") -> (reference out=w95, error out=w96)
          call "Write Key (Double).gvi"(reference in=w95, key="Subsequent Layers", value=w73, error in=w96, section="Deposition Method Specific Parameters") -> (reference out=w97, error out=w98)
          call "Write Key (Boolean).gvi"(reference in=w97, key="Glovebox", value=w74, error in=w98, section="Deposition Method Specific Parameters") -> (reference out=w99, error out=w100)
          call "Write Key (String).gvi"(reference in=w99, key="Comments", value=w75, error in=w100, section="Deposition Method Specific Parameters") -> (reference out=w101, error out=w102)
          call "Write Key (Double).gvi"(reference in=w101, key="Blade Gap (um)", value=w76, error in=w102, section="Deposition Method Specific Parameters") -> (reference out=w103, error out=w104)
          call "Write Key (Double).gvi"(reference in=w103, key="Blade Temperature (ºC)", value=w77, error in=w104, section="Deposition Method Specific Parameters") -> (reference out=w105, error out=w106)
          call "Solution Arrays to String.gvi"(Solution Information:Composition Array In=w82, Solution Information:Solvent Array In=w83, Error In=w106) -> (Solvent Information String Out=w107, Composition Information String Out=w108, Error Out=w109)
          call "Write Key (Double).gvi"(reference in=w105, key="Concentration (mg/ml)", value=w79, error in=w109, section="Solution Specific Parameters") -> (reference out=w110, error out=w111)
          call "Write Key (Double).gvi"(reference in=w110, key="Stirring Time (kr)", value=w80, error in=w111, section="Solution Specific Parameters") -> (reference out=w112, error out=w113)
          call "Write Key (Boolean).gvi"(reference in=w112, key="Glovebox", value=w81, error in=w113, section="Solution Specific Parameters") -> (reference out=w114, error out=w115)
          call "Write Key (String).gvi"(reference in=w114, key="Composition Array", value=w108, error in=w115, section="Solution Specific Parameters") -> (reference out=w116, error out=w117)
          call "Write Key (String).gvi"(reference in=w116, key="Solvent Array", value=w107, error in=w117, section="Solution Specific Parameters") -> (reference out=w118, error out=w119)
          call "Write Key (Double).gvi"(reference in=w118, key="Preparation Date", value=w84, error in=w119, section="Solution Specific Parameters") -> (reference out=w120, error out=w121)
          call "Write Key (String).gvi"(reference in=w120, key="Comments", value=w85, error in=w121, section="Solution Specific Parameters") -> (reference out=w19, error out=w18)
        }
        frame "Drop Casting" {
          Property Node(instance in=w5) -> ("General Parameters:Thickness (nm)"=w122, "General Parameters:Material"=w123, "General Parameters:Comments"=w124, instance out=w125)
          Property Node(instance in=w125) -> ("Solution Information:Concentration (mg/ml)"=w126, "Solution Information:Stirring Time (kr)"=w127, "Solution Information:Glovebox"=w128, "Solution Information:Composition Array"=w129, "Solution Information:Solvent Array"=w130, "Solution Information:Solution Preparation Date"=w131, "Solution Information:Comments"=w132, instance out=w133)
          call "Write Key (Double).gvi"(reference in=w16, key="Thickness (nm)", value=w122, section="Deposition Method Specific Parameters") -> (reference out=w134, error out=w135)
          call "Write Key (String).gvi"(reference in=w134, key="Material", value=w123, error in=w135, section="Deposition Method Specific Parameters") -> (reference out=w136, error out=w137)
          call "Write Key (String).gvi"(reference in=w136, key="Comments", value=w124, error in=w137, section="Deposition Method Specific Parameters") -> (reference out=w138, error out=w139)
          call "Solution Arrays to String.gvi"(Solution Information:Composition Array In=w129, Solution Information:Solvent Array In=w130, Error In=w139) -> (Solvent Information String Out=w140, Composition Information String Out=w141, Error Out=w142)
          call "Write Key (Double).gvi"(reference in=w138, key="Concentration (mg/ml)", value=w126, error in=w142, section="Solution Specific Parameters") -> (reference out=w143, error out=w144)
          call "Write Key (Double).gvi"(reference in=w143, key="Stirring Time (kr)", value=w127, error in=w144, section="Solution Specific Parameters") -> (reference out=w145, error out=w146)
          call "Write Key (Boolean).gvi"(reference in=w145, key="Glovebox", value=w128, error in=w146, section="Solution Specific Parameters") -> (reference out=w147, error out=w148)
          call "Write Key (String).gvi"(reference in=w147, key="Composition Array", value=w141, error in=w148, section="Solution Specific Parameters") -> (reference out=w149, error out=w150)
          call "Write Key (String).gvi"(reference in=w149, key="Solvent Array", value=w140, error in=w150, section="Solution Specific Parameters") -> (reference out=w151, error out=w152)
          call "Write Key (Double).gvi"(reference in=w151, key="Preparation Date", value=w131, error in=w152, section="Solution Specific Parameters") -> (reference out=w153, error out=w154)
          call "Write Key (String).gvi"(reference in=w153, key="Comments", value=w132, error in=w154, section="Solution Specific Parameters") -> (reference out=w19, error out=w18)
        }
        frame "Dip Coating" {
          Property Node(instance in=w5) -> ("General Parameters:Thickness (nm)"=w155, "General Parameters:Material"=w156, "General Parameters:Comments"=w157, instance out=w158)
          Property Node(instance in=w158) -> ("Solution Information:Concentration (mg/ml)"=w159, "Solution Information:Stirring Time (kr)"=w160, "Solution Information:Glovebox"=w161, "Solution Information:Composition Array"=w162, "Solution Information:Solvent Array"=w163, "Solution Information:Solution Preparation Date"=w164, "Solution Information:Comments"=w165, instance out=w166)
          call "Write Key (Double).gvi"(reference in=w16, key="Thickness (nm)", value=w155, section="Deposition Method Specific Parameters") -> (reference out=w167, error out=w168)
          call "Write Key (String).gvi"(reference in=w167, key="Material", value=w156, error in=w168, section="Deposition Method Specific Parameters") -> (reference out=w169, error out=w170)
          call "Write Key (String).gvi"(reference in=w169, key="Comments", value=w157, error in=w170, section="Deposition Method Specific Parameters") -> (reference out=w171, error out=w172)
          call "Solution Arrays to String.gvi"(Solution Information:Composition Array In=w162, Solution Information:Solvent Array In=w163, Error In=w172) -> (Solvent Information String Out=w173, Composition Information String Out=w174, Error Out=w175)
          call "Write Key (Double).gvi"(reference in=w171, key="Concentration (mg/ml)", value=w159, error in=w175, section="Solution Specific Parameters") -> (reference out=w176, error out=w177)
          call "Write Key (Double).gvi"(reference in=w176, key="Stirring Time (kr)", value=w160, error in=w177, section="Solution Specific Parameters") -> (reference out=w178, error out=w179)
          call "Write Key (Boolean).gvi"(reference in=w178, key="Glovebox", value=w161, error in=w179, section="Solution Specific Parameters") -> (reference out=w180, error out=w181)
          call "Write Key (String).gvi"(reference in=w180, key="Composition Array", value=w174, error in=w181, section="Solution Specific Parameters") -> (reference out=w182, error out=w183)
          call "Write Key (String).gvi"(reference in=w182, key="Solvent Array", value=w173, error in=w183, section="Solution Specific Parameters") -> (reference out=w184, error out=w185)
          call "Write Key (Double).gvi"(reference in=w184, key="Preparation Date", value=w164, error in=w185, section="Solution Specific Parameters") -> (reference out=w186, error out=w187)
          call "Write Key (String).gvi"(reference in=w186, key="Comments", value=w165, error in=w187, section="Solution Specific Parameters") -> (reference out=w19, error out=w18)
        }
        frame "Custom Deposition" {
          Property Node(instance in=w5) -> ("General Parameters:Thickness (nm)"=w188, "General Parameters:Material"=w189, "General Parameters:Comments"=w190, instance out=w191)
          Property Node(instance in=w191) -> ("Solution Information:Concentration (mg/ml)"=w192, "Solution Information:Stirring Time (kr)"=w193, "Solution Information:Glovebox"=w194, "Solution Information:Composition Array"=w195, "Solution Information:Solvent Array"=w196, "Solution Information:Solution Preparation Date"=w197, "Solution Information:Comments"=w198, instance out=w199)
          call "Write Key (Double).gvi"(reference in=w16, key="Thickness (nm)", value=w188, section="Deposition Method Specific Parameters") -> (reference out=w200, error out=w201)
          call "Write Key (String).gvi"(reference in=w200, key="Material", value=w189, error in=w201, section="Deposition Method Specific Parameters") -> (reference out=w202, error out=w203)
          call "Write Key (String).gvi"(reference in=w202, key="Comments", value=w190, error in=w203, section="Deposition Method Specific Parameters") -> (reference out=w204, error out=w205)
          call "Solution Arrays to String.gvi"(Solution Information:Composition Array In=w195, Solution Information:Solvent Array In=w196, Error In=w205) -> (Solvent Information String Out=w206, Composition Information String Out=w207, Error Out=w208)
          call "Write Key (Double).gvi"(reference in=w204, key="Concentration (mg/ml)", value=w192, error in=w208, section="Solution Specific Parameters") -> (reference out=w209, error out=w210)
          call "Write Key (Double).gvi"(reference in=w209, key="Stirring Time (kr)", value=w193, error in=w210, section="Solution Specific Parameters") -> (reference out=w211, error out=w212)
          call "Write Key (Boolean).gvi"(reference in=w211, key="Glovebox", value=w194, error in=w212, section="Solution Specific Parameters") -> (reference out=w213, error out=w214)
          call "Write Key (String).gvi"(reference in=w213, key="Composition Array", value=w207, error in=w214, section="Solution Specific Parameters") -> (reference out=w215, error out=w216)
          call "Write Key (String).gvi"(reference in=w215, key="Solvent Array", value=w206, error in=w216, section="Solution Specific Parameters") -> (reference out=w217, error out=w218)
          call "Write Key (Double).gvi"(reference in=w217, key="Preparation Date", value=w197, error in=w218, section="Solution Specific Parameters") -> (reference out=w219, error out=w220)
          call "Write Key (String).gvi"(reference in=w219, key="Comments", value=w198, error in=w220, section="Solution Specific Parameters") -> (reference out=w19, error out=w18)
        }
        frame "Spray Coating" {
          Property Node(instance in=w5) -> ("General Parameters:Thickness (nm)"=w221, "General Parameters:Material"=w222, "General Parameters:Comments"=w223, instance out=w224)
          Property Node(instance in=w224) -> ("Solution Information:Concentration (mg/ml)"=w225, "Solution Information:Stirring Time (kr)"=w226, "Solution Information:Glovebox"=w227, "Solution Information:Composition Array"=w228, "Solution Information:Solvent Array"=w229, "Solution Information:Solution Preparation Date"=w230, "Solution Information:Comments"=w231, instance out=w232)
          call "Write Key (Double).gvi"(reference in=w16, key="Thickness (nm)", value=w221, section="Deposition Method Specific Parameters") -> (reference out=w233, error out=w234)
          call "Write Key (String).gvi"(reference in=w233, key="Material", value=w222, error in=w234, section="Deposition Method Specific Parameters") -> (reference out=w235, error out=w236)
          call "Write Key (String).gvi"(reference in=w235, key="Comments", value=w223, error in=w236, section="Deposition Method Specific Parameters") -> (reference out=w237, error out=w238)
          call "Solution Arrays to String.gvi"(Solution Information:Composition Array In=w228, Solution Information:Solvent Array In=w229, Error In=w238) -> (Solvent Information String Out=w239, Composition Information String Out=w240, Error Out=w241)
          call "Write Key (Double).gvi"(reference in=w237, key="Concentration (mg/ml)", value=w225, error in=w241, section="Solution Specific Parameters") -> (reference out=w242, error out=w243)
          call "Write Key (Double).gvi"(reference in=w242, key="Stirring Time (kr)", value=w226, error in=w243, section="Solution Specific Parameters") -> (reference out=w244, error out=w245)
          call "Write Key (Boolean).gvi"(reference in=w244, key="Glovebox", value=w227, error in=w245, section="Solution Specific Parameters") -> (reference out=w246, error out=w247)
          call "Write Key (String).gvi"(reference in=w246, key="Composition Array", value=w240, error in=w247, section="Solution Specific Parameters") -> (reference out=w248, error out=w249)
          call "Write Key (String).gvi"(reference in=w248, key="Solvent Array", value=w239, error in=w249, section="Solution Specific Parameters") -> (reference out=w250, error out=w251)
          call "Write Key (Double).gvi"(reference in=w250, key="Preparation Date", value=w230, error in=w251, section="Solution Specific Parameters") -> (reference out=w252, error out=w253)
          call "Write Key (String).gvi"(reference in=w252, key="Comments", value=w231, error in=w253, section="Solution Specific Parameters") -> (reference out=w19, error out=w18)
        }
        frame "Screen Printing" {
          Property Node(instance in=w5) -> ("General Parameters:Thickness (nm)"=w254, "General Parameters:Material"=w255, "General Parameters:Comments"=w256, instance out=w257)
          Property Node(instance in=w257) -> ("Solution Information:Concentration (mg/ml)"=w258, "Solution Information:Stirring Time (kr)"=w259, "Solution Information:Glovebox"=w260, "Solution Information:Composition Array"=w261, "Solution Information:Solvent Array"=w262, "Solution Information:Solution Preparation Date"=w263, "Solution Information:Comments"=w264, instance out=w265)
          call "Write Key (Double).gvi"(reference in=w16, key="Thickness (nm)", value=w254, section="Deposition Method Specific Parameters") -> (reference out=w266, error out=w267)
          call "Write Key (String).gvi"(reference in=w266, key="Material", value=w255, error in=w267, section="Deposition Method Specific Parameters") -> (reference out=w268, error out=w269)
          call "Write Key (String).gvi"(reference in=w268, key="Comments", value=w256, error in=w269, section="Deposition Method Specific Parameters") -> (reference out=w270, error out=w271)
          call "Solution Arrays to String.gvi"(Solution Information:Composition Array In=w261, Solution Information:Solvent Array In=w262, Error In=w271) -> (Solvent Information String Out=w272, Composition Information String Out=w273, Error Out=w274)
          call "Write Key (Double).gvi"(reference in=w270, key="Concentration (mg/ml)", value=w258, error in=w274, section="Solution Specific Parameters") -> (reference out=w275, error out=w276)
          call "Write Key (Double).gvi"(reference in=w275, key="Stirring Time (kr)", value=w259, error in=w276, section="Solution Specific Parameters") -> (reference out=w277, error out=w278)
          call "Write Key (Boolean).gvi"(reference in=w277, key="Glovebox", value=w260, error in=w278, section="Solution Specific Parameters") -> (reference out=w279, error out=w280)
          call "Write Key (String).gvi"(reference in=w279, key="Composition Array", value=w273, error in=w280, section="Solution Specific Parameters") -> (reference out=w281, error out=w282)
          call "Write Key (String).gvi"(reference in=w281, key="Solvent Array", value=w272, error in=w282, section="Solution Specific Parameters") -> (reference out=w283, error out=w284)
          call "Write Key (Double).gvi"(reference in=w283, key="Preparation Date", value=w263, error in=w284, section="Solution Specific Parameters") -> (reference out=w285, error out=w286)
          call "Write Key (String).gvi"(reference in=w285, key="Comments", value=w264, error in=w286, section="Solution Specific Parameters") -> (reference out=w19, error out=w18)
        }
        frame "Thermal Evaporation" {
          Property Node(instance in=w5) -> ("Thermal Evaporation Parameters:Thickness (nm)"=w287, "Thermal Evaporation Parameters:Deposition Rate (nm/s)"=w288, "Thermal Evaporation Parameters:Sample Rotation"=w289, "Thermal Evaporation Parameters:Material"=w290, "Thermal Evaporation Parameters:Comments"=w291, instance out=w292)
          call "Write Key (Double).gvi"(reference in=w16, key="Thickness (nm)", value=w287, error in=w17, section="Deposition Method Specific Parameters") -> (reference out=w293, error out=w294)
          call "Write Key (Double).gvi"(reference in=w293, key="Deposition Rate (nm/s)", value=w288, error in=w294, section="Deposition Method Specific Parameters") -> (reference out=w295, error out=w296)
          call "Write Key (Boolean).gvi"(reference in=w295, key="Sample Rotation", value=w289, error in=w296, section="Deposition Method Specific Parameters") -> (reference out=w297, error out=w298)
          call "Write Key (String).gvi"(reference in=w297, key="Material", value=w290, error in=w298, section="Deposition Method Specific Parameters") -> (reference out=w299, error out=w300)
          call "Write Key (String).gvi"(reference in=w299, key="Comments", value=w291, error in=w300, section="Deposition Method Specific Parameters") -> (reference out=w19, error out=w18)
        }
        frame "E-beam Evaporation" {
          Property Node(instance in=w5) -> ("General Parameters:Thickness (nm)"=w301, "General Parameters:Material"=w302, "General Parameters:Comments"=w303, instance out=w304)
          call "Write Key (Double).gvi"(reference in=w16, key="Thickness (nm)", value=w301, error in=w17, section="Deposition Method Specific Parameters") -> (reference out=w305, error out=w306)
          call "Write Key (String).gvi"(reference in=w305, key="Material", value=w302, error in=w306, section="Deposition Method Specific Parameters") -> (reference out=w307, error out=w308)
          call "Write Key (String).gvi"(reference in=w307, key="Comments", value=w303, error in=w308, section="Deposition Method Specific Parameters") -> (reference out=w19, error out=w18)
        }
        frame "Electroplating" {
          Property Node(instance in=w5) -> ("General Parameters:Thickness (nm)"=w309, "General Parameters:Material"=w310, "General Parameters:Comments"=w311, instance out=w312)
          call "Write Key (Double).gvi"(reference in=w16, key="Thickness (nm)", value=w309, error in=w17, section="Deposition Method Specific Parameters") -> (reference out=w313, error out=w314)
          call "Write Key (String).gvi"(reference in=w313, key="Material", value=w310, error in=w314, section="Deposition Method Specific Parameters") -> (reference out=w315, error out=w316)
          call "Write Key (String).gvi"(reference in=w315, key="Comments", value=w311, error in=w316, section="Deposition Method Specific Parameters") -> (reference out=w19, error out=w18)
        }
        frame "Molecular Beam Epitaxy" {
          Property Node(instance in=w5) -> ("General Parameters:Thickness (nm)"=w317, "General Parameters:Material"=w318, "General Parameters:Comments"=w319, instance out=w320)
          call "Write Key (Double).gvi"(reference in=w16, key="Thickness (nm)", value=w317, error in=w17, section="Deposition Method Specific Parameters") -> (reference out=w321, error out=w322)
          call "Write Key (String).gvi"(reference in=w321, key="Material", value=w318, error in=w322, section="Deposition Method Specific Parameters") -> (reference out=w323, error out=w324)
          call "Write Key (String).gvi"(reference in=w323, key="Comments", value=w319, error in=w324, section="Deposition Method Specific Parameters") -> (reference out=w19, error out=w18)
        }
        frame "Pulsed Laser Deposition" {
          Property Node(instance in=w5) -> ("General Parameters:Thickness (nm)"=w325, "General Parameters:Material"=w326, "General Parameters:Comments"=w327, instance out=w328)
          call "Write Key (Double).gvi"(reference in=w16, key="Thickness (nm)", value=w325, error in=w17, section="Deposition Method Specific Parameters") -> (reference out=w329, error out=w330)
          call "Write Key (String).gvi"(reference in=w329, key="Material", value=w326, error in=w330, section="Deposition Method Specific Parameters") -> (reference out=w331, error out=w332)
          call "Write Key (String).gvi"(reference in=w331, key="Comments", value=w327, error in=w332, section="Deposition Method Specific Parameters") -> (reference out=w19, error out=w18)
        }
        frame "Chemical Vapour Deposition" {
          Property Node(instance in=w5) -> ("General Parameters:Thickness (nm)"=w333, "General Parameters:Material"=w334, "General Parameters:Comments"=w335, instance out=w336)
          call "Write Key (Double).gvi"(reference in=w16, key="Thickness (nm)", value=w333, error in=w17, section="Deposition Method Specific Parameters") -> (reference out=w337, error out=w338)
          call "Write Key (String).gvi"(reference in=w337, key="Material", value=w334, error in=w338, section="Deposition Method Specific Parameters") -> (reference out=w339, error out=w340)
          call "Write Key (String).gvi"(reference in=w339, key="Comments", value=w335, error in=w340, section="Deposition Method Specific Parameters") -> (reference out=w19, error out=w18)
        }
        frame "Atomic Layer Deposition" {
          Property Node(instance in=w5) -> ("General Parameters:Thickness (nm)"=w341, "General Parameters:Material"=w342, "General Parameters:Comments"=w343, instance out=w344)
          call "Write Key (Double).gvi"(reference in=w16, key="Thickness (nm)", value=w341, error in=w17, section="Deposition Method Specific Parameters") -> (reference out=w345, error out=w346)
          call "Write Key (String).gvi"(reference in=w345, key="Material", value=w342, error in=w346, section="Deposition Method Specific Parameters") -> (reference out=w347, error out=w348)
          call "Write Key (String).gvi"(reference in=w347, key="Comments", value=w343, error in=w348, section="Deposition Method Specific Parameters") -> (reference out=w19, error out=w18)
        }
        frame "Sputtering" {
          Property Node(instance in=w5) -> ("General Parameters:Thickness (nm)"=w349, "General Parameters:Material"=w350, "General Parameters:Comments"=w351, instance out=w352)
          call "Write Key (Double).gvi"(reference in=w16, key="Thickness (nm)", value=w349, error in=w17, section="Deposition Method Specific Parameters") -> (reference out=w353, error out=w354)
          call "Write Key (String).gvi"(reference in=w353, key="Material", value=w350, error in=w354, section="Deposition Method Specific Parameters") -> (reference out=w355, error out=w356)
          call "Write Key (String).gvi"(reference in=w355, key="Comments", value=w351, error in=w356, section="Deposition Method Specific Parameters") -> (reference out=w19, error out=w18)
        }
      }
      call "Close Config Data.gvi"(reference=w19, error in=w18) -> (error out=w357)
      call "General Simple Prompt.gvi"(Prompt Message="Your layer has been successfully saved!", Okay Button Message="Yay :D", Error In=w357, Prompt?=$"Prompt?") -> (Error Out=w1)
    }
  }
  $"Error Out" <- w1
