vi "String to Layer Information.gvi"   [LabVIEW NXG 5.0.0]
inputs:
  "Info To Retreive": "Info To Retreive.gtype" = "Deposition Method", required
  "Error In": error
  "String To Convert": string
outputs:
  "Error Out": error
  "Deposition Method": "Deposition Method.gtype"
  "Layer Type": "Layer Type.gtype"
types:
  "Info To Retreive.gtype" = enum{"Deposition Method", "Layer Type"}
  "Deposition Method.gtype" = enum{"Blade Coating", "Spin Coating", "Thermal Evaporation", "E-beam Evaporation", "Sputtering", "Drop Casting", "Dip Coating", "Pulsed Laser Deposition", "Chemical Vapour Deposition", "Atomic Layer Deposition", "Spray Coating", "Screen Printing", "Electroplating", "Molecular Beam Epitaxy", "Custom Deposition"}
  "Layer Type.gtype" = enum{"Front Electrode", "Electrode Transport Layer", "Active Layer", "Hole Transport Layer", "Back Electrode", "Annealing Treatment", "Encapsulation", "Custom Layer"}
uses:
  Pika IV Characterization NXG::Main Functions::Layer Composition::File Management::Low Level::Deposition Method Types Extractor.gvi
  Pika IV Characterization NXG::Main Functions::Layer Composition::File Management::Low Level::Layer Types Extractor.gvi
diagram:
  # This subVI takes a folder name and checks if it
  # coincides with any of the sweep type names. If it does
  # it outputs the sweep type and also a true statement.
  case ($"Error In") {
    frame Error, Default {
      w1 = $"Error In"
    }
    frame No Error {
      case ($"Info To Retreive") {
        frame "Deposition Method" {
          call "Deposition Method Types Extractor.gvi"(Deposition Method="Blade Coating", Error In=$"Error In") -> (Deposition Method Types=w2, Error Out=w3)
          s1 = w3  # shift register
          for {
            w4 = each element of w2
            Format Into String(errIn=s1, w4) -> (outString=w6, errOut=w7)
            Search And Replace String(error in (no error)=w7, input string=$"String To Convert", search string=w6) -> (error out=w8, number of replacements=w9)
            Is Not Equal To 0(x=w9) -> w10
            append w4 to w5 if w10
            next s1 = w8
          }
          Array Index(array=w5) -> (out0[0]=w11)
          $"Deposition Method" <- w11
          w1 = s1
        }
        frame "Layer Type" {
          call "Layer Types Extractor.gvi"(Layer Type="Front Electrode", Error In=$"Error In") -> (Layer Types=w12, Error Out=w13)
          s2 = w13  # shift register
          for {
            w14 = each element of w12
            Format Into String(errIn=s2, w14) -> (outString=w16, errOut=w17)
            Search And Replace String(error in (no error)=w17, input string=$"String To Convert", search string=w16) -> (error out=w18, number of replacements=w19)
            Is Not Equal To 0(x=w19) -> w20
            append w14 to w15 if w20
            next s2 = w18
          }
          Array Index(array=w15) -> (out0[0]=w21)
          $"Layer Type" <- w21
          w1 = s2
        }
      }
    }
  }
  $"Error Out" <- w1
