vi "Write Configuration File.gvi"   [LabVIEW NXG 5.0.0]
inputs:
  "Error In": error
outputs:
  "Error Out": error
panel controls:
  "Configuration File Path": path  # configuration file path is the path to the platform-independent configuration file.
  "File Operation": "File Operation.gtype" = "Replace"
types:
  "File Operation.gtype" = enum{"Replace", "Rename", "Do not save"}
uses:
  NI::G Core::Configuration File (INI)::Open Config Data.gvi
  NI::G Core::Configuration File (INI)::Write Key::Write Key (String).gvi
  Pika IV Characterization NXG::Side Functions::Path Manipulation::Rename Prompt Window.gvi
diagram:
  case ($"Error In") {
    frame Error, Default {
      w1 = $"Error In"
    }
    frame No Error {
      case ($"File Operation") {
        frame "Replace" {
          call "Open Config Data.gvi"(configuration file=$"Configuration File Path", error in=$"Error In") -> (reference=w2, error out=w3)
          call "Write Key (String).gvi"(reference in=w2, error in=w3)
        }
        frame "Rename", Default {
          Strip Path(path=$"Configuration File Path") -> (name=w4, stripped path=w5)
          call "Rename Prompt Window.gvi"(Original Filename=w4, Error In=$"Error In") -> (Output=w6, Error Out=w7)
          Build Path(base path=w5, name or relative path=w6) -> (appended path=w8)
          Open Or Create Or Replace File(error in=w7, file path (use dialog)=w8, operation (0:open)="replace or create") -> (error out=w9, refnum out=w10)
          Write To Text File(error in=w9, file (use dialog)=w10) -> (error out=w11, refnum out=w12)
          Close File(error in=w11, refnum=w12) -> (error out=w13)
        }
        frame "Do not save" { }
      }
      w1 = _
    }
  }
  $"Error Out" <- w1
