vi "Single File Handler.gvi"   [LabVIEW NXG 5.0.0]
inputs:
  "Error In": error
  "Full Layer Information In": "Full Layer Information.gtype"
  "Author Path": path
  "File Operation": "Configuration File Operation.gtype" = "Save Configuration File"
outputs:
  "Error Out": error
  "Full Layer Information Out": "Full Layer Information.gtype"
types:
  "Blade Coating Parameters.gtype" = cluster{"Thickness (nm)": f64, "Blade Initial Speed (mm/s)": f64, "Speed Gradient": bool, "Blade Final Speed (mm/s)": f64, "Blade Gap (um)": f64, "Blade Temperature (ºC)": f64, "Droplet Volume (ul)": f64, "Subsequent layers": f64, "Glovebox": bool, "Comments": string}
  "Deposition Method.gtype" = enum{"Blade Coating", "Spin Coating", "Thermal Evaporation", "E-beam Evaporation", "Sputtering", "Drop Casting", "Dip Coating", "Pulsed Laser Deposition", "Chemical Vapour Deposition", "Atomic Layer Deposition", "Spray Coating", "Screen Printing", "Electroplating", "Molecular Beam Epitaxy", "Custom Deposition"}
  "Layer Type.gtype" = enum{"Front Electrode", "Electrode Transport Layer", "Active Layer", "Hole Transport Layer", "Back Electrode", "Annealing Treatment", "Encapsulation", "Custom Layer"}
  "Spin Coating Parameters.gtype" = cluster{"Thickness (nm)": f64, "Spin Speed (rpm)": f64, "Dynamic Deposition": bool, "Spin Acceleration (rpm/s)": f64, "Droplet Volume (ul)": f64, "Subsequent layers": f64, "Glovebox": bool, "Comments": string}
  "Thermal Evaporation Parameters.gtype" = cluster{"Thickness (nm)": f64, "Deposition Rate (nm/s)": f64, "Comments": string, "Sample Rotation": bool, "Material": string}
  "Solution Information.gtype" = cluster{"Concentration (mg/ml)": f64, "Stirring Time (kr)": f64, "Glovebox": bool, "Composition Array": cluster{"Material": string, "Ratio": f64}[], "Solvent Array": cluster{"Solvent": string, "Ratio": f64}[], "Solution Preparation Date": f64, "Comments": string}
  "General Parameters.gtype" = cluster{"Thickness (nm)": f64, "Comments": string, "Material": string}
  "Useless Cluster.gtype" = cluster{"Blade Coating Information": bool, "General Information": bool, "Solution Information": bool, "Spin Coating Information": bool, "Thermal Evaporation Information": bool}
  "Full Layer Information.gtype" = cluster{"Blade Coating Parameters": "Blade Coating Parameters.gtype", "Deposition Method": "Deposition Method.gtype", "Layer Type": "Layer Type.gtype", "Spin Coating Parameters": "Spin Coating Parameters.gtype", "Thermal Evaporation Parameters": "Thermal Evaporation Parameters.gtype", "Solution Information": "Solution Information.gtype", "General Parameters": "General Parameters.gtype", "Current Deposition Method Information Cluster": "Useless Cluster.gtype", "Layer String ID": string}
  "Configuration File Operation.gtype" = enum{"Save Configuration File", "Load Configuration File", "Erase Configuration File"}
uses:
  Pika IV Characterization NXG::Side Functions::Path Manipulation::Name File Prompt Window.gvi
  Pika IV Characterization NXG::Side Functions::Path Manipulation::Path Already Exists prompt.gvi
  Pika IV Characterization NXG::Main Functions::Layer Composition::File Management::Low Level::Single File Save.gvi
  Pika IV Characterization NXG::Side Functions::Path Manipulation::Rename Prompt Window.gvi
  NI::G Core::Error::Clear Error Cluster.gvi
  Pika IV Characterization NXG::Main Functions::Layer Composition::File Management::Low Level::Single File Load.gvi
diagram:
  # This subVI Saves or loads the layer files
  case ($"Error In") {
    frame Error, Default {
      w1 = $"Error In"
      w2 = $"Full Layer Information In"
    }
    frame No Error {
      case ($"File Operation") {
        frame "Save Configuration File", Default {
          call "Name File Prompt Window.gvi"(Error In=$"Error In", Exclusive focus?=FALSE) -> (Output=w3, Error Out=w4)
          Build Path(base path=$"Author Path", name or relative path=w3) -> (appended path=w5)
          call "Path Already Exists prompt.gvi"(Path to Check=w5, Error In=w4) -> (Existing File Instruction out=w6, Error Out=w7)
          case (w6) {
            frame "Replace" {
              call "Single File Save.gvi"(Full Layer Information In=$"Full Layer Information In", Layer Type Data Path=w5, Error In=w7) -> (Error Out=w1)
              w2 = $"Full Layer Information In"
            }
            frame "Rename", Default {
              Strip Path(path=w5) -> (name=w8, stripped path=w9)
              call "Rename Prompt Window.gvi"(Original Filename=w8, Error In=w7) -> (Output=w10, Error Out=w11)
              Build Path(base path=w9, name or relative path=w10) -> (appended path=w12)
              call "Single File Save.gvi"(Full Layer Information In=$"Full Layer Information In", Layer Type Data Path=w12, Error In=w11) -> (Error Out=w1)
              w2 = $"Full Layer Information In"
            }
            frame "Do not save" {
              w1 = w7
              w2 = $"Full Layer Information In"
            }
          }
        }
        frame "Load Configuration File" {
          File Dialog[FileDialogSelectionMode=File, NewOrExistingMode=New](button label="This one please", error in=$"Error In", pattern (all files)="*.ini", pattern label="IV Layer Files (.ini)", prompt="Please select the layer file you want to load", start path=$"Author Path") -> (cancelled=w13, error out=w14, selected path=w15)
          case (w13) {
            frame True {
              call "Clear Error Cluster.gvi"(error in=w14) -> (error out=w1)
              w2 = $"Full Layer Information In"
            }
            frame False {
              call "Single File Load.gvi"(Full Layer Information In=$"Full Layer Information In", Layer Type Data Path=w15, Error In=w14) -> (Full Layer Information Out=w2, Error Out=w1)
            }
          }
        }
      }
    }
  }
  $"Full Layer Information Out" <- w2
  $"Error Out" <- w1
