vi "New Layer Prompt.gvi"   [LabVIEW NXG 5.0.0]
inputs:
  "Error In": error
  "Misc Data Mega Cluster In": "Misc Mega Cluster.gtype"
  "JV Measurements Mega Cluster In": "JV Measurements Mega Cluster.gtype"
outputs:
  "Error Out": error
  "Misc Mega Cluster Data Out": "Misc Mega Cluster.gtype"
  "JV Measurements Mega Cluster Out": "JV Measurements Mega Cluster.gtype"
  "Cancelled?": bool
  "Layer String ID Array": string[]
panel controls:
  "Layer Type": "Layer Type.gtype" = "Front Electrode"
  "Deposition Method": "Deposition Method.gtype" = "Blade Coating"
  "Blade Coating Parameters": "Blade Coating Parameters.gtype"
  "Solution Information": "Solution Information.gtype"
  "Spin Coating Parameters": "Spin Coating Parameters.gtype"
  "Thermal Evaporation Parameters": "Thermal Evaporation Parameters.gtype"
  "General Parameters": "General Parameters.gtype"
  "Add Layer Button": bool
  "Save Layer File": bool
  "Load Layer File": bool
  "Cancel Button": bool
  "Reset Layer Button": bool
  "Layer Controls Prompt Ref Cluster In": "Layer Controls Prompt Ref Cluster.gtype"
types:
  "Layer Type.gtype" = enum{"Front Electrode", "Electron Transport Layer", "Active Layer", "Hole Transport Layer", "Back Electrode", "Custom Layer"}
  "Deposition Method.gtype" = enum{"Blade Coating", "Spin Coating", "Thermal Evaporation", "E-beam Evaporation", "Sputtering", "Drop Casting", "Dip Coating", "Pulsed Laser Deposition", "Chemical Vapour Deposition", "Atomic Layer Deposition", "Spray Coating", "Screen Printing", "Electroplating", "Molecular Beam Epitaxy", "Custom Deposition"}
  "Blade Coating Parameters.gtype" = cluster{"Thickness (nm)": f64, "Blade Initial Speed (mm/s)": f64, "Speed Gradient": bool, "Blade Final Speed (mm/s)": f64, "Blade Gap (um)": f64, "Blade Temperature (ºC)": f64, "Droplet Volume (ul)": f64, "Subsequent layers": f64, "Glovebox": bool, "Comments": string}
  "Solution Information.gtype" = cluster{"Concentration (mg/ml)": f64, "Stir Time (kr)": f64, "Composition Array": cluster{"Material": string, "Ratio": f64}[], "Solvent Array": cluster{"Solvent": string, "Ratio": f64}[], "Solution Preparation Date": string, "Comments": string, "Stir Temp (ºC)": f64, "Glovebox": bool, "Solution Label": string, "Solution Descriptor": string, "Volume (ul)": f64}
  "Spin Coating Parameters.gtype" = cluster{"Thickness (nm)": f64, "Spin Speed (rpm)": f64, "Dynamic Deposition": bool, "Spin Acceleration (rpm/s)": f64, "Droplet Volume (ul)": f64, "Subsequent layers": f64, "Glovebox": bool, "Comments": string, "Spin Time (s)": f64}
  "Thermal Evaporation Parameters.gtype" = cluster{"Thickness (nm)": f64, "Deposition Rate (nm/s)": f64, "Comments": string, "Sample Rotation": bool, "Material": string}
  "General Parameters.gtype" = cluster{"Thickness (nm)": f64, "Comments": string, "Material": string}
  T1 = cluster{"State Ref": "StringControl reference", "Substate Ref": "StringControl reference", "Current State Ref": "EnumSelector reference", "Main Tab Ref": "TabControl reference", "Plot Now Flag Ref": "BooleanControl reference"}
  T2 = cluster{"Default Data Saving Location Ref": "PathSelector reference"}
  T3 = cluster{"Author Initials Ref": "ComboBoxSelector reference", "Batch Name Ref": "StringControl reference", "Cell Number Ref": "StringControl reference", "Current Date Ref": "StringControl reference", "Sample Comments Ref": "StringControl reference", "Sample Prefix Ref": "StringControl reference", "Custom Date Ref": "CheckBox reference", "Label Info Error Label Ref": "StringControl reference", "Label Info Missing Error Ref": "BooleanControl reference"}
  T4 = cluster{"Cell Parameters Ref": "Cluster reference", "Cell Selector Ref": "Cluster reference", "Measurement Precision Ref": "Cluster reference", "JV Scan Mode Ref": "EnumSelector reference"}
  T5 = cluster{"Progress % Ref": "ProgressBar reference", "Progress Counter Ref": "NumericTextBoxDouble reference", "Live JV Parameters Ref": "Cluster reference"}
  T6 = cluster{"Layer Information Ref": "ArrayViewer reference"[]}
  T7 = cluster{"Cell Selector Block Ref": "Rectangle reference", "Smart Mode Block Ref": "Rectangle reference", "dV Block Ref": "Rectangle reference", "Smart Mode Text Ref": "Text reference", "No Multiplexer Detected Text Ref": "Text reference", "Current Range Block Ref": "Rectangle reference"}
  T8 = cluster{"JV Measurements Mega Cluster Ref": "Cluster reference", "Instrument Control Mega Cluster Ref": "Cluster reference"}
  T9 = cluster{"JV Main Graph Ref": "Graph reference", "Voc Graph Ref ": "Graph reference", "Jsc Graph Ref": "Graph reference", "Efficiency Graph Ref": "Graph reference", "Fill Factor Graph Ref": "Graph reference", "Series Resistance Graph Ref": "Graph reference", "Shunt Resistance Graph Ref": "Graph reference"}
  "Full Reference Cluster.gtype" = cluster{"Status Report": T1, "Path Cluster": T2, "Sample Naming Cluster": T3, "Acquisition Parameters": T4, "Live Progress Cluster": T5, "Sample Extra Information": T6, "Visual Elements": T7, "Mega Cluster References": T8, "Plotting": T9, "System Parameters": cluster{"Main VI Ref": VIRefnum}}
  "Misc Mega Cluster.gtype" = cluster{"Full Reference Cluster": "Full Reference Cluster.gtype"}
  "Cell Selector.gtype" = enum{"L.01", "L.02", "L.03", "L.04", "L.05", "L.06", "L.07", "L.08", "L.09", "L.10", "L.11", "L.12", "R.01", "R.02", "R.03", "R.04", "R.05", "R.06", "R.07", "R.08", "R.09", "R.10", "R.11", "R.12", "Custom"}
  "JV Data Cluster.gtype" = cluster{"Voltage (V)": f64[], "Current (A)": f64[], "Current Density (A/m^2)": f64[], "Cell Area (m^2)": f64, "Illumination (W/m^2)": f64, "Voc (V)": f64, "Jsc (A/m^2)": f64, "FF (%)": f64, "Rsh (Ω · m^2)": f64, "Rs (Ω · m^2)": f64, "Eff (%)": f64, "Measured Cell": "Cell Selector.gtype", "No Multiplexer": bool}
  "JV Scan Mode.gtype" = enum{"Rough", "Normal", "Accurate", "Smart", "Custom"}
  "JV Curve Parameters.gtype" = cluster{"JV Scan Mode": "JV Scan Mode.gtype", "Measurement Precision": "Accuracy Parameters.gtype", "Cell Parameters": "Cell Parameters.gtype"}
  "Full Layer Information.gtype" = cluster{"Blade Coating Parameters": "Blade Coating Parameters.gtype", "Deposition Method": "Deposition Method.gtype", "Layer Type": "Layer Type.gtype", "Spin Coating Parameters": "Spin Coating Parameters.gtype", "Thermal Evaporation Parameters": "Thermal Evaporation Parameters.gtype", "Solution Information": "Solution Information.gtype", "General Parameters": "General Parameters.gtype", "Current Deposition Method Information Cluster": "Useless Cluster.gtype", "Layer String ID": string}
  "JV Measurements Mega Cluster.gtype" = cluster{"Cell Array": "Cell Selector.gtype"[], "JV Full Data Array": "JV Data Cluster.gtype"[], "Cell Selector": "Cell Selector.gtype", "JV Curve Parameters": "JV Curve Parameters.gtype", "Full Layer Information Array": "Full Layer Information.gtype"[]}
  "Layer Controls Prompt Ref Cluster.gtype" = cluster{"Add Layer Button Ref": "BooleanControl reference", "This VI Ref": VIRefnum, "Blade Coating Parameters Ref": "Cluster reference", "Deposition Method Ref": "EnumSelector reference", "General Parameters Ref": "Cluster reference", "Layer Type ref": "EnumSelector reference", "Solution Information Ref": "Cluster reference", "Spin Coating Parameters Ref": "Cluster reference", "Thermal Evaporation Parameters Ref": "Cluster reference", "Load Layer File Ref": "BooleanControl reference", "Save Layer File Ref": "BooleanControl reference", "Layer To Edit Ref": "RingSelectorInt32 reference"}
uses:
  Pika IV Characterization NXG::Main Functions::Instruction Handling::FGV Current State.gvi
  Pika IV Characterization NXG::Main Functions::Layer Composition::Controls and Data Clusters::Layer Controls Reference Setting.gvi
  Pika IV Characterization NXG::Main Functions::Layer Composition::Check and Set Control Visibility.gvi
  Pika IV Characterization NXG::Main Functions::Layer Composition::Data Management::Layer Information Cluster Subroutine.gvi
  Pika IV Characterization NXG::Main Functions::Layer Composition::Data Management::Missing info::Missing Information Check.gvi
  Pika IV Characterization NXG::Main Functions::Layer Composition::Data Management::Update Layer Info Array.gvi
  Pika IV Characterization NXG::Main Functions::Layer Composition::File Management::Layer File Handler.gvi
  Pika IV Characterization NXG::Main Functions::Layer Composition::Data Management::Reset Layer Info Subroutine.gvi
  Pika IV Characterization NXG::Main Functions::Layer Composition::Data Management::Layer String Array Generator.gvi
diagram:
  case ($"Error In") {
    frame Error, Default {
      w1 = $"Error In"
      w2 = $"Misc Data Mega Cluster In"
      w3 = default
      w4 = $"JV Measurements Mega Cluster In"
      w5 = default
    }
    frame No Error {
      call "FGV Current State.gvi"(Current State Instructions="Set Current State and Substate", Current State="Add Layer", Current Substate="", Error In=$"Error In") -> (Error Out=w6)
      This VI Reference() -> (reference out=w7)
      Property Node(instance in=w7, error in=w6) -> ("Panel"=w8, error out=w9)
      Property Node(instance in=w8, error in=w9) -> ("Window"=w10, error out=w11)
      Open Window(reference in=w10, error in=w11, modal=TRUE) -> (reference out=w12, error out=w13)
      Property Node(instance in=reference to "Deposition Method", "ValueSignaling"="Blade Coating", error in=w13) -> (error out=w14)
      case (TRUE) {
        frame False, Default {
          w15 = default
          w16 = w14
        }
        frame True {
          This VI Reference() -> (reference out=w17)
          call "Layer Controls Reference Setting.gvi"(Error In=w14, This VI Ref=w17, Add Layer Button Ref=reference to "Add Layer Button", Blade Coating ParametersRef=reference to "Blade Coating Parameters", Deposition Method Ref=reference to "Deposition Method", General ParametersRef=reference to "General Parameters", Layer Type ref=reference to "Layer Type", Solution Information Ref=reference to "Solution Information", Spin Coating ParametersRef=reference to "Spin Coating Parameters", Thermal Evaporation ParametersRef=reference to "Thermal Evaporation Parameters", Load Layer File Ref=reference to "Load Layer File", Save Layer File Ref=reference to "Save Layer File", Layer Controls Prompt Ref Cluster In=$"Layer Controls Prompt Ref Cluster In") -> (Error Out=w16, Layer Controls Prompt Ref Cluster Out=w15)
        }
      }
      s1 = w16  # shift register
      s2 = w15  # shift register
      s3 = $"Misc Data Mega Cluster In"  # shift register
      s4 = "Full Layer Information.gtype" {all zero or empty}  # shift register
      s5 = $"JV Measurements Mega Cluster In"  # shift register
      while {
        event (timeout = 50) {
          on "Timeout" {
            w18 = s1
            w19 = s2
            w20 = default
            w21 = s3
            w22 = s4
            w3 = default
            w23 = s5
          }
          on "Deposition Method" Value changed {
            call "Check and Set Control Visibility.gvi"(Layer Controls Prompt Ref Cluster In=s2, Error In=s1) -> (Layer Controls Prompt Ref Cluster Out=w19, Error Out=w18)
            w20 = default
            w21 = s3
            w22 = s4
            w3 = default
            w23 = s5
          }
          on "Add Layer Button" Value changed {
            call "Layer Information Cluster Subroutine.gvi"(Layer Controls Prompt Ref Cluster In=s2, Full Layer Information In=s4, Error In=s1, Layer Information Operation="Update Cluster") -> (Layer Controls Prompt Ref Cluster Out=w24, Full Layer Information Out=w25, Error Out=w26)
            call "Missing Information Check.gvi"(Layer Controls Prompt Ref Cluster In=w24, Full Layer Information In=w25, Error In=w26) -> (Layer Controls Prompt Ref Cluster Out=w27, Full Layer Information Out=w28, Proceed?=w20, Error Out=w29)
            call "Layer Information Cluster Subroutine.gvi"(Layer Controls Prompt Ref Cluster In=w27, Full Layer Information In=w28, Error In=w29, Layer Information Operation="Update Controls") -> (Layer Controls Prompt Ref Cluster Out=w19, Full Layer Information Out=w30, Error Out=w31)
            call "Update Layer Info Array.gvi"(JV Measurements Mega Cluster In=s5, Full Layer Information In=w30, Proceed?=w20, Error In=w31) -> (JV Measurements Mega Cluster Out=w23, Full Layer Information Out=w22, Error Out=w18)
            w21 = s3
            w3 = default
          }
          on "Save Layer File" Value changed {
            call "FGV Current State.gvi"(Current State Instructions="Set Current Substate", Current Substate="Saving Layer", Error In=s1) -> (Error Out=w32)
            call "Layer Information Cluster Subroutine.gvi"(Layer Controls Prompt Ref Cluster In=s2, Full Layer Information In=s4, Error In=w32, Layer Information Operation="Update Cluster") -> (Layer Controls Prompt Ref Cluster Out=w33, Full Layer Information Out=w34, Error Out=w35)
            call "Missing Information Check.gvi"(Layer Controls Prompt Ref Cluster In=w33, Full Layer Information In=w34, Error In=w35) -> (Layer Controls Prompt Ref Cluster Out=w19, Full Layer Information Out=w36, Proceed?=w37, Error Out=w38)
            call "Layer File Handler.gvi"(Misc Data Mega Cluster In=s3, Full Layer Information In=w36, Proceed?=w37, Error In=w38, Configuration File Operation="Save Configuration File") -> (Misc Data Mega Cluster Out=w21, Full Layer Information Out=w22, Error Out=w18)
            w20 = default
            w3 = default
            w23 = s5
          }
          on "Cancel Button" Value changed; "Window" Close {
            w18 = s1
            w19 = s2
            w20 = TRUE
            w21 = s3
            w22 = s4
            w3 = TRUE
            w23 = s5
          }
          on "Load Layer File" Value changed {
            call "FGV Current State.gvi"(Current State Instructions="Set Current Substate", Current Substate="Loading Layer", Error In=s1) -> (Error Out=w39)
            call "Layer File Handler.gvi"(Misc Data Mega Cluster In=s3, Full Layer Information In=s4, Proceed?=TRUE, Error In=w39, Configuration File Operation="Load Configuration File") -> (Misc Data Mega Cluster Out=w21, Full Layer Information Out=w40, Error Out=w41)
            call "Layer Information Cluster Subroutine.gvi"(Layer Controls Prompt Ref Cluster In=s2, Full Layer Information In=w40, Error In=w41, Layer Information Operation="Update Controls") -> (Layer Controls Prompt Ref Cluster Out=w19, Full Layer Information Out=w22, Error Out=w18)
            w20 = default
            w3 = default
            w23 = s5
          }
          on "Reset Layer Button" Value changed {
            call "Reset Layer Info Subroutine.gvi"(Full Layer Information In=s4, Error In=s1) -> (Full Layer Information Out=w42, Error Out=w43)
            call "Layer Information Cluster Subroutine.gvi"(Layer Controls Prompt Ref Cluster In=s2, Full Layer Information In=w42, Error In=w43, Layer Information Operation="Update Controls") -> (Layer Controls Prompt Ref Cluster Out=w19, Full Layer Information Out=w22, Error Out=w18)
            w20 = default
            w21 = s3
            w3 = default
            w23 = s5
          }
        }
        Logical Or(w18, w20) -> w44
        next s1 = w18
        next s2 = w19
        next s3 = w21
        next s4 = w22
        next s5 = w23
        stop if w44
      }
      Close Window(reference in=w12, error in=s1) -> (error out=w45)
      call "Layer String Array Generator.gvi"(JV Measurements Mega Cluster In=s5, Error In=w45) -> (JV Measurements Mega Cluster Out=w4, Layer String ID Array=w5, Error Out=w1)
      w2 = s3
    }
  }
  $"Cancelled?" <- w3
  $"Misc Mega Cluster Data Out" <- w2
  $"JV Measurements Mega Cluster Out" <- w4
  $"Layer String ID Array" <- w5
  $"Error Out" <- w1
