vi "Extracted Parameters Plotting.gvi"   [LabVIEW NXG 5.0.0]
inputs:
  "Error In": error
  "JV Measurements Mega Cluster In": "JV Measurements Mega Cluster.gtype"
  "Misc Data Mega Cluster In": "Misc Mega Cluster.gtype"
outputs:
  "Error Out": error
  "JV Measurements Mega Cluster Out": "JV Measurements Mega Cluster.gtype"
  "Misc Data Mega Cluster Out": "Misc Mega Cluster.gtype"
panel indicators:
  "Value": cluster{"Element 1": f64[], "Element 2": f64[]}[]
types:
  "Cell Selector.gtype" = enum{"L.01", "L.02", "L.03", "L.04", "L.05", "L.06", "L.07", "L.08", "L.09", "L.10", "L.11", "L.12", "R.01", "R.02", "R.03", "R.04", "R.05", "R.06", "R.07", "R.08", "R.09", "R.10", "R.11", "R.12", "Custom"}
  "JV Data Cluster.gtype" = cluster{"Voltage (V)": f64[], "Current (A)": f64[], "Current Density (A/m^2)": f64[], "Cell Area (m^2)": f64, "Illumination (W/m^2)": f64, "Voc (V)": f64, "Jsc (A/m^2)": f64, "FF (%)": f64, "Rsh (Ω · m^2)": f64, "Rs (Ω · m^2)": f64, "Eff (%)": f64, "Measured Cell": "Cell Selector.gtype", "No Multiplexer": bool}
  "JV Scan Mode.gtype" = enum{"Rough", "Normal", "Accurate", "Smart", "Custom"}
  "JV Curve Parameters.gtype" = cluster{"JV Scan Mode": "JV Scan Mode.gtype", "Measurement Precision": "Accuracy Parameters.gtype", "Cell Parameters": "Cell Parameters.gtype"}
  "Deposition Method.gtype" = enum{"Blade Coating", "Spin Coating", "Thermal Evaporation", "E-beam Evaporation", "Sputtering", "Drop Casting", "Dip Coating", "Pulsed Laser Deposition", "Chemical Vapour Deposition", "Atomic Layer Deposition", "Spray Coating", "Screen Printing", "Electroplating", "Molecular Beam Epitaxy", "Custom Deposition"}
  "Layer Type.gtype" = enum{"Front Electrode", "Electron Transport Layer", "Active Layer", "Hole Transport Layer", "Back Electrode", "Custom Layer"}
  "Full Layer Information.gtype" = cluster{"Blade Coating Parameters": "Blade Coating Parameters.gtype", "Deposition Method": "Deposition Method.gtype", "Layer Type": "Layer Type.gtype", "Spin Coating Parameters": "Spin Coating Parameters.gtype", "Thermal Evaporation Parameters": "Thermal Evaporation Parameters.gtype", "Solution Information": "Solution Information.gtype", "General Parameters": "General Parameters.gtype", "Current Deposition Method Information Cluster": "Useless Cluster.gtype", "Layer String ID": string}
  "JV Measurements Mega Cluster.gtype" = cluster{"Cell Array": "Cell Selector.gtype"[], "JV Full Data Array": "JV Data Cluster.gtype"[], "Cell Selector": "Cell Selector.gtype", "JV Curve Parameters": "JV Curve Parameters.gtype", "Full Layer Information Array": "Full Layer Information.gtype"[]}
  T1 = cluster{"State Ref": "StringControl reference", "Substate Ref": "StringControl reference", "Current State Ref": "EnumSelector reference", "Main Tab Ref": "TabControl reference", "Plot Now Flag Ref": "BooleanControl reference"}
  T2 = cluster{"Default Data Saving Location Ref": "PathSelector reference"}
  T3 = cluster{"Author Initials Ref": "ComboBoxSelector reference", "Batch Name Ref": "StringControl reference", "Cell Number Ref": "StringControl reference", "Current Date Ref": "StringControl reference", "Sample Comments Ref": "StringControl reference", "Sample Prefix Ref": "StringControl reference", "Custom Date Ref": "CheckBox reference", "Label Info Error Label Ref": "StringControl reference", "Label Info Missing Error Ref": "BooleanControl reference"}
  T4 = cluster{"Cell Parameters Ref": "Cluster reference", "Cell Selector Ref": "Cluster reference", "Measurement Precision Ref": "Cluster reference", "JV Scan Mode Ref": "EnumSelector reference"}
  T5 = cluster{"Progress % Ref": "ProgressBar reference", "Progress Counter Ref": "NumericTextBoxDouble reference", "Live JV Parameters Ref": "Cluster reference"}
  T6 = cluster{"Layer Information Ref": "ArrayViewer reference"[]}
  T7 = cluster{"Cell Selector Block Ref": "Rectangle reference", "Smart Mode Block Ref": "Rectangle reference", "dV Block Ref": "Rectangle reference", "Smart Mode Text Ref": "Text reference", "No Multiplexer Detected Text Ref": "Text reference", "Current Range Block Ref": "Rectangle reference"}
  T8 = cluster{"JV Measurements Mega Cluster Ref": "Cluster reference", "Instrument Control Mega Cluster Ref": "Cluster reference"}
  T9 = cluster{"JV Main Graph Ref": "Graph reference", "Voc Graph Ref ": "Graph reference", "Jsc Graph Ref": "Graph reference", "Efficiency Graph Ref": "Graph reference", "Fill Factor Graph Ref": "Graph reference", "Series Resistance Graph Ref": "Graph reference", "Shunt Resistance Graph Ref": "Graph reference"}
  "Full Reference Cluster.gtype" = cluster{"Status Report": T1, "Path Cluster": T2, "Sample Naming Cluster": T3, "Acquisition Parameters": T4, "Live Progress Cluster": T5, "Sample Extra Information": T6, "Visual Elements": T7, "Mega Cluster References": T8, "Plotting": T9, "System Parameters": cluster{"Main VI Ref": VIRefnum}}
  "Misc Mega Cluster.gtype" = cluster{"Full Reference Cluster": "Full Reference Cluster.gtype"}
uses:
  Pika IV Characterization NXG::Side Functions::Utilities::Array Handling::Array Erase 0 Element.gvi
  NI::G Core::Error::Multiplex Errors.gvi
diagram:
  case ($"Error In") {
    frame Error, Default {
      w1 = $"Error In"
      w2 = $"Misc Data Mega Cluster In"
      w3 = $"JV Measurements Mega Cluster In"
    }
    frame No Error {
      Property Node(instance in=$"JV Measurements Mega Cluster In") -> ("JV Full Data Array"=w4, instance out=w3)
      s1 = $"Error In"  # shift register
      s2 = [{"Device Number"=[0], "Voc (V)"=[0]}]  # shift register
      s3 = [{"Device Number"=[0], "Jsc (A/m^2)"=[0]}]  # shift register
      s4 = [{"Device Number"=[0], "Eff (%)"=[0]}]  # shift register
      s5 = [{"Device Number"=[0], "FF (%)"=[0]}]  # shift register
      s6 = [{"Device Number"=[0], "Rs (Ω·m^2)"=[0]}]  # shift register
      s7 = [{"Device Number"=[0], "Rsh (Ω·m^2)"=[0]}]  # shift register
      for {
        w5 = each element of w4
        Property Node(instance in=w5) -> ("Voc (V)"=w6, "Jsc (A/m^2)"=w7, "FF (%)"=w8, "Rsh (Ω · m^2)"=w9, "Rs (Ω · m^2)"=w10, "Eff (%)"=w11, "Measured Cell"=w12)
        Quotient And Remainder(x=w12, y=12) -> (floor(x/y)=w13, x-y*floor(x/y)=w14)
        Array Index(array=s2) -> (out0[w13]=w15)
        Property Node(instance in=w15) -> ("Device Number"=w16, "Voc (V)"=w17, instance out=w18)
        Build Array(w17, w6) -> w19
        Increment(x=w14) -> w20
        Build Array(w16, w20) -> w21
        Property Node(instance in=w18, "Device Number"=w21, "Voc (V)"=w19) -> (instance out=w22)
        Replace Array Subset(inArray=s2, index=w13, new=w22) -> w23
        Array Index(array=s3) -> (out0[w13]=w24)
        Property Node(instance in=w24) -> ("Jsc (A/m^2)"=w25, instance out=w26)
        Build Array(w25, w7) -> w27
        Property Node(instance in=w26, "Device Number"=w21, "Jsc (A/m^2)"=w27) -> (instance out=w28)
        Replace Array Subset(inArray=s3, index=w13, new=w28) -> w29
        Array Index(array=s4) -> (out0[_]=w30)
        Property Node(instance in=w30) -> ("Eff (%)"=w31, instance out=w32)
        Build Array(w31, w11) -> w33
        Property Node(instance in=w32, "Device Number"=w21, "Eff (%)"=w33) -> (instance out=w34)
        Replace Array Subset(inArray=s4, index=w13, new=w34) -> w35
        Array Index(array=s5) -> (out0[_]=w36)
        Property Node(instance in=w36) -> ("FF (%)"=w37, instance out=w38)
        Build Array(w37, w8) -> w39
        Property Node(instance in=w38, "Device Number"=w21, "FF (%)"=w39) -> (instance out=w40)
        Replace Array Subset(inArray=s5, index=w13, new=w40) -> w41
        Array Index(array=s6) -> (out0[_]=w42)
        Property Node(instance in=w42) -> ("Rs (Ω·m^2)"=w43, instance out=w44)
        Build Array(w43, w10) -> w45
        Property Node(instance in=w44, "Device Number"=w21, "Rs (Ω·m^2)"=w45) -> (instance out=w46)
        Replace Array Subset(inArray=s6, index=w13, new=w46) -> w47
        Array Index(array=s7) -> (out0[_]=w48)
        Property Node(instance in=w48) -> ("Rsh (Ω·m^2)"=w49, instance out=w50)
        Build Array(w49, w9) -> w51
        Property Node(instance in=w50, "Device Number"=w21, "Rsh (Ω·m^2)"=w51) -> (instance out=w52)
        Replace Array Subset(inArray=s7, index=w13, new=w52) -> w53
        next s2 = w23
        next s3 = w29
        next s4 = w35
        next s5 = w41
        next s6 = w47
        next s7 = w53
      }
      call "Array Erase 0 Element.gvi"(Array With Element 0=s2, Error In=s1) -> (Array Without Element 0=w54, Error Out=w55)
      $Value <- w54
      Property Node(instance in=$"Misc Data Mega Cluster In") -> ("Full Reference Cluster:Plotting:Voc Graph Ref "=w56, "Full Reference Cluster:Plotting:Jsc Graph Ref"=w57, "Full Reference Cluster:Plotting:Efficiency Graph Ref"=w58, "Full Reference Cluster:Plotting:Fill Factor Graph Ref"=w59, "Full Reference Cluster:Plotting:Series Resistance Graph Ref"=w60, "Full Reference Cluster:Plotting:Shunt Resistance Graph Ref"=w61, instance out=w2)
      Property Node(instance in=w56, "Value"=w54, error in=w55) -> (error out=w62)
      call "Array Erase 0 Element.gvi"(Array With Element 0=s3, Error In=s1) -> (Array Without Element 0=w63, Error Out=w64)
      Property Node(instance in=w57, "Value"=w63, error in=w64) -> (error out=w65)
      call "Array Erase 0 Element.gvi"(Array With Element 0=s4, Error In=s1) -> (Array Without Element 0=w66, Error Out=w67)
      Property Node(instance in=w58, "Value"=w66, error in=w67) -> (error out=w68)
      call "Array Erase 0 Element.gvi"(Array With Element 0=s5, Error In=s1) -> (Array Without Element 0=w69, Error Out=w70)
      Property Node(instance in=w59, "Value"=w69, error in=w70) -> (error out=w71)
      call "Array Erase 0 Element.gvi"(Array With Element 0=s6, Error In=s1) -> (Array Without Element 0=w72, Error Out=w73)
      Property Node(instance in=w60, "Value"=w72, error in=w73) -> (error out=w74)
      call "Array Erase 0 Element.gvi"(Array With Element 0=s7, Error In=s1) -> (Array Without Element 0=w75, Error Out=w76)
      Property Node(instance in=w61, "Value"=w75, error in=w76) -> (error out=w77)
      Build Array(w62, w65, w68, w71, w74, w77) -> w78
      call "Multiplex Errors.gvi"(error array in=w78) -> (error out=w1)
    }
  }
  $"Misc Data Mega Cluster Out" <- w2
  $"JV Measurements Mega Cluster Out" <- w3
  $"Error Out" <- w1
