vi "Time Out Subroutine.gvi"   [LabVIEW NXG 5.0.0]
inputs:
  "Misc Data Mega Cluster In": "Misc Mega Cluster.gtype"
  "Error In": error
  "Queue In": Queue<"Queue Instructions Control.gtype">
outputs:
  "Queue Out": Queue<"Queue Instructions Control.gtype">
  "Error Out": error
  "Stop App?": bool
types:
  "Queue Instructions Control.gtype" = enum{"Undefined State", "Debug Check", "Initialize App", "Idle", "Change Cell", "IV Curves Acquisition", "Saving TXT Files", "Generating Origin Files", "Stopping App", "Add Layer", "State2", "State3", "State4", "State5"}
  T1 = cluster{"State Ref": "StringControl reference", "Substate Ref": "StringControl reference", "Current State Ref": "EnumSelector reference", "Main Tab Ref": "TabControl reference", "Plot Now Flag Ref": "BooleanControl reference"}
  T2 = cluster{"Default Data Saving Location Ref": "PathSelector reference"}
  T3 = cluster{"Author Initials Ref": "ComboBoxSelector reference", "Batch Name Ref": "StringControl reference", "Cell Number Ref": "StringControl reference", "Current Date Ref": "StringControl reference", "Sample Comments Ref": "StringControl reference", "Sample Prefix Ref": "StringControl reference", "Custom Date Ref": "CheckBox reference", "Label Info Error Label Ref": "StringControl reference", "Label Info Missing Error Ref": "BooleanControl reference"}
  T4 = cluster{"Cell Parameters Ref": "Cluster reference", "Cell Selector Ref": "Cluster reference", "Measurement Precision Ref": "Cluster reference", "JV Scan Mode Ref": "EnumSelector reference"}
  T5 = cluster{"Progress % Ref": "ProgressBar reference", "Progress Counter Ref": "NumericTextBoxDouble reference", "Live JV Parameters Ref": "Cluster reference"}
  T6 = cluster{"Layer Information Ref": "ArrayViewer reference"[]}
  T7 = cluster{"Cell Selector Block Ref": "Rectangle reference", "Smart Mode Block Ref": "Rectangle reference", "dV Block Ref": "Rectangle reference", "Smart Mode Text Ref": "Text reference", "No Multiplexer Detected Text Ref": "Text reference"}
  T8 = cluster{"JV Measurements Mega Cluster Ref": "Cluster reference", "Instrument Control Mega Cluster Ref": "Cluster reference"}
  T9 = cluster{"JV Main Graph Ref": "Graph reference", "Voc Graph Ref ": "Graph reference", "Jsc Graph Ref": "Graph reference", "Efficiency Graph Ref": "Graph reference", "Fill Factor Graph Ref": "Graph reference", "Series Resistance Graph Ref": "Graph reference", "Shunt Resistance Graph Ref": "Graph reference"}
  "Full Reference Cluster.gtype" = cluster{"Status Report": T1, "Path Cluster": T2, "Sample Naming Cluster": T3, "Acquisition Parameters": T4, "Live Progress Cluster": T5, "Sample Extra Information": T6, "Visual Elements": T7, "Mega Cluster References": T8, "Plotting": T9, "System Parameters": cluster{"Main VI Ref": VIRefnum}}
  "Deposition Method.gtype" = enum{"Blade Coating", "Spin Coating", "Thermal Evaporation", "E-beam Evaporation", "Sputtering", "Drop Casting", "Dip Coating", "Pulsed Laser Deposition", "Chemical Vapour Deposition", "Atomic Layer Deposition", "Spray Coating", "Screen Printing", "Electroplating", "Molecular Beam Epitaxy", "Custom Deposition"}
  "Layer Type.gtype" = enum{"Front Electrode", "Electrode Transport Layer", "Active Layer", "Hole Transport Layer", "Back Electrode", "Annealing Treatment", "Encapsulation", "Custom Layer"}
  "Full Layer Information.gtype" = cluster{"Blade Coating Parameters": "Blade Coating Parameters.gtype", "Deposition Method": "Deposition Method.gtype", "Layer Type": "Layer Type.gtype", "Spin Coating Parameters": "Spin Coating Parameters.gtype", "Thermal Evaporation Parameters": "Thermal Evaporation Parameters.gtype", "Solution Information": "Solution Information.gtype", "General Parameters": "General Parameters.gtype", "Current Deposition Method Information Cluster": "Useless Cluster.gtype", "Layer String ID": string}
  "Misc Mega Cluster.gtype" = cluster{"Full Reference Cluster": "Full Reference Cluster.gtype", "Full Layer Information Array": "Full Layer Information.gtype"[]}
uses:
  Pika IV Characterization NXG::Main Functions::Instruction Handling::FGV Current State.gvi
  Pika IV Characterization NXG::Main Functions::Initializing App::Prompt::Initializing app prompt.gvi
  Pika IV Characterization NXG::Side Functions::Abort Control::FGV Global Abort.gvi
diagram:
  # This is the sequence that executes every 50 ms to check
  # the current state of the application. It outputs the current
  # state and substate and also shows the Initialization prompt
  # when the application is initializing.
  # Finally it checks if the current state is Stop App and outputs
  # the result to stop the master loop.
  # It also checks for the Global Abort state. In case the local abort is triggered it flushes the Queue
  # and enqueues an Idle instruction. Otherwise if the Global abort is true it flushes the queue and
  # enqueues a Stop App instruction
  case ($"Error In") {
    frame Error, Default {
      w1 = $"Error In"
      w2 = $"Queue In"
      w3 = default
    }
    frame No Error {
      call "FGV Current State.gvi"(Current State Instructions="Read Current State and Substate", Error In=$"Error In") -> (Current State Out=w4, Current SubState Out=w5, Error Out=w6)
      Is Equal(x=w4, y="Stopping App") -> w7
      Is Equal(x=w4, y="Initialize App") -> w8
      case (w8) {
        frame False, Default {
          w9 = w6
        }
        frame True {
          call "Initializing app prompt.gvi"(Error In=w6) -> (Error Out=w9)
        }
      }
      call "FGV Global Abort.gvi"(Global Abort Instructions="Read Current State", Error In=w9) -> (Local Abort Out=w10, Global Abort Out=w11, Error Out=w12)
      case (w11) {
        frame True {
          Flush Queue(error in=w12, queue=$"Queue In") -> (error out=w15, queue out=w16)
          Enqueue Element At Opposite End(element="Stopping App", error in=w15, queue=w16) -> (error out=w13, queue out=w2)
          w14 = TRUE
        }
        frame False {
          case (w10) {
            frame False, Default {
              w13 = w12
              w2 = $"Queue In"
            }
            frame True {
              Flush Queue(error in=w12, queue=$"Queue In") -> (error out=w17, queue out=w18)
              Enqueue Element At Opposite End(element="Idle", error in=w17, queue=w18) -> (error out=w13, queue out=w2)
            }
          }
          w14 = FALSE
        }
      }
      Logical Or(w14, w7) -> w3
      Property Node(instance in=$"Misc Data Mega Cluster In") -> ("Full Reference Cluster:Status Report:State Ref"=w19, "Full Reference Cluster:Status Report:Substate Ref"=w20, "Full Reference Cluster:Status Report:Current State Ref"=w21)
      Format Into String(errIn=w13, w4) -> (outString=w22, errOut=w23)
      Property Node(instance in=w19, "Value"=w22, error in=w23) -> (error out=w24)
      Property Node(instance in=w20, "Value"=w5, error in=w24) -> (error out=w25)
      Property Node(instance in=w21, "Value"=w4, error in=w25) -> (error out=w1)
    }
  }
  $"Stop App?" <- w3
  $"Queue Out" <- w2
  $"Error Out" <- w1
