vi "Update Cell Parameters.gvi"   [LabVIEW NXG 5.0.0]
inputs:
  "Error In": error
  "Misc Data Mega Cluster In": "Misc Mega Cluster.gtype"
outputs:
  "Error Out": error
  "Misc Data Mega Cluster Out": "Misc Mega Cluster.gtype"
types:
  T1 = cluster{"State Ref": "StringControl reference", "Substate Ref": "StringControl reference", "Current State Ref": "EnumSelector reference", "Main Tab Ref": "TabControl reference", "Plot Now Flag Ref": "BooleanControl reference"}
  T2 = cluster{"Default Data Saving Location Ref": "PathSelector reference"}
  T3 = cluster{"Author Initials Ref": "ComboBoxSelector reference", "Batch Name Ref": "StringControl reference", "Cell Number Ref": "StringControl reference", "Current Date Ref": "StringControl reference", "Sample Comments Ref": "StringControl reference", "Sample Prefix Ref": "StringControl reference", "Custom Date Ref": "CheckBox reference", "Label Info Error Label Ref": "StringControl reference", "Label Info Missing Error Ref": "BooleanControl reference"}
  T4 = cluster{"Cell Parameters Ref": "Cluster reference", "Cell Selector Ref": "Cluster reference", "Measurement Precision Ref": "Cluster reference", "JV Scan Mode Ref": "EnumSelector reference"}
  T5 = cluster{"Progress % Ref": "ProgressBar reference", "Progress Counter Ref": "NumericTextBoxDouble reference", "Live JV Parameters Ref": "Cluster reference"}
  T6 = cluster{"Layer Information Ref": "ArrayViewer reference"[]}
  T7 = cluster{"Cell Selector Block Ref": "Rectangle reference", "Smart Mode Block Ref": "Rectangle reference", "dV Block Ref": "Rectangle reference", "Smart Mode Text Ref": "Text reference", "No Multiplexer Detected Text Ref": "Text reference", "Current Range Block Ref": "Rectangle reference"}
  T8 = cluster{"JV Measurements Mega Cluster Ref": "Cluster reference", "Instrument Control Mega Cluster Ref": "Cluster reference"}
  T9 = cluster{"JV Main Graph Ref": "Graph reference", "Voc Graph Ref ": "Graph reference", "Jsc Graph Ref": "Graph reference", "Efficiency Graph Ref": "Graph reference", "Fill Factor Graph Ref": "Graph reference", "Series Resistance Graph Ref": "Graph reference", "Shunt Resistance Graph Ref": "Graph reference"}
  "Full Reference Cluster.gtype" = cluster{"Status Report": T1, "Path Cluster": T2, "Sample Naming Cluster": T3, "Acquisition Parameters": T4, "Live Progress Cluster": T5, "Sample Extra Information": T6, "Visual Elements": T7, "Mega Cluster References": T8, "Plotting": T9, "System Parameters": cluster{"Main VI Ref": VIRefnum}}
  "Misc Mega Cluster.gtype" = cluster{"Full Reference Cluster": "Full Reference Cluster.gtype"}
diagram:
  # This SubVI Takes care of the control of the MRM Cell Selector update process. It reads the multiple states and sets the controls
  # accordingly to ease the selection of the cells.
  case ($"Error In") {
    frame Error, Default {
      w1 = $"Error In"
      w2 = $"Misc Data Mega Cluster In"
    }
    frame No Error {
      Property Node(instance in=$"Misc Data Mega Cluster In") -> ("Full Reference Cluster:Acquisition Parameters:Cell Parameters Ref"=w3, "Full Reference Cluster:Visual Elements:Current Range Block Ref"=w4, instance out=w2)
      Property Node(instance in=w3, error in=$"Error In") -> ("Value"=w5, error out=w6)
      Property Node(instance in=w5) -> ("Autorange"=w7)
      Property Node(instance in=w4, "Visible"=w7, error in=w6) -> (error out=w1)
    }
  }
  $"Misc Data Mega Cluster Out" <- w2
  $"Error Out" <- w1
