vi "Update Measurement Precision.gvi"   [LabVIEW NXG 5.0.0]
inputs:
  "Error In": error
  "Misc Data Mega Cluster In": "Misc Mega Cluster.gtype"
outputs:
  "Error Out": error
  "Misc Data Mega Cluster Out": "Misc Mega Cluster.gtype"
types:
  T1 = cluster{"State Ref": "StringControl reference", "Substate Ref": "StringControl reference", "Current State Ref": "EnumSelector reference", "Main Tab Ref": "TabControl reference"}
  T2 = cluster{"Default Data Saving Location Ref": "PathSelector reference"}
  T3 = cluster{"Author Initials Ref": "ComboBoxSelector reference", "Batch Name Ref": "StringControl reference", "Cell Number Ref": "StringControl reference", "Current Date Ref": "StringControl reference", "Sample Comments Ref": "StringControl reference", "Sample Prefix Ref": "StringControl reference", "Custom Date Ref": "CheckBox reference", "Label Info Error Label Ref": "StringControl reference", "Label Info Missing Error Ref": "BooleanControl reference"}
  T4 = cluster{"Cell Parameters Ref": "Cluster reference", "Cell Selector Ref": "Cluster reference", "Measurement Precision Ref": "Cluster reference", "JV Scan Mode Ref": "EnumSelector reference"}
  T5 = cluster{"Live JV Parameters Ref": "Cluster reference", "Progress % Ref": "ProgressBar reference", "Progress Counter Ref": "NumericTextBoxDouble reference"}
  T6 = cluster{"Layer Information Ref": "ArrayViewer reference"[]}
  T7 = cluster{"Cell Selector Block Ref": "Rectangle reference", "Smart Mode Block Ref": "Rectangle reference", "dV Block Ref": "Rectangle reference", "Smart Mode Text Ref": "Text reference"}
  "Full Reference Cluster.gtype" = cluster{"Status Report": T1, "Path Cluster": T2, "Sample Naming Cluster": T3, "Acquisition Parameters": T4, "Live Progress Cluster": T5, "Sample Extra Information": T6, "Visual Elements": T7}
  "Misc Mega Cluster.gtype" = cluster{"Full Reference Cluster": "Full Reference Cluster.gtype"}
uses:
  Pika IV Characterization NXG::Main Functions::Update Clusters::Scan Mode Set Presets.gvi
diagram:
  # This SubVI Calculates the dV with the current parameters and outputs the result directly into the Measurement Precision control.
  # It also enables and disables the Measurement precision control in case the curtom option is selected.
  # Finally it sets the presets for the different scanning modes as well as hiding or showing the smart mode block
  case ($"Error In") {
    frame Error, Default {
      w1 = $"Error In"
      w2 = $"Misc Data Mega Cluster In"
    }
    frame No Error {
      Property Node(instance in=$"Misc Data Mega Cluster In") -> ("Full Reference Cluster:Acquisition Parameters:Measurement Precision Ref"=w3, "Full Reference Cluster:Acquisition Parameters:Cell Parameters Ref"=w4, "Full Reference Cluster:Acquisition Parameters:JV Scan Mode Ref"=w5, "Full Reference Cluster:Visual Elements:Smart Mode Text Ref"=w6, instance out=w2)
      Property Node(instance in=w5) -> ("Value"=w7)
      Is Not Equal(x="Custom", y=w7) -> w8
      Is Equal(x="Smart", y=w7) -> w9
      Property Node(instance in=w6, "Visible"=w9) -> (error out=w10)
      Property Node(instance in=w3, "Disabled"=w8, error in=w10) -> ("Value"=w11, error out=w12, instance out=w13)
      call "Scan Mode Set Presets.gvi"(Accuracy Parameters In=w11, Error In=w12, JV Scan Mode=w7) -> (Accuracy Parameters Out=w14, Error Out=w15)
      Property Node(instance in=w4, error in=w15) -> ("Value"=w16, error out=w17)
      Property Node(instance in=w14) -> ("V Points"=w18, instance out=w19)
      To Double Precision Float(number=w18) -> w20
      Property Node(instance in=w16) -> ("Max (V)"=w21, "Min (V)"=w22)
      Subtract(x=w21, y=w22) -> w23
      Absolute Value(x=w23) -> w24
      Divide(x=w24, y=w20) -> w25
      Property Node(instance in=w19, "dV (V)"=w25) -> (instance out=w26)
      Property Node(instance in=w13, "Value"=w26, error in=w17) -> (error out=w1)
    }
  }
  $"Misc Data Mega Cluster Out" <- w2
  $"Error Out" <- w1
