vi "Abort Sequence.gvi"   [LabVIEW NXG 5.0.0]
panel controls:
  "Global Abort": bool  # Force exit either the current process or the entire app (you will be prompted)
  "Error In": error
  "Queue In": Queue<"Queue Instructions Control.gtype">
panel indicators:
  "Error Out": error
  "Queue Out": Queue<"Queue Instructions Control.gtype">
types:
  "Queue Instructions Control.gtype" = enum{"Undefined State", "Debug Check", "Initialize App", "Idle", "Change Cell", "IV Curve", "Saving TXT Files", "Generating Origin Files", "Stopping App", "State 1", "State2", "State3", "State4", "State5"}
uses:
  Pika IV Characterization NXG::Side Functions::Abort Control::FGV Global Abort.gvi
diagram:
  # This SubVI Takes Care of the abort button functionality.
  # It prompts the user to decide if it wants to completely abort
  # setting the Global Abort flag on and sending a Stopping App
  # Instruction in front of the queue.
  # Or if it wants to only kill the current process (local abort)
  # where it will be brought back to idle after it kills the process.
  case ($"Error In") {
    frame Error, Default {
      w1 = $"Error In"
      w2 = $"Queue In"
    }
    frame No Error {
      w3 = """Do you want to abort the current measurement or do
you want to close the app? (Warning, everything not 
saved will be lost) """
      w4 = "No please do not\nclose the app just\nabort the current\nmeasurement."
      w5 = "Oh my god, please\ncontinue, I pressed\nglobal abort by mistake!"
      Three Button Dialog(Allow user to close window? (TRUE)=FALSE, Center Button Text ("No")="Close everything,\nI'm outta here!", Left Button Text ("Yes")=w4, Right Button Text ("Cancel")=w5, Window Title (" ")="Are you Sure?", message=w3) -> (Which Button?=w6)
      case (w6) {
        frame "left button" {
          call "FGV Global Abort.gvi"(Global Abort Instructions="Set State", Local Abort=TRUE, Global Abort=FALSE, Error In=$"Error In") -> (Error Out=w7)
          Flush Queue(error in=w7, queue=$"Queue In") -> (error out=w8, queue out=w9)
          Enqueue Element At Opposite End(element="Idle", error in=w8, queue=w9) -> (error out=w1, queue out=w2)
        }
        frame "center button" {
          call "FGV Global Abort.gvi"(Global Abort Instructions="Set State", Local Abort=FALSE, Global Abort=TRUE, Error In=$"Error In") -> (Error Out=w10)
          Enqueue Element At Opposite End(element="Stopping App", error in=w10, queue=$"Queue In") -> (error out=w1, queue out=w2)
        }
        frame "right button", Default {
          w2 = $"Queue In"
          w1 = $"Error In"
        }
      }
    }
  }
  $"Queue Out" <- w2
  $"Error Out" <- w1
