vi "Debugging Cluster Instrument Extractor.gvi"   [LabVIEW NXG 5.0.0]
inputs:
  "Instrument Control Mega Cluster In": "Instrument Control Mega Cluster.gtype"
  "Error In": error
outputs:
  "Instrument Control Mega Cluster Out": "Instrument Control Mega Cluster.gtype"
  "Instruments To Detect": "Instruments To Detect.gtype"[]
  "Error Out": error
types:
  "Instruments To Detect.gtype" = enum{"Keithley", "Arduino"}
  T1 = cluster{"Element 1": "VISA Instr", "Element 2": string}
  T2 = enum{"Keithley 2400 Series", "Keithley 2450 Series"}
  "Instrument Control.gtype" = cluster{"Multiplexer Arduino Detected?": bool, "Multiplexer Arduino Address": "VISA Instr", "Arduinos List": T1[], "Multiplexer Log": string, "Keythley Address": "VISA Instr", "Keithley Detected?": bool, "Keithley ID": string, "Detected Keithley Type": T2}
  "Debugging Cluster.gtype" = cluster{"Debugging mode?": bool, "Initialize App": bool, "Insturment Debugging": cluster{"Keithley": bool, "Arduino": bool}}
  "Instrument Control Mega Cluster.gtype" = cluster{"Instrument Control": "Instrument Control.gtype", "Debugging Cluster": "Debugging Cluster.gtype"}
uses:
  Pika IV Characterization NXG::Side Functions::Instrument Control::Instruments To Detect Extractor.gvi
diagram:
  # This SubVI reads the debugging state of each instrument and appends it or not
  # depending on what the user has specified to detect and initialize.
  case ($"Error In") {
    frame Error, Default {
      w1 = $"Error In"
      w2 = default
      w3 = $"Instrument Control Mega Cluster In"
    }
    frame No Error {
      Property Node(instance in=$"Instrument Control Mega Cluster In") -> ("Debugging Cluster:Debugging mode?"=w4, "Debugging Cluster:Insturment Debugging"=w5, instance out=w3)
      Property Node(instance in=w5) -> ("Keithley"=w6, "Arduino"=w7)
      Build Array(w6, w7) -> w8
      for {
        w9 = each element of w8
        w10 = each element of ["Keithley", "Arduino"]
        append w10 to w11 if w9
      }
      call "Instruments To Detect Extractor.gvi"(Error In=$"Error In") -> (Instruments to Detect Array=w12, Error Out=w1)
      Select(s=w4, t=w11, f=w12) -> w2
    }
  }
  $"Error Out" <- w1
  $"Instrument Control Mega Cluster Out" <- w3
  $"Instruments To Detect" <- w2
