vi "Debugging Prompt.gvi"   [LabVIEW NXG 5.0.0]
inputs:
  "Error In": error
  "Instrument Control Mega Cluster In": "Instrument Control Mega Cluster.gtype"
outputs:
  "Error Out": error
  "Instrument Control Mega Cluster Out": "Instrument Control Mega Cluster.gtype"
types:
  T1 = cluster{"Element 1": "VISA Instr", "Element 2": string}
  T2 = enum{"Keithley 2400 Series", "Keithley 2450 Series"}
  "Instrument Control.gtype" = cluster{"Multiplexer Arduino Detected?": bool, "Multiplexer Arduino Address": "VISA Instr", "Arduinos List": T1[], "Multiplexer Log": string, "Keythley Address": "VISA Instr", "Keithley Detected?": bool, "Keithley ID": string, "Detected Keithley Type": T2}
  "Debugging Cluster.gtype" = cluster{"Debugging mode?": bool, "Initialize App": bool, "Insturment Debugging": cluster{"Keithley": bool, "Arduino": bool}}
  "Instrument Control Mega Cluster.gtype" = cluster{"Instrument Control": "Instrument Control.gtype", "Debugging Cluster": "Debugging Cluster.gtype"}
uses:
  Pika IV Characterization NXG::Main Functions::Instruction Handling::FGV Current State.gvi
diagram:
  # This SubVI prompts the user warning him that the software is on debugging mode and might
  # have compromised functionalities and offers the option to turn debugging off.
  case ($"Error In") {
    frame Error, Default {
      w1 = $"Error In"
      w2 = $"Instrument Control Mega Cluster In"
    }
    frame No Error {
      Property Node(instance in=$"Instrument Control Mega Cluster In") -> ("Debugging Cluster:Debugging mode?"=w3, "Debugging Cluster:Initialize App"=w4, instance out=w5)
      call "FGV Current State.gvi"(Current State Instructions="Set Current State and Substate", Current State="Debug Check", Current Substate="", Error In=$"Error In") -> (Error Out=w6)
      case (w3) {
        frame True {
          Select(s=w4, t="", f="Initialize App") -> w7
          w8 = "BEWARE!! Debugging Mode\nis on and these functionalities\nhave been turned off:"
          w9 = "Some functionalities might be\ncompromised.\nDo you wish to continue with\nthe debugging mode on?"
          Concatenate Strings(w8, "\r\n", w7, "\r\n", w9) -> w10
          Two Button Dialog(F button name ("Cancel")="Oh no Please turn \ndebugging off D:", T button name ("OK")="Yes Please I'm debugging\nthe software :D", message=w10) -> (T Button?=w11)
          case (w11) {
            frame True {
              w2 = w5
            }
            frame False {
              Property Node(instance in=w5, "Debugging Cluster:Debugging mode?"=FALSE, "Debugging Cluster:Initialize App"=FALSE, "Debugging Cluster:Insturment Debugging:Keithley"=FALSE) -> (instance out=w2)
            }
          }
          w1 = w6
        }
        frame False {
          w2 = w5
          w1 = w6
        }
      }
    }
  }
  $"Error Out" <- w1
  $"Instrument Control Mega Cluster Out" <- w2
