vi "Exit App Sequence.gvi"   [LabVIEW NXG 5.0.0]
inputs:
  "Error In": error
  "Queue In": Queue<"Queue Instructions Control.gtype">
  "Exit App": bool
outputs:
  "Error Out": error
  "Queue Out": Queue<"Queue Instructions Control.gtype">
  "Exit?": bool
types:
  "Queue Instructions Control.gtype" = enum{"Undefined State", "Debug Check", "Initialize App", "Idle", "Change Cell", "IV Curves Acquisition", "Saving TXT Files", "Generating Origin Files", "Stopping App", "State 1", "State2", "State3", "State4", "State5"}
diagram:
  # This is the sequence that prompts the user if he actually wants to exit the app
  # and if so it enqueues the instruction to be executed after all other instructions have
  # finished.
  case ($"Error In") {
    frame Error, Default {
      w1 = $"Error In"
      w2 = $"Queue In"
      w3 = default
    }
    frame No Error {
      Two Button Dialog(F button name ("Cancel")="No please I want to\nwork more :3", T button name ("OK")="Yes (The app will close\nonce everything is finished)", message="Are you sure you want to exit?") -> (T Button?=w3)
      case (w3) {
        frame False, Default {
          w2 = $"Queue In"
          w1 = $"Error In"
        }
        frame True {
          Enqueue Element(element="Stopping App", error in=$"Error In", queue=$"Queue In") -> (error out=w1, queue out=w2)
        }
      }
    }
  }
  $"Exit?" <- w3
  $"Queue Out" <- w2
  $"Error Out" <- w1
