vi "Arduino Detection Prompt.gvi"   [LabVIEW NXG 5.0.0]
inputs:
  "Error In": error
  "Instrument Control Mega Cluster In": "Instrument Control Mega Cluster.gtype"
  "Loop iteration": i32
  "Prompt Arduinos?": bool
outputs:
  "Error Out": error
  "Proceed?": bool
types:
  T1 = cluster{"Element 1": "VISA Instr", "Element 2": string}
  T2 = enum{"Keithley 2400 Series", "Keithley 2450 Series"}
  "Instrument Control.gtype" = cluster{"Multiplexer Arduino Detected?": bool, "Multiplexer Arduino Address": "VISA Instr", "Arduinos List": T1[], "Multiplexer Log": string, "Keythley Address": "VISA Instr", "Keithley Detected?": bool, "Keithley ID": string, "Detected Keithley Type": T2}
  "Debugging Cluster.gtype" = cluster{"Debugging mode?": bool, "Initialize App": bool, "Insturment Debugging": cluster{"Keithley": bool, "Arduino": bool}}
  "Instrument Control Mega Cluster.gtype" = cluster{"Instrument Control": "Instrument Control.gtype", "Debugging Cluster": "Debugging Cluster.gtype"}
diagram:
  # This loop prompts the user in case the multiplexer arduino has not been correctly connected. After some attempts it
  # prompts the user with the option to skip the detection with a warning that some functionalities might be compromised.
  case ($"Error In") {
    frame Error, Default {
      w1 = $"Error In"
      w2 = default
    }
    frame No Error {
      Property Node(instance in=$"Instrument Control Mega Cluster In") -> ("Instrument Control:Multiplexer Arduino Detected?"=w3)
      Logical Or(w3, not $"Prompt Arduinos?") -> w4
      case (w4) {
        frame False, Default {
          case (w3) {
            frame False, Default {
              w7 = """It looks like the Multiplexer Arduino is not
connected or the connection is failing,
please connect it and make sure no other
software is using the connection (i.e. the 
arduino software, cura ...)"""
              One Button Dialog(button name ("OK")="Okay I will Reconnect it", message=w7)
            }
            frame True { }
          }
          Wait Until Next Multiple(multiple to wait=500)
          w5 = default
          w6 = $"Error In"
        }
        frame True {
          w5 = TRUE
          w6 = $"Error In"
        }
      }
      Is Greater Or Equal(x=$"Loop iteration", y=2) -> w8
      case (w8) {
        frame False, Default {
          w9 = FALSE
          w1 = w6
        }
        frame True {
          w10 = """Seems you're having some trouble
connecting the multiplexer, do you 
want to proceed without connecting it
and hope for the best?
(WARNING: some functionalities might
be compromized)"""
          Two Button Dialog(F button name ("Cancel")="Oh dear no, I'd rather ask for help", T button name ("OK")="Yes please, I like to live dangerously", message=w10) -> (T Button?=w9)
          w1 = w6
        }
      }
      Logical Or(w9, w5) -> w2
    }
  }
  $"Proceed?" <- w2
  $"Error Out" <- w1
