vi "Arduino Detection Subroutine.gvi"   [LabVIEW NXG 5.0.0]
inputs:
  "Instrument Control Mega Cluster In": "Instrument Control Mega Cluster.gtype"
  "Error In": error
  "Prompt Arduinos?": bool = TRUE
outputs:
  "Error Out": error
  "Instrument Control Mega Cluster Out": "Instrument Control Mega Cluster.gtype"
types:
  T1 = cluster{"Element 1": "VISA Instr", "Element 2": string}
  T2 = enum{"Keithley 2400 Series", "Keithley 2450 Series"}
  "Instrument Control.gtype" = cluster{"Multiplexer Arduino Detected?": bool, "Multiplexer Arduino Address": "VISA Instr", "Arduinos List": T1[], "Multiplexer Log": string, "Keythley Address": "VISA Instr", "Keithley Detected?": bool, "Keithley ID": string, "Detected Keithley Type": T2}
  "Debugging Cluster.gtype" = cluster{"Debugging mode?": bool, "Initialize App": bool, "Insturment Debugging": cluster{"Keithley": bool, "Arduino": bool}}
  "Instrument Control Mega Cluster.gtype" = cluster{"Instrument Control": "Instrument Control.gtype", "Debugging Cluster": "Debugging Cluster.gtype"}
uses:
  Pika IV Characterization NXG::Side Functions::Abort Control::FGV Global Abort.gvi
  Pika IV Characterization NXG::Side Functions::Instrument Control::Arduino Multiplexer::Arduino Detector.gvi
  Pika IV Characterization NXG::Side Functions::Instrument Control::Arduino Multiplexer::Arduino Detection Prompt.gvi
diagram:
  # This is the subroutine to detect the arduino multiplexer.
  # It basically scans for arduinos and prompts the
  # user to reconnect them in case they have not been detected.
  case ($"Error In") {
    frame Error, Default {
      w1 = $"Error In"
      w2 = $"Instrument Control Mega Cluster In"
    }
    frame No Error {
      s1 = $"Instrument Control Mega Cluster In"  # shift register
      while (iteration -> i1) {
        call "FGV Global Abort.gvi"(Global Abort Instructions="Read Current State", Error In=$"Error In") -> (Global Abort Out=w3, Error Out=w4)
        call "Arduino Detector.gvi"(Instrument Control Mega Cluster=s1, Error In=w4) -> (Instrument Control Mega Cluster Out=w5, Error Out=w6)
        Logical And($"Prompt Arduinos?", not w3) -> w7
        call "Arduino Detection Prompt.gvi"(Instrument Control Mega Cluster In=w5, Loop iteration=i1, Error In=w6, Prompt Arduinos?=w7) -> (Proceed?=w8, Error Out=w1)
        Logical Or(w8, w3) -> w9
        next s1 = w5
        stop if w9
      }
      w2 = s1
    }
  }
  $"Instrument Control Mega Cluster Out" <- w2
  $"Error Out" <- w1
