vi "Arduino Detector.gvi"   [LabVIEW NXG 5.0.0]
inputs:
  "Error In": error
  "Instrument Control Mega Cluster": "Instrument Control Mega Cluster.gtype"
outputs:
  "Instrument Control Mega Cluster Out": "Instrument Control Mega Cluster.gtype"
  "Error Out": error
panel indicators:
  "Visa Log": string
  "Found Resources": string[]
types:
  T1 = cluster{"Element 1": "VISA Instr", "Element 2": string}
  T2 = enum{"Keithley 2400 Series", "Keithley 2450 Series"}
  "Instrument Control.gtype" = cluster{"Multiplexer Arduino Detected?": bool, "Multiplexer Arduino Address": "VISA Instr", "Arduinos List": T1[], "Multiplexer Log": string, "Keythley Address": "VISA Instr", "Keithley Detected?": bool, "Keithley ID": string, "Detected Keithley Type": T2}
  "Debugging Cluster.gtype" = cluster{"Debugging mode?": bool, "Initialize App": bool, "Insturment Debugging": cluster{"Keithley": bool, "Arduino": bool}}
  "Instrument Control Mega Cluster.gtype" = cluster{"Instrument Control": "Instrument Control.gtype", "Debugging Cluster": "Debugging Cluster.gtype"}
uses:
  NI::VISA::Find Resource (Search Resources).gvi
  Pika IV Characterization NXG::Main Functions::Instruction Handling::FGV Current State.gvi
  Pika IV Characterization NXG::Side Functions::Abort Control::FGV Global Abort.gvi
  NI::VISA::Open (Instr).gvi
  NI::VISA::Clear (Instr).gvi
  NI::VISA::Read (Instr, String).gvi
  NI::VISA::Close (Instr).gvi
  NI::G Core::Error::Clear Error Cluster.gvi
diagram:
  # This loop scans all the VISA found sources and queries them in search for the arduino VISA addresses.
  # Once it finds the desired arduino it outputs the address into the Predefined cluster and the program finishes.
  case ($"Error In") {
    frame Error, Default {
      w1 = $"Error In"
      w2 = $"Instrument Control Mega Cluster"
    }
    frame No Error {
      call "Find Resource (Search Resources).gvi"() -> (found resources=w3)
      $"Found Resources" <- w3
      call "FGV Current State.gvi"(Current State Instructions="Set Current Substate", Current Substate="Detecting Arduino", Error In=$"Error In") -> (Error Out=w4)
      s1 = ""  # shift register
      for {
        w5 = each element of w3
        call "FGV Global Abort.gvi"(Global Abort Instructions="Read Current State", Error In=w4) -> (Global Abort Out=w9, Error Out=w10)
        Search And Replace String(error in (no error)=w10, input string=w5, search string="ASRL") -> (error out=w11, number of replacements=w12)
        Is Not Equal To 0(x=w12) -> w13
        case (w13) {
          frame False, Default {
            w14 = w11
            w15 = ""
            w16 = ""
          }
          frame True {
            call "Open (Instr).gvi"(resource name=w5, error in=w11, open timeout=300) -> (session out=w17, error out=w18)
            call "Clear (Instr).gvi"(session in=w17, error in=w18) -> (session out=w19, error out=w20)
            call "Read (Instr, String).gvi"(session in=w19, error in=w20, byte count=100) -> (session out=w16, error out=w21, read buffer=w15)
            call "Close (Instr).gvi"(session in=w16, error in=w21) -> (error out=w22)
            call "Clear Error Cluster.gvi"(error in=w22) -> (error out=w14)
          }
        }
        Concatenate Strings(w15, s1, "\r") -> w23
        $"Visa Log" <- s1
        Search And Replace String(error in (no error)=w14, input string=w15, search string="Arduin") -> (error out=w24, number of replacements=w25)
        Search And Replace String(error in (no error)=w24, input string=w15, search string="Multiplex") -> (error out=w1, number of replacements=w26)
        Is Not Equal To 0(x=w26) -> w27
        Build Cluster(w16, w15) -> w28
        Is Not Equal To 0(x=w25) -> w29
        Logical And(w29, w13) -> w30
        append w28 to w6 if w30
        append w27 to w7
        w8 = w16 if w27
        next s1 = w23
        stop if w9
      }
      $"Visa Log" <- s1
      Or Array Elements(Boolean array=w7) -> (logical OR=w31)
      Property Node(instance in=$"Instrument Control Mega Cluster", "Instrument Control:Multiplexer Arduino Detected?"=w31, "Instrument Control:Multiplexer Arduino Address"=w8, "Instrument Control:Arduinos List"=w6) -> (instance out=w2)
    }
  }
  $"Instrument Control Mega Cluster Out" <- w2
  $"Error Out" <- w1
