vi "Set Cell Requisites.gvi"   [LabVIEW NXG 5.0.0]
inputs:
  "Error In": error
  "Queue In": Queue<"Queue Instructions Control.gtype">
  "Instrument Control Mega Cluster": "Instrument Control Mega Cluster.gtype"
  "Set Cell": bool
outputs:
  "Error Out": error
  "Queue Out": Queue<"Queue Instructions Control.gtype">
types:
  "Queue Instructions Control.gtype" = enum{"Undefined State", "Debug Check", "Initialize App", "Idle", "Change Cell", "IV Curves Acquisition", "Saving TXT Files", "Generating Origin Files", "Stopping App", "State 1", "State2", "State3", "State4", "State5"}
  T1 = cluster{"Element 1": "VISA Instr", "Element 2": string}
  T2 = enum{"Keithley 2400 Series", "Keithley 2450 Series"}
  "Instrument Control.gtype" = cluster{"Multiplexer Arduino Detected?": bool, "Multiplexer Arduino Address": "VISA Instr", "Arduinos List": T1[], "Multiplexer Log": string, "Keythley Address": "VISA Instr", "Keithley Detected?": bool, "Keithley ID": string, "Detected Keithley Type": T2}
  "Debugging Cluster.gtype" = cluster{"Debugging mode?": bool, "Initialize App": bool, "Insturment Debugging": cluster{"Keithley": bool, "Arduino": bool}}
  "Instrument Control Mega Cluster.gtype" = cluster{"Instrument Control": "Instrument Control.gtype", "Debugging Cluster": "Debugging Cluster.gtype"}
diagram:
  # This SubVI checks if the Arduino Multiplexer is connected, if not
  # it does not allow you to use the Change Cell feature
  # except if we are debugging.
  case ($"Error In") {
    frame Error, Default {
      w1 = $"Error In"
      w2 = $"Queue In"
    }
    frame No Error {
      Property Node(instance in=$"Instrument Control Mega Cluster") -> ("Instrument Control:Multiplexer Arduino Detected?"=w3, "Debugging Cluster:Debugging mode?"=w4)
      Logical Or(w3, w4) -> w5
      case (w5) {
        frame False {
          w6 = "The XZ Stage has not\nbeen detected please connect\nit propperly restart the app\nand try again."
          One Button Dialog(button name ("OK")="Okay I'll do that", message=w6)
          w2 = $"Queue In"
          w1 = $"Error In"
        }
        frame True {
          Enqueue Element(element="Change Cell", error in=$"Error In", queue=$"Queue In") -> (error out=w1, queue out=w2)
        }
      }
    }
  }
  $"Queue Out" <- w2
  $"Error Out" <- w1
