vi "Set Cell Subroutine.gvi"   [LabVIEW NXG 5.0.0]
inputs:
  "Instrument Control Mega Cluster In": "Instrument Control Mega Cluster.gtype"
  "Error In": error
  "Desired Cell": "Cell Selector.gtype" = "L.01"
outputs:
  "Instrument Control Mega Cluster Out": "Instrument Control Mega Cluster.gtype"
  "Error Out": error
types:
  "Cell Selector.gtype" = enum{"L.01", "L.02", "L.03", "L.04", "L.05", "L.06", "L.07", "L.08", "L.09", "L.10", "L.11", "L.12", "R.01", "R.02", "R.03", "R.04", "R.05", "R.06", "R.07", "R.08", "R.09", "R.10", "R.11", "R.12", "Custom"}
  T1 = cluster{"Element 1": "VISA Instr", "Element 2": string}
  T2 = enum{"Keithley 2400 Series", "Keithley 2450 Series"}
  "Instrument Control.gtype" = cluster{"Multiplexer Arduino Detected?": bool, "Multiplexer Arduino Address": "VISA Instr", "Arduinos List": T1[], "Multiplexer Log": string, "Keythley Address": "VISA Instr", "Keithley Detected?": bool, "Keithley ID": string, "Detected Keithley Type": T2}
  "Debugging Cluster.gtype" = cluster{"Debugging mode?": bool, "Initialize App": bool, "Insturment Debugging": cluster{"Keithley": bool, "Arduino": bool}}
  "Instrument Control Mega Cluster.gtype" = cluster{"Instrument Control": "Instrument Control.gtype", "Debugging Cluster": "Debugging Cluster.gtype"}
uses:
  Pika IV Characterization NXG::Main Functions::Instruction Handling::FGV Current State.gvi
  Pika IV Characterization NXG::Side Functions::Instrument Control::Arduino Multiplexer::Low Level::Set Cell Low Level.gvi
diagram:
  # This subVI Checks that the arduino is allowed to switch cells by the debugging module
  # and if it is it converts the Desired cell into a string and feeds it to the low level set cell
  # subVI
  case ($"Error In") {
    frame Error, Default {
      w1 = $"Error In"
      w2 = $"Instrument Control Mega Cluster In"
    }
    frame No Error {
      Property Node(instance in=$"Instrument Control Mega Cluster In") -> ("Debugging Cluster:Debugging mode?"=w3, "Debugging Cluster:Insturment Debugging:Arduino"=w4, instance out=w5)
      call "FGV Current State.gvi"(Current State Instructions="Set Current State", Current State="Change Cell", Error In=$"Error In") -> (Error Out=w6)
      Format Into String(errIn=w6, $"Desired Cell") -> (outString=w7, errOut=w8)
      Logical And[output inverted](w3, not w4) -> w9
      case (w9) {
        frame False, Default {
          w1 = w8
          w2 = w5
        }
        frame True {
          call "Set Cell Low Level.gvi"(Instrument Control Mega Cluster In=w5, Cell Label=w7, Error In=w8) -> (Instrument Control Mega Cluster Out=w2, Error Out=w1)
        }
      }
    }
  }
  $"Instrument Control Mega Cluster Out" <- w2
  $"Error Out" <- w1
