vi "Instrument Detection Subroutine.gvi"   [LabVIEW NXG 5.0.0]
inputs:
  "Error In": error
  "Instrument Control Mega Cluster In": "Instrument Control Mega Cluster.gtype"
outputs:
  "Error Out": error
  "Instrument Control Mega Cluster Out": "Instrument Control Mega Cluster.gtype"
types:
  T1 = cluster{"Element 1": "VISA Instr", "Element 2": string}
  T2 = enum{"Keithley 2400 Series", "Keithley 2450 Series"}
  "Instrument Control.gtype" = cluster{"Multiplexer Arduino Detected?": bool, "Multiplexer Arduino Address": "VISA Instr", "Arduinos List": T1[], "Multiplexer Log": string, "Keythley Address": "VISA Instr", "Keithley Detected?": bool, "Keithley ID": string, "Detected Keithley Type": T2}
  "Debugging Cluster.gtype" = cluster{"Debugging mode?": bool, "Initialize App": bool, "Insturment Debugging": cluster{"Keithley": bool, "Arduino": bool}}
  "Instrument Control Mega Cluster.gtype" = cluster{"Instrument Control": "Instrument Control.gtype", "Debugging Cluster": "Debugging Cluster.gtype"}
uses:
  Pika IV Characterization NXG::Side Functions::Debugging::Debugging Cluster Instrument Extractor.gvi
  Pika IV Characterization NXG::Side Functions::Instrument Control::Instrument Detector.gvi
  Pika IV Characterization NXG::Side Functions::Abort Control::FGV Global Abort.gvi
diagram:
  # This SubVI Initializes all the instruments that the Debugging cluster allows to initialize
  case ($"Error In") {
    frame Error, Default {
      w1 = $"Instrument Control Mega Cluster In"
      w2 = $"Error In"
    }
    frame No Error {
      call "Debugging Cluster Instrument Extractor.gvi"(Instrument Control Mega Cluster In=$"Instrument Control Mega Cluster In", Error In=$"Error In") -> (Instrument Control Mega Cluster Out=w3, Instruments To Detect=w4, Error Out=w5)
      s1 = w5  # shift register
      s2 = w3  # shift register
      for {
        w6 = each element of w4
        call "Instrument Detector.gvi"(Instrument Control Mega Cluster In=s2, Instruments To Detect control=w6, Error In=s1) -> (Instrument Control Mega Cluster Out=w7, Error Out=w8)
        call "FGV Global Abort.gvi"(Global Abort Instructions="Read Current State", Error In=w8) -> (Global Abort Out=w9, Error Out=w10)
        next s1 = w10
        next s2 = w7
        stop if w9
      }
      w1 = s2
      w2 = s1
    }
  }
  $"Instrument Control Mega Cluster Out" <- w1
  $"Error Out" <- w2
