vi "Instrument Detector.gvi"   [LabVIEW NXG 5.0.0]
inputs:
  "Error In": error
  "Instrument Control Mega Cluster In": "Instrument Control Mega Cluster.gtype"
  "Instruments To Detect control": "Instruments To Detect.gtype" = "Keithley"
  "Stand Alone?": bool
outputs:
  "Error Out": error
  "Instrument Control Mega Cluster Out": "Instrument Control Mega Cluster.gtype"
types:
  "Instruments To Detect.gtype" = enum{"Keithley", "Arduino"}
  T1 = cluster{"Element 1": "VISA Instr", "Element 2": string}
  T2 = enum{"Keithley 2400 Series", "Keithley 2450 Series"}
  "Instrument Control.gtype" = cluster{"Multiplexer Arduino Detected?": bool, "Multiplexer Arduino Address": "VISA Instr", "Arduinos List": T1[], "Multiplexer Log": string, "Keythley Address": "VISA Instr", "Keithley Detected?": bool, "Keithley ID": string, "Detected Keithley Type": T2}
  "Debugging Cluster.gtype" = cluster{"Debugging mode?": bool, "Initialize App": bool, "Insturment Debugging": cluster{"Keithley": bool, "Arduino": bool}}
  "Instrument Control Mega Cluster.gtype" = cluster{"Instrument Control": "Instrument Control.gtype", "Debugging Cluster": "Debugging Cluster.gtype"}
uses:
  Pika IV Characterization NXG::Main Functions::Instruction Handling::FGV Current State.gvi
  Pika IV Characterization NXG::Side Functions::Instrument Control::Keithley::Keithley Detection Subroutine.gvi
  Pika IV Characterization NXG::Side Functions::Instrument Control::Arduino Multiplexer::Arduino Detection Subroutine.gvi
diagram:
  # This SubVI is a caller subVI that detects any instrument specified by the instruments to detect control and then
  # stores the required information within ghe instrument Addresses Cluster
  case ($"Error In") {
    frame Error, Default {
      w1 = $"Error In"
      w2 = $"Instrument Control Mega Cluster In"
    }
    frame No Error {
      case ($"Instruments To Detect control") {
        frame "Keithley" {
          call "FGV Current State.gvi"(Current State Instructions="Set Current Substate", Current Substate="Detecting Keithley", Error In=$"Error In") -> (Error Out=w3)
          call "Keithley Detection Subroutine.gvi"(Instrument Control Mega Cluster In=$"Instrument Control Mega Cluster In", Error In=w3) -> (Instrument Control Mega Cluster Out=w2, Error Out=w1)
        }
        frame "Arduino" {
          call "FGV Current State.gvi"(Current State Instructions="Set Current Substate", Current Substate="Detecting Arduinos", Error In=$"Error In") -> (Error Out=w4)
          call "Arduino Detection Subroutine.gvi"(Instrument Control Mega Cluster In=$"Instrument Control Mega Cluster In", Error In=w4) -> (Instrument Control Mega Cluster Out=w2, Error Out=w1)
        }
      }
    }
  }
  $"Instrument Control Mega Cluster Out" <- w2
  $"Error Out" <- w1
