vi "K2450 Set Constant Parameters.gvi"   [LabVIEW NXG 5.0.0]
inputs:
  "Error In": error
  "Instrument Control Mega Cluster In": "Instrument Control Mega Cluster.gtype"
  "JV Measurements Mega Cluster In": "JV Measurements Mega Cluster.gtype" = {"Cell Array"=[], "JV Full Data Array"=[], "JV Curve Parameters"={1, -0.2, FALSE, 0.1, TRUE, 1, 8e-06, 1000, 100, 3, 0.5, 1, 0, 0}, "Cell Selector"={FALSE, FALSE, FALSE, FALSE, FALSE, FALSE, FALSE, FALSE, FALSE, FALSE, FALSE, FALSE, FALSE, FALSE, FALSE, FALSE, FALSE, FALSE, FALSE, FALSE, FALSE, FALSE, FALSE, FALSE, FALSE, FALSE, FALSE, FALSE, FALSE, FALSE}}
outputs:
  "Error Out": error
  "Instrument Control Mega Cluster Out": "Instrument Control Mega Cluster.gtype"
  "JV Measurements Mega Cluster Out": "JV Measurements Mega Cluster.gtype"
types:
  T1 = cluster{"Element 1": "VISA Instr", "Element 2": string}
  T2 = enum{"Keithley 2400 Series", "Keithley 2450 Series"}
  "Instrument Control.gtype" = cluster{"Multiplexer Arduino Detected?": bool, "Multiplexer Arduino Address": "VISA Instr", "Arduinos List": T1[], "Multiplexer Log": string, "Keythley Address": "VISA Instr", "Keithley Detected?": bool, "Keithley ID": string, "Detected Keithley Type": T2}
  "Debugging Cluster.gtype" = cluster{"Debugging mode?": bool, "Initialize App": bool, "Insturment Debugging": cluster{"Keithley": bool, "Arduino": bool}}
  "Instrument Control Mega Cluster.gtype" = cluster{"Instrument Control": "Instrument Control.gtype", "Debugging Cluster": "Debugging Cluster.gtype"}
  "Cell Selector.gtype" = enum{"L.01", "L.02", "L.03", "L.04", "L.05", "L.06", "L.07", "L.08", "L.09", "L.10", "L.11", "L.12", "R.01", "R.02", "R.03", "R.04", "R.05", "R.06", "R.07", "R.08", "R.09", "R.10", "R.11", "R.12", "Custom"}
  "JV Data Cluster.gtype" = cluster{"Voltage (V)": f64[], "Current (A)": f64[], "Current Density (A/m^2)": f64[], "Cell Area (m^2)": f64, "Illumination (W/m^2)": f64, "Voc (V)": f64, "Jsc (A/m^2)": f64, "FF (%)": f64, "Rsh (Ω · m^2)": f64, "Rs (Ω · m^2)": f64, "Eff (%)": f64, "Measured Cell": "Cell Selector.gtype", "No Multiplexer": bool}
  "JV Scan Mode.gtype" = enum{"Rough", "Normal", "Accurate", "Smart", "Custom"}
  "JV Curve Parameters.gtype" = cluster{"Cell Parameters": "Cell Parameters.gtype", "Measurement Precision": "Accuracy Parameters.gtype", "JV Scan Mode": "JV Scan Mode.gtype"}
  "JV Measurements Mega Cluster.gtype" = cluster{"Cell Array": "Cell Selector.gtype"[], "JV Full Data Array": "JV Data Cluster.gtype"[], "JV Curve Parameters": "JV Curve Parameters.gtype", "Cell Selector": "Cell Selector.gtype"}
uses:
  Pika IV Characterization NXG::Main Functions::Instruction Handling::FGV Current State.gvi
  Pika IV Characterization NXG::Side Functions::Instrument Control::Keithley::Keithley Sweep Parameter Calculator.gvi
  Labview_NXG_Keithley_SMU_2450_2460_2461::Configure::Configure Measurement Range.gvi
  Labview_NXG_Keithley_SMU_2450_2460_2461::Configure::Configure Output.gvi
  Labview_NXG_Keithley_SMU_2450_2460_2461::Configure::Configure Source Function.gvi
  Labview_NXG_Keithley_SMU_2450_2460_2461::Configure::Configure Measurement Function.gvi
  Labview_NXG_Keithley_SMU_2450_2460_2461::Configure::Configure Integration Filter.gvi
  Labview_NXG_Keithley_SMU_2450_2460_2461::Configure::Configure Linear Mode Sweep.gvi
diagram:
  # This SubVI Sets all the constant parameters for the keithley and if we are in "smart" mode, it prevents the keithley from sweeping since
  # this mode performs uneven IV curves that are not compatible with the sweep functionality
  case ($"Error In") {
    frame Error, Default {
      w1 = $"Error In"
      w2 = $"Instrument Control Mega Cluster In"
      w3 = $"JV Measurements Mega Cluster In"
    }
    frame No Error {
      Property Node(instance in=$"Instrument Control Mega Cluster In") -> ("Instrument Control:Keythley Address"=w4, instance out=w5)
      call "FGV Current State.gvi"(Current State Instructions="Set Current Substate", Current Substate="Setting Keithley Parameters", Error In=$"Error In") -> (Error Out=w6)
      call "Keithley Sweep Parameter Calculator.gvi"(JV Measurements Mega Cluster In=$"JV Measurements Mega Cluster In", Error In=w6) -> (JV Measurements Mega Cluster Out=w7, Measurement Speed (1 PLC)=w8, Manual Range (1.0)=w9, Sweep Points=w10, Error Out=w11, Enable Auto Range (T:Enable)=w12)
      call "Configure Measurement Range.gvi"(VISA resource name=w4, Function (0: Volts)="Volts"(0), Enable Auto Range (T:Enable)=TRUE, error in (no error)=w11) -> (VISA resource name out=w13, error out=w14)
      call "Configure Measurement Range.gvi"(Manual Range (1.0)=w9, VISA resource name=w13, Function (0: Volts)="Current"(1), Enable Auto Range (T:Enable)=w12, error in (no error)=w14) -> (VISA resource name out=w15, error out=w16)
      call "Configure Output.gvi"(VISA resource name=w15, Source Mode (0: Voltage)="Voltage"(0), error in (no error)=w16) -> (VISA resource name out=w17, error out=w18)
      call "Configure Source Function.gvi"(VISA resource name=w17, Function (0: Volts)="Volts"(0), error in (no error)=w18) -> (VISA resource name out=w19, error out=w20)
      call "Configure Measurement Function.gvi"(VISA resource name=w19, Function (0: Volts)="Current"(1), error in (no error)=w20) -> (VISA resource name out=w21, error out=w22)
      call "Configure Integration Filter.gvi"(VISA resource name=w21, Function (0: Volts)="Current"(1), Measurement Speed (1 PLC)=w8, error in (no error)=w22) -> (VISA resource name out=w23, error out=w24)
      Property Node(instance in=w7) -> ("JV Curve Parameters:JV Scan Mode"=w25, instance out=w3)
      Is Not Equal(x="Smart", y=w25) -> w26
      case (w26) {
        frame False, Default {
          w27 = w23
          w1 = w24
        }
        frame True {
          call "Configure Linear Mode Sweep.gvi"(VISA resource name=w23, Source Mode (0: Voltage)="Voltage"(0), Sweep Points=w10, Delay (0)=0, error in (no error)=w24) -> (VISA resource name out=w27, error out=w1)
        }
      }
      Property Node(instance in=w5, "Instrument Control:Keythley Address"=w27) -> (instance out=w2)
    }
  }
  $"JV Measurements Mega Cluster Out" <- w3
  $"Instrument Control Mega Cluster Out" <- w2
  $"Error Out" <- w1
