vi "K2450 Sweep Subroutine.gvi"   [LabVIEW NXG 5.0.0]
inputs:
  "Error In": error
  "Instrument Control Mega Cluster In": "Instrument Control Mega Cluster.gtype"
  "JV Data Cluster In": "JV Data Cluster.gtype"
  "JV Measurements Mega Cluster In": "JV Measurements Mega Cluster.gtype"
outputs:
  "Error Out": error
  "Instrument Control Mega Cluster Out": "Instrument Control Mega Cluster.gtype"
  "JV Data Cluster Out": "JV Data Cluster.gtype"
types:
  "Cell Selector.gtype" = enum{"L.01", "L.02", "L.03", "L.04", "L.05", "L.06", "L.07", "L.08", "L.09", "L.10", "L.11", "L.12", "R.01", "R.02", "R.03", "R.04", "R.05", "R.06", "R.07", "R.08", "R.09", "R.10", "R.11", "R.12", "Custom"}
  "JV Data Cluster.gtype" = cluster{"Voltage (V)": f64[], "Current (A)": f64[], "Current Density (A/m^2)": f64[], "Cell Area (m^2)": f64, "Illumination (W/m^2)": f64, "Voc (V)": f64, "Jsc (A/m^2)": f64, "FF (%)": f64, "Rsh (Ω · m^2)": f64, "Rs (Ω · m^2)": f64, "Eff (%)": f64, "Measured Cell": "Cell Selector.gtype", "No Multiplexer": bool}
  T1 = cluster{"Element 1": "VISA Instr", "Element 2": string}
  T2 = enum{"Keithley 2400 Series", "Keithley 2450 Series"}
  "Instrument Control.gtype" = cluster{"Multiplexer Arduino Detected?": bool, "Multiplexer Arduino Address": "VISA Instr", "Arduinos List": T1[], "Multiplexer Log": string, "Keythley Address": "VISA Instr", "Keithley Detected?": bool, "Keithley ID": string, "Detected Keithley Type": T2}
  "Debugging Cluster.gtype" = cluster{"Debugging mode?": bool, "Initialize App": bool, "Insturment Debugging": cluster{"Keithley": bool, "Arduino": bool}}
  "Instrument Control Mega Cluster.gtype" = cluster{"Instrument Control": "Instrument Control.gtype", "Debugging Cluster": "Debugging Cluster.gtype"}
  "JV Scan Mode.gtype" = enum{"Rough", "Normal", "Accurate", "Smart", "Custom"}
  "JV Curve Parameters.gtype" = cluster{"JV Scan Mode": "JV Scan Mode.gtype", "Measurement Precision": "Accuracy Parameters.gtype", "Cell Parameters": "Cell Parameters.gtype"}
  "Deposition Method.gtype" = enum{"Blade Coating", "Spin Coating", "Thermal Evaporation", "E-beam Evaporation", "Sputtering", "Drop Casting", "Dip Coating", "Pulsed Laser Deposition", "Chemical Vapour Deposition", "Atomic Layer Deposition", "Spray Coating", "Screen Printing", "Electroplating", "Molecular Beam Epitaxy", "Custom Deposition"}
  "Layer Type.gtype" = enum{"Front Electrode", "Electrode Transport Layer", "Active Layer", "Hole Transport Layer", "Back Electrode", "Annealing Treatment", "Encapsulation", "Custom Layer"}
  "Full Layer Information.gtype" = cluster{"Blade Coating Parameters": "Blade Coating Parameters.gtype", "Deposition Method": "Deposition Method.gtype", "Layer Type": "Layer Type.gtype", "Spin Coating Parameters": "Spin Coating Parameters.gtype", "Thermal Evaporation Parameters": "Thermal Evaporation Parameters.gtype", "Solution Information": "Solution Information.gtype", "General Parameters": "General Parameters.gtype", "Current Deposition Method Information Cluster": "Useless Cluster.gtype", "Layer String ID": string}
  "JV Measurements Mega Cluster.gtype" = cluster{"Cell Array": "Cell Selector.gtype"[], "JV Full Data Array": "JV Data Cluster.gtype"[], "Cell Selector": "Cell Selector.gtype", "JV Curve Parameters": "JV Curve Parameters.gtype", "Full Layer Information Array": "Full Layer Information.gtype"[]}
uses:
  Pika IV Characterization NXG::Main Functions::Instruction Handling::FGV Current State.gvi
  Labview_NXG_Keithley_SMU_2450_2460_2461::Configure::Clear Buffer.gvi
  Labview_NXG_Keithley_SMU_2450_2460_2461::Action Status::Enable Output.gvi
  Labview_NXG_Keithley_SMU_2450_2460_2461::Data::Low Level::Initiate.gvi
  Pika IV Characterization NXG::Side Functions::Instrument Control::Keithley::FGV Keithley Timeout.gvi
  Labview_NXG_Keithley_SMU_2450_2460_2461::Data::Low Level::Wait for Operation Complete.gvi
  Labview_NXG_Keithley_SMU_2450_2460_2461::Data::Read (Multiple Points).gvi
  Pika IV Characterization NXG::Side Functions::Instrument Control::Keithley::Keithley Timeout Check.gvi
  NI::VISA::Write (Instr, String).gvi
  Labview_NXG_Keithley_SMU_2450_2460_2461::Examples::Keithley 2450 Sweep and Acquire Measurements.gvi
  Labview_NXG_Keithley_SMU_2450_2460_2461::Examples::Keithley 2450 Read Multiple.gvi
diagram:
  case ($"Error In") {
    frame Error, Default {
      w1 = $"Error In"
      w2 = $"Instrument Control Mega Cluster In"
      w3 = $"JV Data Cluster In"
    }
    frame No Error {
      Property Node(instance in=$"JV Measurements Mega Cluster In") -> ("JV Curve Parameters:JV Scan Mode"=w4, instance out=w5)
      Is Not Equal(x=w4, y="Smart") -> w6
      case (w6) {
        frame False, Default {
          w2 = $"Instrument Control Mega Cluster In"
          w1 = $"Error In"
          w3 = $"JV Data Cluster In"
        }
        frame True {
          Property Node(instance in=w5) -> ("JV Curve Parameters:Measurement Precision:V Points"=w7)
          # Clears all event registers and Error Queue
          Property Node(instance in=$"Instrument Control Mega Cluster In") -> ("Instrument Control:Keythley Address"=w8, instance out=w9)
          call "FGV Current State.gvi"(Current State Instructions="Set Current Substate", Current Substate="Sweeping Keithley", Error In=$"Error In") -> (Error Out=w10)
          call "Clear Buffer.gvi"(VISA resource name=w8, error in (no error)=w10) -> (VISA resource name out=w11, error out=w12)
          call "Enable Output.gvi"(VISA resource name=w11, Enable Output (T: Enable)=TRUE, error in (no error)=w12) -> (VISA resource name out=w13, error out=w14)
          call "Initiate.gvi"(VISA resource name=w13, error in (no error)=w14) -> (VISA resource name out=w15, error out=w16)
          call "FGV Keithley Timeout.gvi"(FGV Instructions="Read State", Error In=w16) -> (Timeout in ms Out=w17, Error Out=w18)
          call "Wait for Operation Complete.gvi"(VISA resource name=w15, Timeout (10000 ms)=w17, error in (no error)=w18) -> (VISA resource name out=w19, error out=w20)
          call "Read (Multiple Points).gvi"(VISA resource name=w19, Start Index (1)=1, End Index (1)=w7, error in (no error)=w20, Buffer Elements="SOUR, READ") -> (VISA resource name out=w21, Data out=w22, error out=w23)
          Spreadsheet String To Array(array type=f64[] [], delimiter=",", format string="%s", spreadsheet string=w22) -> (array=w24)
          Decimate Array(array=w24) -> (out0=w25, out1=w26)
          Property Node(instance in=$"JV Data Cluster In", "Voltage (V)"=w25, "Current (A)"=w26) -> (instance out=w3)
          call "Keithley Timeout Check.gvi"(Error In=w23) -> (Error Out=w27)
          call "Enable Output.gvi"(VISA resource name=w21, Enable Output (T: Enable)=FALSE, error in (no error)=w27) -> (VISA resource name out=w28, error out=w29)
          call "Write (Instr, String).gvi"(session in=w28, error in=w29, write buffer="*CLS;") -> (session out=w30, error out=w1)
          Property Node(instance in=w9, "Instrument Control:Keythley Address"=w30) -> (instance out=w2)
        }
      }
    }
  }
  $"JV Data Cluster Out" <- w3
  $"Instrument Control Mega Cluster Out" <- w2
  $"Error Out" <- w1
  call "Keithley 2450 Sweep and Acquire Measurements.gvi"()
  call "Keithley 2450 Read Multiple.gvi"()
