vi "Keithley Close Subroutine.gvi"   [LabVIEW NXG 5.0.0]
inputs:
  "Error In": error
  "Instrument Control Mega Cluster In": "Instrument Control Mega Cluster.gtype"
outputs:
  "Error Out": error
  "Instrument Control Mega Cluster Out": "Instrument Control Mega Cluster.gtype"
types:
  T1 = cluster{"Element 1": "VISA Instr", "Element 2": string}
  T2 = enum{"Keithley 2400 Series", "Keithley 2450 Series"}
  "Instrument Control.gtype" = cluster{"Multiplexer Arduino Detected?": bool, "Multiplexer Arduino Address": "VISA Instr", "Arduinos List": T1[], "Multiplexer Log": string, "Keythley Address": "VISA Instr", "Keithley Detected?": bool, "Keithley ID": string, "Detected Keithley Type": T2}
  "Debugging Cluster.gtype" = cluster{"Debugging mode?": bool, "Initialize App": bool, "Insturment Debugging": cluster{"Keithley": bool, "Arduino": bool}}
  "Instrument Control Mega Cluster.gtype" = cluster{"Instrument Control": "Instrument Control.gtype", "Debugging Cluster": "Debugging Cluster.gtype"}
uses:
  Keithley 24XX::Close.gvi
  Labview_NXG_Keithley_SMU_2450_2460_2461::Miscelaneous::Close.gvi
diagram:
  # This SubVI Initializes the Keithley Comunication In case the debugging allows it to do so
  case ($"Error In") {
    frame Error, Default {
      w1 = $"Error In"
      w2 = $"Instrument Control Mega Cluster In"
    }
    frame No Error {
      Property Node(instance in=$"Instrument Control Mega Cluster In") -> ("Debugging Cluster:Debugging mode?"=w3, "Debugging Cluster:Insturment Debugging:Keithley"=w4, instance out=w5)
      Logical And[output inverted](w3, not w4) -> w6
      case (w6) {
        frame False, Default {
          w2 = w5
          w1 = $"Error In"
        }
        frame True {
          Property Node(instance in=w5) -> ("Instrument Control:Keythley Address"=w7, "Instrument Control:Detected Keithley Type"=w8, instance out=w2)
          case (w8) {
            frame "Keithley 2400 Series", Default {
              call "Close.gvi"(VISA resource name=w7, error in=$"Error In") -> (error out=w1)
            }
            frame "Keithley 2450 Series" {
              call "Close.gvi"(VISA resource name=w7, error in (no error)=$"Error In") -> (error out=w1)
            }
          }
        }
      }
    }
  }
  $"Instrument Control Mega Cluster Out" <- w2
  $"Error Out" <- w1
