vi "Keithley Detection Subroutine.gvi"   [LabVIEW NXG 5.0.0]
inputs:
  "Instrument Control Mega Cluster In": "Instrument Control Mega Cluster.gtype"
  "Error In": error
outputs:
  "Error Out": error
  "Instrument Control Mega Cluster Out": "Instrument Control Mega Cluster.gtype"
types:
  T1 = cluster{"Element 1": "VISA Instr", "Element 2": string}
  T2 = enum{"Keithley 2400 Series", "Keithley 2450 Series"}
  "Instrument Control.gtype" = cluster{"Multiplexer Arduino Detected?": bool, "Multiplexer Arduino Address": "VISA Instr", "Arduinos List": T1[], "Multiplexer Log": string, "Keythley Address": "VISA Instr", "Keithley Detected?": bool, "Keithley ID": string, "Detected Keithley Type": T2}
  "Debugging Cluster.gtype" = cluster{"Debugging mode?": bool, "Initialize App": bool, "Insturment Debugging": cluster{"Keithley": bool, "Arduino": bool}}
  "Instrument Control Mega Cluster.gtype" = cluster{"Instrument Control": "Instrument Control.gtype", "Debugging Cluster": "Debugging Cluster.gtype"}
uses:
  Pika IV Characterization NXG::Side Functions::Abort Control::FGV Global Abort.gvi
  NI::VISA::Find Resource (Search Resources).gvi
  NI::G Core::Error::Clear Error Cluster.gvi
diagram:
  # This subVi scans all dhe available resources in search for the keithley and if found returns its address.
  # If not found it prompts the user to connect it propperly.
  case ($"Error In") {
    frame Error, Default {
      w1 = $"Error In"
      w2 = $"Instrument Control Mega Cluster In"
    }
    frame No Error {
      while (iteration -> i1) {
        call "FGV Global Abort.gvi"(Global Abort Instructions="Read Current State", Error In=$"Error In") -> (Global Abort Out=w3, Error Out=w4)
        call "Find Resource (Search Resources).gvi"(error in=w4) -> (found resources=w5, error out=w6)
        for {
          w7 = each element of w5
          Search And Replace String(error in (no error)=w6, input string=w7, search string="2450") -> (error out=w9, number of replacements=w10)
          Is Greater Than 0(x=w10) -> w11
          append w7 to w8 if w11
        }
        Is Empty Array(array=w8) -> w12
        Array Size(array=w8) -> (size(s)=w13)
        Is Greater(x=w13, y=1) -> w14
        Logical Or(w12, w14) -> w15
        case (w15) {
          frame False, Default {
            Array Index(array=w8) -> (out0[0]=w17)
            w16 = TRUE
            w18 = w9
            w19 = TRUE
          }
          frame True {
            call "Clear Error Cluster.gvi"(error in=w9) -> (error out=w18)
            Wait Until Next Multiple(multiple to wait=500)
            w20 = """Seems like you have connected
either more than one 2450 keithley
to this computer or none at all, 
please disconnect all of them but
one, or connect at least one
and then retry."""
            One Button Dialog(button name ("OK")="Okay, sorry.", message=w20)
            w16 = FALSE
            w17 = ""
            w19 = default
          }
        }
        Type Cast(type="VISA Instr" "", x=w17) -> w21
        Is Greater(x=i1, y=5) -> w22
        case (w22) {
          frame False, Default {
            w23 = FALSE
            w1 = w18
          }
          frame True {
            w24 = """Seems you're having some trouble
connecting the keithley, do you 
want to proceed without connecting it
and hope for the best?
(WARNING: some functionalities might
be compromized, or the entire program 
can crash)"""
            Two Button Dialog(F button name ("Cancel")="Oh dear no, I'd rather ask for help", T button name ("OK")="Yes please, I like to live dangerously", message=w24) -> (T Button?=w23)
            w1 = w18
          }
        }
        Logical Or(w16, w23, w3) -> w25
        stop if w25
      }
      Property Node(instance in=$"Instrument Control Mega Cluster In", "Instrument Control:Keythley Address"=w21, "Instrument Control:Keithley Detected?"=w19) -> (instance out=w2)
    }
  }
  $"Instrument Control Mega Cluster Out" <- w2
  $"Error Out" <- w1
