vi "Keithley Set Constant Parameters.gvi"   [LabVIEW NXG 5.0.0]
inputs:
  "Instrument Control Mega Cluster In": "Instrument Control Mega Cluster.gtype"
  "JV Measurements Mega Cluster In": "JV Measurements Mega Cluster.gtype" = {"Cell Array"=[], "JV Full Data Array"=[], "JV Curve Parameters"={1, -0.2, FALSE, 0.1, TRUE, 1, 8e-06, 1000, 100, 3, 0.5, 1, 0, 0}, "Cell Selector"={FALSE, FALSE, FALSE, FALSE, FALSE, FALSE, FALSE, FALSE, FALSE, FALSE, FALSE, FALSE, FALSE, FALSE, FALSE, FALSE, FALSE, FALSE, FALSE, FALSE, FALSE, FALSE, FALSE, FALSE, FALSE, FALSE, FALSE, FALSE, FALSE, FALSE}}
  "Error In": error
outputs:
  "Instrument Control Mega Cluster Out": "Instrument Control Mega Cluster.gtype"
  "JV Measurements Mega Cluster Out": "JV Measurements Mega Cluster.gtype"
  "Error Out": error
types:
  T1 = cluster{"Element 1": "VISA Instr", "Element 2": string}
  T2 = enum{"Keithley 2400 Series", "Keithley 2450 Series"}
  "Instrument Control.gtype" = cluster{"Multiplexer Arduino Detected?": bool, "Multiplexer Arduino Address": "VISA Instr", "Arduinos List": T1[], "Multiplexer Log": string, "Keythley Address": "VISA Instr", "Keithley Detected?": bool, "Keithley ID": string, "Detected Keithley Type": T2}
  "Debugging Cluster.gtype" = cluster{"Debugging mode?": bool, "Initialize App": bool, "Insturment Debugging": cluster{"Keithley": bool, "Arduino": bool}}
  "Instrument Control Mega Cluster.gtype" = cluster{"Instrument Control": "Instrument Control.gtype", "Debugging Cluster": "Debugging Cluster.gtype"}
  "Cell Selector.gtype" = enum{"L.01", "L.02", "L.03", "L.04", "L.05", "L.06", "L.07", "L.08", "L.09", "L.10", "L.11", "L.12", "R.01", "R.02", "R.03", "R.04", "R.05", "R.06", "R.07", "R.08", "R.09", "R.10", "R.11", "R.12", "Custom"}
  "JV Data Cluster.gtype" = cluster{"Voltage (V)": f64[], "Current (A)": f64[], "Current Density (A/m^2)": f64[], "Cell Area (m^2)": f64, "Illumination (W/m^2)": f64, "Voc (V)": f64, "Jsc (A/m^2)": f64, "FF (%)": f64, "Rsh (Ω · m^2)": f64, "Rs (Ω · m^2)": f64, "Eff (%)": f64, "Measured Cell": "Cell Selector.gtype", "No Multiplexer": bool}
  "JV Scan Mode.gtype" = enum{"Rough", "Normal", "Accurate", "Smart", "Custom"}
  "JV Curve Parameters.gtype" = cluster{"Cell Parameters": "Cell Parameters.gtype", "Measurement Precision": "Accuracy Parameters.gtype", "JV Scan Mode": "JV Scan Mode.gtype"}
  "JV Measurements Mega Cluster.gtype" = cluster{"Cell Array": "Cell Selector.gtype"[], "JV Full Data Array": "JV Data Cluster.gtype"[], "JV Curve Parameters": "JV Curve Parameters.gtype", "Cell Selector": "Cell Selector.gtype"}
uses:
  Pika IV Characterization NXG::Side Functions::Instrument Control::Keithley::Keithley 2450::K2450 Set Constant Parameters.gvi
diagram:
  # This SubVI Sets all the desired parameter for the keitley sweep
  case ($"Error In") {
    frame Error, Default {
      w1 = $"Error In"
      w2 = $"Instrument Control Mega Cluster In"
      w3 = $"JV Measurements Mega Cluster In"
    }
    frame No Error {
      Property Node(instance in=$"Instrument Control Mega Cluster In") -> ("Debugging Cluster:Debugging mode?"=w4, "Debugging Cluster:Insturment Debugging:Keithley"=w5, instance out=w6)
      Logical And[output inverted](w4, not w5) -> w7
      case (w7) {
        frame False, Default {
          w2 = w6
          w1 = $"Error In"
          w3 = $"JV Measurements Mega Cluster In"
        }
        frame True {
          Property Node(instance in=w6) -> ("Instrument Control:Detected Keithley Type"=w8, instance out=w9)
          case (w8) {
            frame "Keithley 2400 Series", Default {
              w2 = w9
              w3 = $"JV Measurements Mega Cluster In"
              w1 = $"Error In"
            }
            frame "Keithley 2450 Series" {
              call "K2450 Set Constant Parameters.gvi"(Instrument Control Mega Cluster In=w9, JV Measurements Mega Cluster In=$"JV Measurements Mega Cluster In", Error In=$"Error In") -> (Instrument Control Mega Cluster Out=w2, JV Measurements Mega Cluster Out=w3, Error Out=w1)
            }
          }
        }
      }
    }
  }
  $"Instrument Control Mega Cluster Out" <- w2
  $"JV Measurements Mega Cluster Out" <- w3
  $"Error Out" <- w1
