vi "Keithley Sweep Parameter Calculator.gvi"   [LabVIEW NXG 5.0.0]
inputs:
  "Error In": error
  "JV Measurements Mega Cluster In": "JV Measurements Mega Cluster.gtype" = {"Cell Array"=[], "JV Full Data Array"=[], "JV Curve Parameters"={1, -0.2, FALSE, 0.1, TRUE, 1, 8e-06, 1000, 100, 3, 0.5, 1, 0, 0}, "Cell Selector"={FALSE, FALSE, FALSE, FALSE, FALSE, FALSE, FALSE, FALSE, FALSE, FALSE, FALSE, FALSE, FALSE, FALSE, FALSE, FALSE, FALSE, FALSE, FALSE, FALSE, FALSE, FALSE, FALSE, FALSE, FALSE, FALSE, FALSE, FALSE, FALSE, FALSE}}
outputs:
  "Error Out": error
  "Enable Auto Range (T:Enable)": bool
  "JV Measurements Mega Cluster Out": "JV Measurements Mega Cluster.gtype"
  "Measurement Speed (1 PLC)": f64
  "Manual Range (1.0)": f64
  "Sweep Points": T1
types:
  T1 = cluster{"Start ": f64, "Stop ": f64, "Number of Points (5)": u32}
  "Cell Selector.gtype" = enum{"L.01", "L.02", "L.03", "L.04", "L.05", "L.06", "L.07", "L.08", "L.09", "L.10", "L.11", "L.12", "R.01", "R.02", "R.03", "R.04", "R.05", "R.06", "R.07", "R.08", "R.09", "R.10", "R.11", "R.12", "Custom"}
  "JV Data Cluster.gtype" = cluster{"Voltage (V)": f64[], "Current (A)": f64[], "Current Density (A/m^2)": f64[], "Cell Area (m^2)": f64, "Illumination (W/m^2)": f64, "Voc (V)": f64, "Jsc (A/m^2)": f64, "FF (%)": f64, "Rsh (Ω · m^2)": f64, "Rs (Ω · m^2)": f64, "Eff (%)": f64, "Measured Cell": "Cell Selector.gtype", "No Multiplexer": bool}
  "JV Scan Mode.gtype" = enum{"Rough", "Normal", "Accurate", "Smart", "Custom"}
  "JV Curve Parameters.gtype" = cluster{"Cell Parameters": "Cell Parameters.gtype", "Measurement Precision": "Accuracy Parameters.gtype", "JV Scan Mode": "JV Scan Mode.gtype"}
  "JV Measurements Mega Cluster.gtype" = cluster{"Cell Array": "Cell Selector.gtype"[], "JV Full Data Array": "JV Data Cluster.gtype"[], "JV Curve Parameters": "JV Curve Parameters.gtype", "Cell Selector": "Cell Selector.gtype"}
uses:
  Pika IV Characterization NXG::Side Functions::Utilities::Calculations::Voltage Direction Calculator.gvi
  Pika IV Characterization NXG::Side Functions::Utilities::Calculations::Order of Magnitude Extractor.gvi
diagram:
  # This SubVI Calculates the number of sweep points required for the
  # specified SRM parameters. It also extracts all the parameters so that
  # they can be set correctly on the keithley.
  case ($"Error In") {
    frame Error, Default {
      w1 = default
      w2 = default
      w3 = $"Error In"
      w4 = $"JV Measurements Mega Cluster In"
      w5 = default
      w6 = default
    }
    frame No Error {
      Property Node(instance in=$"JV Measurements Mega Cluster In") -> ("JV Curve Parameters:Cell Parameters:Curr Range (A)"=w7, "JV Curve Parameters:Cell Parameters:Autorange"=w1, "JV Curve Parameters:Cell Parameters:Max (A)"=w8, "JV Curve Parameters:Measurement Precision:Integration Time"=w6, "JV Curve Parameters:Cell Parameters:Max (V)"=w9, "JV Curve Parameters:Cell Parameters:Min (V)"=w10, "JV Curve Parameters:Measurement Precision:V Points"=w11, "JV Curve Parameters:Cell Parameters:Sweep Dir"=w12, instance out=w4)
      In Range And Coerce(lower limit=1e-08, upper limit=1, x=w7) -> (coerced(x)=w13)
      Select(s=w1, t=w8, f=w13) -> w2
      call "Voltage Direction Calculator.gvi"(Max Voltage (V)=w9, Min Voltage (V)=w10, Error In=$"Error In", Sweep Direction=w12) -> (Start=w14, End=w15, Error Out=w16)
      call "Order of Magnitude Extractor.gvi"(Number to extract order of magnitude=w13, Error In=w16) -> (Error Out=w3)
      Property Node(instance in=T1 {"Start "=1, "Stop "=0, "Number of Points (5)"=5}, "Start "=w14, "Stop "=w15, "Number of Points (5)"=w11) -> (instance out=w5)
    }
  }
  $"Enable Auto Range (T:Enable)" <- w1
  $"Manual Range (1.0)" <- w2
  $"JV Measurements Mega Cluster Out" <- w4
  $"Error Out" <- w3
  $"Measurement Speed (1 PLC)" <- w6
  $"Sweep Points" <- w5
