vi "Keithley Sweep Subroutine General.gvi"   [LabVIEW NXG 5.0.0]
inputs:
  "Instrument Control Mega Cluster In": "Instrument Control Mega Cluster.gtype"
  "JV Measurements Mega Cluster In": "JV Measurements Mega Cluster.gtype"
  "Error In": error
outputs:
  "Instrument Control Mega Cluster Out": "Instrument Control Mega Cluster.gtype"
  "JV Measurements Mega Cluster Out": "JV Measurements Mega Cluster.gtype"
  "JV Data Cluster Out": "JV Data Cluster.gtype"
  "Error Out": error
types:
  "Cell Selector.gtype" = enum{"L.01", "L.02", "L.03", "L.04", "L.05", "L.06", "L.07", "L.08", "L.09", "L.10", "L.11", "L.12", "R.01", "R.02", "R.03", "R.04", "R.05", "R.06", "R.07", "R.08", "R.09", "R.10", "R.11", "R.12", "Custom"}
  "JV Data Cluster.gtype" = cluster{"Voltage (V)": f64[], "Current (A)": f64[], "Current Density (A/m^2)": f64[], "Cell Area (m^2)": f64, "Illumination (W/m^2)": f64, "Voc (V)": f64, "Jsc (A/m^2)": f64, "FF (%)": f64, "Rsh (Ω · m^2)": f64, "Rs (Ω · m^2)": f64, "Eff (%)": f64, "Measured Cell": "Cell Selector.gtype", "No Multiplexer": bool}
  T1 = cluster{"Element 1": "VISA Instr", "Element 2": string}
  T2 = enum{"Keithley 2400 Series", "Keithley 2450 Series"}
  "Instrument Control.gtype" = cluster{"Multiplexer Arduino Detected?": bool, "Multiplexer Arduino Address": "VISA Instr", "Arduinos List": T1[], "Multiplexer Log": string, "Keythley Address": "VISA Instr", "Keithley Detected?": bool, "Keithley ID": string, "Detected Keithley Type": T2, "Database Detected?": bool}
  T3 = cluster{"Keithley": bool, "Arduino": bool, "Database": bool}
  "Debugging Cluster.gtype" = cluster{"Debugging mode?": bool, "Initialize App": bool, "Insturment Debugging": T3}
  "Instrument Control Mega Cluster.gtype" = cluster{"Instrument Control": "Instrument Control.gtype", "Debugging Cluster": "Debugging Cluster.gtype"}
  "JV Scan Mode.gtype" = enum{"Rough", "Normal", "Accurate", "Smart", "Custom"}
  "JV Curve Parameters.gtype" = cluster{"JV Scan Mode": "JV Scan Mode.gtype", "Measurement Precision": "Accuracy Parameters.gtype", "Cell Parameters": "Cell Parameters.gtype"}
  "Deposition Method.gtype" = enum{"Blade Coating", "Spin Coating", "Thermal Evaporation", "E-beam Evaporation", "Sputtering", "Drop Casting", "Dip Coating", "Pulsed Laser Deposition", "Chemical Vapour Deposition", "Atomic Layer Deposition", "Spray Coating", "Screen Printing", "Electroplating", "Molecular Beam Epitaxy", "Custom Deposition"}
  "Layer Type.gtype" = enum{"Front Electrode", "Electron Transport Layer", "Active Layer", "Hole Transport Layer", "Back Electrode", "Custom Layer"}
  "Full Layer Information.gtype" = cluster{"Blade Coating Parameters": "Blade Coating Parameters.gtype", "Deposition Method": "Deposition Method.gtype", "Layer Type": "Layer Type.gtype", "Spin Coating Parameters": "Spin Coating Parameters.gtype", "Thermal Evaporation Parameters": "Thermal Evaporation Parameters.gtype", "Solution Information": "Solution Information.gtype", "General Parameters": "General Parameters.gtype", "Current Deposition Method Information Cluster": "Useless Cluster.gtype", "Layer String ID": string}
  "JV Measurements Mega Cluster.gtype" = cluster{"Cell Array": "Cell Selector.gtype"[], "JV Full Data Array": "JV Data Cluster.gtype"[], "Cell Selector": "Cell Selector.gtype", "JV Curve Parameters": "JV Curve Parameters.gtype", "Full Layer Information Array": "Full Layer Information.gtype"[]}
uses:
  Pika IV Characterization NXG::Side Functions::Utilities::Calculations::Random IV Curve Generator.gvi
  Pika IV Characterization NXG::Side Functions::Instrument Control::Keithley::Keithley 2450::K2450 Sweep Subroutine.gvi
diagram:
  # This SubVI Sweeps the Keithley Comunication In case the debugging allows it to do so
  case ($"Error In") {
    frame Error, Default {
      w1 = $"Error In"
      w2 = $"Instrument Control Mega Cluster In"
      w3 = default
      w4 = $"JV Measurements Mega Cluster In"
    }
    frame No Error {
      Property Node(instance in=$"Instrument Control Mega Cluster In") -> ("Debugging Cluster:Debugging mode?"=w5, "Debugging Cluster:Insturment Debugging:Keithley"=w6, instance out=w7)
      Logical And[output inverted](w5, not w6) -> w8
      case (w8) {
        frame False, Default {
          call "Random IV Curve Generator.gvi"(JV Measurement Mega Cluster In=$"JV Measurements Mega Cluster In", Intensity Constant=1, Light Intensity=-1.7, Error In=$"Error In") -> (Voltage=w9, Current=w10, Error Out=w1)
          Property Node(instance in="JV Data Cluster.gtype" {all zero or empty}, "Voltage (V)"=w9, "Current (A)"=w10) -> (instance out=w3)
          w2 = w7
          w4 = $"JV Measurements Mega Cluster In"
        }
        frame True {
          Property Node(instance in=w7) -> ("Instrument Control:Detected Keithley Type"=w11, instance out=w12)
          case (w11) {
            frame "Keithley 2400 Series", Default {
              w1 = $"Error In"
              w3 = "JV Data Cluster.gtype" {all zero or empty}
              w2 = w12
              w4 = $"JV Measurements Mega Cluster In"
            }
            frame "Keithley 2450 Series" {
              call "K2450 Sweep Subroutine.gvi"(Instrument Control Mega Cluster In=w12, JV Data Cluster In="JV Data Cluster.gtype" {all zero or empty}, Error In=$"Error In", JV Measurements Mega Cluster In=$"JV Measurements Mega Cluster In") -> (Instrument Control Mega Cluster Out=w2, JV Data Cluster Out=w3, Error Out=w1)
              w4 = $"JV Measurements Mega Cluster In"
            }
          }
        }
      }
    }
  }
  $"Instrument Control Mega Cluster Out" <- w2
  $"JV Data Cluster Out" <- w3
  $"Error Out" <- w1
  $"JV Measurements Mega Cluster Out" <- w4
