vi "Keithley Sweep Subroutine.gvi"   [LabVIEW NXG 5.0.0]
inputs:
  "Instrument Control Mega Cluster In": "Instrument Control Mega Cluster.gtype"
  "IV Measurements Mega Cluster In": "IV Measurements Mega Cluster.gtype"
  "Error In": error
outputs:
  "Instrument Control Mega Cluster Out": "Instrument Control Mega Cluster.gtype"
  "IV Measurements Mega Cluster Out": "IV Measurements Mega Cluster.gtype"
  "IV Data Cluster Out": "IV Data Cluster.gtype"
  "Error Out": error
types:
  "IV Mode.gtype" = enum{"Rough", "Normal", "Accurate", "Smart", "Custom"}
  "IV Curve Parameters.gtype" = cluster{"Cell Parameters": "Cell Parameters.gtype", "Measurement Precision": "Accuracy Parameters.gtype", "IV Accuracy Mode": "IV Mode.gtype"}
  T1 = cluster{"L.01": bool, "R.01": bool, "L.02": bool, "R.02": bool, "L.03": bool, "R.03": bool, "L.04": bool, "R.04": bool, "L.05": bool, "R.05": bool, "L.06": bool, "R.06": bool, "L.07": bool, "R.07": bool, "L.08": bool, "R.08": bool, "L.09": bool, "R.09": bool, "L.10": bool, "R.10": bool, "L.11": bool, "R.11": bool, "L.12": bool, "R.12": bool}
  "Cell Selector.gtype" = cluster{"All": bool, "Left": bool, "Right": bool, "Cell Cluster": T1, "Reset": bool, "Random Order ": bool, "Continuous Cell": bool}
  "IV Measurements Mega Cluster.gtype" = cluster{"IV Curve Parameters": "IV Curve Parameters.gtype", "Cell Selector": "Cell Selector.gtype"}
  T2 = cluster{"Element 1": "VISA Instr", "Element 2": string}
  T3 = enum{"Keithley 2400 Series", "Keithley 2450 Series"}
  "Instrument Control.gtype" = cluster{"Multiplexer Arduino Detected?": bool, "Multiplexer Arduino Address": "VISA Instr", "Arduinos List": T2[], "Multiplexer Log": string, "Keythley Address": "VISA Instr", "Keithley Detected?": bool, "Keithley ID": string, "Detected Keithley Type": T3}
  "Debugging Cluster.gtype" = cluster{"Debugging mode?": bool, "Initialize App": bool, "Insturment Debugging": cluster{"Keithley": bool, "Arduino": bool}}
  "Instrument Control Mega Cluster.gtype" = cluster{"Instrument Control": "Instrument Control.gtype", "Debugging Cluster": "Debugging Cluster.gtype"}
  "IV Data Cluster.gtype" = cluster{"Voltage (V)": f64[], "Current (A)": f64[], "Current Density (A/m^2)": f64[], "Cell Area (m^2)": f64, "Illumination (W/m^2)": f64, "Voc (V)": f64, "Jsc (A/m^2)": f64, "FF (%)": f64, "Rsh (Ω · m^2)": f64, "Rs (Ω · m^2)": f64, "Eff (%)": f64, "Measured Cell": "Cell Selector.gtype", "Continuous Cell": bool}
uses:
  Pika IV Characterization NXG::Side Functions::Utilities::Calculations::Random IV Curve Generator.gvi
  Pika IV Characterization NXG::Side Functions::Instrument Control::Keithley::Keithley 2450::K2450 Sweep Subroutine.gvi
diagram:
  # This SubVI Sweeps the Keithley Comunication In case the debugging allows it to do so
  case ($"Error In") {
    frame Error, Default {
      w1 = $"Error In"
      w2 = $"Instrument Control Mega Cluster In"
      w3 = default
      w4 = $"IV Measurements Mega Cluster In"
    }
    frame No Error {
      Property Node(instance in=$"Instrument Control Mega Cluster In") -> ("Debugging Cluster:Debugging mode?"=w5, "Debugging Cluster:Insturment Debugging:Keithley"=w6, instance out=w7)
      Logical And[output inverted](w5, not w6) -> w8
      case (w8) {
        frame False, Default {
          call "Random IV Curve Generator.gvi"(IV Measurement Mega Cluster In=$"IV Measurements Mega Cluster In", Intensity Constant=1, Light Intensity=-1.7, Error In=$"Error In") -> (Voltage=w9, Current=w10, Error Out=w1)
          Property Node(instance in="IV Data Cluster.gtype" {all zero or empty}, "Voltage (V)"=w9, "Current (A)"=w10) -> (instance out=w3)
          w2 = w7
          w4 = $"IV Measurements Mega Cluster In"
        }
        frame True {
          Property Node(instance in=w7) -> ("Instrument Control:Detected Keithley Type"=w11, instance out=w12)
          case (w11) {
            frame "Keithley 2400 Series", Default {
              w1 = $"Error In"
              w3 = "IV Data Cluster.gtype" {all zero or empty}
              w2 = w12
              w4 = $"IV Measurements Mega Cluster In"
            }
            frame "Keithley 2450 Series" {
              call "K2450 Sweep Subroutine.gvi"(Instrument Control Mega Cluster In=w12, IV Data Cluster In="IV Data Cluster.gtype" {all zero or empty}, IV Measurements Mega Cluster In=$"IV Measurements Mega Cluster In") -> (Instrument Control Mega Cluster Out=w2, IV Data Cluster Out=w3, Error Out=w1)
              w4 = $"IV Measurements Mega Cluster In"
            }
          }
        }
      }
    }
  }
  $"Instrument Control Mega Cluster Out" <- w2
  $"IV Data Cluster Out" <- w3
  $"Error Out" <- w1
  $"IV Measurements Mega Cluster Out" <- w4
