vi "Keithley Timeout Check.gvi"   [LabVIEW NXG 5.0.0]
inputs:
  "Error In": error
outputs:
  "Error Out": error
uses:
  NI::G Core::Error::Read Description.gvi
  NI::G Core::Error::Clear Error Cluster.gvi
  Pika IV Characterization NXG::Side Functions::Instrument Control::Keithley::FGV Keithley Timeout.gvi
  Pika IV Characterization NXG::Side Functions::Messages And Prompts::Input Value Prompt.gvi
diagram:
  case ($"Error In") {
    frame Error, Default {
      call "Read Description.gvi"(error in=$"Error In") -> (description=w2)
      Search And Replace String(error in (no error)=$"Error In", input string=w2, search string="Timeout") -> (error out=w3, number of replacements=w4)
      Search And Replace String(error in (no error)=w3, input string=w2, search string="timed out") -> (error out=w5, number of replacements=w6)
      Is Greater Than 0(x=w6) -> w7
      Is Greater Than 0(x=w4) -> w8
      Logical Or(w8, w7) -> w9
      case (w9) {
        frame False, Default {
          w1 = w5
        }
        frame True {
          w10 = "The Keithley is taking a lot of time per sweep, do you wish to increase the time we wait for it to finish?\n(Caution Accept only if you see the keithley is actually measuring!!)"
          Two Button Dialog(F button name ("Cancel")="Oh dear no, i'll \nfetch some help", T button name ("OK")="Yes please, increase\nthe timeout.", message=w10) -> (T Button?=w11)
          call "Clear Error Cluster.gvi"(error in=w5) -> (error out=w12)
          Select(s=w11, t=w12, f=w5) -> w13
          case (w11) {
            frame False, Default {
              w1 = w13
            }
            frame True {
              call "FGV Keithley Timeout.gvi"(FGV Instructions="Read State", Error In=w13) -> (Timeout in ms Out=w14, Error Out=w15)
              call "Input Value Prompt.gvi"(Old Value=w14, Main Message="Please insert the new value for the Keithley Timeout in ms", Sub message="The Old Value Was:", Error In=w15) -> (New Value Out=w16, Error Out=w17)
              call "FGV Keithley Timeout.gvi"(FGV Instructions="Set State", Timeout in ms In=w16, Error In=w17) -> (Error Out=w1)
            }
          }
        }
      }
    }
    frame No Error {
      w1 = $"Error In"
    }
  }
  $"Error Out" <- w1
