vi "Full IV Measurement Subroutine.gvi"   [LabVIEW NXG 5.0.0]
inputs:
  "Error In": error
  "Instrument Control Mega Cluster In": "Instrument Control Mega Cluster.gtype"
  "Misc Data Mega Cluster In": "Misc Mega Cluster.gtype"
  "JV Measurements Mega Cluster In": "IV Measurements Mega Cluster.gtype"
outputs:
  "Instrument Control Mega Cluster Out": "Instrument Control Mega Cluster.gtype"
  "Misc Data Mega Cluster Out": "Misc Mega Cluster.gtype"
  "JV Measurements Mega Cluster Out": "IV Measurements Mega Cluster.gtype"
  "Error Out": error
types:
  T1 = cluster{"Element 1": "VISA Instr", "Element 2": string}
  T2 = enum{"Keithley 2400 Series", "Keithley 2450 Series"}
  "Instrument Control.gtype" = cluster{"Multiplexer Arduino Detected?": bool, "Multiplexer Arduino Address": "VISA Instr", "Arduinos List": T1[], "Multiplexer Log": string, "Keythley Address": "VISA Instr", "Keithley Detected?": bool, "Keithley ID": string, "Detected Keithley Type": T2}
  "Debugging Cluster.gtype" = cluster{"Debugging mode?": bool, "Initialize App": bool, "Insturment Debugging": cluster{"Keithley": bool, "Arduino": bool}}
  "Instrument Control Mega Cluster.gtype" = cluster{"Instrument Control": "Instrument Control.gtype", "Debugging Cluster": "Debugging Cluster.gtype"}
  "Full Reference Cluster.gtype" = cluster{"Sample Extra Information": "Sample extra imformation.gtype", "Acquisition Parameters": "Acquisition Parameters.gtype", "Status Report": "Status Report.gtype", "Live Progress": "Live Progress.gtype", "Sample Naming Cluster": "Sample Naming Cluster.gtype", "Path Cluster": "Path Cluster.gtype"}
  "Misc Mega Cluster.gtype" = cluster{"Full Reference Cluster": "Full Reference Cluster.gtype"}
  "JV Scan Mode.gtype" = enum{"Rough", "Normal", "Accurate", "Smart", "Custom"}
  "IV Curve Parameters.gtype" = cluster{"Cell Parameters": "Cell Parameters.gtype", "Measurement Precision": "Accuracy Parameters.gtype", "IV Accuracy Mode": "JV Scan Mode.gtype"}
  T3 = cluster{"L.01": bool, "R.01": bool, "L.02": bool, "R.02": bool, "L.03": bool, "R.03": bool, "L.04": bool, "R.04": bool, "L.05": bool, "R.05": bool, "L.06": bool, "R.06": bool, "L.07": bool, "R.07": bool, "L.08": bool, "R.08": bool, "L.09": bool, "R.09": bool, "L.10": bool, "R.10": bool, "L.11": bool, "R.11": bool, "L.12": bool, "R.12": bool}
  "Cell Selector.gtype" = cluster{"All": bool, "Left": bool, "Right": bool, "Cell Cluster": T3, "Reset": bool, "Random Order ": bool, "Continuous Cell": bool}
  "JV Data Cluster.gtype" = cluster{"Voltage (V)": f64[], "Current (A)": f64[], "Current Density (A/m^2)": f64[], "Cell Area (m^2)": f64, "Illumination (W/m^2)": f64, "Voc (V)": f64, "Jsc (A/m^2)": f64, "FF (%)": f64, "Rsh (Ω · m^2)": f64, "Rs (Ω · m^2)": f64, "Eff (%)": f64, "Measured Cell": "Cell Selector.gtype", "No Multiplexer": bool}
  "IV Measurements Mega Cluster.gtype" = cluster{"IV Curve Parameters": "IV Curve Parameters.gtype", "Cell Selector": "Cell Selector.gtype", "Cell Array": "Cell Selector.gtype"[], "IV Full Data Array": "JV Data Cluster.gtype"[]}
uses:
  Pika IV Characterization NXG::Main Functions::JV Curve Full Subroutine::Initialization::FGV JV Operation.gvi
  Pika IV Characterization NXG::Main Functions::Instruction Handling::FGV Current State.gvi
  Pika IV Characterization NXG::Main Functions::JV Curve Full Subroutine::Initialization::Reset JV Data Cluster.gvi
  Pika IV Characterization NXG::Main Functions::JV Curve Full Subroutine::State Machine::JV Measurements Abort Detect.gvi
  Pika IV Characterization NXG::Side Functions::Instrument Control::Keithley::Keithley Initialization Subroutine.gvi
  Pika IV Characterization NXG::Main Functions::JV Curve Full Subroutine::State Machine::JV Curves Aquiring::JV Curves Acquire Subroutine.gvi
  Pika IV Characterization NXG::Side Functions::Instrument Control::Keithley::Keithley Close Subroutine.gvi
  Pika IV Characterization NXG::Main Functions::JV Curve Full Subroutine::State Machine::Saving Data::JV Curve Save Prompt.gvi
  Pika IV Characterization NXG::Main Functions::JV Curve Full Subroutine::State Machine::Saving Data::JV File Saving Subroutine.gvi
  Pika IV Characterization NXG::Side Functions::Timeout::FGV Progress.gvi
diagram:
  # This SubVI Measures the Light power for each motor position for each sweep type and outputs the data so that it can be plotted
  # on the main window for checking and for calibration purposes
  case ($"Error In") {
    frame Error, Default {
      w1 = $"Error In"
      w2 = $"Instrument Control Mega Cluster In"
      w3 = $"JV Measurements Mega Cluster In"
      w4 = $"Misc Data Mega Cluster In"
    }
    frame No Error {
      call "FGV JV Operation.gvi"(FGV Instructions="Read State", Error In=$"Error In") -> (IV Operation Out=w5, Error Out=w6)
      call "FGV Current State.gvi"(Current State Instructions="Set Current State and Substate", Current State="IV Curves Acquisition", Current Substate="", Error In=w6) -> (Error Out=w7)
      call "Reset JV Data Cluster.gvi"(JV Measurements Mega Cluster In=$"JV Measurements Mega Cluster In", Error In=w7, JV Operation Selector=w5) -> (JV Measurements Mega Cluster Out=w8, Error Out=w9)
      s1 = w9  # shift register
      s2 = "Start App"  # shift register
      s3 = $"Instrument Control Mega Cluster In"  # shift register
      s4 = $"Misc Data Mega Cluster In"  # shift register
      s5 = w8  # shift register
      while {
        call "JV Measurements Abort Detect.gvi"(Previous State=s2, Error In=s1) -> (Next State=w10, Stop Loop=w11, Error Out=w12)
        case (w10) {
          frame "Start App", Default {
            call "FGV Current State.gvi"(Current State Instructions="Set Current Substate", Current Substate="Starting IV Measurements", Error In=w12) -> (Error Out=w13)
            w14 = "Initialize Instruments"
            w15 = s5
            w16 = s3
            w17 = s4
            w18 = default
          }
          frame "Initialize Instruments" {
            call "FGV Current State.gvi"(Current State Instructions="Set Current Substate", Current Substate="Initializing Instruments", Error In=w12) -> (Error Out=w19)
            call "Keithley Initialization Subroutine.gvi"(Instrument Control Mega Cluster In=s3, Error In=w19) -> (Instrument Control Mega Cluster Out=w16, Error Out=w13)
            w14 = "Acquire IV Curves"
            w15 = s5
            w17 = s4
            w18 = default
          }
          frame "Acquire IV Curves" {
            call "JV Curves Acquire Subroutine.gvi"(Instrument Control Mega Cluster In=s3, IV Measurements Mega Cluster In=s5, Error In=w12) -> (Instrument Control Mega Cluster Out=w16, IV Measurements Mega Cluster Out=w15, Error Out=w13)
            w14 = "Close Coms"
            w17 = s4
            w18 = default
          }
          frame "Close Coms" {
            call "FGV Current State.gvi"(Current State Instructions="Set Current Substate", Current Substate="Closing Coms", Error In=w12) -> (Error Out=w20)
            call "Keithley Close Subroutine.gvi"(Instrument Control Mega Cluster In=s3, Error In=w20) -> (Instrument Control Mega Cluster Out=w16, Error Out=w21)
            call "JV Curve Save Prompt.gvi"(Error In=w21) -> (Next State=w14, Error Out=w13)
            w15 = s5
            w17 = s4
            w18 = default
          }
          frame "Load Measurement" {
            w13 = w12
            w14 = "Stop App"
            w15 = s5
            w16 = s3
            w17 = s4
            w18 = default
          }
          frame "Save Files" {
            call "JV File Saving Subroutine.gvi"(Misc Data Mega Cluster In=s4, IV Measurements Mega Cluster In=s5, Error In=w12) -> (Error Out=w13)
            w14 = "Stop App"
            w15 = s5
            w16 = s3
            w17 = s4
            w18 = default
          }
          frame "Stop App" {
            w13 = w12
            w14 = "Start App"
            w15 = s5
            w16 = s3
            w17 = s4
            w18 = TRUE
          }
        }
        call "FGV Progress.gvi"(FGV Instructions="Set State", Progress In=0, Error In=w13) -> (Error Out=w22)
        Logical Or(w11, w22, w18) -> w23
        next s1 = w22
        next s2 = w14
        next s3 = w16
        next s4 = w17
        next s5 = w15
        stop if w23
      }
      w1 = s1
      w2 = s3
      w3 = s5
      w4 = s4
    }
  }
  $"Instrument Control Mega Cluster Out" <- w2
  $"JV Measurements Mega Cluster Out" <- w3
  $"Error Out" <- w1
  $"Misc Data Mega Cluster Out" <- w4
