vi "Check Default Path Subroutine.gvi"   [LabVIEW NXG 5.0.0]
inputs:
  "Misc Data Mega Cluster In": "Misc Mega Cluster.gtype"
  "Error In": error
outputs:
  "Default Data Saving Location Path Out": path
  "Misc Data Mega Cluster Out": "Misc Mega Cluster.gtype"
  "Error Out": error
types:
  T1 = cluster{"State Ref": "StringControl reference", "Substate Ref": "StringControl reference", "Current State Ref": "EnumSelector reference", "Main Tab Ref": "TabControl reference"}
  T2 = cluster{"Default Data Saving Location Ref": "PathSelector reference"}
  T3 = cluster{"Author Initials Ref": "ComboBoxSelector reference", "Batch Name Ref": "StringControl reference", "Cell Number Ref": "StringControl reference", "Current Date Ref": "StringControl reference", "Sample Comments Ref": "StringControl reference", "Sample Prefix Ref": "StringControl reference", "Custom Date Ref": "CheckBox reference", "Label Info Error Label Ref": "StringControl reference", "Label Info Missing Error Ref": "BooleanControl reference"}
  T4 = cluster{"Cell Parameters Ref": "Cluster reference", "IV Mode Ref": "EnumSelector reference", "Measurement Precision Ref": "Cluster reference", "Cell Selector Ref": "Cluster reference"}
  T5 = cluster{"Progress % Ref": "ProgressBar reference", "Progress Counter Ref": "NumericTextBoxDouble reference", "Live IV Parameters Ref": "Cluster reference"}
  T6 = cluster{"Layer Information Ref": "ArrayViewer reference"[]}
  "Full Reference Cluster.gtype" = cluster{"Status Report": T1, "Path Cluster": T2, "Sample Naming Cluster": T3, "Acquisition Parameters": T4, "Live Progress Cluster": T5, "Sample Extra Information": T6}
  "Misc Mega Cluster.gtype" = cluster{"Full Reference Cluster": "Full Reference Cluster.gtype"}
uses:
  NI::G Core::File IO (General)::Check if File or Folder Exists.gvi
  Pika IV Characterization NXG::Side Functions::Messages And Prompts::FGV Select Default Path Prompt.gvi
  Pika IV Characterization NXG::Side Functions::Messages And Prompts::Select path prompt.gvi
diagram:
  # This SubVI checks if the provided default data path is empty or not a
  # real path and if so it prompts the user to input a new, valid path.
  # If the user has already input a path it uses the value it spored the first
  # time the user has input a new default path.
  case ($"Error In") {
    frame Error, Default {
      w1 = default
      w2 = $"Misc Data Mega Cluster In"
      w3 = $"Error In"
    }
    frame No Error {
      Property Node(instance in=$"Misc Data Mega Cluster In") -> ("Full Reference Cluster:Path Cluster:Default Data Saving Location Ref"=w4, instance out=w5)
      Property Node(instance in=w4, error in=$"Error In") -> ("Value"=w6, error out=w7)
      call "Check if File or Folder Exists.gvi"(file or folder=w6, error in=w7) -> (file or folder exists?=w8, error out=w9)
      Is Empty String Or Path(string/path=w6) -> w10
      Logical Or(w10, not w8) -> w11
      case (w11) {
        frame False {
          w1 = w6
          w3 = w9
          w2 = w5
        }
        frame True {
          call "FGV Select Default Path Prompt.gvi"(FGV Instructions="Read State", Error In=w9) -> (Already Selected Path? Out=w12, Selected Default Path Out=w13, Error Out=w14)
          case (w12) {
            frame True {
              w3 = w14
              w2 = w5
              w1 = w13
            }
            frame False {
              w15 = "Please specify the path where you want to save all your measurements:"
              call "Select path prompt.gvi"(Main Message=w15, Sub message="Sub paths with your name, date and device will be created", Error In=w14) -> (New Path=w1, Error Out=w16)
              Property Node(instance in=w5) -> ("Full Reference Cluster:Path Cluster:Default Data Saving Location Ref"=w17, instance out=w2)
              call "FGV Select Default Path Prompt.gvi"(FGV Instructions="Set State", Already Selected Path? In=TRUE, Default Selected Path=w1, Error In=w16) -> (Error Out=w18)
              Property Node(instance in=w17, "Value"=w1, error in=w18) -> (error out=w3)
            }
          }
        }
      }
    }
  }
  $"Misc Data Mega Cluster Out" <- w2
  $"Default Data Saving Location Path Out" <- w1
  $"Error Out" <- w3
