vi "Check File Extension.gvi"   [LabVIEW NXG 5.0.0]
inputs:
  "Error In": error
  "Original Filename": string = "Input your new filename"
  "Force Extension": string = "Input your new filename"
outputs:
  "Error Out": error
  "Filename With Extension": string
uses:
  NI::G Core::File IO (General)::Replace File Extension (file name).gvi
  NI::G Core::File IO (General)::Get File Extension (file name).gvi
diagram:
  # This SubVI makes sure every file has an extension if it does not,
  # it adds the .txt extension by default
  # It also gives the oportunity to force an extension replacement
  case ($"Error In") {
    frame Error, Default {
      w1 = $"Error In"
      w2 = $"Original Filename"
    }
    frame No Error {
      call "Replace File Extension (file name).gvi"(file name=$"Original Filename", new extension=$"Force Extension") -> (file name with new extension=w3)
      Is Empty String Or Path(string/path=$"Force Extension") -> w4
      Select(s=w4, t=$"Original Filename", f=w3) -> w5
      Select(s=w4, t=".txt", f=$"Force Extension") -> w6
      Concatenate Strings($"Original Filename", w6) -> w7
      call "Get File Extension (file name).gvi"(file name=$"Original Filename") -> (lowercase file extension=w8)
      for {
        w9 = each element of ["txt", "xlsx", "doc", "opj", "opju", "ppt", "pptx", "docx"]
        Is Equal(x=w8, y=w9) -> w11
        append w11 to w10
      }
      Or Array Elements(Boolean array=w10) -> (logical OR=w12)
      Select(s=w12, t=w5, f=w7) -> w2
      Is Empty String Or Path(string/path=w8)
      w1 = $"Error In"
    }
  }
  $"Error Out" <- w1
  $"Filename With Extension" <- w2
