vi "Create or Open Folder.gvi"   [LabVIEW NXG 5.0.0]
inputs:
  "Error In": error
  "Folder Root Path": path, required
  "Folder Name": string, required
outputs:
  "Error Out": error
  "New Folder's Path": path
uses:
  NI::G Core::File IO (General)::Check if File or Folder Exists.gvi
diagram:
  # This SubVI Checks if a folder with the provided name exists;
  # If it does it just outputs the path of the folder if it does not exist
  # it creates it and returns the path of the newly created folder
  case ($"Error In") {
    frame Error, Default {
      w1 = $"Error In"
      w2 = $"Folder Root Path"
    }
    frame No Error {
      Is Empty String Or Path(string/path=$"Folder Name") -> w3
      case (w3) {
        frame True {
          w4 = """Somehow one of the folder names
ended up being blank so the files might 
be saved in weird locations, always within
the main data storage folder."""
          One Button Dialog(message=w4)
          w1 = $"Error In"
          w2 = $"Folder Root Path"
        }
        frame False {
          Build Path(base path=$"Folder Root Path", name or relative path=$"Folder Name") -> (appended path=w5)
          call "Check if File or Folder Exists.gvi"(file or folder=w5, error in=$"Error In") -> (file or folder exists?=w6, error out=w7)
          case (w6) {
            frame True {
              w1 = w7
              w2 = w5
            }
            frame False {
              Create Folder(error in=w7, path (use dialog)=w5) -> (created path=w2, error out=w1)
            }
          }
        }
      }
    }
  }
  $"New Folder's Path" <- w2
  $"Error Out" <- w1
