vi "Erase All Files in Folder.gvi"   [LabVIEW NXG 5.0.0]
inputs:
  "Error In": error
  "Folder With Files To Erase": path
outputs:
  "Error Out": error
uses:
  NI::G Core::Error::Clear Error Cluster.gvi
diagram:
  # This SubVI Erases all files within a folder
  case ($"Error In") {
    frame Error, Default {
      w1 = $"Error In"
    }
    frame No Error {
      List Folder(error in=$"Error In", path=$"Folder With Files To Erase") -> (error out=w2, file names=w3, path out=w4)
      s1 = w2  # shift register
      for {
        w5 = each element of w3
        Build Path(base path=w4, name or relative path=w5) -> (appended path=w6)
        Delete File Or Folder(error in=s1, path (use dialog)=w6) -> (error out=w7)
        call "Clear Error Cluster.gvi"(error in=w7) -> (error out=w8)
        next s1 = w8
      }
      w1 = s1
    }
  }
  $"Error Out" <- w1
