vi "Erase Forbidden Chars.gvi"   [LabVIEW NXG 5.0.0]
inputs:
  "Error In": error
  "Filename": string
  "Replace option": string
outputs:
  "Error Out": error
  "Clean Filename": string
  "Forbidden Chars?": bool
diagram:
  # This SubVI Checks for chars that cannot be input as a filename and
  # erases them from the input for a clean windows safe filename
  case ($"Error In") {
    frame Error, Default {
      w1 = $"Error In"
      w2 = $Filename
      w3 = default
    }
    frame No Error {
      s1 = $Filename  # shift register
      s2 = $"Error In"  # shift register
      for {
        w4 = each element of ["/", "\\", "*", ":", "?", "\"", ">", "<", "|"]
        Search And Replace String(error in (no error)=s2, input string=s1, replace all (F)=TRUE, replace string ("")=$"Replace option", search string=w4) -> (error out=w6, number of replacements=w7, result string=w8)
        # We erase any non accepted characters before outputting the
        # filename
        Is Not Equal To 0(x=w7) -> w9
        append w9 to w5
        next s1 = w8
        next s2 = w6
      }
      Or Array Elements(Boolean array=w5) -> (logical OR=w3)
      w1 = s2
      w2 = s1
    }
  }
  $"Clean Filename" <- w2
  $"Forbidden Chars?" <- w3
  $"Error Out" <- w1
