vi "Get Filie Ext Smart.gvi"   [LabVIEW NXG 5.0.0]
inputs:
  "Error In": error
  "Filename": string = "Input your new filename"
outputs:
  "Error Out": error
  "Extension (Blank if none)": string
uses:
  NI::G Core::File IO (General)::Get File Extension (file name).gvi
diagram:
  # This SubVI Checks a filename for common extensions
  # if it does not find any it returns a blank, otherwise it returns
  # the extracted extension
  case ($"Error In") {
    frame Error, Default {
      w1 = $"Error In"
      w2 = $Filename
    }
    frame No Error {
      call "Get File Extension (file name).gvi"(file name=$Filename) -> (lowercase file extension=w3)
      for {
        w4 = each element of ["txt", "xlsx", "doc", "opj", "opju", "ppt", "pptx", "docx"]
        Is Equal(x=w3, y=w4) -> w6
        append w6 to w5
      }
      Or Array Elements(Boolean array=w5) -> (logical OR=w7)
      Select(s=w7, t=w3, f="") -> w2
      w1 = $"Error In"
    }
  }
  $"Error Out" <- w1
  $"Extension (Blank if none)" <- w2
