vi "Name File Prompt Window.gvi"   [LabVIEW NXG 5.0.0]
inputs:
  "Exclusive focus?": bool
  "Error In": error
outputs:
  "Output": string
  "Error Out": error
panel controls:
  "Filename:": string
  "Okay button": bool
diagram:
  # This SubVI Takes a filename and prompts the user to chose a different one because the current one is already in use.
  # It also makes sure that the new filename does not contain forbidden characters and erases those from the name automatically.
  case ($"Error In") {
    frame Error, Default {
      w1 = $"Error In"
      w2 = default
    }
    frame No Error {
      # We first open the prompt window separately
      Property Node(instance in=reference to unnamed native front panel, error in=$"Error In") -> ("Window"=w3, error out=w4)
      Open Window(reference in=w3, error in=w4, modal=$"Exclusive focus?") -> (reference out=w5, error out=w6)
      Property Node(instance in=reference to "Filename:", "Value"="", error in=w6) -> (error out=w7)
      while {
        Wait Until Next Multiple(multiple to wait=50)
        s1 = $"Filename:"  # shift register
        for {
          w8 = each element of ["/", "\\", "*", ":", "?", "\"", ">", "<", "|"]
          Search And Replace String(error in (no error)=w7, input string=s1, replace all (F)=TRUE, search string=w8) -> (error out=w10, number of replacements=w11, result string=w12)
          # We erase any non accepted characters before outputting the
          # filename
          Is Not Equal To 0(x=w11) -> w13
          append w13 to w9
          next s1 = w12
        }
        Or Array Elements(Boolean array=w9) -> (logical OR=w14)
        case (w14) {
          frame False, Default { }
          frame True {
            w15 = "Please refrain from using the\nfollowing Characters:\n\\  /  *  :  ?  \"  >  <  |  "
            One Button Dialog(button name ("OK")="Oh sorry, I did not Know they\ncould not be used", message=w15)
          }
        }
        Is Empty String Or Path(string/path=s1) -> w16
        Logical And($"Okay button", w16) -> w17
        # We prompt the user if the provided filenames are
        # not acceptable
        case (w17) {
          frame False, Default { }
          frame True {
            w18 = "Oh sorry, I thought an empty \nfilename was completely acceptable\nand not :O"
            w19 = "Renaming the file means you \nhave to change the name not \ncompletely erase it :')"
            One Button Dialog(button name ("OK")=w18, message=w19)
          }
        }
        Logical Or($"Okay button", w14) -> w20
        case (w20) {
          frame False, Default {
            w21 = w10
          }
          frame True {
            Property Node(instance in=reference to "Filename:", "Value"=s1, error in=w10) -> (error out=w21)
            Wait Until Next Multiple(multiple to wait=2000)
          }
        }
        stop if $"Okay button"
      }
      String Length(string=s1) -> (length=w22)
      Subtract(x=w22, y=4) -> w23
      Replace Substring(length (len. of substring)=4, offset=w23, string=s1) -> (replaced substring=w24)
      Is Not Equal(x=w24, y=".ini") -> w25
      case (w25) {
        frame False, Default {
          # If the filename does not contain extension
          # we add the extension automatically
          w2 = s1
        }
        frame True {
          Concatenate Strings(s1, ".ini") -> w2
        }
      }
      Close Window(reference in=w5, error in=w21) -> (error out=w1)
    }
  }
  $Output <- w2
  $"Error Out" <- w1
