vi "Path Already Exists prompt.gvi"   [LabVIEW NXG 5.0.0]
inputs:
  "Error In": error
  "Path to Check": path
outputs:
  "Error Out": error
  "Existing File Instruction out": "File Operation.gtype"
types:
  "File Operation.gtype" = enum{"Replace", "Rename", "Do not save"}
uses:
  Pika IV Characterization NXG::Side Functions::Messages And Prompts::FGV Repeat Operation for all following files.gvi
  NI::G Core::File IO (General)::Check if File or Folder Exists.gvi
diagram:
  # This SubVi checks if a file already exists and prompts the
  # user to decide between replacing renaming or not saving the file
  # If the user decides to replace the file we erase the existing file
  # to avoid conflicts
  case ($"Error In") {
    frame Error, Default {
      w1 = $"Error In"
      w2 = default
    }
    frame No Error {
      call "FGV Repeat Operation for all following files.gvi"(FGV Instructions="Read State", Error In=$"Error In") -> (Prompt?=w3, File Operation=w4, Error Out=w5)
      case (w3) {
        frame False, Default {
          w2 = w4
          w6 = w5
        }
        frame True {
          call "Check if File or Folder Exists.gvi"(file or folder=$"Path to Check", error in=w5) -> (file or folder exists?=w7, error out=w8)
          case (w7) {
            frame False, Default {
              w9 = w8
              w10 = "left button"
            }
            frame True {
              w11 = "The file you're trying to save already exists, do you want to:"
              Three Button Dialog(Allow user to close window? (TRUE)=FALSE, Center Button Text ("No")="Rename the file \nso that they are both safe", Justify Message (Left)="center", Left Button Text ("Yes")="Replace the already\nexisting file!", Right Button Text ("Cancel")="Do not save the\ncurrent file", Window Title (" ")="Existing File", message=w11) -> (Which Button?=w10)
              w9 = w8
            }
          }
          case (w10) {
            frame "left button" {
              case (w7) {
                frame False, Default {
                  w6 = w9
                }
                frame True {
                  Delete File Or Folder(error in=w9, path (use dialog)=$"Path to Check") -> (error out=w6)
                }
              }
              w2 = "Replace"
            }
            frame "center button", Default {
              w12 = "Rename"  # File Operation
              w2 = w12
              w6 = w9
            }
            frame "right button" {
              w13 = "Do not save"  # File Operation
              w2 = w13
              w6 = w9
            }
          }
        }
      }
      call "FGV Repeat Operation for all following files.gvi"(FGV Instructions="Set State", Used File Operation=w2, Error In=w6) -> (Error Out=w1)
    }
  }
  $"Existing File Instruction out" <- w2
  $"Error Out" <- w1
