vi "Rename Fle Errors Pompt.gvi"   [LabVIEW NXG 5.0.0]
inputs:
  "Empty Name?": bool
  "Unchanged Filename?": bool
  "Forbidden Chars?": bool
diagram:
  case ($"Forbidden Chars?") {
    frame False, Default { }
    frame True {
      w1 = "Please refrain from using the\nfollowing Characters:\n\\  /  *  :  ?  \"  >  <  |  "
      One Button Dialog(button name ("OK")="Oh sorry, I did not Know they\ncould not be used", message=w1)
    }
  }
  case ($"Empty Name?") {
    frame False, Default { }
    frame True {
      w2 = "Oh sorry, I thought an empty \nfilename was completely acceptable\nand not :O"
      w3 = "Renaming the file means you \nhave to change the name not \ncompletely erase it :')"
      One Button Dialog(button name ("OK")=w2, message=w3)
    }
  }
  case ($"Unchanged Filename?") {
    frame False, Default { }
    frame True {
      One Button Dialog(button name ("OK")="Oh sorry, I thought this name\nwas different :O", message="Renaming the file means you \nhave to change the name :')")
    }
  }
