vi "Rename Prompt Window.gvi"   [LabVIEW NXG 5.0.0]
inputs:
  "Error In": error
  "Original Filename": string = "Input your new filename"
outputs:
  "New Filename": string
  "Error Out": error
panel controls:
  "Filename:": string
  "Okay button": bool
  "Reset Button": bool
uses:
  Pika IV Characterization NXG::Side Functions::Path Manipulation::Erase Forbidden Chars.gvi
  Pika IV Characterization NXG::Side Functions::Path Manipulation::Rename Fle Errors Pompt.gvi
  Pika IV Characterization NXG::Side Functions::Path Manipulation::Get Filie Ext Smart.gvi
  Pika IV Characterization NXG::Side Functions::Path Manipulation::Check File Extension.gvi
diagram:
  # This SubVI Takes a filename and prompts the user to chose a different one because the current one is already in use.
  # It also makes sure that the new filename does not contain forbidden characters and erases those from the name automatically.
  case ($"Error In") {
    frame Error, Default {
      w1 = $"Error In"
      w2 = default
    }
    frame No Error {
      Property Node(instance in=reference to unnamed native front panel, error in=$"Error In") -> ("Window"=w3, error out=w4)
      Open Window(reference in=w3, error in=w4, modal=TRUE) -> (reference out=w5, error out=w6)
      Property Node(instance in=reference to "Filename:", "Value"=$"Original Filename", error in=w6) -> (error out=w7)
      while {
        Wait Until Next Multiple(multiple to wait=50)
        call "Erase Forbidden Chars.gvi"(Filename=$"Filename:", Error In=w7) -> (Clean Filename=w8, Forbidden Chars?=w9, Error Out=w10)
        Select(s=$"Reset Button", t=$"Original Filename", f=w8) -> w11
        Is Empty String Or Path(string/path=w11) -> w12
        Logical And($"Okay button", w12) -> w13
        Is Not Equal(x=w11, y=$"Original Filename") -> w14
        Not(x=w14) -> w15
        Logical And(w15, $"Okay button") -> w16
        # We prompt the user if the provided filenames are
        # not acceptable
        call "Rename Fle Errors Pompt.gvi"(Empty Name?=w13, Unchanged Filename?=w16, Forbidden Chars?=w9)
        Logical Or($"Okay button", $"Reset Button", w9) -> w17
        case (w17) {
          frame False, Default {
            w18 = w10
          }
          frame True {
            Property Node(instance in=reference to "Filename:", "Value"=w11, error in=w10) -> (error out=w18)
            Wait Until Next Multiple(multiple to wait=2000)
          }
        }
        Logical And($"Okay button", w14) -> w19
        stop if w19
      }
      Close Window(reference in=w5, error in=w18) -> (error out=w20)
      call "Get Filie Ext Smart.gvi"(Filename=$"Original Filename", Error In=w20) -> (Extension (Blank if none)=w21, Error Out=w22)
      call "Check File Extension.gvi"(Original Filename=w11, Force Extension=w21, Error In=w22) -> (Filename With Extension=w2, Error Out=w1)
    }
  }
  $"New Filename" <- w2
  $"Error Out" <- w1
