vi "Time Out Subroutine.gvi"   [LabVIEW NXG 5.0.0]
inputs:
  "Misc Data Mega Cluster In": "Misc Mega Cluster.gtype"
  "Error In": error
  "Queue In": Queue<"Queue Instructions Control.gtype">
outputs:
  "Queue Out": Queue<"Queue Instructions Control.gtype">
  "Error Out": error
  "Stop App?": bool
  "Misc Data Mega Cluster Out": "Misc Mega Cluster.gtype"
types:
  "Queue Instructions Control.gtype" = enum{"Undefined State", "Debug Check", "Initialize App", "Idle", "Change Cell", "IV Curves Acquisition", "Saving TXT Files", "Generating Origin Files", "Stopping App", "State 1", "State2", "State3", "State4", "State5"}
  T1 = cluster{"State Ref": "StringControl reference", "Substate Ref": "StringControl reference", "Current State Ref": "EnumSelector reference", "Main Tab Ref": "TabControl reference"}
  T2 = cluster{"Default Data Saving Location Ref": "PathSelector reference"}
  T3 = cluster{"Author Initials Ref": "ComboBoxSelector reference", "Batch Name Ref": "StringControl reference", "Cell Number Ref": "StringControl reference", "Current Date Ref": "StringControl reference", "Sample Comments Ref": "StringControl reference", "Sample Prefix Ref": "StringControl reference", "Custom Date Ref": "CheckBox reference", "Label Info Error Label Ref": "StringControl reference", "Label Info Missing Error Ref": "BooleanControl reference"}
  T4 = cluster{"Cell Parameters Ref": "Cluster reference", "IV Mode Ref": "EnumSelector reference", "Measurement Precision Ref": "Cluster reference", "Cell Selector Ref": "Cluster reference"}
  T5 = cluster{"Progress % Ref": "ProgressBar reference", "Progress Counter Ref": "NumericTextBoxDouble reference", "Live IV Parameters Ref": "Cluster reference"}
  T6 = cluster{"Layer Information Ref": "ArrayViewer reference"[]}
  "Full Reference Cluster.gtype" = cluster{"Status Report": T1, "Path Cluster": T2, "Sample Naming Cluster": T3, "Acquisition Parameters": T4, "Live Progress Cluster": T5, "Sample Extra Information": T6}
  "Misc Mega Cluster.gtype" = cluster{"Full Reference Cluster": "Full Reference Cluster.gtype"}
uses:
  Pika IV Characterization NXG::Main Functions::Instruction Handling::FGV Current State.gvi
  Pika IV Characterization NXG::Main Functions::Initializing App::Prompt::Initializing app prompt.gvi
  Pika IV Characterization NXG::Side Functions::Abort Control::FGV Global Abort.gvi
diagram:
  # This is the sequence that executes every 50 ms to check
  # the current state of the application. It outputs the current
  # state and substate and also shows the Initialization prompt
  # when the application is initializing.
  # Finally it checks if the current state is Stop App and outputs
  # the result to stop the master loop.
  # It also checks for the Global Abort state. In case the local abort is triggered it flushes the Queue
  # and enqueues an Idle instruction. Otherwise if the Global abort is true it flushes the queue and
  # enqueues a Stop App instruction
  case ($"Error In") {
    frame Error, Default {
      w1 = $"Error In"
      w2 = $"Queue In"
      w3 = default
      w4 = $"Misc Data Mega Cluster In"
    }
    frame No Error {
      call "FGV Current State.gvi"(Current State Instructions="Read Current State and Substate", Error In=$"Error In") -> (Current State Out=w5, Current SubState Out=w6, Error Out=w7)
      Is Equal(x=w5, y="Stopping App") -> w8
      Is Equal(x=w5, y="Initialize App") -> w9
      case (w9) {
        frame False, Default {
          w10 = w7
        }
        frame True {
          call "Initializing app prompt.gvi"(Error In=w7) -> (Error Out=w10)
        }
      }
      call "FGV Global Abort.gvi"(Global Abort Instructions="Read Current State", Error In=w10) -> (Local Abort Out=w11, Global Abort Out=w12, Error Out=w13)
      case (w12) {
        frame True {
          Flush Queue(error in=w13, queue=$"Queue In") -> (error out=w16, queue out=w17)
          Enqueue Element At Opposite End(element="Stopping App", error in=w16, queue=w17) -> (error out=w14, queue out=w2)
          w15 = TRUE
        }
        frame False {
          case (w11) {
            frame False, Default {
              w14 = w13
              w2 = $"Queue In"
            }
            frame True {
              Flush Queue(error in=w13, queue=$"Queue In") -> (error out=w18, queue out=w19)
              Enqueue Element At Opposite End(element="Idle", error in=w18, queue=w19) -> (error out=w14, queue out=w2)
            }
          }
          w15 = FALSE
        }
      }
      Logical Or(w15, w8) -> w3
      Property Node(instance in=$"Misc Data Mega Cluster In") -> ("Full Reference Cluster:Status Report:State Ref"=w20, "Full Reference Cluster:Status Report:Substate Ref"=w21, "Full Reference Cluster:Status Report:Current State Ref"=w22, instance out=w4)
      Format Into String(errIn=w14, w5) -> (outString=w23, errOut=w24)
      Property Node(instance in=w20, "Value"=w23, error in=w24) -> (error out=w25)
      Property Node(instance in=w21, "Value"=w6, error in=w25) -> (error out=w26)
      Property Node(instance in=w22, "Value"=w5, error in=w26) -> (error out=w1)
    }
  }
  $"Misc Data Mega Cluster Out" <- w4
  $"Stop App?" <- w3
  $"Queue Out" <- w2
  $"Error Out" <- w1
