vi "Array Erase 0 Element.gvi"   [LabVIEW NXG 5.0.0]
inputs:
  "Error In": error
  "Array With Element 0": T1[]
outputs:
  "Error Out": error
  "Array Without Element 0": T1[]
types:
  T1 = cluster{"Device Number": f64[], "Measured Value": f64[]}
diagram:
  case ($"Error In") {
    frame Error, Default {
      w1 = $"Error In"
      w2 = $"Array With Element 0"
    }
    frame No Error {
      for {
        w3 = each element of $"Array With Element 0"
        Property Node(instance in=w3) -> ("Device Number"=w4, "Measured Value"=w5, instance out=w6)
        for {
          w7 = each element of w4
          w8 = each element of w5
          Is Not Equal To 0(x=w7) -> w11
          append w7 to w9 if w11
          append w8 to w10 if w11
        }
        Property Node(instance in=w6, "Device Number"=w9, "Measured Value"=w10) -> (instance out=w12)
        append w12 to w2
      }
      w1 = $"Error In"
    }
  }
  $"Error Out" <- w1
  $"Array Without Element 0" <- w2
