vi "Check String Array Duplicates.gvi"   [LabVIEW NXG 5.0.0]
inputs:
  "String Array": string[]
  "Error In": error
outputs:
  "Error Out": error
  "Duplicates?": bool
diagram:
  # This subVI Scans a string array in search of duplicates
  case ($"Error In") {
    frame Error, Default {
      w1 = $"Error In"
      w2 = default
    }
    frame No Error {
      for {
        w3 = each element of $"String Array"
        s1 = 0  # shift register
        for {
          w5 = each element of $"String Array"
          Increment(x=s1) -> w6
          Is Equal(x=w3, y=w5) -> w7
          Select(s=w7, t=w6, f=s1) -> w8
          next s1 = w8
        }
        Is Not Equal(x=s1, y=1) -> w9
        append w9 to w4
        stop if w9
      }
      Or Array Elements(Boolean array=w4) -> (logical OR=w2)
      w1 = $"Error In"
    }
  }
  $"Error Out" <- w1
  $"Duplicates?" <- w2
