vi "Find Closest In Array.gvi"   [LabVIEW NXG 5.0.0]
inputs:
  "Array In": f64[]
  "Desired Value": f64
  "Tolerance": f64
  "Error In": error
outputs:
  "Error Out": error
  "Closest Value Index": i32
  "Closest Value": f64
  "Within Tolerance?": bool
diagram:
  # This SubVI takes an array and a value and
  #  returns the index of the array value which is closest
  # to the Desired Value
  case ($"Error In") {
    frame Error, Default {
      w1 = $"Error In"
      w2 = -1
      w3 = -1
      w4 = default
    }
    frame No Error {
      Subtract(x=$"Array In", y=$"Desired Value") -> w5
      Absolute Value(x=w5) -> w6
      Array Max And Min(array=w6) -> (min index(es)=w2, min value=w7)
      Is Greater(x=$Tolerance, y=w7) -> w4
      Array Index(array=$"Array In") -> (out0[w2]=w3)
      w1 = $"Error In"
    }
  }
  $"Error Out" <- w1
  $"Within Tolerance?" <- w4
  $"Closest Value Index" <- w2
  $"Closest Value" <- w3
