vi "Random IV Curve Generator.gvi"   [LabVIEW NXG 5.0.0]
inputs:
  "Error In": error
  "JV Measurement Mega Cluster In": "JV Measurements Mega Cluster.gtype"
  "Intensity Constant": f64
  "Light Intensity": f64
outputs:
  "Error Out": error
  "Voltage": f64[]
  "Current": f64[]
panel controls:
  "Photocurrent (a)": f64 = -129.3
  "Voltage Constant multiple (b)": f64 = 7
  "Reverse Current Constant (c)": f64 = 14
  "Series Resistance(d)": f64
  "Voltage Constant Aditive (f)": f64 = -0.42
panel indicators:
  "Graph": cluster{"Element 1": f64[], "Element 2": f64[]}[]
types:
  "Cell Selector.gtype" = enum{"L.01", "L.02", "L.03", "L.04", "L.05", "L.06", "L.07", "L.08", "L.09", "L.10", "L.11", "L.12", "R.01", "R.02", "R.03", "R.04", "R.05", "R.06", "R.07", "R.08", "R.09", "R.10", "R.11", "R.12", "Custom"}
  "JV Data Cluster.gtype" = cluster{"Voltage (V)": f64[], "Current (A)": f64[], "Current Density (A/m^2)": f64[], "Cell Area (m^2)": f64, "Illumination (W/m^2)": f64, "Voc (V)": f64, "Jsc (A/m^2)": f64, "FF (%)": f64, "Rsh (Ω · m^2)": f64, "Rs (Ω · m^2)": f64, "Eff (%)": f64, "Measured Cell": "Cell Selector.gtype", "No Multiplexer": bool}
  "JV Scan Mode.gtype" = enum{"Rough", "Normal", "Accurate", "Smart", "Custom"}
  "JV Curve Parameters.gtype" = cluster{"JV Scan Mode": "JV Scan Mode.gtype", "Measurement Precision": "Accuracy Parameters.gtype", "Cell Parameters": "Cell Parameters.gtype"}
  "Deposition Method.gtype" = enum{"Blade Coating", "Spin Coating", "Thermal Evaporation", "E-beam Evaporation", "Sputtering", "Drop Casting", "Dip Coating", "Pulsed Laser Deposition", "Chemical Vapour Deposition", "Atomic Layer Deposition", "Spray Coating", "Screen Printing", "Electroplating", "Molecular Beam Epitaxy", "Custom Deposition"}
  "Layer Type.gtype" = enum{"Front Electrode", "Electron Transport Layer", "Active Layer", "Hole Transport Layer", "Back Electrode", "Custom Layer"}
  "Full Layer Information.gtype" = cluster{"Blade Coating Parameters": "Blade Coating Parameters.gtype", "Deposition Method": "Deposition Method.gtype", "Layer Type": "Layer Type.gtype", "Spin Coating Parameters": "Spin Coating Parameters.gtype", "Thermal Evaporation Parameters": "Thermal Evaporation Parameters.gtype", "Solution Information": "Solution Information.gtype", "General Parameters": "General Parameters.gtype", "Current Deposition Method Information Cluster": "Useless Cluster.gtype", "Layer String ID": string}
  "JV Measurements Mega Cluster.gtype" = cluster{"Cell Array": "Cell Selector.gtype"[], "JV Full Data Array": "JV Data Cluster.gtype"[], "Cell Selector": "Cell Selector.gtype", "JV Curve Parameters": "JV Curve Parameters.gtype", "Full Layer Information Array": "Full Layer Information.gtype"[]}
uses:
  NI::G Core::Numeric::Random Number (Range) DBL.gvi
  Pika IV Characterization NXG::Side Functions::Instrument Control::Keithley::Keithley Sweep Parameter Calculator.gvi
  Pika IV Characterization NXG::Side Functions::Utilities::Calculations::Variation.gvi
diagram:
  case ($"Error In") {
    frame Error, Default {
      w1 = $"Error In"
      w2 = f64[] []
      w3 = default
    }
    frame No Error {
      call "Random Number (Range) DBL.gvi"(upper bound=1.2, lower bound=0.8) -> (number=w4)
      Multiply(w4, $"Light Intensity") -> w5
      Multiply($"Intensity Constant", w4) -> w6
      call "Keithley Sweep Parameter Calculator.gvi"(JV Measurements Mega Cluster In=$"JV Measurement Mega Cluster In", Error In=$"Error In") -> (Sweep Points=w7, Error Out=w1)
      Property Node(instance in=w7) -> ("Start "=w8, "Stop "=w9, "Number of Points (5)"=w10)
      call "Variation.gvi"(Value In=$"Photocurrent (a)", Error percentage=30) -> (Value Out=w11)
      call "Variation.gvi"(Value In=$"Voltage Constant multiple (b)", Error percentage=1) -> (Value Out=w12)
      call "Variation.gvi"(Value In=$"Voltage Constant Aditive (f)", Error percentage=1) -> (Value Out=w13)
      call "Variation.gvi"(Value In=$"Reverse Current Constant (c)", Error percentage=5) -> (Value Out=w14)
      call "Variation.gvi"(Value In=$"Series Resistance(d)", Error percentage=5) -> (Value Out=w15)
      To Signed 32 Bit Integer(number=w10) -> w16
      Subtract(x=w9, y=w8) -> w17
      To Double Precision Float(number=w10) -> w18
      Divide(x=w17, y=w18) -> w19
      for (N = w16) (iteration -> i1) {
        To Double Precision Float(number=i1) -> w20
        Multiply(w19, w20) -> w21
        Add(w8, w21) -> w22
        Exponential(x=w22) -> w23
        Multiply(w23, w6) -> w24
        Add(w5, w24) -> w25
        To Double Precision Float(number=w22) -> w26
        Multiply(w26, w15) -> w27
        Add(w26, w13) -> w28
        Multiply(w12, w28) -> w29
        Exponential(x=w29) -> w30
        Decrement(x=w30) -> w31
        Multiply(w31, w14) -> w32
        Add(w11, w32, w27) -> w33
        call "Variation.gvi"(Value In=w33, Error percentage=1) -> (Value Out=w34)
        append w26 to w2
        append w34 to w3
      }
    }
  }
  $Voltage <- w2
  Build Cluster(w2, w3) -> w35
  Build Array(w35, w35) -> w36
  Array Size(array=w36) -> (size(s)=w37)
  Is Greater(x=w37, y=10) -> w38
  Select(s=w38, t=cluster{"Element 1": f64[], "Element 2": f64[]}[] [], f=w36) -> w39
  $Graph <- w39
  $Current <- w3
  $"Error Out" <- w1
