vi "Variation.gvi"   [LabVIEW NXG 5.0.0]
inputs:
  "Value In": f64
  "Error percentage": f64
outputs:
  "Value Out": f64
uses:
  NI::G Core::Numeric::Random Number (Range) DBL.gvi
diagram:
  Add($"Error percentage", 100) -> w1
  Subtract(x=100, y=$"Error percentage") -> w2
  call "Random Number (Range) DBL.gvi"(upper bound=w1, lower bound=w2) -> (number=w3)
  Divide(x=w3, y=100) -> w4
  Multiply(w4, $"Value In") -> w5
  $"Value Out" <- w5
