vi "FGV Sample Prefix.gvi"   [LabVIEW NXG 5.0.0]
inputs:
  "FGV Instructions": "FGV Instructions.gtype" = "Read State", required
  "Error In": error
  "Misc Mega Cluster In": "Misc Mega Cluster.gtype"
outputs:
  "Error Out": error
  "Sample Prefix Out": string
types:
  "FGV Instructions.gtype" = enum{"Read State", "Set State", "Reset State"}
  T1 = cluster{"State Ref": "StringControl reference", "Substate Ref": "StringControl reference", "Current State Ref": "EnumSelector reference", "Main Tab Ref": "TabControl reference"}
  T2 = cluster{"Default Data Saving Location Ref": "PathSelector reference"}
  T3 = cluster{"Author Initials Ref": "ComboBoxSelector reference", "Batch Name Ref": "StringControl reference", "Cell Number Ref": "StringControl reference", "Current Date Ref": "StringControl reference", "Sample Comments Ref": "StringControl reference", "Sample Prefix Ref": "StringControl reference", "Custom Date Ref": "CheckBox reference", "Label Info Error Label Ref": "StringControl reference", "Label Info Missing Error Ref": "BooleanControl reference"}
  T4 = cluster{"Cell Parameters Ref": "Cluster reference", "IV Mode Ref": "EnumSelector reference", "Measurement Precision Ref": "Cluster reference", "Cell Selector Ref": "Cluster reference"}
  T5 = cluster{"Progress % Ref": "ProgressBar reference", "Progress Counter Ref": "NumericTextBoxDouble reference", "Live IV Parameters Ref": "Cluster reference"}
  T6 = cluster{"Layer Information Ref": "ArrayViewer reference"[]}
  "Full Reference Cluster.gtype" = cluster{"Status Report": T1, "Path Cluster": T2, "Sample Naming Cluster": T3, "Acquisition Parameters": T4, "Live Progress Cluster": T5, "Sample Extra Information": T6}
  "Misc Mega Cluster.gtype" = cluster{"Full Reference Cluster": "Full Reference Cluster.gtype"}
diagram:
  # This FGV Stores the Sample Prefix Info so that it can be easily
  # accessed from anywhere within the code
  case ($"Error In") {
    frame Error, Default {
      w1 = $"Error In"
    }
    frame No Error {
      s1 = $"Error In"  # shift register
      s2 = uninitialised  # shift register
      while {
        case ($"FGV Instructions") {
          frame "Read State", Default {
            $"Sample Prefix Out" <- s2
            w2 = s1
            w3 = s2
          }
          frame "Set State" {
            Property Node(instance in=$"Misc Mega Cluster In") -> ("Full Reference Cluster:Sample Naming Cluster:Sample Prefix Ref"=w4)
            Property Node(instance in=w4, error in=s1) -> ("Value"=w3, error out=w2)
          }
          frame "Reset State" {
            w2 = s1
            w3 = default
          }
        }
        next s1 = w2
        next s2 = w3
        stop if TRUE
      }
      w1 = s1
    }
  }
  $"Error Out" <- w1
