vi "Prefix Generator.gvi"   [LabVIEW NXG 5.0.0]
inputs:
  "Error In": error
  "Misc Data Mega Cluster In": "Misc Mega Cluster.gtype"
  "Cell number required?": bool
  "Current Date": string
  "Cell Number": string
outputs:
  "Error Out": error
  "Misc Data Mega Cluster Out": "Misc Mega Cluster.gtype"
types:
  T1 = cluster{"State Ref": "StringControl reference", "Substate Ref": "StringControl reference", "Current State Ref": "EnumSelector reference", "Main Tab Ref": "TabControl reference"}
  T2 = cluster{"Default Data Saving Location Ref": "PathSelector reference"}
  T3 = cluster{"Author Initials Ref": "ComboBoxSelector reference", "Batch Name Ref": "StringControl reference", "Cell Number Ref": "StringControl reference", "Current Date Ref": "StringControl reference", "Sample Comments Ref": "StringControl reference", "Sample Prefix Ref": "StringControl reference", "Custom Date Ref": "CheckBox reference", "Label Info Error Label Ref": "StringControl reference", "Label Info Missing Error Ref": "BooleanControl reference"}
  T4 = cluster{"Cell Parameters Ref": "Cluster reference", "Cell Selector Ref": "Cluster reference", "Measurement Precision Ref": "Cluster reference", "JV Scan Mode Ref": "EnumSelector reference"}
  T5 = cluster{"Live JV Parameters Ref": "Cluster reference", "Progress % Ref": "ProgressBar reference", "Progress Counter Ref": "NumericTextBoxDouble reference"}
  T6 = cluster{"Layer Information Ref": "ArrayViewer reference"[]}
  T7 = cluster{"Cell Selector Block Ref": "Rectangle reference", "Smart Mode Block Ref": "Rectangle reference", "dV Block Ref": "Rectangle reference", "Smart Mode Text Ref": "Text reference"}
  T8 = cluster{"JV Measurements Mega Cluster Ref": "Cluster reference", "Instrument Control Mega Cluster Ref": "Cluster reference"}
  "Full Reference Cluster.gtype" = cluster{"Status Report": T1, "Path Cluster": T2, "Sample Naming Cluster": T3, "Acquisition Parameters": T4, "Live Progress Cluster": T5, "Sample Extra Information": T6, "Visual Elements": T7, "Mega Cluster References": T8}
  "Misc Mega Cluster.gtype" = cluster{"Full Reference Cluster": "Full Reference Cluster.gtype"}
uses:
  Pika IV Characterization NXG::Side Functions::Utilities::Cell Naming::Prefix Error Check.gvi
diagram:
  # This SubVI takes all the needed Parameters and creates the cell prefix.
  # It also creates an error label in case there is something wrong with the
  # name such as missing labels or forbidden characters
  case ($"Error In") {
    frame Error, Default {
      w1 = $"Error In"
      w2 = $"Misc Data Mega Cluster In"
    }
    frame No Error {
      Property Node(instance in=$"Misc Data Mega Cluster In") -> ("Full Reference Cluster:Sample Naming Cluster:Author Initials Ref"=w3, "Full Reference Cluster:Sample Naming Cluster:Batch Name Ref"=w4, "Full Reference Cluster:Sample Naming Cluster:Sample Comments Ref"=w5, instance out=w6)
      Property Node(instance in=w3) -> ("Value"=w7)
      Property Node(instance in=w4) -> ("Value"=w8)
      Property Node(instance in=w5) -> ("Value"=w9)
      Build Array(w7, $"Current Date", w8, w9, $"Cell Number") -> w10
      s1 = ""  # shift register
      for {
        w11 = each element of w10
        Is Empty String Or Path(string/path=w11) -> w12
        case (w12) {
          frame False, Default {
            Concatenate Strings(s1, w11, ".") -> w13
          }
          frame True {
            w13 = s1
          }
        }
        next s1 = w13
      }
      s2 = $"Error In"  # shift register
      for {
        w14 = each element of ["/", "\\", "*", ":", "?", "\"", ">", "<", "|"]
        Search And Replace String(error in (no error)=s2, input string=s1, replace all (F)=TRUE, search string=w14) -> (error out=w16, number of replacements=w17, result string=w18)
        Is Greater Than 0(x=w17) -> w19
        append w19 to w15
        next s2 = w16
      }
      Or Array Elements(Boolean array=w15) -> (logical OR=w20)
      call "Prefix Error Check.gvi"(Misc Data Mega Cluster In=w6, Current Date=$"Current Date", Cell Number=$"Cell Number", Error In=s2, Cell number required?=$"Cell number required?", Forbidden Characters?=w20) -> (Misc Data Mega Cluster Out=w21, Error Out=w22)
      Property Node(instance in=w21) -> ("Full Reference Cluster:Sample Naming Cluster:Sample Prefix Ref"=w23, instance out=w2)
      Property Node(instance in=w23, "Value"=w18, error in=w22) -> (error out=w1)
    }
  }
  $"Error Out" <- w1
  $"Misc Data Mega Cluster Out" <- w2
