vi "Sample Naming Subroutine.gvi"   [LabVIEW NXG 5.0.0]
panel controls:
  "Error In": error
  "Misc Data Mega Cluster In": "Misc Mega Cluster.gtype"
panel indicators:
  "Error Out": error
  "Misc Data Mega Cluster Out": "Misc Data Mega Cluster.gtype"
types:
  "Full Reference Cluster.gtype" = cluster{"Enum Reference Cluster": "Enum Control Reference Cluster.gtype", "Boolean Reference Cluster": "Boolean Control Reference Cluster.gtype", "Numeric Reference Cluster": "Numeric Control Reference Cluster.gtype", "Numeric Cluster Reference Cluster": "Numeric Cluster Reference Cluster.gtype", "Path Reference Cluster": "Path Reference Cluster.gtype", "Cluster Reference Cluster": "Cluster Reference Cluster.gtype", "XZ Stage Controls Reference Cluster": "XZ Stage Controls Reference Cluster.gtype"}
  "Cell Naming Cluster.gtype" = cluster{"Cell Label": string, "Sample Prefix": string, "Author Initials": string, "Current Date": string, "Batch Name": string}
  T1 = cluster{"X Coordinate (mm)": f64, "Z Coordinate (mm)": f64, "Aprch Distance (mm)": f64}
  T2 = cluster{"X Coordinate (mm)": f64, "Z Coordinate (mm)": f64, "Vertical Spacing (mm)": f64, "Aprch Distance (mm)": f64, "Aprch Dstnc L.12 (mm)": f64}
  "XZ All Position Cluster.gtype" = cluster{"Diffusor Coordinates": T1, "Photodetector Coordinates": T1, "Cell R.01 Coordinates": T2}
  T3 = cluster{"Thorlabs Motor Serial Number File Path": path, "Default Data Saving Location": path}
  "Misc Data Mega Cluster.gtype" = cluster{"Full Reference Cluster": "Full Reference Cluster.gtype", "Cell Naming Cluster": "Cell Naming Cluster.gtype", "All XZ Position Cluster": "XZ All Position Cluster.gtype", "All Paths": T3}
  "Misc Mega Cluster.gtype" = cluster{"Full Reference Cluster": "Full Reference Cluster.gtype"}
uses:
  Pika IV Characterization NXG::Side Functions::Utilities::Time::Get Date YYMMDD.gvi
  Rainbow Measurement Setup::Side Functions::Sample Naming::Prefix Generator.gvi
diagram:
  # This SubVI Takes the data from the Sample Naming Variables and it generates the prefix so that the files can be propperly saved
  case ($"Error In") {
    frame Error, Default {
      w1 = $"Error In"
      w2 = $"Misc Data Mega Cluster In"
    }
    frame No Error {
      Property Node(instance in=$"Misc Data Mega Cluster In") -> ("Full Reference Cluster:Sample Naming Cluster:Custom Date"=w3, "Full Reference Cluster:Sample Naming Cluster:Current Date"=w4, instance out=w5)
      Property Node(instance in=w4, error in=$"Error In") -> ("Value"=w6, error out=w7, instance out=w8)
      Property Node(instance in=w3, error in=w7) -> ("Value"=w9, error out=w10)
      case (w9) {
        frame True {
          Property Node(instance in=w8, "Disabled"=FALSE, error in=w10) -> (error out=w12, instance out=w13)
          w11 = w6
        }
        frame False {
          Property Node(instance in=w8, "Disabled"=TRUE, error in=w10) -> (error out=w14, instance out=w13)
          call "Get Date YYMMDD.gvi"(Error In=w14) -> (Date YYMMDD=w11, Error Out=w12)
        }
      }
      Property Node(instance in=w5) -> ("Full Reference Cluster:Enum Reference Cluster:Main Tab"=w15, "Full Reference Cluster:Enum Reference Cluster:Rainbow Measurement tab"=w16, "Full Reference Cluster:Cluster Reference Cluster:Cell Number"=w17, instance out=w18)
      Property Node(instance in=w13, "Value"=w11, error in=w12) -> (error out=w19)
      Property Node(instance in=w15, error in=w19) -> ("Value"=w20, error out=w21)
      Property Node(instance in=w16, error in=w21) -> ("Value"=w22, error out=w23)
      Property Node(instance in=w17, error in=w23) -> ("Value"=w24, error out=w25, instance out=w26)
      Is Equal(x=w20, y=0) -> w27
      Is Equal(x=w22, y=1) -> w28
      Logical And(w27, w28) -> w29
      case (w29) {
        frame False, Default {
          Property Node(instance in=w26, "Disabled"=TRUE, error in=w25) -> (error out=w32)
          w30 = ""
          w31 = FALSE
        }
        frame True {
          Property Node(instance in=w26, "Disabled"=FALSE, error in=w25) -> (error out=w32)
          w30 = w24
          w31 = TRUE
        }
      }
      call "Prefix Generator.gvi"(Misc Data Mega Cluster In=w18, Current Date=w11, Cell Number=w30, Error In=w32, Cell number required?=w31) -> (Misc Data Mega Cluster Out=w2, Error Out=w1)
    }
  }
  $"Misc Data Mega Cluster Out" <- w2
  $"Error Out" <- w1
