vi "Fractional String Trim 0.gvi"   [LabVIEW NXG 5.0.0]
inputs:
  "String with trailing 0": string
outputs:
  "String Without 0": string
diagram:
  Search And Replace String(input string=$"String with trailing 0", search string=".") -> (number of replacements=w1)
  Is Not Equal To 0(x=w1) -> w2
  case (w2) {
    frame False, Default {
      w3 = $"String with trailing 0"
    }
    frame True {
      String Length(string=$"String with trailing 0") -> (length=w4)
      To Double Precision Float(number=w4) -> w5
      # This SubVI Takes a string containing 0 after the last decimal
      # and removes them from the string
      s1 = 0  # shift register
      for (N = w4) (iteration -> i1) {
        Increment(x=s1) -> w6
        Increment(x=i1) -> w7
        Subtract(x=w4, y=w7) -> w8
        String Subset(length (rest)=1, offset (0)=w8, string=$"String with trailing 0") -> w9
        Is Equal(x=w9, y="0") -> w10
        Is Equal(x=w9, y=".") -> w11
        Logical Or(w10, w11) -> w12
        Select(s=w12, t=w6, f=s1) -> w13
        Not(x=w10) -> w14
        Logical Or(w14, w11) -> w15
        next s1 = w13
        stop if w15
      }
      Subtract(x=w5, y=s1) -> w16
      String Subset(length (rest)=w16, string=$"String with trailing 0") -> w3
    }
  }
  $"String Without 0" <- w3
