vi "test.gvi"   [LabVIEW NXG 5.0.0]
panel controls:
  "Measured Cell": T1 = "L.01"
panel indicators:
  "remainder": u16
  "quotient": u16
  "Execution State": "Execution State.gtype"
  "Size": cluster{"Width": f32, "Height": f32}
  "Position": cluster{"Left": f32, "Top": f32}
  "Title": string
types:
  T1 = enum{"L.01", "L.02", "L.03", "L.04", "L.05", "L.06", "L.07", "L.08", "L.09", "L.10", "L.11", "L.12", "R.01", "R.02", "R.03", "R.04", "R.05", "R.06", "R.07", "R.08", "R.09", "R.10", "R.11", "R.12", "Custom"}
  "Execution State.gtype" = enum{"Bad", "Idle", "Running Top Level", "Running"}
diagram:
  This VI Reference() -> (reference out=w1)
  Property Node(instance in=w1) -> ("Panel"=w2, instance out=w3)
  Property Node(instance in=w2) -> ("Window"=w4)
  Open Window(reference in=w4, modal=TRUE) -> (error out=w5)
  while (after w2) (after w5) {
    Wait Until Next Multiple(multiple to wait=50)
    Quotient And Remainder(x=$"Measured Cell", y=12) -> (floor(x/y)=w6, x-y*floor(x/y)=w7)
    Increment(x=w7) -> w8
    $remainder <- w8
    $quotient <- w6
    Property Node(instance in=w3) -> ("Execution State"=w9, "Panel"=w10)
    Property Node(instance in=w10) -> ("Window"=w11)
    Property Node(instance in=w11) -> ("Size"=w12, "Position"=w13, "Title"=w14)
    $Size <- w12
    $Position <- w13
    $Title <- w14
    $"Execution State" <- w9
    stop if FALSE
  }
  while {
    event (timeout = 50) {
      on "Window" Close? {
        Two Button Dialog(message="Are you sure you want to exit?") -> (T Button?=w15)
        Not(x=w15) -> w16
        Event Filter("Discard?"=w16)
      }
      on "Timeout" {
        w15 = default
      }
    }
    stop if w15
  }
